# Grasshopper definition 2.2 The C# Script Component.gh (Grasshopper 1.0.7)

mixbag_component = CSharpScript(x=Slider(10, range=0..10), y=Slider(10, range=0..10))  # -> out, A, sum, sqrt, mult; inputs x: Double, y: Double
# ---------- mixbag_component: C# ----------
    Print("Hello message to the console!");
    Print("First input value was " + x);

    // Outputs
    A = "Hello World!";
    sum = x + y;
    sqrt = Math.Sqrt(x);
    mult = x * y;
# ---------- end mixbag_component ----------
panel = Panel(mixbag_component.out)
panel_2 = Panel(mixbag_component.A)
panel_3 = Panel(mixbag_component.sum)
panel_4 = Panel(mixbag_component.sqrt)
panel_5 = Panel(mixbag_component.mult)
