# Grasshopper definition 3.2 Scripting with Geometry.gh (Grasshopper 1.0.7)

construct_point = CSharpScript(x=Slider(2.83, range=0..10), y=Slider(3.68, range=0..10), z=Slider(7.56, range=0..10))  # -> out, P; inputs x: Double, y: Double, z: Double
# ---------- construct_point: C# ----------
    // Algorithm
    Point3d p = new Point3d(x, y, z);

    // Outputs
    P = p;
# ---------- end construct_point ----------
construct_point_2 = CSharpScript(x=Slider(6.61, range=0..10), y=Slider(4.27, range=0..10), z=Slider(3.41, range=0..10))  # -> out, P; inputs x: Double, y: Double, z: Double; same code as construct_point
construct_vector = CSharpScript(x=Slider(2.53, range=0..10), y=Slider(2.9, range=0..10), z=Slider(6.77, range=0..10))  # -> out, V; inputs x: Double, y: Double, z: Double
# ---------- construct_vector: C# ----------
    // Algorithm
    Vector3d v = new Vector3d(x, y, z);

    // Outputs
    V = v;
# ---------- end construct_vector ----------
construct_point_3 = CSharpScript(x=Slider(2.83, range=0..10), y=Slider(2.7, range=0..10), z=Slider(7.56, range=0..10))  # -> out, P; inputs x: Double, y: Double, z: Double; same code as construct_point
construct_vector_2 = CSharpScript(x=Slider(6.76, range=0..10), y=Slider(5.18, range=0..10), z=Slider(3.9, range=0..10))  # -> out, V; inputs x: Double, y: Double, z: Double; same code as construct_vector
construct_vector_3 = CSharpScript(x=Slider(4.96, range=0..10), y=Slider(2.49, range=0..10), z=Slider(6.28, range=0..10))  # -> out, V; inputs x: Double, y: Double, z: Double; same code as construct_vector
panel = Panel(construct_vector_3.V)
line = CSharpScript(A=construct_point_2.P, B=construct_point.P)  # -> out, L; inputs A: Point3d, B: Point3d
# ---------- line: C# ----------
    // Algorithm
    Line line = new Line(A, B);
    
    // Outputs
    L = line;
# ---------- end line ----------
vector_2pt = CSharpScript(A=construct_point_2.P, B=construct_point.P)  # -> out, V; inputs A: Point3d, B: Point3d
# ---------- vector_2pt: C# ----------
    // Algorithm
    Vector3d v = B - A;  // rc operator oveloads

    // Outputs
    V = v;
# ---------- end vector_2pt ----------
deconstruct_point = CSharpScript(P=construct_point_2.P)  # -> out, X, Y, Z; inputs P: Point3d
# ---------- deconstruct_point: C# ----------
    // Algorithm
    
    // Output
    X = P.X;
    Y = P.Y;
    Z = P.Z;
# ---------- end deconstruct_point ----------
plane = CSharpScript(O=construct_point_3.P, X=construct_vector.V, Y=construct_vector_2.V)  # -> out, Pl; inputs O: Point3d, X: Vector3d, Y: Vector3d
# ---------- plane: C# ----------
    // Algorithm
    Plane pl = new Plane(O, X, Y);
    
    // Outputs
    Pl = pl;
# ---------- end plane ----------
panel_2 = Panel(vector_2pt.V)
vdis = VectorDisplay(Anchor=construct_point_2.P, Vector=vector_2pt.V)
panel_3 = Panel(deconstruct_point.X)
panel_4 = Panel(deconstruct_point.Y)
panel_5 = Panel(plane.Pl)
panel_6 = Panel(deconstruct_point.Z)
panel_7 = Panel(line.L)
pointat_line = CSharpScript(L=line.L, t=Slider(0.64, range=-5..5))  # -> out, P; inputs L: Line, t: Double
# ---------- pointat_line: C# ----------
    // Algorithm
    Point3d pt = L.PointAt(t);
    
    // Outputs
    P = pt;
# ---------- end pointat_line ----------
panel_8 = Panel(pointat_line.P)
