# Grasshopper definition 4.1 Classes Vs. Structs.gh (Grasshopper 1.0.7)

vec = VectorXYZ(XComponent=Slider(10, range=0..10), YComponent=Slider(0, range=0..10), ZComponent=Slider(0, range=0..10))  # -> Vector, Length
crv = Curve(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)
c_script = CSharpScript(C=crv)  # -> out, C1, C2; inputs C: Curve
# ---------- c_script: C# ----------
    Curve c1 = C;

    C.Domain = new Interval(0, 1);

    Curve c2 = C;

    // Outputs
    C1 = c1;
    C2 = c2;
# ---------- end c_script ----------
c_script_2 = CSharpScript(V=vec.Vector)  # -> out, V1, V2; inputs V: Vector3d
# ---------- c_script_2: C# ----------
    Vector3d v1 = V;

    V.Unitize();

    Vector3d v2 = V;

    // Ouptuts
    V1 = v1;
    V2 = v2;
# ---------- end c_script_2 ----------
domain = Domain(crv)
domain_2 = Domain(c_script.C2)
domain_3 = Domain(c_script.C1)
panel = Panel(c_script_2.V2)
panel_2 = Panel(domain)
panel_3 = Panel(c_script_2.V1)
panel_4 = Panel(domain_3)
panel_5 = Panel(domain_2)
