# Grasshopper definition 4.5 Extending Script Functionality.gh (Grasshopper 1.0.7)

c_script = CSharpScript(name="Jose Luis", age=Slider(100, range=0..100))  # -> out, P; inputs name: String, age: Int32
# ---------- c_script: C# ----------
    Person jl = new Person(name, age);

    P = jl;
# ---------- c_script: C# additional code ----------
  public class Person
  {
    public string Name;
    public int Age;

    public Person(string name, int age)
    {
      this.Name = name;
      this.Age = age;
    }

    public string SayHi()
    {
      return "Hello! My name is " + this.Name +
        " and I am " + this.Age + " years old!";
    }

    public override string ToString()
    {
      return this.Name + ", " + this.Age;
    }
  }
# ---------- end c_script ----------
c_script_2 = CSharpScript(x=Slider(10, range=-10..10), y=Slider(10, range=-10..10), z=Slider(10, range=-10..10))  # -> out, V, Length, caffeinated; inputs x: Double, y: Double, z: Double
# ---------- c_script_2: C# ----------
    // Algorithm
    Vector3d vec = new Vector3d(x, y, z);

    // Outputs
    V = vec;
    Length = VectorLength(vec);
    caffeinated = HaveYouHadCoffee;
# ---------- c_script_2: C# additional code ----------
  bool HaveYouHadCoffee = false;


  double VectorLength(Vector3d v)
  {
    double len = Math.Sqrt(v.X * v.X + v.Y * v.Y + v.Z * v.Z);
    return len;
  }
# ---------- end c_script_2 ----------
c_script_3 = CSharpScript(P=c_script.P)  # -> out, name, age
# ---------- c_script_3: C# ----------
    Person person = (Person) P;
    
    name = person.Name;
    age = person.Age;
# ---------- c_script_3: C# additional code ----------
  public class Person
  {
    public string Name;
    public int Age;

    public Person(string name, int age)
    {
      this.Name = name;
      this.Age = age;
    }

    public string SayHi()
    {
      return "Hello! My name is " + this.Name +
        " and I am " + this.Age + " years old!";
    }

    public override string ToString()
    {
      return this.Name + ", " + this.Age;
    }
  }
# ---------- end c_script_3 ----------
panel = Panel(c_script.P)
panel_2 = Panel([c_script_3.name, c_script_3.age])
panel_3 = Panel(c_script_2.Length)
panel_4 = Panel(c_script_2.V)
panel_5 = Panel(c_script_2.caffeinated)
