# Grasshopper definition 4.6 Continuous Execution.gh (Grasshopper 1.0.7)

X = UnitX(Factor=1)
pt = Point(<point referenced from the Rhino model>)
pt_2 = Point(<point referenced from the Rhino model>)
pt_3 = Point(<point referenced from the Rhino model>)
trigger = Trigger(Interval=200, TimerInterval=200, Target=c_script)  # disabled
trigger_2 = Trigger(Interval=100, TimerInterval=100, Target=c_script_2)  # disabled
vec2pt = Vector2Pt(PointA=pt_2, PointB=pt_3, Unitize=False)  # -> Vector, Length
c_script = CSharpScript(P=pt, V=vec2pt.Vector, R=Button())  # -> out, M; inputs P: Point3d, V: Vector3d, R: Boolean
# ---------- c_script: C# ----------
    if (R)
    {
      currentLocation = P;
    }

    currentLocation += V;


    M = currentLocation;
# ---------- c_script: C# additional code ----------
  Point3d currentLocation = Point3d.Unset;
# ---------- end c_script ----------
c_script_2 = CSharpScript(x=Slider(7, range=0..10), R=Button())  # -> out, A, B, executions; inputs x: Double, R: Boolean
# ---------- c_script_2: C# ----------
    if (R)
    {
      it = 0;
      val = 2;
    }
    
    it++;

    val = val * 1.2;

    executions = it;
    B = val;
# ---------- c_script_2: C# additional code ----------
  int it = 0;
  double val = 2;
# ---------- end c_script_2 ----------
panel = Panel(c_script.M)
geo = Geometry(c_script.M)
vdis = VectorDisplay(Anchor=c_script.M, Vector=vec2pt.Vector)
vdis_2 = VectorDisplay(Anchor=pt_2, Vector=vec2pt.Vector)
panel_2 = Panel(c_script_2.executions)
panel_3 = Panel(c_script_2.B)
