# Grasshopper definition 4.7 Loading External Assemblies.gh (Grasshopper 1.0.7)

c_script = CSharpScript(x=Slider(3.859, range=0..10), y=Slider(5.087, range=0..10), z=Slider(6.821, range=0..10))  # -> out, V; inputs x: Double, y: Double, z: Double
# ---------- c_script: C# ----------
    // Algorithm
    Vector3d v = new Vector3d(x, y, z);

    // Outputs
    V = v;
# ---------- end c_script ----------
c_script_2 = CSharpScript(V=c_script.V)  # -> out, X, Y, Z; inputs V: Vector3d
# ---------- c_script_2: C# ----------
    // Outputs
    X = V.X;
    Y = V.Y;
    Z = V.Z;
# ---------- end c_script_2 ----------
panel = Panel(c_script_2.X)
panel_2 = Panel(c_script_2.Y)
panel_3 = Panel(c_script_2.Z)

c_script_3 = CSharpScript(
    name="Jose Luis",
    age=Slider(83, range=0..100),
    isProfessor=Toggle(False),
    Reference="D:\Dropbox\JL\ParametricCamp\10 - Files\2021.08.27 - Advanced GH\4.7 Loading External Assemblies\PersonClass.dll")  # -> out, person; inputs name: String, age: Int32, isProfessor: Boolean
# ---------- c_script_3: C# usings ----------
using PersonClass;
# ---------- c_script_3: C# ----------
    // Algorithm
    Person p = new Person(name, age, isProfessor);

    // Outputs
    person = p;
# ---------- end c_script_3 ----------
c_script_4 = CSharpScript(
    person=c_script_3.person,
    Reference="D:\Dropbox\JL\ParametricCamp\10 - Files\2021.08.27 - Advanced GH\4.7 Loading External Assemblies\PersonClass.dll")  # -> out, name, age, isProfessor
# ---------- c_script_4: C# ----------
    // Algorithm
    Person p = (Person) person;

    // Outputs
    name = p.Name;
    age = p.Age;
    isProfessor = p.IsProfessor;
# ---------- end c_script_4 ----------
panel_4 = Panel(c_script_4.name)
panel_5 = Panel(c_script_4.age)
panel_6 = Panel(c_script_4.isProfessor)

vec = VectorXYZ(XComponent=Slider(3.859, range=0..10), YComponent=Slider(5.087, range=0..10), ZComponent=Slider(6.821, range=0..10))  # -> Vector, Length
pdecon = Deconstruct(Point=vec.Vector)  # -> XComponent, YComponent, ZComponent
panel_7 = Panel(pdecon.XComponent)
panel_8 = Panel(pdecon.YComponent)
panel_9 = Panel(pdecon.ZComponent)

c_script_5 = CSharpScript(name="Jose Luis", age=Slider(100, range=0..100), isProfessor=Toggle(True))  # -> out, person; inputs name: String, age: Int32, isProfessor: Boolean
# ---------- c_script_5: C# ----------
    // Algorithm
    Person p = new Person(name, age, isProfessor);

    // Outputs
    person = p;
# ---------- c_script_5: C# additional code ----------
  public class Person
  {
    public string Name;
    public int Age;
    public bool IsProfessor;

    public Person(string n, int a, bool ip)
    {
      this.Name = n;
      this.Age = a;
      this.IsProfessor = ip;
    }
    //
    //    public override string ToString()
    //    {
    //      return this.Name + ", age: " + this.Age + " is professor? " + this.IsProfessor;
    //    }
  }
# ---------- end c_script_5 ----------
c_script_6 = CSharpScript(person=c_script_5.person)  # -> out, name, age, isProfessor
# ---------- c_script_6: C# ----------
    // Algorithm
    Person p = (Person) person;
# ---------- c_script_6: C# additional code ----------
  
  public class Person
  {
    public string Name;
    public int Age;
    public bool IsProfessor;

    public Person(string n, int a, bool ip)
    {
      this.Name = n;
      this.Age = a;
      this.IsProfessor = ip;
    }
    //
    //    public override string ToString()
    //    {
    //      return this.Name + ", age: " + this.Age + " is professor? " + this.IsProfessor;
    //    }
  }
# ---------- end c_script_6 ----------
panel_10 = Panel(c_script_6.name)
panel_11 = Panel(c_script_6.age)
panel_12 = Panel(c_script_6.isProfessor)

panel_13 = Panel(c_script_3.person)
panel_14 = Panel(c_script_5.person)
panel_15 = Panel(c_script_4.out)
panel_16 = Panel(c_script_6.out)
