# Grasshopper definition components.gh (Grasshopper 1.0.7)
# plug-ins: PCampGHPlugin

# ---- group: Custom vector rendering
vector_xyz = VectorXYZ(
    XComponent=Slider(124.96, range=-1000..1000),
    YComponent=Slider(48.45, range=-1000..1000),
    ZComponent=Slider(10, range=-1000..1000))  # -> Vector, Length
point = Point(<point referenced from the Rhino model>)

# ----
point_2 = Point(<point referenced from the Rhino model>)
point_3 = Point(<point referenced from the Rhino model>)
unit_z = UnitZ(Factor=Slider(-1, range=-1..1))
construct_domain = ConstructDomain(DomainStart=0, DomainEnd=1)
construct_point = ConstructPoint(XCoordinate=Slider(5, range=0..10), YCoordinate=Slider(5, range=0..10), ZCoordinate=Slider(0, range=0..10))
curve = Curve(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)
trigger = Trigger(Interval=100, TimerInterval=100, Target=counter)  # disabled

mesh = Mesh(<mesh referenced from the Rhino model>)
panel = Panel(mesh)
target_length = Slider(0.445, range=0..1)
passes = Slider(5, range=0..20)
mesh_to_dmesh3 = MeshToDMesh3(Mesh=mesh)
panel_2 = Panel(mesh_to_dmesh3)
remesh = Remesh(Dmesh3=mesh_to_dmesh3, TargetEdgeLength=target_length, Passes=passes)
dmesh3_to_mesh = DMesh3ToMesh(Dmesh3=remesh)
panel_3 = Panel(dmesh3_to_mesh)

add_numbers = AddNumbers(NumberA=Slider(10, range=0..10), NumberB=Slider(4.52, range=0..10))
elasticchain = ElasticChain(
    Reset=Button(),
    AutoUpdate=Toggle(False),
    Interval=Slider(20, range=0..1000),
    Anchor0=point_2,
    Anchor1=point_3,
    NodeCount=Slider(10, range=0..10),
    Mass=Slider(0.01, range=0..1),
    Gravity=unit_z,
    Stiffness=Slider(0.01, range=0..1),
    Friction=Slider(0.98, range=0..1))  # -> Nodes, Velocities, Chain
string_concatenation = StringConcatenation(StringA="Jose ", StringB="Luis")  # -> Concat, Length
range = Range(Domain=construct_domain, Steps=Slider(10, range=0..10))
series = Series(Start=Slider(0, range=0..10), Step=Slider(1.5, range=0..10), Count=Slider(10, range=0..10))
mass_addition = MassAddition(Numbers=series)  # -> R, Pr
divide_curve = DivideCurve(Curve=curve, Steps=Slider(10, range=0..10))  # -> Points, Parameters, Tangents
counterautoupdate = CounterAutoUpdate(Ticker=Slider(4, range=0..10), Reset=Button(), AutoUpdate=Toggle(False), UpdateInterval=Slider(193, range=0..1000))
construct_vector = ConstructVector(X=Slider(4.063, range=0..10), Y=Slider(4.882, range=0..10), Z=Slider(3.552, range=0..10))
point_grid = PointGrid(
    Start=construct_point,
    CountX=Slider(4, range=0..10),
    CountY=Slider(5, range=0..10),
    StepX=Slider(0.9079, range=0..1),
    StepY=Slider(0.9939, range=0..1))
tree_info = TreeInfo(Tree=point_grid)  # -> Topology, Description, Paths, Branches, Items
tree_info_2 = TreeInfo(Tree=point_grid)  # -> Topology, Description, Paths, Branches, Items
counter = Counter(Ticker=Slider(4, range=0..10), Reset=Button())

trigger_2 = Trigger(Interval=1000, TimerInterval=1000, Target=pconsolelogger)
pconsolelogger = PConsoleLogger(Update=Toggle(True), Clear=Button())

vector_preview = VectorPreview(Anchor=point, Vector=vector_xyz.Vector)
panel_4 = Panel(series)
panel_5 = Panel(add_numbers)
panel_6 = Panel([string_concatenation.Concat, string_concatenation.Length])
panel_7 = Panel(range)
panel_8 = Panel(construct_vector)
panel_9 = Panel(divide_curve.Points)
panel_10 = Panel(mass_addition.R)
panel_11 = Panel(mass_addition.Pr)
panel_12 = Panel(point_grid)
panel_13 = Panel(tree_info.Topology)
panel_14 = Panel(tree_info.Description)
panel_15 = Panel(tree_info.Paths)
panel_16 = Panel(tree_info.Branches)
panel_17 = Panel(tree_info.Items)
panel_18 = Panel(counterautoupdate)
vector_display = VectorDisplay(Anchor=elasticchain.Nodes, Vector=elasticchain.Velocities)
panel_19 = Panel(counter)
plugin_version = PluginVersion()  # -> Version, Major, Minor, Patch
plugin_version_2 = PluginVersion()
geometry = Geometry(elasticchain.Nodes)
geometry_2 = Geometry(elasticchain.Chain)
panel_20 = Panel(geometry)
panel_21 = Panel(plugin_version_2)
panel_22 = Panel([plugin_version.Version, plugin_version.Major, plugin_version.Minor, plugin_version.Patch])
panel_23 = Panel(divide_curve.Parameters)
panel_24 = Panel(pconsolelogger)
panel_25 = Panel(divide_curve.Tangents)
remove_item = RemoveItem(List=point_grid, Index=Slider(10, range=0..10))
panel_26 = Panel(remove_item)
