# Grasshopper definition 3.3 Advanced Geometry.gh (Grasshopper 1.0.7)

crv = Curve(<curve referenced from the Rhino model>)
crv_2 = Curve(<curve referenced from the Rhino model>)
pt = Point(<point referenced from the Rhino model>)
pt_2 = Point(<point referenced from the Rhino model>)
pt_3 = Point(<point referenced from the Rhino model>)
pt_4 = Point(<point referenced from the Rhino model>)
c_script = CSharpScript(A=crv_2, B=crv)  # -> out, BLEND; inputs A: Curve, B: Curve
# ---------- c_script: C# ----------
    // Algorithm
    Curve blend = Curve.CreateBlendCurve(A, B, BlendContinuity.Curvature);

    // Outputs
    BLEND = blend;
# ---------- end c_script ----------
blendc = BlendCurve(CurveA=crv_2, CurveB=crv, BulgeA=1, BulgeB=1, Continuity=Slider(2, range=0..10))
c_script_2 = CSharpScript(A=pt, B=pt_2, C=pt_3, D=pt_4)  # -> out, S; inputs A: Point3d, B: Point3d, C: Point3d, D: Point3d
# ---------- c_script_2: C# ----------
    // Algorithm
    Brep surf = Brep.CreateFromCornerPoints(A, B, C, D, 0.001);

    // Outputs
    S = surf;
# ---------- end c_script_2 ----------
srf4pt = _4PointSurface(CornerA=pt, CornerB=pt_2, CornerC=pt_3, CornerD=pt_4)
pt_5 = Point(<point referenced from the Rhino model>)
xy = XYPlane(Origin=pt_5)
c_script_3 = CSharpScript(B=c_script_2.S, P=xy)  # -> out, C, Pts; inputs B: Brep, P: Plane
# ---------- c_script_3: C# ----------
    // Algorithm
    Curve[] sections;
    Point3d[] intersects;
    bool success = Rhino.Geometry.Intersect.Intersection.BrepPlane(B, P, 0.001, out sections, out intersects);
    if (success)
    {
      Print("Intersection worked!");
    }
    else
    {
      Print("Intersection failed!");
    }

    // Outputs
    C = sections;
    Pts = intersects;
# ---------- end c_script_3 ----------
sec = BrepPlane(Brep=c_script_2.S, Plane=xy)  # -> Curves, Points
panel = Panel(sec.Curves)
panel_2 = Panel(sec.Points)
panel_3 = Panel(c_script_3.Pts)
panel_4 = Panel(c_script_3.C)
panel_5 = Panel(c_script_3.out)
