# Grasshopper definition 4.2 List as Data Inputs.gh (Grasshopper 1.0.7)

srf = Surface(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)
number_slider = Slider(0, range=0..10)
toggle = BooleanToggle(False)
sdivide = DivideSurface(Surface=srf, UCount=Slider(3, range=0..10), VCount=Slider(1, range=0..10))  # -> Points, Normals, Parameters
panel = Panel(sdivide.Points)
series = Series(Start=Slider(4.58, range=0..10), Step=Slider(6.83, range=0..10), Count=Slider(10, range=0..10))
panel_2 = Panel(series)
loft_opt = LoftOptions(Closed=toggle, Adjust=False, Rebuild=0, Refit=0, Type=number_slider)
crv = Curve([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])
c_script = CSharpScript(P=sdivide.Points)  # -> out, A; inputs P: tree of Point3d
# ---------- c_script: C# ----------
    A = "Hey, I made a calculation";
# ---------- end c_script ----------
loft = CSharpScript(C=crv, T=number_slider, P=toggle)  # -> out, L; inputs C: list of Curve, T: Int32, P: Boolean
# ---------- loft: C# ----------
    // Algorithm
    LoftType lt = (LoftType) T;
    Brep[] lofts = Brep.CreateFromLoft(C, Point3d.Unset,
      Point3d.Unset, lt, P);

    // Ouputs
    L = lofts;
# ---------- end loft ----------
average = CSharpScript(S=series)  # -> out, Avg; inputs S: list of Double
# ---------- average: C# ----------
    // Algorithm
    double sum = 0;
    for (int i = 0; i < S.Count; i++)
    {
      sum += S[i];
    }
    double average = sum / S.Count;

    // Outputs
    Avg = average;
# ---------- end average ----------
loft_2 = Loft(Curves=crv, Options=loft_opt)
panel_3 = Panel(c_script.A)
panel_4 = Panel(loft.L)
panel_5 = Panel(loft_2)
panel_6 = Panel(average.Avg)
