# Grasshopper definition 4.7b Loading External Assemblies Rhino 8.gh (Grasshopper 1.0.8)
# plug-ins: RhinoCodePluginGH

c_script = CSharpScript(x=Slider(3.859, range=0..10), y=Slider(5.087, range=0..10), z=Slider(6.821, range=0..10))  # -> out, V; inputs x: Double, y: Double, z: Double
# ---------- c_script: C# ----------
    // Algorithm
    Vector3d v = new Vector3d(x, y, z);

    // Outputs
    V = v;
# ---------- end c_script ----------
c_script_2 = CSharpScript(V=c_script.V)  # -> out, X, Y, Z; inputs V: Vector3d
# ---------- c_script_2: C# ----------
    // Outputs
    X = V.X;
    Y = V.Y;
    Z = V.Z;
# ---------- end c_script_2 ----------
panel = Panel(c_script_2.X)
panel_2 = Panel(c_script_2.Y)
panel_3 = Panel(c_script_2.Z)

c_script_3 = CSharpScript(
    name="Jose Luis",
    age=Slider(83, range=0..100),
    isProfessor=Toggle(False),
    Reference="E:\_PARAMETRICCAMP\10 - FILES\2021.08.27 - ADVANCED GH\4.7 LOADING EXTERNAL ASSEMBLIES\PersonClass.dll")  # -> out, person; inputs name: String, age: Int32, isProfessor: Boolean
# ---------- c_script_3: C# usings ----------
using PersonClass;
# ---------- c_script_3: C# ----------
    // Algorithm
    Person p = new Person(name, age, isProfessor);

    // Outputs
    person = p;
# ---------- end c_script_3 ----------
c_script_4 = CSharpScript(
    person=c_script_3.person,
    Reference="E:\_PARAMETRICCAMP\10 - FILES\2021.08.27 - ADVANCED GH\4.7 LOADING EXTERNAL ASSEMBLIES\PersonClass.dll")  # -> out, name, age, isProfessor
# ---------- c_script_4: C# ----------
    // Algorithm
    Person p = (Person) person;

    // Outputs
    name = p.Name;
    age = p.Age;
    isProfessor = p.IsProfessor;
# ---------- end c_script_4 ----------
panel_4 = Panel(c_script_4.name)
panel_5 = Panel(c_script_4.age)
panel_6 = Panel(c_script_4.isProfessor)

vec = VectorXYZ(XComponent=Slider(3.859, range=0..10), YComponent=Slider(5.087, range=0..10), ZComponent=Slider(6.821, range=0..10))  # -> Vector, Length
pdecon = Deconstruct(Point=vec.Vector)  # -> XComponent, YComponent, ZComponent
panel_7 = Panel(pdecon.XComponent)
panel_8 = Panel(pdecon.YComponent)
panel_9 = Panel(pdecon.ZComponent)

c_script_5 = CSharpScript(name="Jose Luis", age=Slider(100, range=0..100), isProfessor=Toggle(True))  # -> out, person; inputs name: String, age: Int32, isProfessor: Boolean
# ---------- c_script_5: C# ----------
    // Algorithm
    Person p = new Person(name, age, isProfessor);

    // Outputs
    person = p;
# ---------- c_script_5: C# additional code ----------
  public class Person
  {
    public string Name;
    public int Age;
    public bool IsProfessor;

    public Person(string n, int a, bool ip)
    {
      this.Name = n;
      this.Age = a;
      this.IsProfessor = ip;
    }
    //
    //    public override string ToString()
    //    {
    //      return this.Name + ", age: " + this.Age + " is professor? " + this.IsProfessor;
    //    }
  }
# ---------- end c_script_5 ----------
c_script_6 = CSharpScript(person=c_script_5.person)  # -> out, name, age, isProfessor
# ---------- c_script_6: C# ----------
    // Algorithm
    Person p = (Person) person;
# ---------- c_script_6: C# additional code ----------
  
  public class Person
  {
    public string Name;
    public int Age;
    public bool IsProfessor;

    public Person(string n, int a, bool ip)
    {
      this.Name = n;
      this.Age = a;
      this.IsProfessor = ip;
    }
    //
    //    public override string ToString()
    //    {
    //      return this.Name + ", age: " + this.Age + " is professor? " + this.IsProfessor;
    //    }
  }
# ---------- end c_script_6 ----------
panel_10 = Panel(c_script_6.name)
panel_11 = Panel(c_script_6.age)
panel_12 = Panel(c_script_6.isProfessor)

panel_13 = Panel(c_script_3.person)
panel_14 = Panel(c_script_5.person)

c_script_7 = CSharpScript()  # -> out, emptyDMesh
# ---------- c_script_7: C# ----------
// Grasshopper Script Instance
#region Usings
using System;
#r "nuget: geometry3Sharp, 1.0.324"
using System.Linq;
using System.Collections;
using System.Collections.Generic;
using System.Drawing;

using Rhino;
using Rhino.Geometry;

using Grasshopper;
using Grasshopper.Kernel;
using Grasshopper.Kernel.Data;
using Grasshopper.Kernel.Types;

using g3;
#endregion

public class Script_Instance : GH_ScriptInstance
{
    #region Notes
    /* 
      Members:
        RhinoDoc RhinoDocument
        GH_Document GrasshopperDocument
        IGH_Component Component
        int Iteration

      Methods (Virtual & overridable):
        Print(string text)
        Print(string format, params object[] args)
        Reflect(object obj)
        Reflect(object obj, string method_name)
    */
    #endregion

    private void RunScript(ref object emptyDMesh)
    {

        DMesh3 mesh = new DMesh3(true, true, true, true);

        emptyDMesh = mesh;

    }
}
# ---------- end c_script_7 ----------
panel_15 = Panel(c_script_7.emptyDMesh)

panel_16 = Panel(c_script_4.out)
panel_17 = Panel(c_script_6.out)
c_script_8 = CSharpScript(name="Jose Luis", age=Slider(83, range=0..100), isProfessor=Toggle(False))  # -> out, person; inputs name: String, age: Int32, isProfessor: Boolean
# ---------- c_script_8: C# ----------
// Grasshopper Script Instance
#region Usings
using System;
#r "lib\PersonClass.dll"
using System.Linq;
using System.Collections;
using System.Collections.Generic;
using System.Drawing;

using Rhino;
using Rhino.Geometry;

using Grasshopper;
using Grasshopper.Kernel;
using Grasshopper.Kernel.Data;
using Grasshopper.Kernel.Types;

using PersonClass;
#endregion

public class Script_Instance : GH_ScriptInstance
{
    #region Notes
    /* 
      Members:
        RhinoDoc RhinoDocument
        GH_Document GrasshopperDocument
        IGH_Component Component
        int Iteration

      Methods (Virtual & overridable):
        Print(string text)
        Print(string format, params object[] args)
        Reflect(object obj)
        Reflect(object obj, string method_name)
    */
    #endregion

    private void RunScript(
	string name,
	int age,
	bool isProfessor,
	ref object person)
    {
        Person p = new Person(name, age, isProfessor);

        person = p;
    }
}
# ---------- end c_script_8 ----------
panel_18 = Panel(c_script_8.person)
c_script_9 = CSharpScript(person=c_script_8.person)  # -> out, name, age, isProfessor
# ---------- c_script_9: C# ----------
// Grasshopper Script Instance
#region Usings
using System;
#r "lib\PersonClass.dll"
using System.Linq;
using System.Collections;
using System.Collections.Generic;
using System.Drawing;

using Rhino;
using Rhino.Geometry;

using Grasshopper;
using Grasshopper.Kernel;
using Grasshopper.Kernel.Data;
using Grasshopper.Kernel.Types;

using PersonClass;
#endregion

public class Script_Instance : GH_ScriptInstance
{
    #region Notes
    /* 
      Members:
        RhinoDoc RhinoDocument
        GH_Document GrasshopperDocument
        IGH_Component Component
        int Iteration

      Methods (Virtual & overridable):
        Print(string text)
        Print(string format, params object[] args)
        Reflect(object obj)
        Reflect(object obj, string method_name)
    */
    #endregion

    private void RunScript(
	object person,
	ref object name,
	ref object age,
	ref object isProfessor)
    {
        Person p = (Person)person;

        name = p.Name;
        age = p.Age;
        isProfessor = p.IsProfessor;
    }
}
# ---------- end c_script_9 ----------

panel_19 = Panel(c_script_9.name)
panel_20 = Panel(c_script_9.age)
panel_21 = Panel(c_script_9.isProfessor)
