# Grasshopper definition E.1 Utility Components.gh (Grasshopper 1.0.7)

# ---- group: Arithmetic
# UTILITY COMPONENTS
number_slider = Slider(10, range=-10..10)
division = CSharpScript(A=Slider(10, range=-10..10), B=Slider(10, range=-10..10))  # -> out, R; inputs A: Double, B: Double
# ---------- division: C# ----------
    // Algorithm
    double result = A / B;

    // Output
    R = result;
# ---------- end division ----------
subtraction = CSharpScript(A=Slider(10, range=-10..10), B=Slider(10, range=-10..10))  # -> out, R; inputs A: Double, B: Double
# ---------- subtraction: C# ----------
    // Algorithm
    double sub = A - B;

    // Output
    R = sub;
# ---------- end subtraction ----------
multiplication = CSharpScript(A=Slider(10, range=-10..10), B=Slider(10, range=-10..10))  # -> out, R; inputs A: Double, B: Double
# ---------- multiplication: C# ----------
    // Algorithm
    double result = A * B;

    // Output
    R = result;
# ---------- end multiplication ----------
addition = CSharpScript(A=number_slider, B=Slider(10, range=-10..10))  # -> out, R; inputs A: Double, B: Double
# ---------- addition: C# ----------
    // Algorithm
    double sum = A + B;
    
    // Output
    R = sum;
# ---------- end addition ----------
panel = Panel(division.R)
panel_2 = Panel(subtraction.R)
panel_3 = Panel(multiplication.R)
panel_4 = Panel(addition.R)
abs = CSharpScript(A=Slider(-8.49, range=-10..10))  # -> out, R; inputs A: Double
# ---------- abs: C# ----------
    // Algorithm
    double result = Math.Abs(A);

    // Output
    R = result;
# ---------- end abs ----------
power = CSharpScript(A=Slider(10, range=-10..10), B=Slider(3, range=-10..10))  # -> out, R; inputs A: Double, B: Double
# ---------- power: C# ----------
    // Algorithm
    double result = Math.Pow(A, B);

    // Output
    R = result;
# ---------- end power ----------
power_2 = CSharpScript(A=Slider(4, range=-10..10))  # -> out, R; inputs A: Double
# ---------- power_2: C# ----------
    // Algorithm
    double result = Math.Sqrt(A);

    // Output
    R = result;
# ---------- end power_2 ----------
panel_5 = Panel(abs.R)
panel_6 = Panel(power.R)
panel_7 = Panel(power_2.R)

# ---- group: String Manipulations
string_length = CSharpScript(S="Hello World!")  # -> out, Chars; inputs S: String
# ---------- string_length: C# ----------
    // Algorithm
    List<char> characters = new List<char>();
    
    for (int i = 0; i < S.Length; i++)
    {
      characters.Add(S[i]);
    }
    
    // Outputs
    Chars = characters;
# ---------- end string_length ----------
string_concat = CSharpScript(A="Hello ", B="World!")  # -> out, R; inputs A: String, B: String
# ---------- string_concat: C# ----------
    // Algorithm
    string result = A + B;

    // Output
    R = result;
# ---------- end string_concat ----------
string_length_2 = CSharpScript(S="Hello World!")  # -> out, L; inputs S: String
# ---------- string_length_2: C# ----------
    // Algorithm
    int res = S.Length;
    
    // Outputs
    L = res;
# ---------- end string_length_2 ----------
panel_8 = Panel(string_concat.R)
panel_9 = Panel(string_length_2.L)
panel_10 = Panel(string_length.Chars)

# ---- group: Numerical Sequences
dom = ConstructDomain(DomainStart=Slider(0, range=-10..10), DomainEnd=Slider(10, range=-10..10))
series = CSharpScript(S=Slider(0, range=-10..10), N=Slider(1.5, range=-10..10), C=Slider(7, range=0..10))  # -> out, Sout; inputs S: Double, N: Double, C: Int32
# ---------- series: C# ----------
    // Algorithm
    List<double> vals = new List<double>();

    for (int i = 0; i < C; i++)
    {
      double v = S + i * N;
      vals.Add(v);
    }

    // Outputs
    Sout = vals;
# ---------- end series ----------
range = CSharpScript(D=dom, N=Slider(9, range=0..10))  # -> out, R; inputs N: Int32
# ---------- range: C# ----------
    // Algorithm
    double step = (D.T1 - D.T0) / N;

    List<double> vals = new List<double>();

    for (int i = 0; i < N + 1; i++)
    {
      double v = D.T0 + i * step;
      vals.Add(v);
    }

    // Outputs
    R = vals;
# ---------- end range ----------
panel_11 = Panel(series.Sout)
panel_12 = Panel(range.R)
