# Grasshopper definition E.3 NURBS Components.gh (Grasshopper 1.0.7)

# ---- group: Arithmetic
# UTILITY COMPONENTS
number_slider = Slider(10, range=-10..10)
division = CSharpScript(A=Slider(10, range=-10..10), B=Slider(10, range=-10..10))  # -> out, R; inputs A: Double, B: Double
# ---------- division: C# ----------
    // Algorithm
    double result = A / B;

    // Output
    R = result;
# ---------- end division ----------
subtraction = CSharpScript(A=Slider(10, range=-10..10), B=Slider(10, range=-10..10))  # -> out, R; inputs A: Double, B: Double
# ---------- subtraction: C# ----------
    // Algorithm
    double sub = A - B;

    // Output
    R = sub;
# ---------- end subtraction ----------
multiplication = CSharpScript(A=Slider(10, range=-10..10), B=Slider(10, range=-10..10))  # -> out, R; inputs A: Double, B: Double
# ---------- multiplication: C# ----------
    // Algorithm
    double result = A * B;

    // Output
    R = result;
# ---------- end multiplication ----------
addition = CSharpScript(A=number_slider, B=Slider(10, range=-10..10))  # -> out, R; inputs A: Double, B: Double
# ---------- addition: C# ----------
    // Algorithm
    double sum = A + B;
    
    // Output
    R = sum;
# ---------- end addition ----------
panel = Panel(division.R)
panel_2 = Panel(subtraction.R)
panel_3 = Panel(multiplication.R)
panel_4 = Panel(addition.R)
abs = CSharpScript(A=Slider(-8.49, range=-10..10))  # -> out, R; inputs A: Double
# ---------- abs: C# ----------
    // Algorithm
    double result = Math.Abs(A);

    // Output
    R = result;
# ---------- end abs ----------
power = CSharpScript(A=Slider(10, range=-10..10), B=Slider(3, range=-10..10))  # -> out, R; inputs A: Double, B: Double
# ---------- power: C# ----------
    // Algorithm
    double result = Math.Pow(A, B);

    // Output
    R = result;
# ---------- end power ----------
power_2 = CSharpScript(A=Slider(4, range=-10..10))  # -> out, R; inputs A: Double
# ---------- power_2: C# ----------
    // Algorithm
    double result = Math.Sqrt(A);

    // Output
    R = result;
# ---------- end power_2 ----------
panel_5 = Panel(abs.R)
panel_6 = Panel(power.R)
panel_7 = Panel(power_2.R)

# ----
# VECTOR COMPONENTS
number_slider_2 = Slider(6.61, range=0..10)
construct_point = CSharpScript(x=number_slider_2, y=Slider(4.27, range=0..10), z=Slider(3.41, range=0..10))  # -> out, P; inputs x: Double, y: Double, z: Double
# ---------- construct_point: C# ----------
    // Algorithm
    Point3d p = new Point3d(x, y, z);

    // Outputs
    P = p;
# ---------- end construct_point ----------
deconstruct_point = CSharpScript(P=construct_point.P)  # -> out, X, Y, Z; inputs P: Point3d
# ---------- deconstruct_point: C# ----------
    // Algorithm
    
    // Output
    X = P.X;
    Y = P.Y;
    Z = P.Z;
# ---------- end deconstruct_point ----------
panel_8 = Panel(construct_point.P)
panel_9 = Panel(deconstruct_point.X)
panel_10 = Panel(deconstruct_point.Y)
panel_11 = Panel(deconstruct_point.Z)
pt = Point(Point(6.61, 4.27, 3.41))
pt_2 = Point(Point(2.83, 3.68, 7.56))
vec = Vector(Vector(2.53, 2.9, 6.77))
pt_3 = Point(Point(2.83, 2.7, 7.56))
vec_2 = Vector(Vector(6.76, 5.18, 3.9))
vector_2pt = CSharpScript(A=pt, B=pt_2)  # -> out, V; inputs A: Point3d, B: Point3d
# ---------- vector_2pt: C# ----------
    // Algorithm
    Vector3d v = B - A;  // rc operator oveloads

    // Outputs
    V = v;
# ---------- end vector_2pt ----------
plane = CSharpScript(O=pt_3, X=vec, Y=vec_2)  # -> out, Pl; inputs O: Point3d, X: Vector3d, Y: Vector3d
# ---------- plane: C# ----------
    // Algorithm
    Plane pl = new Plane(O, X, Y);
    
    // Outputs
    Pl = pl;
# ---------- end plane ----------
construct_vector = CSharpScript(x=Slider(4.96, range=0..10), y=Slider(2.49, range=0..10), z=Slider(6.28, range=0..10))  # -> out, V; inputs x: Double, y: Double, z: Double
# ---------- construct_vector: C# ----------
    // Algorithm
    Vector3d v = new Vector3d(x, y, z);

    // Outputs
    V = v;
# ---------- end construct_vector ----------
panel_12 = Panel(plane.Pl)
panel_13 = Panel(construct_vector.V)
panel_14 = Panel(vector_2pt.V)
pt_4 = Point(Point(6.61, 4.27, 3.41))
pt_5 = Point(Point(2.83, 3.68, 7.56))
line = CSharpScript(A=pt_4, B=pt_5)  # -> out, L; inputs A: Point3d, B: Point3d
# ---------- line: C# ----------
    // Algorithm
    Line line = new Line(A, B);
    
    // Outputs
    L = line;
# ---------- end line ----------
pointat_line = CSharpScript(L=line.L, t=Slider(1, range=0..1))  # -> out, P; inputs L: Line, t: Double
# ---------- pointat_line: C# ----------
    // Algorithm
    Point3d pt = L.PointAt(t);
    
    // Outputs
    P = pt;
# ---------- end pointat_line ----------
panel_15 = Panel(line.L)
panel_16 = Panel(pointat_line.P)

vec_3 = Vector(construct_vector.V)
vec_4 = Vector(construct_vector.V)
vec_5 = Vector(construct_vector.V)
vector_length = CSharpScript(V=vec_5)  # -> out, L; inputs V: Vector3d
# ---------- vector_length: C# ----------
    // Algorithm (manual)
    // double length = Math.Sqrt(V.X * V.X + V.Y * V.Y + V.Z * V.Z);

    // Algorithm (RhinoCommon)
    double length = V.Length;

    // Outputs
    L = length;
# ---------- end vector_length ----------
unitize_vector = CSharpScript(V=vec_3)  # -> out, Vout; inputs V: Vector3d
# ---------- unitize_vector: C# ----------
    // Algorithm (manual)
    //    double length = Math.Sqrt(V.X * V.X + V.Y * V.Y + V.Z * V.Z);
    //    Vector3d newV = new Vector3d(V.X / length, V.Y / length, V.Z / length);

    // Algorithm (RhinoCommon)
    V.Unitize();

    // Outputs
    Vout = V;
# ---------- end unitize_vector ----------
set_vector_length = CSharpScript(V=vec_4, L=Slider(10, range=0..10))  # -> out, Vout; inputs V: Vector3d, L: Double
# ---------- set_vector_length: C# ----------
    // Algorithm (manual)
    //    double length = Math.Sqrt(V.X * V.X + V.Y * V.Y + V.Z * V.Z);
    //    double factor = L / length;
    //    Vector3d newV = new Vector3d(factor * V.X, factor * V.Y, factor * V.Z);

    // Algorithm (RhinoCommon)
    V.Unitize();
    Vector3d newV = L * V;

    // Outputs
    Vout = newV;
# ---------- end set_vector_length ----------
panel_17 = Panel(vector_length.L)
panel_18 = Panel(set_vector_length.Vout)
panel_19 = Panel(unitize_vector.Vout)
vec_6 = Vector(construct_vector.V)
vec_7 = Vector(vector_2pt.V)
vec_8 = Vector(construct_vector.V)
vec_9 = Vector(vector_2pt.V)
vec_10 = Vector(construct_vector.V)
vector_cross_product = CSharpScript(A=vec_6, B=vec_7, U=Toggle(False))  # -> out, V, L; inputs A: Vector3d, B: Vector3d, U: Boolean
# ---------- vector_cross_product: C# ----------
    // Algorithm
    Vector3d cross = Vector3d.CrossProduct(A, B);
    
    if (U)
    {
      cross.Unitize();
    }

    // Output
    V = cross;
    L = cross.Length;
# ---------- end vector_cross_product ----------
vector_tween = CSharpScript(A=vec_10, B=vec_9, t=Slider(0.234, range=-1..2))  # -> out, V; inputs A: Vector3d, B: Vector3d, t: Double
# ---------- vector_tween: C# ----------
    // Algorithm (manual)
    //    double dx = B.X - A.X;
    //    double dy = B.Y - A.Y;
    //    double dz = B.Z - A.Z;
    //    Vector3d tween = new Vector3d(
    //      A.X + t * dx,
    //      A.Y + t * dy,
    //      A.Z + t * dz);

    // Algorithm (RhinoCommon)
    Vector3d C = B - A;
    Vector3d tween = A + C * t;

    // Outputs
    V = tween;
# ---------- end vector_tween ----------
vector_addition = CSharpScript(A=vec_8, B=vec_8)  # -> out, V; inputs A: Vector3d, B: Vector3d
# ---------- vector_addition: C# ----------
    // Algorithm (manual)
//    Vector3d sum = new Vector3d(A.X + B.X, A.Y + B.Y, A.Z + B.Z);

    // Algorithm (RhinoCommon)
    Vector3d sum = A + B;

    // Outputs
    V = sum;
# ---------- end vector_addition ----------
panel_20 = Panel(vector_addition.V)
panel_21 = Panel(vector_tween.V)
panel_22 = Panel(vector_cross_product.V)
panel_23 = Panel(vector_cross_product.L)

crv = Curve(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)
# NURBS COMPONENTS
crv_2 = Curve(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)
blend_curve = CSharpScript(A=crv_2, B=crv)  # -> out, BLEND; inputs A: Curve, B: Curve
# ---------- blend_curve: C# ----------
    // Algorithm
    Curve blend = Curve.CreateBlendCurve(A, B, BlendContinuity.Curvature);

    // Outputs
    BLEND = blend;
# ---------- end blend_curve ----------
pt_6 = Point(Point(3.249016238, 12.62505604, 0.470307846))
pt_7 = Point(Point(7.127253697, 12.20313404, -0.2982870258))
pt_8 = Point(Point(7.668711709, 7.961568486, 1.407879106))
pt_9 = Point(Point(3.385158437, 7.648926515, 0))
_4point_surface = CSharpScript(A=pt_6, B=pt_7, C=pt_8, D=pt_9)  # -> out, S; inputs A: Point3d, B: Point3d, C: Point3d, D: Point3d
# ---------- _4point_surface: C# ----------
    // Algorithm
    Brep surf = Brep.CreateFromCornerPoints(A, B, C, D, 0.001);

    // Outputs
    S = surf;
# ---------- end _4point_surface ----------
pt_10 = Point(Point(1.687028843, 10.26280391, -1.753171499))
xy = XYPlane(Origin=pt_10)
brep_plane_intersection = CSharpScript(B=_4point_surface.S, P=xy)  # -> out, C, Pts; inputs B: Brep, P: Plane
# ---------- brep_plane_intersection: C# ----------
    // Algorithm
    Curve[] sections;
    Point3d[] intersects;
    bool success = Rhino.Geometry.Intersect.Intersection.BrepPlane(B, P, 0.001, out sections, out intersects);
    if (success)
    {
      Print("Intersection worked!");
    }
    else
    {
      Print("Intersection failed!");
    }

    // Outputs
    C = sections;
    Pts = intersects;
# ---------- end brep_plane_intersection ----------
panel_24 = Panel(brep_plane_intersection.Pts)
panel_25 = Panel(brep_plane_intersection.C)
panel_26 = Panel(brep_plane_intersection.out)

crv_3 = Curve(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)
crv_4 = Curve(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)
srf = Surface(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)
sweep1 = CSharpScript(R=crv_4, S=crv_3, C=Toggle(False))  # -> out, Sweep; inputs R: Curve, S: Curve, C: Boolean
# ---------- sweep1: C# ----------
    // Algorithm
    Brep[] sweeps = Brep.CreateFromSweep(R, S, C, 0.001);


    // Outputs
    Sweep = sweeps;
# ---------- end sweep1 ----------
divide_surface = CSharpScript(S=srf, U=Slider(5, range=0..10), V=Slider(10, range=0..10))  # -> out, P, N, M, G, uv; inputs S: Surface, U: Int32, V: Int32
# ---------- divide_surface: C# ----------
    // Algorithm
    // Get domains
    Interval uDomain = S.Domain(0);
    double uStep = uDomain.Length / U;
    Interval vDomain = S.Domain(1);
    double vStep = vDomain.Length / V;

    // Generate output information coordinates
    List<Point3d> pts = new List<Point3d>();
    List<Vector3d> normals = new List<Vector3d>();
    List<Point2d> uvPts = new List<Point2d>();
    List<double> means = new List<double>();
    List<double> gaussians = new List<double>();
    for (int i = 0; i < U + 1; i++)
    {
      double u = uDomain.T0 + i * uStep;
      for (int j = 0; j < V + 1; j++)
      {
        double v = vDomain.T0 + j * vStep;

        // Manually
        //        // Get the pt on surface
        //        Point3d pt = S.PointAt(u, v);
        //        pts.Add(pt);
        //
        //        // Get the normal on the surface
        //        Vector3d normal = S.NormalAt(u, v);
        //        normals.Add(normal);
        //
        //        // Create UV points
        //        Point3d p = new Point3d(u, v, 0);
        //        uvPts.Add(p);
        
        // Get surface curvature values
        SurfaceCurvature sc = S.CurvatureAt(u, v);

        // Extract info from the SC object
        pts.Add(sc.Point);
        normals.Add(sc.Normal);
        uvPts.Add(sc.UVPoint);
        means.Add(sc.Mean);
        gaussians.Add(sc.Gaussian);
      }
    }

    // Outputs
    P = pts;
    N = normals;
    M = means;
    G = gaussians;
    uv = uvPts;
# ---------- end divide_surface ----------
divide_curve = CSharpScript(C=crv_4, N=Slider(10, range=0..10))  # -> out, P, T, t; inputs C: Curve, N: Int32
# ---------- divide_curve: C# ----------
    // Algorithm
    //    // Find parameters for divisions
    //    double[] parameters = C.DivideByCount(N, true);
    //
    //    // Find points & vectors for these parameters
    //    Point3d[] points = new Point3d[parameters.Length];
    //    Vector3d[] tangents = new Vector3d[parameters.Length];
    //    for (int i = 0; i < parameters.Length; i++)
    //    {
    //      double p = parameters[i];
    //
    //      Point3d pt = C.PointAt(p);
    //      points[i] = pt;
    //
    //      Vector3d v = C.TangentAt(p);
    //      tangents[i] = v;
    //    }

    // Find parameters & points for divisions
    Point3d[] points;
    double[] parameters = C.DivideByCount(N, true, out points);

    // Find vectors for these parameters
    Vector3d[] tangents = new Vector3d[parameters.Length];
    for (int i = 0; i < parameters.Length; i++)
    {
      double p = parameters[i];

      Vector3d v = C.TangentAt(p);
      tangents[i] = v;
    }

    // Outputs
    P = points;
    T = tangents;
    t = parameters;
# ---------- end divide_curve ----------
panel_27 = Panel(divide_curve.P)
panel_28 = Panel(divide_surface.P)
panel_29 = Panel(sweep1.Sweep)
panel_30 = Panel(divide_curve.T)
panel_31 = Panel(divide_surface.N)
panel_32 = Panel(divide_curve.t)
panel_33 = Panel(divide_surface.M)
panel_34 = Panel(divide_surface.G)
panel_35 = Panel(divide_surface.uv)
pt_11 = Point([Point(5.209074957, 0.4950278282, 0), Point(1.381233475, 5.600009881, 0), Point(5.076857034, 9.745677052, 0), Point(8.855930063, 5.506734812, 0), Point(13.15022283, 0.7481223904, 0), Point(13.66579701, 6.553227999, 0)])
crv_5 = Curve(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)
srf_2 = Surface(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)
reparameterize_surface = CSharpScript(S=srf_2)  # -> out, Sout; inputs S: Surface
# ---------- reparameterize_surface: C# ----------
    // Algorithm
    S.SetDomain(0, new Interval(0, 1));
    S.SetDomain(1, new Interval(0, 1));

    // Outputs
    Sout = S;
# ---------- end reparameterize_surface ----------
reparameterize_curve = CSharpScript(C=crv_5)  # -> out, Cout; inputs C: Curve
# ---------- reparameterize_curve: C# ----------
    // Algorithm
    C.Domain = new Interval(0, 1);
    
    // Outputs
    Cout = C;
# ---------- end reparameterize_curve ----------
domain² = Domain²(srf_2)
domain = Domain(crv_5)
interpolate_curve = CSharpScript(V=pt_11, D=Slider(3, range=0..10), P=Toggle(False), K=Slider(1, range=0..10))  # -> out, C, L, Dom; inputs V: list of Point3d, D: Int32, P: Boolean, K: Int32
# ---------- interpolate_curve: C# ----------
    // Algorithm
    if (K < 0 || K > 2)
    {
      Print("Invalid knot style");
      return;
    }

    if (P)
    {
      K += 3;
      V.Add(V[0]);
    }

    CurveKnotStyle cks = (CurveKnotStyle) K;
    Curve c = Curve.CreateInterpolatedCurve(V, D, cks);

    // Outputs
    C = c;
    L = c.GetLength();
    Dom = c.Domain;
# ---------- end interpolate_curve ----------
domain²_2 = Domain²(reparameterize_surface.Sout)
domain_2 = Domain(reparameterize_curve.Cout)
panel_36 = Panel(domain)
panel_37 = Panel(domain²)
panel_38 = Panel(domain²_2)
panel_39 = Panel(domain_2)
panel_40 = Panel(interpolate_curve.out)
panel_41 = Panel(interpolate_curve.C)
panel_42 = Panel(interpolate_curve.L)
panel_43 = Panel(interpolate_curve.Dom)

# ---- group: String Manipulations
string_length = CSharpScript(S="Hello World!")  # -> out, Chars; inputs S: String
# ---------- string_length: C# ----------
    // Algorithm
    List<char> characters = new List<char>();
    
    for (int i = 0; i < S.Length; i++)
    {
      characters.Add(S[i]);
    }
    
    // Outputs
    Chars = characters;
# ---------- end string_length ----------
string_concat = CSharpScript(A="Hello ", B="World!")  # -> out, R; inputs A: String, B: String
# ---------- string_concat: C# ----------
    // Algorithm
    string result = A + B;

    // Output
    R = result;
# ---------- end string_concat ----------
string_length_2 = CSharpScript(S="Hello World!")  # -> out, L; inputs S: String
# ---------- string_length_2: C# ----------
    // Algorithm
    int res = S.Length;
    
    // Outputs
    L = res;
# ---------- end string_length_2 ----------
panel_44 = Panel(string_concat.R)
panel_45 = Panel(string_length_2.L)
panel_46 = Panel(string_length.Chars)

# ---- group: Numerical Sequences
dom = ConstructDomain(DomainStart=Slider(0, range=-10..10), DomainEnd=Slider(10, range=-10..10))
series = CSharpScript(S=Slider(0, range=-10..10), N=Slider(1.5, range=-10..10), C=Slider(7, range=0..10))  # -> out, Sout; inputs S: Double, N: Double, C: Int32
# ---------- series: C# ----------
    // Algorithm
    List<double> vals = new List<double>();

    for (int i = 0; i < C; i++)
    {
      double v = S + i * N;
      vals.Add(v);
    }

    // Outputs
    Sout = vals;
# ---------- end series ----------
range = CSharpScript(D=dom, N=Slider(9, range=0..10))  # -> out, R; inputs N: Int32
# ---------- range: C# ----------
    // Algorithm
    double step = (D.T1 - D.T0) / N;

    List<double> vals = new List<double>();

    for (int i = 0; i < N + 1; i++)
    {
      double v = D.T0 + i * step;
      vals.Add(v);
    }

    // Outputs
    R = vals;
# ---------- end range ----------
panel_47 = Panel(series.Sout)
panel_48 = Panel(range.R)
