# Grasshopper definition pcamp-components.gh (Grasshopper 1.0.7)
# plug-ins: Firefly.X, PCampGHPlugin

# ---- group: Arithmetic
# UTILITY COMPONENTS
number_slider = Slider(10, range=-10..10)
division = CSharpScript(A=Slider(10, range=-10..10), B=Slider(10, range=-10..10))  # -> out, R; inputs A: Double, B: Double
# ---------- division: C# ----------
    // Algorithm
    double result = A / B;

    // Output
    R = result;
# ---------- end division ----------
subtraction = CSharpScript(A=Slider(10, range=-10..10), B=Slider(10, range=-10..10))  # -> out, R; inputs A: Double, B: Double
# ---------- subtraction: C# ----------
    // Algorithm
    double sub = A - B;

    // Output
    R = sub;
# ---------- end subtraction ----------
multiplication = CSharpScript(A=Slider(10, range=-10..10), B=Slider(10, range=-10..10))  # -> out, R; inputs A: Double, B: Double
# ---------- multiplication: C# ----------
    // Algorithm
    double result = A * B;

    // Output
    R = result;
# ---------- end multiplication ----------
addition = CSharpScript(A=number_slider, B=Slider(10, range=-10..10))  # -> out, R; inputs A: Double, B: Double
# ---------- addition: C# ----------
    // Algorithm
    double sum = A + B;
    
    // Output
    R = sum;
# ---------- end addition ----------
panel = Panel(division.R)
panel_2 = Panel(subtraction.R)
panel_3 = Panel(multiplication.R)
panel_4 = Panel(addition.R)
abs = CSharpScript(A=Slider(-8.49, range=-10..10))  # -> out, R; inputs A: Double
# ---------- abs: C# ----------
    // Algorithm
    double result = Math.Abs(A);

    // Output
    R = result;
# ---------- end abs ----------
power = CSharpScript(A=Slider(10, range=-10..10), B=Slider(3, range=-10..10))  # -> out, R; inputs A: Double, B: Double
# ---------- power: C# ----------
    // Algorithm
    double result = Math.Pow(A, B);

    // Output
    R = result;
# ---------- end power ----------
power_2 = CSharpScript(A=Slider(4, range=-10..10))  # -> out, R; inputs A: Double
# ---------- power_2: C# ----------
    // Algorithm
    double result = Math.Sqrt(A);

    // Output
    R = result;
# ---------- end power_2 ----------
panel_5 = Panel(abs.R)
panel_6 = Panel(power.R)
panel_7 = Panel(power_2.R)

# ----
# VECTOR COMPONENTS
number_slider_2 = Slider(6.61, range=0..10)
construct_point = CSharpScript(x=number_slider_2, y=Slider(4.27, range=0..10), z=Slider(3.41, range=0..10))  # -> out, P; inputs x: Double, y: Double, z: Double
# ---------- construct_point: C# ----------
    // Algorithm
    Point3d p = new Point3d(x, y, z);

    // Outputs
    P = p;
# ---------- end construct_point ----------
deconstruct_point = CSharpScript(P=construct_point.P)  # -> out, X, Y, Z; inputs P: Point3d
# ---------- deconstruct_point: C# ----------
    // Algorithm
    
    // Output
    X = P.X;
    Y = P.Y;
    Z = P.Z;
# ---------- end deconstruct_point ----------
panel_8 = Panel(construct_point.P)
panel_9 = Panel(deconstruct_point.X)
panel_10 = Panel(deconstruct_point.Y)
panel_11 = Panel(deconstruct_point.Z)
pt = Point(Point(6.61, 4.27, 3.41))
pt_2 = Point(Point(2.83, 3.68, 7.56))
vec = Vector(Vector(2.53, 2.9, 6.77))
pt_3 = Point(Point(2.83, 2.7, 7.56))
vec_2 = Vector(Vector(6.76, 5.18, 3.9))
vector_2pt = CSharpScript(A=pt, B=pt_2)  # -> out, V; inputs A: Point3d, B: Point3d
# ---------- vector_2pt: C# ----------
    // Algorithm
    Vector3d v = B - A;  // rc operator oveloads

    // Outputs
    V = v;
# ---------- end vector_2pt ----------
plane = CSharpScript(O=pt_3, X=vec, Y=vec_2)  # -> out, Pl; inputs O: Point3d, X: Vector3d, Y: Vector3d
# ---------- plane: C# ----------
    // Algorithm
    Plane pl = new Plane(O, X, Y);
    
    // Outputs
    Pl = pl;
# ---------- end plane ----------
construct_vector = CSharpScript(x=Slider(4.96, range=0..10), y=Slider(2.49, range=0..10), z=Slider(6.28, range=0..10))  # -> out, V; inputs x: Double, y: Double, z: Double
# ---------- construct_vector: C# ----------
    // Algorithm
    Vector3d v = new Vector3d(x, y, z);

    // Outputs
    V = v;
# ---------- end construct_vector ----------
panel_12 = Panel(plane.Pl)
panel_13 = Panel(construct_vector.V)
panel_14 = Panel(vector_2pt.V)
pt_4 = Point(Point(6.61, 4.27, 3.41))
pt_5 = Point(Point(2.83, 3.68, 7.56))
line = CSharpScript(A=pt_4, B=pt_5)  # -> out, L; inputs A: Point3d, B: Point3d
# ---------- line: C# ----------
    // Algorithm
    Line line = new Line(A, B);
    
    // Outputs
    L = line;
# ---------- end line ----------
pointat_line = CSharpScript(L=line.L, t=Slider(1, range=0..1))  # -> out, P; inputs L: Line, t: Double
# ---------- pointat_line: C# ----------
    // Algorithm
    Point3d pt = L.PointAt(t);
    
    // Outputs
    P = pt;
# ---------- end pointat_line ----------
panel_15 = Panel(line.L)
panel_16 = Panel(pointat_line.P)

vec_3 = Vector(construct_vector.V)
vec_4 = Vector(construct_vector.V)
vec_5 = Vector(construct_vector.V)
vector_length = CSharpScript(V=vec_5)  # -> out, L; inputs V: Vector3d
# ---------- vector_length: C# ----------
    // Algorithm (manual)
    // double length = Math.Sqrt(V.X * V.X + V.Y * V.Y + V.Z * V.Z);

    // Algorithm (RhinoCommon)
    double length = V.Length;

    // Outputs
    L = length;
# ---------- end vector_length ----------
unitize_vector = CSharpScript(V=vec_3)  # -> out, Vout; inputs V: Vector3d
# ---------- unitize_vector: C# ----------
    // Algorithm (manual)
    //    double length = Math.Sqrt(V.X * V.X + V.Y * V.Y + V.Z * V.Z);
    //    Vector3d newV = new Vector3d(V.X / length, V.Y / length, V.Z / length);

    // Algorithm (RhinoCommon)
    if (V.Unitize() == false)
    {
      Component.AddRuntimeMessage(GH_RuntimeMessageLevel.Error, "Cannot unitize this vector");
    }

    // Outputs
    Vout = V;
# ---------- end unitize_vector ----------
set_vector_length = CSharpScript(V=vec_4, L=Slider(10, range=0..10))  # -> out, Vout; inputs V: Vector3d, L: Double
# ---------- set_vector_length: C# ----------
    // Algorithm (manual)
    //    double length = Math.Sqrt(V.X * V.X + V.Y * V.Y + V.Z * V.Z);
    //    double factor = L / length;
    //    Vector3d newV = new Vector3d(factor * V.X, factor * V.Y, factor * V.Z);

    // Algorithm (RhinoCommon)
    V.Unitize();
    Vector3d newV = L * V;

    // Outputs
    Vout = newV;
# ---------- end set_vector_length ----------
panel_17 = Panel(vector_length.L)
panel_18 = Panel(set_vector_length.Vout)
panel_19 = Panel(unitize_vector.Vout)
vec_6 = Vector(construct_vector.V)
vec_7 = Vector(vector_2pt.V)
vec_8 = Vector(construct_vector.V)
vec_9 = Vector(vector_2pt.V)
vec_10 = Vector(construct_vector.V)
vector_cross_product = CSharpScript(A=vec_6, B=vec_7, U=Toggle(False))  # -> out, V, L; inputs A: Vector3d, B: Vector3d, U: Boolean
# ---------- vector_cross_product: C# ----------
    // Algorithm
    Vector3d cross = Vector3d.CrossProduct(A, B);
    
    if (U)
    {
      cross.Unitize();
    }

    // Output
    V = cross;
    L = cross.Length;
# ---------- end vector_cross_product ----------
vector_tween = CSharpScript(A=vec_10, B=vec_9, t=Slider(0.703, range=-1..2))  # -> out, V; inputs A: Vector3d, B: Vector3d, t: Double
# ---------- vector_tween: C# ----------
    // Algorithm (manual)
    //    double dx = B.X - A.X;
    //    double dy = B.Y - A.Y;
    //    double dz = B.Z - A.Z;
    //    Vector3d tween = new Vector3d(
    //      A.X + t * dx,
    //      A.Y + t * dy,
    //      A.Z + t * dz);

    // Algorithm (RhinoCommon)
    Vector3d C = B - A;
    Vector3d tween = A + C * t;

    // Add a warning
    if (t < 0 || t > 1)
    {
      Component.AddRuntimeMessage(GH_RuntimeMessageLevel.Warning, "Your parameter is outside the [0,1] range");
    }

    // Outputs
    V = tween;
# ---------- end vector_tween ----------
vector_addition = CSharpScript(A=vec_8, B=vec_8)  # -> out, V; inputs A: Vector3d, B: Vector3d
# ---------- vector_addition: C# ----------
    // Algorithm (manual)
//    Vector3d sum = new Vector3d(A.X + B.X, A.Y + B.Y, A.Z + B.Z);

    // Algorithm (RhinoCommon)
    Vector3d sum = A + B;

    // Outputs
    V = sum;
# ---------- end vector_addition ----------
panel_20 = Panel(vector_addition.V)
panel_21 = Panel(vector_tween.V)
panel_22 = Panel(vector_cross_product.V)
panel_23 = Panel(vector_cross_product.L)

crv = Curve(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)
# NURBS COMPONENTS
crv_2 = Curve(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)
blend_curve = CSharpScript(A=crv_2, B=crv)  # -> out, BLEND; inputs A: Curve, B: Curve
# ---------- blend_curve: C# ----------
    // Algorithm
    Curve blend = Curve.CreateBlendCurve(A, B, BlendContinuity.Curvature);

    // Outputs
    BLEND = blend;
# ---------- end blend_curve ----------
pt_6 = Point(Point(3.249016238, 12.62505604, 0.470307846))
pt_7 = Point(Point(7.127253697, 12.20313404, -0.2982870258))
pt_8 = Point(Point(7.668711709, 7.961568486, 1.407879106))
pt_9 = Point(Point(3.385158437, 7.648926515, 0))
_4point_surface = CSharpScript(A=pt_6, B=pt_7, C=pt_8, D=pt_9)  # -> out, S; inputs A: Point3d, B: Point3d, C: Point3d, D: Point3d
# ---------- _4point_surface: C# ----------
    // Algorithm
    Brep surf = Brep.CreateFromCornerPoints(A, B, C, D, 0.001);

    // Outputs
    S = surf;
# ---------- end _4point_surface ----------
pt_10 = Point(Point(1.687028843, 10.26280391, -1.753171499))
xy = XYPlane(Origin=pt_10)
brep_plane_intersection = CSharpScript(B=_4point_surface.S, P=xy)  # -> out, C, Pts; inputs B: Brep, P: Plane
# ---------- brep_plane_intersection: C# ----------
    // Algorithm
    Curve[] sections;
    Point3d[] intersects;
    bool success = Rhino.Geometry.Intersect.Intersection.BrepPlane(B, P, 0.001, out sections, out intersects);
    if (success)
    {
      Print("Intersection worked!");
    }
    else
    {
      Print("Intersection failed!");
    }

    // Outputs
    C = sections;
    Pts = intersects;
# ---------- end brep_plane_intersection ----------
panel_24 = Panel(brep_plane_intersection.Pts)
panel_25 = Panel(brep_plane_intersection.C)
panel_26 = Panel(brep_plane_intersection.out)

number_slider_3 = Slider(5, range=0..10)
number_slider_4 = Slider(10, range=0..10)
crv_3 = Curve(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)
crv_4 = Curve(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)
srf = Surface(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)
sweep1 = CSharpScript(R=crv_4, S=crv_3, C=Toggle(False))  # -> out, Sweep; inputs R: Curve, S: Curve, C: Boolean
# ---------- sweep1: C# ----------
    // Algorithm
    Brep[] sweeps = Brep.CreateFromSweep(R, S, C, 0.001);


    // Outputs
    Sweep = sweeps;
# ---------- end sweep1 ----------
divide_surface_tree = CSharpScript(S=srf, U=number_slider_3, V=number_slider_4)  # -> out, P, N, M, G, uv; inputs S: Surface, U: Int32, V: Int32
# ---------- divide_surface_tree: C# ----------
    // Algorithm
    // Get domains
    Interval uDomain = S.Domain(0);
    double uStep = uDomain.Length / U;
    Interval vDomain = S.Domain(1);
    double vStep = vDomain.Length / V;

    // Generate output information coordinates
    DataTree<Point3d> pts = new DataTree<Point3d>();
    DataTree<Vector3d> normals = new DataTree<Vector3d>();
    DataTree<Point2d> uvPts = new DataTree<Point2d>();
    DataTree<double> means = new DataTree<double>();
    DataTree<double> gaussians = new DataTree<double>();
    for (int i = 0; i < U + 1; i++)
    {
      double u = uDomain.T0 + i * uStep;
      GH_Path path = new GH_Path(i);
      
      for (int j = 0; j < V + 1; j++)
      {
        double v = vDomain.T0 + j * vStep;

        // Get surface curvature values
        SurfaceCurvature sc = S.CurvatureAt(u, v);
        
        // Extract info from the SC object
        pts.Add(sc.Point, path);
        normals.Add(sc.Normal, path);
        uvPts.Add(sc.UVPoint, path);
        means.Add(sc.Mean, path);
        gaussians.Add(sc.Gaussian, path);
      }
    }

    // Outputs
    P = pts;
    N = normals;
    M = means;
    G = gaussians;
    uv = uvPts;
# ---------- end divide_surface_tree ----------
divide_surface_list = CSharpScript(S=srf, U=number_slider_3, V=number_slider_4)  # -> out, P, N, M, G, uv; inputs S: Surface, U: Int32, V: Int32
# ---------- divide_surface_list: C# ----------
    // Algorithm
    // Get domains
    Interval uDomain = S.Domain(0);
    double uStep = uDomain.Length / U;
    Interval vDomain = S.Domain(1);
    double vStep = vDomain.Length / V;

    // Generate output information coordinates
    List<Point3d> pts = new List<Point3d>();
    List<Vector3d> normals = new List<Vector3d>();
    List<Point2d> uvPts = new List<Point2d>();
    List<double> means = new List<double>();
    List<double> gaussians = new List<double>();
    for (int i = 0; i < U + 1; i++)
    {
      double u = uDomain.T0 + i * uStep;
      for (int j = 0; j < V + 1; j++)
      {
        double v = vDomain.T0 + j * vStep;

        // Manually
        //        // Get the pt on surface
        //        Point3d pt = S.PointAt(u, v);
        //        pts.Add(pt);
        //
        //        // Get the normal on the surface
        //        Vector3d normal = S.NormalAt(u, v);
        //        normals.Add(normal);
        //
        //        // Create UV points
        //        Point3d p = new Point3d(u, v, 0);
        //        uvPts.Add(p);
        
        // Get surface curvature values
        SurfaceCurvature sc = S.CurvatureAt(u, v);

        // Extract info from the SC object
        pts.Add(sc.Point);
        normals.Add(sc.Normal);
        uvPts.Add(sc.UVPoint);
        means.Add(sc.Mean);
        gaussians.Add(sc.Gaussian);
      }
    }

    // Outputs
    P = pts;
    N = normals;
    M = means;
    G = gaussians;
    uv = uvPts;
# ---------- end divide_surface_list ----------
divide_curve = CSharpScript(C=crv_4, N=Slider(10, range=0..10))  # -> out, P, T, t; inputs C: Curve, N: Int32
# ---------- divide_curve: C# ----------
    // Algorithm
    //    // Find parameters for divisions
    //    double[] parameters = C.DivideByCount(N, true);
    //
    //    // Find points & vectors for these parameters
    //    Point3d[] points = new Point3d[parameters.Length];
    //    Vector3d[] tangents = new Vector3d[parameters.Length];
    //    for (int i = 0; i < parameters.Length; i++)
    //    {
    //      double p = parameters[i];
    //
    //      Point3d pt = C.PointAt(p);
    //      points[i] = pt;
    //
    //      Vector3d v = C.TangentAt(p);
    //      tangents[i] = v;
    //    }

    // Find parameters & points for divisions
    Point3d[] points;
    double[] parameters = C.DivideByCount(N, true, out points);

    // Find vectors for these parameters
    Vector3d[] tangents = new Vector3d[parameters.Length];
    for (int i = 0; i < parameters.Length; i++)
    {
      double p = parameters[i];

      Vector3d v = C.TangentAt(p);
      tangents[i] = v;
    }

    // Outputs
    P = points;
    T = tangents;
    t = parameters;
# ---------- end divide_curve ----------
panel_27 = Panel(divide_surface_tree.P)
panel_28 = Panel(divide_curve.P)
panel_29 = Panel(divide_surface_list.P)
panel_30 = Panel(sweep1.Sweep)
panel_31 = Panel(divide_curve.T)
panel_32 = Panel(divide_surface_tree.N)
panel_33 = Panel(divide_surface_list.N)
panel_34 = Panel(divide_curve.t)
panel_35 = Panel(divide_surface_tree.M)
panel_36 = Panel(divide_surface_list.M)
panel_37 = Panel(divide_surface_tree.G)
panel_38 = Panel(divide_surface_list.G)
panel_39 = Panel(divide_surface_tree.uv)
panel_40 = Panel(divide_surface_list.uv)
pt_11 = Point([Point(5.209074957, 0.4950278282, 0), Point(1.381233475, 5.600009881, 0), Point(5.076857034, 9.745677052, 0), Point(8.855930063, 5.506734812, 0), Point(13.15022283, 0.7481223904, 0), Point(13.66579701, 6.553227999, 0)])
crv_5 = Curve(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)
srf_2 = Surface(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)
reparameterize_surface = CSharpScript(S=srf_2)  # -> out, Sout; inputs S: Surface
# ---------- reparameterize_surface: C# ----------
    // Algorithm
    S.SetDomain(0, new Interval(0, 1));
    S.SetDomain(1, new Interval(0, 1));

    // Outputs
    Sout = S;
# ---------- end reparameterize_surface ----------
reparameterize_curve = CSharpScript(C=crv_5)  # -> out, Cout; inputs C: Curve
# ---------- reparameterize_curve: C# ----------
    // Algorithm
    C.Domain = new Interval(0, 1);
    
    // Outputs
    Cout = C;
# ---------- end reparameterize_curve ----------
domain² = Domain²(srf_2)
domain = Domain(crv_5)
interpolate_curve = CSharpScript(V=pt_11, D=Slider(3, range=0..10), P=Toggle(False), K=Slider(1, range=0..10))  # -> out, C, L, Dom; inputs V: list of Point3d, D: Int32, P: Boolean, K: Int32
# ---------- interpolate_curve: C# ----------
    // Algorithm
    if (K < 0 || K > 2)
    {
      Print("Invalid knot style");
      return;
    }

    if (P)
    {
      K += 3;
      V.Add(V[0]);
    }

    CurveKnotStyle cks = (CurveKnotStyle) K;
    Curve c = Curve.CreateInterpolatedCurve(V, D, cks);

    // Outputs
    C = c;
    L = c.GetLength();
    Dom = c.Domain;
# ---------- end interpolate_curve ----------
domain²_2 = Domain²(reparameterize_surface.Sout)
domain_2 = Domain(reparameterize_curve.Cout)
panel_41 = Panel(domain)
panel_42 = Panel(domain²)
panel_43 = Panel(domain²_2)
panel_44 = Panel(domain_2)
panel_45 = Panel(interpolate_curve.out)
panel_46 = Panel(interpolate_curve.C)
panel_47 = Panel(interpolate_curve.L)
panel_48 = Panel(interpolate_curve.Dom)

# ----
# MESH COMPONENTS
mesh = Mesh(<mesh referenced from the Rhino model>)
meshtodmesh3 = CSharpScript(
    mesh=mesh,
    Reference="D:\DROPBOX\JL\CODE\PARAMETRICCAMP\TUTORIALFILES\ADVANCED_DEVELOPMENT_GRASSHOPPER\PCAMP-GH-PLUGIN\SAMPLE-FILES\geometry3.dll")  # -> out, dmesh3; inputs mesh: Mesh
# ---------- meshtodmesh3: C# usings ----------
using g3;
# ---------- meshtodmesh3: C# ----------
    if (mesh == null) return;

    // Outputs
    dmesh3 = ConvertMesh(mesh);
# ---------- meshtodmesh3: C# additional code ----------
  public DMesh3 ConvertMesh(Mesh mesh)
  {
    // Create empty DMesh3
    DMesh3 dm = new DMesh3(true, true, true, true);

    // Copy all vertices
    for (int i = 0; i < mesh.Vertices.Count; i++)
    {
      Point3f v = mesh.Vertices[i];
      dm.AppendVertex(v.X, v.Y, v.Z);
    }

    // Copy all the faces
    for (int i = 0; i < mesh.Faces.Count; i++)
    {
      MeshFace mf = mesh.Faces.GetFace(i);
      if (mf.IsTriangle)
      {
        dm.AppendTriangle(mf.A, mf.B, mf.C);
      }
    }

    return dm;
  }
# ---------- end meshtodmesh3 ----------
panel_49 = Panel(meshtodmesh3.dmesh3)
mesh_reduce_triangles = CSharpScript(
    dMeshIn=meshtodmesh3.dmesh3,
    targetTriangles=Slider(1000, range=0..1000),
    Reference="D:\DROPBOX\JL\CODE\PARAMETRICCAMP\TUTORIALFILES\ADVANCED_DEVELOPMENT_GRASSHOPPER\PCAMP-GH-PLUGIN\SAMPLE-FILES\geometry3.dll")  # -> out, dMeshOut, prevTriangleCount, finalTriangleCount; inputs targetTriangles: Int32
# ---------- mesh_reduce_triangles: C# ----------
    if (dMeshIn == null) return;

    // Cast
    DMesh3 cast = (DMesh3) dMeshIn;

    // Copy (avoid changes to the original obj reference)
    DMesh3 dm = new DMesh3(cast, true, true, true, true);

    prevTriangleCount = cast.TriangleCount;

    // Reduce it
    Reducer r = new Reducer(dm);
    r.ReduceToTriangleCount(targetTriangles);

    // For some reason, the reduced mesh had invalid vertices.
    // This gets solved by re-creating a new mesh as a copy from the invalid one...
    // Need to do more research as to why this is not working...
    DMesh3 copy = new DMesh3(dm, true, true, true, true);

    // Outputs
    dMeshOut = copy;
    finalTriangleCount = dm.TriangleCount;
# ---------- end mesh_reduce_triangles ----------
dmesh3_reduce_vertices = CSharpScript(
    dmesh3=meshtodmesh3.dmesh3,
    targetVertices=Slider(932, range=0..1000),
    Reference="D:\DROPBOX\JL\CODE\PARAMETRICCAMP\TUTORIALFILES\ADVANCED_DEVELOPMENT_GRASSHOPPER\PCAMP-GH-PLUGIN\SAMPLE-FILES\geometry3.dll")  # -> out, dmeshout, prevVertexCount, finalVertexCount; inputs targetVertices: Int32
# ---------- dmesh3_reduce_vertices: C# ----------
    if (dmesh3 == null) return;
    
    // Algorithm
    DMesh3 cast = (DMesh3) dmesh3;

    // Clone the DMesh3
    DMesh3 dm = new DMesh3(cast, true, true, true, true);

    prevVertexCount = dm.VertexCount;

    // Reduce the mesh
    Reducer r = new Reducer(dm);
    r.ReduceToVertexCount(targetVertices);

    // For some reason, the reduced mesh had invalid vertices.
    // This gets solved by re-creating a new mesh as a copy from the invalid one...
    // Need to do more research as to why this is not working...
    DMesh3 copy = new DMesh3(dm, true, true, true, true);


    // Outputs
    dmeshout = copy;
    finalVertexCount = copy.VertexCount;
# ---------- end dmesh3_reduce_vertices ----------
mesh_remesh = CSharpScript(
    dMeshIn=meshtodmesh3.dmesh3,
    targetEdgeLength=Slider(0.15, range=0..1),
    passes=Slider(10, range=0..20),
    Reference="D:\DROPBOX\JL\CODE\PARAMETRICCAMP\TUTORIALFILES\ADVANCED_DEVELOPMENT_GRASSHOPPER\PCAMP-GH-PLUGIN\SAMPLE-FILES\geometry3.dll")  # -> out, dMeshOut; inputs targetEdgeLength: Double, passes: Int32
# ---------- mesh_remesh: C# ----------
if (dMeshIn == null) return;
    
    // Cast
    DMesh3 cast = (DMesh3) dMeshIn;

    // Copy (avoid changes to the original obj reference)
    DMesh3 dm = new DMesh3(cast, true, true, true, true);

    // Remesh it
    Remesher r = new Remesher(dm);
    r.PreventNormalFlips = true;
    r.SetTargetEdgeLength(targetEdgeLength);
    for (int i = 0; i < passes; i++)
    {
      r.BasicRemeshPass();
    }

    // For some reason, the reduced mesh had invalid vertices.
    // This gets solved by re-creating a new mesh as a copy from the invalid one...
    // Need to do more research as to why this is not working...
    DMesh3 copy = new DMesh3(dm, true, true, true, true);

    // Outputs
    dMeshOut = copy;
# ---------- end mesh_remesh ----------
mesh_reduce_edges = CSharpScript(
    dMeshIn=meshtodmesh3.dmesh3,
    minEdgeLength=Slider(0, range=0..1),
    Reference="D:\DROPBOX\JL\CODE\PARAMETRICCAMP\TUTORIALFILES\ADVANCED_DEVELOPMENT_GRASSHOPPER\PCAMP-GH-PLUGIN\SAMPLE-FILES\geometry3.dll")  # -> out, dMeshOut; inputs minEdgeLength: Double
# ---------- mesh_reduce_edges: C# ----------
  if (dMeshIn == null) return;
    
    // Cast
    DMesh3 cast = (DMesh3) dMeshIn;

    // Copy (avoid changes to the original obj reference)
    DMesh3 dm = new DMesh3(cast, true, true, true, true);

    // Reduce it
    Reducer r = new Reducer(dm);
    r.ReduceToEdgeLength(minEdgeLength);

    // For some reason, the reduced mesh had invalid vertices.
    // This gets solved by re-creating a new mesh as a copy from the invalid one...
    // Need to do more research as to why this is not working...
    DMesh3 copy = new DMesh3(dm, true, true, true, true);

    // Outputs
    dMeshOut = copy;
# ---------- end mesh_reduce_edges ----------
dmesh3_analysis = CSharpScript(
    dmesh3=meshtodmesh3.dmesh3,
    Reference="D:\DROPBOX\JL\CODE\PARAMETRICCAMP\TUTORIALFILES\ADVANCED_DEVELOPMENT_GRASSHOPPER\PCAMP-GH-PLUGIN\SAMPLE-FILES\geometry3.dll")  # -> out, isValid, vertexCount, triangleCount, edgeCount, minEdgeLength, avgEdgeLength, maxEdgeLength
# ---------- dmesh3_analysis: C# ----------
    if (dmesh3 == null) return;
    
    // Algorithm
    DMesh3 dm = (DMesh3) dmesh3;

    double minLen, avgLen, maxLen;
    MeshQueries.EdgeLengthStats(dm, out minLen, out maxLen, out avgLen);

    // Ouputs
    isValid = dm.CheckValidity(false, FailMode.ReturnOnly);
    vertexCount = dm.VertexCount;
    triangleCount = dm.TriangleCount;
    edgeCount = dm.EdgeCount;
    minEdgeLength = minLen;
    avgEdgeLength = avgLen;
    maxEdgeLength = maxLen;
# ---------- end dmesh3_analysis ----------
dmesh3_analysis_2 = CSharpScript(
    dmesh3=mesh_remesh.dMeshOut,
    Reference="D:\DROPBOX\JL\CODE\PARAMETRICCAMP\TUTORIALFILES\ADVANCED_DEVELOPMENT_GRASSHOPPER\PCAMP-GH-PLUGIN\SAMPLE-FILES\geometry3.dll")  # -> out, isValid, vertexCount, triangleCount, edgeCount, minEdgeLength, avgEdgeLength, maxEdgeLength; same code as dmesh3_analysis
panel_50 = Panel([dmesh3_analysis.isValid, dmesh3_analysis.vertexCount, dmesh3_analysis.triangleCount, dmesh3_analysis.edgeCount, dmesh3_analysis.minEdgeLength, dmesh3_analysis.avgEdgeLength, dmesh3_analysis.maxEdgeLength])
panel_51 = Panel([dmesh3_reduce_vertices.dmeshout, dmesh3_reduce_vertices.prevVertexCount, dmesh3_reduce_vertices.finalVertexCount])
panel_52 = Panel([dmesh3_analysis_2.isValid, dmesh3_analysis_2.vertexCount, dmesh3_analysis_2.triangleCount, dmesh3_analysis_2.edgeCount, dmesh3_analysis_2.minEdgeLength, dmesh3_analysis_2.avgEdgeLength, dmesh3_analysis_2.maxEdgeLength])
panel_53 = Panel([mesh_reduce_triangles.dMeshOut, mesh_reduce_triangles.prevTriangleCount, mesh_reduce_triangles.finalTriangleCount])
panel_54 = Panel(mesh_reduce_edges.dMeshOut)
panel_55 = Panel(mesh_remesh.dMeshOut)
dmesh3tomesh = CSharpScript(
    dmesh3=mesh_remesh.dMeshOut,
    Reference="D:\DROPBOX\JL\CODE\PARAMETRICCAMP\TUTORIALFILES\ADVANCED_DEVELOPMENT_GRASSHOPPER\PCAMP-GH-PLUGIN\SAMPLE-FILES\geometry3.dll")  # -> out, mesh
# ---------- dmesh3tomesh: C# ----------
if (dmesh3 == null) return;
    
    // Algorithm
    DMesh3 dm = (DMesh3) dmesh3;

    // Empty rhino mesh
    Mesh m = new Mesh();

    // Copy all the vertices
    for (int i = 0; i < dm.VertexCount; i++)
    {
      if (dm.IsVertex(i))
      {
        g3.Vector3d v = dm.GetVertex(i);
        m.Vertices.Add(v.x, v.y, v.z);
      }
    }

    // Copy all the faces
    for (int i = 0; i < dm.TriangleCount; i++)
    {
      if (dm.IsTriangle(i))
      {
        Index3i t = dm.GetTriangle(i);
        m.Faces.AddFace(t.a, t.b, t.c);
      }
    }

    m.RebuildNormals();

    // Ouputs
    mesh = m;
# ---------- end dmesh3tomesh ----------
dmesh3tomesh_2 = CSharpScript(
    dmesh3=dmesh3_reduce_vertices.dmeshout,
    Reference="D:\DROPBOX\JL\CODE\PARAMETRICCAMP\TUTORIALFILES\ADVANCED_DEVELOPMENT_GRASSHOPPER\PCAMP-GH-PLUGIN\SAMPLE-FILES\geometry3.dll")  # -> out, mesh
# ---------- dmesh3tomesh_2: C# ----------
    if (dmesh3 == null) return;

    // Algorithm
    DMesh3 dm = (DMesh3) dmesh3;

    // Empty rhino mesh
    Mesh m = new Mesh();

    // Copy all the vertices
    for (int i = 0; i < dm.VertexCount; i++)
    {
      if (dm.IsVertex(i))
      {
        g3.Vector3d v = dm.GetVertex(i);
        m.Vertices.Add(v.x, v.y, v.z);
      }
    }

    // Copy all the faces
    for (int i = 0; i < dm.TriangleCount; i++)
    {
      if (dm.IsTriangle(i))
      {
        Index3i t = dm.GetTriangle(i);
        m.Faces.AddFace(t.a, t.b, t.c);
      }
    }

    m.RebuildNormals();

    // Ouputs
    mesh = m;
# ---------- end dmesh3tomesh_2 ----------
panel_56 = Panel(dmesh3tomesh.mesh)
panel_57 = Panel(dmesh3tomesh_2.mesh)

# ----
# DYNAMIC SIMULATION COMPONENTS
button = Button()
pt_12 = Point(<point referenced from the Rhino model>)
pt_13 = Point(<point referenced from the Rhino model>)
vec2pt = Vector2Pt(PointA=pt_12, PointB=pt_13, Unitize=False)  # -> Vector, Length
trigger = Trigger(Interval=20, TimerInterval=20, Target=c_script)  # disabled
vdis = VectorDisplay(Anchor=pt_12, Vector=vec2pt.Vector)
c_script = CSharpScript(
    reset=button,
    startPoint=pt_12,
    startVelocity=vec2pt.Vector,
    width=Slider(100, range=0..100),
    height=Slider(61.75, range=0..100))  # -> out, R, P, T, V; inputs reset: Boolean, startPoint: Point3d, startVelocity: Vector3d, width: Double, height: Double
# ---------- c_script: C# ----------
    // Algorithms
    if (reset)
    {
      location = startPoint;
      currentVelocity = startVelocity;
      trace = new Polyline();
      return;
    }

    Rectangle3d boundary = new Rectangle3d(Plane.WorldXY, width, height);

    // Update location of moving point with velocity
    location += currentVelocity;

    // Bounce off boundaries
    if (location.X > boundary.Width || location.X < 0)
    {
      currentVelocity.X = -currentVelocity.X;
    }

    if (location.Y > boundary.Height || location.Y < 0)
    {
      currentVelocity.Y = -currentVelocity.Y;
    }

    // Add current location to the "footprint" polyline
    trace.Add(location);


    // Output
    R = boundary;
    P = location;
//    T = trace;
    V = currentVelocity;
    if (trace.Length > 0) T = trace;
# ---------- c_script: C# additional code ----------
  Point3d location = Point3d.Unset;
  Vector3d currentVelocity = Vector3d.Unset;
  Polyline trace = new Polyline();
# ---------- end c_script ----------
geo = Geometry(c_script.T)
panel_58 = Panel(c_script.out)
panel_59 = Panel(c_script.R)
vdis_2 = VectorDisplay(Anchor=c_script.P, Vector=c_script.V)
pt_14 = Point(<point referenced from the Rhino model>)
pt_15 = Point(<point referenced from the Rhino model>)
Z = UnitZ(Factor="-1")
trigger_2 = Trigger(Interval=20, TimerInterval=20, Target=c_script_2)  # disabled
c_script_2 = CSharpScript(
    reset=Button(),
    anchorPoint=pt_14,
    startPoint=pt_15,
    radius=Slider(1, range=0..1),
    gravity=Z,
    stiffness=Slider(0.1, range=0..1),
    friction=Slider(0.98, range=0..1))  # -> out, L, S, P, V, T; inputs reset: Boolean, anchorPoint: Point3d, startPoint: Point3d, radius: Double, gravity: Vector3d, stiffness: Double, friction: Double
# ---------- c_script_2: C# ----------
    // Algorithms
    if (reset)
    {
      currentLocation = startPoint;
      currentVelocity = Vector3d.Zero;
      trace = new Polyline();
    }

    // Calculate all forces acting on the particle
    Vector3d gravityForce = gravity;
    Vector3d springForce = -stiffness * (currentLocation - anchorPoint);

    Vector3d totalForces = gravityForce + springForce;

    // Update the currentVelocity with all the acting forces
    currentVelocity += totalForces;

    // Damp down velocity a little assuming friction on the system
    currentVelocity *= friction;

    // Update the location based on the velocity
    currentLocation += currentVelocity;

    trace.Add(currentLocation);

    // Output
    if (anchorPoint != Point3d.Unset && currentLocation != Point3d.Unset) L = new Line(anchorPoint, currentLocation);
    var s = new Sphere(currentLocation, radius).ToBrep();
    if (s != null) S = s;
    P = currentLocation;
    V = currentVelocity;
    if (trace.Length > 0) T = trace;
# ---------- c_script_2: C# additional code ----------
  Point3d currentLocation = Point3d.Unset;
  Vector3d currentVelocity = Vector3d.Unset;
  Polyline trace = new Polyline();
# ---------- end c_script_2 ----------
panel_60 = Panel(c_script_2.out)
geo_2 = Geometry(c_script_2.L)
geo_3 = Geometry(c_script_2.S)
geo_4 = Geometry(c_script_2.P)
vdis_3 = VectorDisplay(Anchor=c_script_2.P, Vector=c_script_2.V)
geo_5 = Geometry(c_script_2.T)
pt_16 = Point(<point referenced from the Rhino model>)
pt_17 = Point(<point referenced from the Rhino model>)
Z_2 = UnitZ(Factor="-1")
trigger_3 = Trigger(Interval=20, TimerInterval=20, Target=c_script_3)  # disabled
c_script_3 = CSharpScript(
    reset=Button(),
    anchor0=pt_16,
    anchor1=pt_17,
    nodeCount=Slider(10, range=0..10),
    mass=Slider(0.01, range=0..1),
    gravity=Z_2,
    stiffness=Slider(0.01, range=0..1),
    friction=Slider(0.98, range=0..1))  # -> out, P, V, C; inputs reset: Boolean, anchor0: Point3d, anchor1: Point3d, nodeCount: Int32, mass: Double, gravity: Vector3d, stiffness: Double, friction: Double
# ---------- c_script_3: C# ----------
    // Algorithm
    if (reset)
    {
      nodes.Clear();
      vels.Clear();

      Line line = new Line(anchor0, anchor1);
      NurbsCurve lineCurve = line.ToNurbsCurve();

      Point3d[] pts;
      lineCurve.DivideByCount(nodeCount - 1, true, out pts);
      nodes.AddRange(pts);

      for (int i = 0; i < nodeCount; i++)
      {
        vels.Add(new Vector3d(0, 0, 0));
      }
    }
    
    // Check
    if (nodes.Count == 0) return;

    // Update the location of the anchors
    nodes[0] = anchor0;
    nodes[nodes.Count - 1] = anchor1;

    // Simulate forces for each node
    for (int i = 1; i < nodes.Count - 1; i++)
    {
      Point3d n = nodes[i];
      Vector3d v = vels[i];

      // Calculating all the forces
      Vector3d gravityForce = mass * gravity;
      Vector3d prevSpring = -stiffness * (n - nodes[i - 1]);
      Vector3d nextSpring = -stiffness * (n - nodes[i + 1]);

      // Aggregate all the forces
      Vector3d totalForce = gravityForce + prevSpring + nextSpring;

      // Update velocity
      v += totalForce;

      // Add friction
      v *= friction;

      // Update location of the node
      n += v;

      // Update values on the original lists
      nodes[i] = n;
      vels[i] = v;
    }


    // Output
    P = nodes;
    V = vels;
    if (nodes.Count > 0) C = new Polyline(nodes);
# ---------- c_script_3: C# additional code ----------
  List<Point3d> nodes = new List<Point3d>();
  List<Vector3d> vels = new List<Vector3d>();
# ---------- end c_script_3 ----------
vdis_4 = VectorDisplay(Anchor=c_script_3.P, Vector=c_script_3.V)
geo_6 = Geometry(c_script_3.C)
geo_7 = Geometry(c_script_3.P)

# ----
# PREVIEW COMPONENTS
panel_61 = Panel("HEAVY DUTY")
get_heavy_objects = CSharpScript(threshold=Slider(100, range=0..100))  # -> out, names, millis, guids; inputs threshold: Int32
# ---------- get_heavy_objects: C# ----------
    // Algorithm
    List<string> cNames = new List<string>();
    List<int> cMillis = new List<int>();
    List<Guid> cIds = new List<Guid>();

    List<IGH_ActiveObject> components = GrasshopperDocument.ActiveObjects();

    foreach (IGH_ActiveObject c in components)
    {
      if (c.ProcessorTime.Milliseconds >= threshold)
      {
        cNames.Add(c.NickName);
        cMillis.Add(c.ProcessorTime.Milliseconds);
        cIds.Add(c.InstanceGuid);
      }
    }


    // Outputs
    names = cNames;
    millis = cMillis;
    guids = cIds;
# ---------- end get_heavy_objects ----------
heavy_calc = CSharpScript()  # -> out, A
# ---------- heavy_calc: C# usings ----------
using System.IO;
# ---------- heavy_calc: C# ----------
    long counter = 0;
    for (int i = 0; i < 100000000; i++)
    {
      counter += i;
    }

    A = counter;
# ---------- end heavy_calc ----------
add_message = CSharpScript(guid=get_heavy_objects.guids, msg=panel_61)  # -> out; inputs guid: Guid, msg: String
# ---------- add_message: C# ----------
    IGH_Component c = GrasshopperDocument.FindComponent(guid);
    
    c.Message = msg;
# ---------- end add_message ----------
panel_62 = Panel(heavy_calc.A)
panel_63 = Panel(get_heavy_objects.names)
panel_64 = Panel(get_heavy_objects.out)
panel_65 = Panel(add_message)
panel_66 = Panel(get_heavy_objects.millis)
panel_67 = Panel(get_heavy_objects.guids)

# ----
# DOCUMENT COMPONENTS
rhino_doc = CSharpScript()  # -> out, fileName, filePath, path, objects
# ---------- rhino_doc: C# ----------
    fileName = RhinoDocument.Name;

    string p = RhinoDocument.Path;
    filePath = p;
    path = Path.GetDirectoryName(p);
    
    objects = RhinoDocument.Objects.Count;
# ---------- end rhino_doc ----------
panel_68 = Panel([rhino_doc.fileName, rhino_doc.filePath, rhino_doc.path, rhino_doc.objects])

gh_doc = CSharpScript()  # -> out, fileName, filePath, path, objects, thumbnail
# ---------- gh_doc: C# ----------
    if (this.GrasshopperDocument.IsFilePathDefined)
    {
      string p = this.GrasshopperDocument.FilePath;
      fileName = Path.GetFileName(p);
      filePath = p;
      path = Path.GetDirectoryName(p);
    }

    objects = this.GrasshopperDocument.ActiveObjects().Count;
    
    thumbnail = this.GrasshopperDocument.Thumbnail;
# ---------- end gh_doc ----------
panel_69 = Panel([gh_doc.fileName, gh_doc.filePath, gh_doc.path, gh_doc.objects, gh_doc.thumbnail])
convert = ConvertFromSystemDrawingBitmap(SystemDrawingBitmap=gh_doc.thumbnail)
painter = BitmapPainter(BitmapToPaint=convert)

preview_color = CSharpScript(A=Slider(68, range=0..255), R=Slider(0, range=0..255), G=Slider(0, range=0..255), B=Slider(138, range=0..255))  # -> out; inputs A: Int32, R: Int32, G: Int32, B: Int32
# ---------- preview_color: C# usings ----------
using System.Drawing;
# ---------- preview_color: C# ----------
    Color clr = Color.FromArgb(A, R, G, B);

    GrasshopperDocument.PreviewColour = clr;
# ---------- end preview_color ----------
preview_color_selected = CSharpScript(A=Slider(68, range=0..255), R=Slider(108, range=0..255), G=Slider(197, range=0..255), B=Slider(145, range=0..255))  # -> out; inputs A: Int32, R: Int32, G: Int32, B: Int32
# ---------- preview_color_selected: C# ----------
    Color clr = Color.FromArgb(A, R, G, B);
    
    GrasshopperDocument.PreviewColourSelected = clr;
# ---------- end preview_color_selected ----------
panel_70 = Panel(preview_color)
panel_71 = Panel(preview_color_selected)
box = CenterBox(Base=PlaneXY(0, 0, 0), X=1, Y=1, Z=1)

# ---- group: Custom vector rendering
rgb = ColourRGB(Alpha=255, Red=Slider(197, range=0..255), Green=Slider(49, range=0..255), Blue=Slider(74, range=0..255))
vec_11 = VectorXYZ(
    XComponent=Slider(10.94, range=-100..100),
    YComponent=Slider(1.06, range=-100..100),
    ZComponent=Slider(9.53, range=-100..100))  # -> Vector, Length
pt_18 = Point(Point(9.048767542, 10.42851366, 0))
vector_preview = CSharpScript(A=pt_18, V=vec_11.Vector, C=rgb, L=Toggle(True), S=Slider(0.744, range=0..100))  # -> out; inputs A: Point3d, V: Vector3d, C: Color, L: Boolean, S: Double
# ---------- vector_preview: C# usings ----------
using Rhino.Display;
using System.Drawing;
# ---------- vector_preview: C# ----------
    anchor = A;
    vector = V;
    arrow = new Line(anchor, vector);
    color = C;
    displayLength = L;
    size = S;
# ---------- vector_preview: C# additional code ----------
  Point3d anchor;
  Vector3d vector;
  Line arrow;
  Color color;
  bool displayLength;
  double size;

  //Return a BoundingBox that contains all the geometry you are about to draw.
  public override BoundingBox ClippingBox
  {
    get
    {
      return arrow.BoundingBox;
    }
  }

  //Draw all meshes in this method.
  public override void DrawViewportMeshes(IGH_PreviewArgs args)
  {
  }

  //Draw all wires and points in this method.
  public override void DrawViewportWires(IGH_PreviewArgs args)
  {
    args.Display.DrawArrow(arrow, color);

    //    Plane pl = Plane.WorldXY;
    //    pl.Origin = anchor + vector;

    double len = arrow.Length;
    string lenRound = String.Format("{0:0.000}", len);

    if (displayLength) {
      Plane pl;
      args.Viewport.GetCameraFrame(out pl);
      pl.Origin = anchor + 1.1 * vector;

      args.Display.Draw3dText(
        lenRound,
        color,
        pl,
        size,
        "Courier New");
    }

  }
# ---------- end vector_preview ----------

# ----
rgb_2 = ColourRGB(Alpha=255, Red=Slider(203, range=0..255), Green=Slider(170, range=0..255), Blue=Slider(122, range=0..255))
crv_6 = Curve(<curve referenced from the Rhino model>)
curve_curvature_graph = CSharpScript(C=crv_6, Clr=rgb_2, S=Slider(106, range=0..200), HD=Slider(11, range=0..100), SD=Slider(53, range=0..100))  # -> out; inputs C: Curve, Clr: Color, S: Int32, HD: Int32, SD: Int32
# ---------- curve_curvature_graph: C# ----------
    curve = C;
    color = Clr;
    hairScale = S;
    hairDensity = HD;
    sampleDensity = SD;
# ---------- curve_curvature_graph: C# additional code ----------
  Curve curve;
  System.Drawing.Color color;
  int hairScale;
  int hairDensity;
  int sampleDensity;


  //Return a BoundingBox that contains all the geometry you are about to draw.
  public override BoundingBox ClippingBox
  {
    get
    {
      if (curve == null) return BoundingBox.Empty;

      return curve.GetBoundingBox(false);
    }
  }

  //Draw all meshes in this method.
  public override void DrawViewportMeshes(IGH_PreviewArgs args)
  {
  }

  //Draw all wires and points in this method.
  public override void DrawViewportWires(IGH_PreviewArgs args)
  {
    if (curve == null) return;

    args.Display.DrawCurvatureGraph(
      curve,
      color,
      hairScale,
      hairDensity,
      sampleDensity);
  }
# ---------- end curve_curvature_graph ----------

srf_3 = Surface(<surface referenced from the Rhino model>)
surface_curvature_graph = CSharpScript(S=srf_3, GS=Slider(0.68, range=0..10))  # -> out, M, C, N; inputs S: Surface, GS: Double
# ---------- surface_curvature_graph: C# usings ----------
using Rhino.Display;
# ---------- surface_curvature_graph: C# ----------
    if (S == null) return;

    // Generate grid mesh from surface
    // For each vertex, compute curvature value
    // For each curvature value, compute corresponding color
    // Apply that color as vertex color

    MeshingParameters mp = MeshingParameters.Minimal;
    mp.GridAspectRatio = 1;
    mp.MaximumEdgeLength = GS;
    mp.MinimumEdgeLength = GS;

    Mesh mesh = Mesh.CreateFromSurface(S, mp);

    // For each vertex, compute curvature value
    double[] curvatures = new double[mesh.Vertices.Count];
    double min = Double.MaxValue;
    double max = Double.MinValue;
    for (int i = 0; i < mesh.Vertices.Count; i++)
    {
      Point3f vertex = mesh.Vertices[i];

      double u, v;
      S.ClosestPoint(vertex, out u, out v);

      SurfaceCurvature sc = S.CurvatureAt(u, v);
      curvatures[i] = sc.Gaussian;

      if (sc.Gaussian > max) max = sc.Gaussian;
      if (sc.Gaussian < min) min = sc.Gaussian;
    }

    Print(min.ToString());
    Print(max.ToString());

    double[] norm = new double[mesh.Vertices.Count];
    double range = Math.Max(Math.Abs(min), Math.Abs(max));
    for (int i = 0; i < norm.Length; i++)
    {
      double c = curvatures[i];
      double n = c / range;
      norm[i] = n;
    }

    for (int i = 0; i < mesh.Vertices.Count; i++)
    {
      double n = norm[i];

      if (n >= 0) {
        int clr = (int) (255 * n);
        mesh.VertexColors.Add(clr, 0, 0);
      }
      else
      {
        int clr = (int) (-255 * n);
        mesh.VertexColors.Add(0, clr, 0);
      }

    }

    Print(range.ToString());


    // Outputs
    M = mesh;
    C = curvatures;
    N = norm;


    renderMesh = mesh;
# ---------- surface_curvature_graph: C# additional code ----------
  Mesh renderMesh;


  //Return a BoundingBox that contains all the geometry you are about to draw.
  public override BoundingBox ClippingBox
  {
    get
    {
      if (renderMesh == null) return BoundingBox.Empty;

      return renderMesh.GetBoundingBox(false);
    }
  }

  //Draw all meshes in this method.
  public override void DrawViewportMeshes(IGH_PreviewArgs args)
  {
    if (renderMesh == null) return;

    args.Display.DrawMeshFalseColors(renderMesh);
  }
# ---------- end surface_curvature_graph ----------
bnd = Bounds(Numbers=surface_curvature_graph.N)
panel_72 = Panel(surface_curvature_graph.out)
panel_73 = Panel(surface_curvature_graph.C)
panel_74 = Panel(surface_curvature_graph.M)
panel_75 = Panel(bnd)
panel_76 = Panel(surface_curvature_graph.N)

mesh_2 = Mesh(surface_curvature_graph.M)
mesh_face_planarity = CSharpScript(M=mesh_2)  # -> out, P, N; inputs M: Mesh
# ---------- mesh_face_planarity: C# ----------
    if (M == null) return;

    // Compute planarity for each face.
    // Normalize them.
    // Render each face as a single mesh with VertexColors.

    double[] offsets = new double[M.Faces.Count];
    double max = Double.MinValue;
    for (int i = 0; i < M.Faces.Count; i++)
    {
      double off = Planarity(M, i);
      offsets[i] = off;
      if (off > max) max = off;
    }

    double[] norms = new double[M.Faces.Count];
    for (int i = 0; i < norms.Length; i++)
    {
      norms[i] = offsets[i] / max;
    }

    // Outputs
    P = offsets;
    N = norms;

    renderMesh = M;
    normOffsets = norms;
# ---------- mesh_face_planarity: C# additional code ----------
  Mesh renderMesh;
  double[] normOffsets;


  public double Planarity(Mesh m, int faceId)
  {
    MeshFace face = m.Faces[faceId];

    if (face.IsTriangle) return 0;

    Vector3d AB = m.Vertices[face.B] - m.Vertices[face.A];
    var AC = m.Vertices[face.C] - m.Vertices[face.A];
    var AD = m.Vertices[face.D] - m.Vertices[face.A];

    Vector3d cross = Vector3d.CrossProduct(AB, AD);
    cross.Unitize();

    double proj = AC * cross;  // dot product

    return Math.Abs(proj);
  }



  //Return a BoundingBox that contains all the geometry you are about to draw.
  public override BoundingBox ClippingBox
  {
    get
    {
      if (renderMesh == null) return BoundingBox.Empty;
      
      return renderMesh.GetBoundingBox(false);
    }
  }

  //Draw all meshes in this method.
  public override void DrawViewportMeshes(IGH_PreviewArgs args)
  {
    if (renderMesh == null) return;
    
    for (int i = 0; i < renderMesh.Faces.Count; i++)
    {
      var n = normOffsets[i];
      int clr = (int) (255 * n);
      Mesh m = MeshFromFace(renderMesh, i, clr);

      args.Display.DrawMeshFalseColors(m);
    }
  }

  public Mesh MeshFromFace(Mesh mesh, int faceId, int color)
  {
    MeshFace face = mesh.Faces[faceId];

    Mesh m = new Mesh();
    m.Vertices.Add(mesh.Vertices[face.A]);
    m.Vertices.Add(mesh.Vertices[face.B]);
    m.Vertices.Add(mesh.Vertices[face.C]);
    if (face.IsTriangle)
    {
      m.Faces.AddFace(0, 1, 2);
    }
    else
    {
      m.Vertices.Add(mesh.Vertices[face.D]);
      m.Faces.AddFace(0, 1, 2, 3);
    }

    for (int i = 0; i < m.Vertices.Count; i++)
    {
      m.VertexColors.Add(color, 0, 0);
    }

    return m;
  }
# ---------- end mesh_face_planarity ----------
panel_77 = Panel(mesh_face_planarity.out)
panel_78 = Panel(mesh_face_planarity.P)
bnd_2 = Bounds(Numbers=mesh_face_planarity.P)
bnd_3 = Bounds(Numbers=mesh_face_planarity.N)
panel_79 = Panel(bnd_2)
panel_80 = Panel(bnd_3)
panel_81 = Panel(mesh_face_planarity.N)

# ---- group: String Manipulations
string_length = CSharpScript(S="Hello World!")  # -> out, Chars; inputs S: String
# ---------- string_length: C# ----------
    // Algorithm
    List<char> characters = new List<char>();
    
    for (int i = 0; i < S.Length; i++)
    {
      characters.Add(S[i]);
    }
    
    // Outputs
    Chars = characters;
# ---------- end string_length ----------
string_concat = CSharpScript(A="Hello ", B="World!")  # -> out, R; inputs A: String, B: String
# ---------- string_concat: C# ----------
    // Algorithm
    string result = A + B;

    // Output
    R = result;
# ---------- end string_concat ----------
string_length_2 = CSharpScript(S="Hello World!")  # -> out, L; inputs S: String
# ---------- string_length_2: C# ----------
    // Algorithm
    int res = S.Length;
    
    // Outputs
    L = res;
# ---------- end string_length_2 ----------
panel_82 = Panel(string_concat.R)
panel_83 = Panel(string_length_2.L)
panel_84 = Panel(string_length.Chars)

# ----
panel_85 = Panel(vector_preview)

vdis_5 = VectorDisplay(Anchor="{0,0,0}", Vector=vec_10)
vdis_6 = VectorDisplay(Anchor="{0,0,0}", Vector=vec_9)
vdis_7 = VectorDisplay(Anchor="{0,0,0}", Vector=vector_tween.V)

# ---- group: Numerical Sequences
dom = ConstructDomain(DomainStart=Slider(0, range=-10..10), DomainEnd=Slider(10, range=-10..10))
series = CSharpScript(S=Slider(0, range=-10..10), N=Slider(1.5, range=-10..10), C=Slider(7, range=0..10))  # -> out, Sout; inputs S: Double, N: Double, C: Int32
# ---------- series: C# ----------
    // Algorithm
    List<double> vals = new List<double>();

    for (int i = 0; i < C; i++)
    {
      double v = S + i * N;
      vals.Add(v);
    }

    // Outputs
    Sout = vals;
# ---------- end series ----------
range = CSharpScript(D=dom, N=Slider(9, range=0..10))  # -> out, R; inputs N: Int32
# ---------- range: C# ----------
    // Algorithm
    double step = (D.T1 - D.T0) / N;

    List<double> vals = new List<double>();

    for (int i = 0; i < N + 1; i++)
    {
      double v = D.T0 + i * step;
      vals.Add(v);
    }

    // Outputs
    R = vals;
# ---------- end range ----------
panel_86 = Panel(series.Sout)
panel_87 = Panel(range.R)

# ----
pt_19 = Point(Point(6.263459481, 9.127812048, 0))
point_grid = CSharpScript(
    S=pt_19,
    NX=Slider(5, range=0..10),
    DX=Slider(1.44, range=0..10),
    NY=Slider(3, range=0..10),
    DY=Slider(2.05, range=0..10))  # -> out, P; inputs S: Point3d, NX: Int32, DX: Double, NY: Int32, DY: Double
# ---------- point_grid: C# ----------
    // Algorithm
    DataTree<Point3d> pts = new DataTree<Point3d>();

    for (int j = 0; j < NY; j++)
    {
      double y = S.Y + DY * j;
      GH_Path path = new GH_Path(j);

      for (int i = 0; i < NX; i++)
      {
        double x = S.X + DX * i;
        Point3d p = new Point3d(x, y, S.Z);

        pts.Add(p, path);
      }
    }

    // Outputs
    P = pts;
# ---------- end point_grid ----------
panel_88 = Panel(point_grid.P)

# ----
# DATA COMPONENTS
data = Data(point_grid.P)
tree_info = CSharpScript(T=data)  # -> out, Topology, Description, Paths, BranchCount, ItemCount; inputs T: tree
# ---------- tree_info: C# ----------
    // Algorithm
    List<string> sentences = new List<string>();
    for (int i = 0; i < T.BranchCount; i++)
    {
      List<object> branch = T.Branches[i];
      GH_Path path = T.Paths[i];
      string str = "Branch " + path.ToString() +
        " contains " + branch.Count + " elements";
      sentences.Add(str);
    }
    
    // Outputs
    Topology = T.TopologyDescription;
    Description = sentences;
    Paths = T.Paths;
    BranchCount = T.BranchCount;
    ItemCount = T.DataCount;
# ---------- end tree_info ----------
graft = GraftTree(Tree=data, IncludeEmptyLists=True, IncludeNullItems=True)
panel_89 = Panel(graft)
number_slider_5 = Slider(14, range=-5..25)
panel_90 = Panel(tree_info.Topology)
panel_91 = Panel(tree_info.BranchCount)
panel_92 = Panel(data)
panel_93 = Panel(tree_info.Description)
panel_94 = Panel(tree_info.Paths)
panel_95 = Panel(tree_info.ItemCount)
get_branch = CSharpScript(T=graft, i=number_slider_5)  # -> out, B; inputs T: tree, i: Int32
# ---------- get_branch: C# ----------
    // Sanity
    if (i < 0 || i > T.BranchCount - 1)
    {
      Component.AddRuntimeMessage(GH_RuntimeMessageLevel.Warning, "Index is out of bounds");
      B = null;
      return;
    }
    
    // Algorithm
    DataTree<object> clean = new DataTree<object>();

    List<object> branch = T.Branches[i];
    GH_Path path = T.Paths[i];

    clean.AddRange(branch, path);

    // Outputs
    B = clean;
# ---------- end get_branch ----------
remove_branch = CSharpScript(T=graft, i=number_slider_5)  # -> out, B; inputs T: tree, i: Int32
# ---------- remove_branch: C# ----------
    // Sanity
    if (i < 0 || i > T.BranchCount - 1)
    {
      Component.AddRuntimeMessage(GH_RuntimeMessageLevel.Warning, "Index out of bounds");
    }

    // Algorithm
    DataTree < object > clean = new DataTree<object>();
    for (int j = 0; j < T.BranchCount; j++)
    {
      if (j != i)
      {
        clean.AddRange(T.Branches[j], T.Paths[j]);
      }
    }


    // Outputs
    B = clean;
# ---------- end remove_branch ----------
panel_96 = Panel(remove_branch.B)
number_slider_6 = Slider(8, range=-10..10)
panel_97 = Panel(get_branch.B)
get_item = CSharpScript(L=data, i=number_slider_6, W=Toggle(True))  # -> out, iout; inputs L: list, i: Int32, W: Boolean
# ---------- get_item: C# ----------
    // Sanity
    if (i < 0)
    {
      if (W)
      {
        while (i < 0)
        {
          i += L.Count;
        }
      }
      else
      {
        Component.AddRuntimeMessage(GH_RuntimeMessageLevel.Warning, "Index is too low.");
        iout = null;
        return;
      }
    }
    else if (i >= L.Count)
    {
      if (W)
      {
        i = i % L.Count;
      }
      else
      {
        Component.AddRuntimeMessage(GH_RuntimeMessageLevel.Warning, "Index is too high.");
        iout = null;
        return;
      }
    }

    // Algorithm
    object item = L[i];

    // Outputs
    iout = item;
# ---------- end get_item ----------
get_last = CSharpScript(L=data)  # -> out, iout; inputs L: list
# ---------- get_last: C# ----------
    // Algorithm
    object item = L[L.Count - 1];

    // Outputs
    iout = item;
# ---------- end get_last ----------
get_first = CSharpScript(L=data)  # -> out, iout; inputs L: list
# ---------- get_first: C# ----------
    // Algorithm
    object item = L[0];

    // Outputs
    iout = item;
# ---------- end get_first ----------
panel_98 = Panel(get_item.iout)
panel_99 = Panel(get_last.iout)
panel_100 = Panel(get_first.iout)
get_branch_by_path = CSharpScript(T=graft, p="{  1 ; 2 }   ")  # -> out, B; inputs T: tree, p: String
# ---------- get_branch_by_path: C# ----------
    // Algorithm
    GH_Path path = PathFromString(p);
    
    // Check if path exists
    if (!T.PathExists(path))
    {
      Component.AddRuntimeMessage(GH_RuntimeMessageLevel.Warning, "Path does not exist");
      B = null;
      return;
    }


    DataTree<object> tree = new DataTree<object>();
    List<object> branch = T.Branch(path);
    tree.AddRange(branch, path);

    // Outputs
    B = tree;
# ---------- get_branch_by_path: C# additional code ----------
  GH_Path PathFromString(string stringPath)
  {
    string str = stringPath;
    str = str.Replace("{", "");
    str = str.Replace("}", "");
    str = str.Replace(" ", "");
    string[] digitStrings = str.Split(';');
    int[] digits = new int[digitStrings.Length];
    for (int i = 0; i < digitStrings.Length; i++)
    {
      digits[i] = Int32.Parse(digitStrings[i]);
    }
    GH_Path path = new GH_Path(digits);

    return path;
  }
# ---------- end get_branch_by_path ----------
remove_branch_by_path = CSharpScript(T=graft, p="{  1 ; 2 }   ")  # -> out, B; inputs T: tree, p: String
# ---------- remove_branch_by_path: C# ----------
    // Algorithm
    GH_Path path = PathFromString(p);

    // Check if path exists
    if (!T.PathExists(path))
    {
      Component.AddRuntimeMessage(GH_RuntimeMessageLevel.Warning, "Path does not exist");
    }

    T.RemovePath(path);

    // Outputs
    B = T;
# ---------- remove_branch_by_path: C# additional code ----------
  GH_Path PathFromString(string stringPath)
  {
    string str = stringPath;
    str = str.Replace("{", "");
    str = str.Replace("}", "");
    str = str.Replace(" ", "");
    string[] digitStrings = str.Split(';');
    int[] digits = new int[digitStrings.Length];
    for (int i = 0; i < digitStrings.Length; i++)
    {
      digits[i] = Int32.Parse(digitStrings[i]);
    }
    GH_Path path = new GH_Path(digits);

    return path;
  }
# ---------- end remove_branch_by_path ----------
panel_101 = Panel(get_branch_by_path.B)
panel_102 = Panel(remove_branch_by_path.B)
remove_first = CSharpScript(L=data)  # -> out, Lout; inputs L: list
# ---------- remove_first: C# ----------
    // Algorithm
    L.RemoveAt(0);

    // Outputs
    Lout = L;
# ---------- end remove_first ----------
remove_last = CSharpScript(L=data)  # -> out, Lout; inputs L: list
# ---------- remove_last: C# ----------
    // Algorithm
    L.RemoveAt(L.Count - 1);

    // Outputs
    Lout = L;
# ---------- end remove_last ----------
remove_item = CSharpScript(L=data, i=number_slider_6)  # -> out, Lout; inputs L: list, i: Int32
# ---------- remove_item: C# ----------
    // Sanity
    if (i < 0 || i > L.Count - 1)
    {
      Component.AddRuntimeMessage(GH_RuntimeMessageLevel.Warning, "Index out of bounds!");
      Lout = L;
      return;
    }

    // Algorithm
    L.RemoveAt(i);

    // Outputs
    Lout = L;
# ---------- end remove_item ----------
panel_103 = Panel(remove_first.Lout)
panel_104 = Panel(remove_item.Lout)
panel_105 = Panel(remove_last.Lout)
flatten = CSharpScript(T=data)  # -> out, Flat; inputs T: tree
# ---------- flatten: C# ----------
    // Algorithm
    T.Flatten();
    
    // Outputs
    Flat = T;
# ---------- end flatten ----------
graft_2 = CSharpScript(T=data)  # -> out, Graft; inputs T: tree
# ---------- graft_2: C# ----------
    // Algorithm
    T.Graft(false);

    // Outputs
    Graft = T;
# ---------- end graft_2 ----------
panel_106 = Panel(flatten.Flat)
panel_107 = Panel(graft_2.Graft)

panel_108 = Panel(c_script_3.out)

# ----
# ASYNC COMPONENTS
# Adapted from https://github.com/specklesystems/GrasshopperAsyncComponent/blob/main/LICENSE
number_slider_7 = Slider(31572984.17, range=0..100000000)
asyncforloop = AsyncForLoop(Iterations=number_slider_7)
asyncforloop_speckle = AsyncForLoopSpeckle(Iterations=number_slider_7)
rec = DataRecorder(asyncforloop, DataLimit=-10, RecordData=True)
rec_2 = DataRecorder(asyncforloop_speckle, DataLimit=-10, RecordData=True)
panel_109 = Panel(rec_2)
panel_110 = Panel(rec)

# ----
# VECTOR COMPONENTS
number_slider_8 = Slider(6.61, range=0..10)
construct_point_2 = ConstructPoint(X=number_slider_8, Y=Slider(4.27, range=0..10), Z=Slider(3.41, range=0..10))
deconstructpoint = DeconstructPoint(P=construct_point_2)  # -> X, Y, Z
panel_111 = Panel(construct_point_2)
panel_112 = Panel(deconstructpoint.X)
panel_113 = Panel(deconstructpoint.Y)
panel_114 = Panel(deconstructpoint.Z)
pt_20 = Point(Point(6.61, 4.27, 3.41))
pt_21 = Point(Point(2.83, 3.68, 7.56))
vec_12 = Vector(Vector(2.53, 2.9, 6.77))
vec_13 = Vector(Vector(6.76, 5.18, 3.9))
pt_22 = Point(Point(2.83, 2.7, 7.56))
new_vector = ConstructVector(X=Slider(4.96, range=0..10), Y=Slider(2.49, range=0..10), Z=Slider(6.28, range=0..10))
vector2pts = Vector2Ptst(A=pt_20, B=pt_21)
plane_2 = Plane(O=pt_22, X=vec_12, Y=vec_13)
panel_115 = Panel(plane_2)
panel_116 = Panel(new_vector)
panel_117 = Panel(vector2pts)
pt_23 = Point(Point(6.61, 4.27, 3.41))
pt_24 = Point(Point(2.83, 3.68, 7.56))
line_2 = Line(A=pt_23, B=pt_24)
pointatline = PointAtLine(L=line_2, T=Slider(1, range=0..1))
panel_118 = Panel(line_2)
panel_119 = Panel(pointatline)

# ---- group: Arithmetic
# UTILITY COMPONENTS
number_slider_9 = Slider(10, range=-10..10)
addnums = AddNumbers(NumberA=number_slider_9, NumberB=Slider(10, range=-10..10))
subtraction_2 = Subtraction(NumberA=Slider(10, range=-10..10), NumberB=Slider(10, range=-10..10))
multiplication_2 = Multiplication(NumberA=Slider(10, range=-10..10), NumberB=Slider(10, range=-10..10))
division_2 = Division(NumberA=Slider(10, range=-10..10), NumberB=Slider(10, range=-10..10))
panel_120 = Panel(division_2)
panel_121 = Panel(subtraction_2)
panel_122 = Panel(addnums)
panel_123 = Panel(multiplication_2)
panel_124 = Panel("""1
53
2
3
4
6
78
3
2""")
power_3 = Power(NumberA=Slider(10, range=-10..10), NumberB=Slider(3, range=-10..10))
sqrt = Sqrt(NumberA=Slider(4, range=-10..10))
abs_2 = Abs(NumberA=Slider(-8.49, range=-10..10))
massadd = MassAddition(Numbers=panel_124)  # -> Result, Partial
panel_125 = Panel(abs_2)
panel_126 = Panel(power_3)
panel_127 = Panel(sqrt)
panel_128 = Panel(massadd.Result)
panel_129 = Panel(massadd.Partial)

# ----
vec_14 = Vector(new_vector)
vec_15 = Vector(new_vector)
vec_16 = Vector(new_vector)
setvectorlength = SetVectorLength(V=vec_15, L=Slider(10, range=0..10))
unitizevector = UnitizeVector(V=vec_14)
vectorlength = VectorLength(V=vec_16)
panel_130 = Panel(setvectorlength)
panel_131 = Panel(unitizevector)
panel_132 = Panel(vectorlength)
vec_17 = Vector(new_vector)
vec_18 = Vector(vector2pts)
vec_19 = Vector(new_vector)
vec_20 = Vector(new_vector)
vec_21 = Vector(vector2pts)
crossproduct = CrossProduct(A=vec_17, B=vec_18, U=Toggle(False))  # -> V, L
vectortween = VectorTween(A=vec_20, B=vec_21, T=Slider(0.703, range=-1..2))
vectoraddition = VectorAddition(A=vec_19, B=vec_19)
panel_133 = Panel(vectoraddition)
panel_134 = Panel(vectortween)
panel_135 = Panel(crossproduct.V)
panel_136 = Panel(crossproduct.L)

# ---- group: String Manipulations
string_concat_2 = StringConcatenation(StringA="Hello ", StringB="World!")  # -> Concat, Length
string_length_3 = StringLength(StringA="Hello World!")
string_characters = StringCharacters(StringA="Hello World!")
panel_137 = Panel([string_concat_2.Concat, string_concat_2.Length])
panel_138 = Panel(string_length_3)
panel_139 = Panel(string_characters)

# ----
vdis_8 = VectorDisplay(Anchor="{0,0,0}", Vector=vec_20)
vdis_9 = VectorDisplay(Anchor="{0,0,0}", Vector=vec_21)
vdis_10 = VectorDisplay(Anchor="{0,0,0}", Vector=vectortween)

# ---- group: Numerical Sequences
dom_2 = ConstructDomain(DomainStart=Slider(0, range=-10..10), DomainEnd=Slider(10, range=-10..10))
series_2 = Series(Start=Slider(0, range=-10..10), Step=Slider(1.5, range=-10..10), Count=Slider(7, range=0..10))
range_2 = Range(Domain=dom_2, Steps=Slider(9, range=0..10))
panel_140 = Panel(series_2)
panel_141 = Panel(range_2)

# ----
pt_25 = Point(Point(6.263459481, 9.127812048, 0))
ptgrid = PointGrid(
    Start=pt_25,
    CountX=Slider(5, range=0..10),
    CountY=Slider(1.44, range=0..10),
    StepX=Slider(3, range=0..10),
    StepY=Slider(2.05, range=0..10))
panel_142 = Panel(ptgrid)
