# Grasshopper definition 01_BerlinHolocaustMemorial_p2_200415_WK.gh (Grasshopper 1.0.7)

# ---- group: Grid Parameters
# ALGORITHMIC MODELLING SERIES
# Berlin Holocaust Memorial
# By Peter Eisenman
# 01
# Part 2
# Jose Luis García del Castillo y López
# Cleaned by: Wojciech Karnowka & Ramy Aydarous
number_slider = Slider(9.79, range=0..10)
number_slider_2 = Slider(6.41, range=0..10)
number_slider_3 = Slider(17, range=0..100)
number_slider_4 = Slider(18, range=0..100)

# ---- group: Block Size
width = Slider(2.97, range=0..10)
depth = Slider(2.05, range=0..10)

# ---- group: Random Parameters
propability_limit = Slider(1.53, range=0..5)
culling_seed = Slider(5, range=0..10)
rotation_seed = Slider(0, range=0..10)
maximum_tilt = Slider(2, range=0..10)
tilt_seed = Slider(1, range=0..10)

# ---- group: Boundary Curve
crv = Curve(<curve referenced from the Rhino model>)

# ---- group: Bottom Surface
srf = Surface(<surface referenced from the Rhino model>)

# ---- group: Top Surface
srf_2 = Surface(<surface referenced from the Rhino model>)

# ---- group: Points Grid
recgrid = Rectangular(Plane=PlaneXY(0, 0, 0), SizeX=number_slider, SizeY=number_slider_2, ExtentX=number_slider_3, ExtentY=number_slider_4)  # -> Cells, Points

# ---- group: Remove points ouside boundary curve
pt = Point(recgrid.Points)
incurve = PointInCurve(Point=pt, Curve=crv)  # -> Relationship, Point
cull = CullPattern(List=pt, CullPattern=incurve.Relationship)
flatten = FlattenTree(Tree=cull, Path="{0}")

# ---- group: Contained Points
pt_2 = Point(flatten)

# ---- group: Randomly culling points closest to the edge
# Larger values get higher probablity to be removed
lng = ListLength(List=pt_2)
crv_cp = CurveClosestPoint(Point=pt_2, Curve=crv)  # -> Point, Parameter, Distance
distance_to_the_edge = Panel(crv_cp.Distance)
random = Random(Range=propability_limit, Number=lng, Seed=culling_seed)
division = Division(A="1", B=crv_cp.Distance)
inverted_distance = Panel(division)
larger = LargerThan(FirstNumber=random, SecondNumber=division)  # -> LargerThan, OrEqualTo
random_values = Panel(random)
cull_2 = CullPattern(List=pt_2, CullPattern=larger.LargerThan)

# ---- group: Culled Points
pt_3 = Point(cull_2)

# ---- group: Projecting points on bottom surface
Z = UnitZ(Factor="-1")
project = ProjectPoint(Point=pt_3, Direction=Z, Geometry=srf)  # -> Point, Index

# ---- group: Projected Points
pt_4 = Point(project.Point)

# ---- group: Randomly tilt the blocks
# X axis is rotated randomly around Z Axis
# 
# Planes are tilted randomly around (rotated) X axis
xy = XYPlane(Origin=pt_4)
pln = Plane(xy)
flatten_2 = FlattenTree(Tree=pln, Path="{0}")
deplane = DeconstructPlane(Plane=flatten_2)  # -> Origin, XAxis, YAxis, ZAxis
lng_2 = ListLength(List=flatten_2)
neg = Negative(Value=maximum_tilt)
rotation_domain = Panel("0 To 360")
dom = ConstructDomain(DomainStart=neg, DomainEnd=maximum_tilt)
random_2 = Random(Range=rotation_domain, Number=lng_2, Seed=rotation_seed)
rot3d = Rotate3D(Geometry=deplane.XAxis, Angle=degrees(random_2), Center=Point(0, 0, 0), Axis=deplane.ZAxis)  # -> Geometry, Transform
random_3 = Random(Range=dom, Number=lng_2, Seed=tilt_seed)
rot3d_2 = Rotate3D(Geometry=flatten_2, Angle=degrees(random_3), Center=deplane.Origin, Axis=rot3d.Geometry)  # -> Geometry, Transform

# ---- group: Tilted Planes
pln_2 = Plane(rot3d_2.Geometry)

# ---- group: Block Width
num = Number(width)

# ---- group: Block Depth
num_2 = Number(depth)

# ---- group: Draw the Blocks from size domains
# X & Y domains are constructed using same value in negative (domain start) and positive (domain end). This allows the block to grow in both directions.
# 
# Z domain is constructed by a single value representing the domain end. Start of the domain is 0 by default.
# 
# Block height (Z) is the distance between the lower and upper points
deplane_2 = DeconstructPlane(Plane=pln_2)  # -> Origin, XAxis, YAxis, ZAxis
project_2 = ProjectPoint(Point=deplane_2.Origin, Direction=deplane_2.ZAxis, Geometry=srf_2)  # -> Point, Index
neg_2 = Negative(Value=num)
neg_3 = Negative(Value=num_2)
dist = Distance(PointA=deplane_2.Origin, PointB=project_2.Point)
dom_2 = ConstructDomain(DomainStart=neg_2, DomainEnd=num)
dom_3 = ConstructDomain(DomainStart=neg_3, DomainEnd=num_2)
box = DomainBox(Base=pln_2, X=dom_2, Y=dom_3, Z=dist)

# ---- group: Generated Blocks
box_2 = Box(box)

# ---- group: Preview geometry
material = CreateMaterial(Diffuse="gray", Specular=RGB(255, 255, 255), Emission=RGB(0, 0, 0), Transparency=0, Shine=0)
preview = CustomPreview(Geometry=[srf, box_2], Material=material)
