# Grasshopper definition 01_BerlinHolocaustMemorial_p1_200415_WK.gh (Grasshopper 1.0.7)

# ---- group: Grid Parameters
number_slider = Slider(6.41, range=0..10)
number_slider_2 = Slider(18, range=0..100)
# ALGORITHMIC MODELLING SERIES
# Berlin Holocaust Memorial
# By Peter Eisenman
# 01
# Part 1
# Script: Jose Luis García del Castillo y López
# Cleaned by: Wojciech Karnowka
number_slider_3 = Slider(9.79, range=0..10)
number_slider_4 = Slider(17, range=0..100)

# ---- group: Block Size
width = Slider(2.97, range=0..10)
depth = Slider(2.05, range=0..10)

# ---- group: Top Surface - reference
srf = Surface(<surface referenced from the Rhino model>)

# ---- group: Points Grid
recgrid = Rectangular(Plane=PlaneXY(0, 0, 0), SizeX=number_slider_3, SizeY=number_slider, ExtentX=number_slider_4, ExtentY=number_slider_2)  # -> Cells, Points

# ----
pt = Point(recgrid.Points)

# ---- group: Projecting points on bottom surface
xy = XYPlane(Origin=pt)
deplane = DeconstructPlane(Plane=xy)  # -> Origin, XAxis, YAxis, ZAxis
project = ProjectPoint(Point=deplane.Origin, Direction=deplane.ZAxis, Geometry=srf)  # -> Point, Index
dist = Distance(PointA=deplane.Origin, PointB=project.Point)

# ---- group: Block Width
num = Number(width)

# ---- group: Block Depth
num_2 = Number(depth)

# ---- group: Draw the Blocks from size domains
# X & Y domains are constructed using same value in negative (domain start) and positive (domain end). This allows the block to grow in both directions.
# 
# Z domain is constructed by a single value representing the domain end. Start of the domain is 0 by default.
# 
# Block height (Z) is the distance between the lower and upper points
neg = Negative(Value=num)
neg_2 = Negative(Value=num_2)
dom = ConstructDomain(DomainStart=neg_2, DomainEnd=depth)
dom_2 = ConstructDomain(DomainStart=neg, DomainEnd=width)
box = DomainBox(Base=xy, X=dom_2, Y=dom, Z=dist)

# ---- group: Generated Blocks
box_2 = Box(box)

# ---- group: Preview geometry
material = CreateMaterial(Diffuse="gray", Specular=RGB(255, 255, 255), Emission=RGB(0, 0, 0), Transparency=0, Shine=0)
preview = CustomPreview(Geometry=box_2, Material=material)
