# Grasshopper definition 01_BerlinHolocaustMemorial_p3_200415_WK.gh (Grasshopper 1.0.7)

# ---- group: Grid Parameters
# ALGORITHMIC MODELLING SERIES
# Berlin Holocaust Memorial
# By Peter Eisenman
# 01
# Part 3
# Jose Luis García del Castillo y López
# Cleaned by: Wojciech Karnowka
number_slider = Slider(9.79, range=0..10)
number_slider_2 = Slider(6.41, range=0..10)
number_slider_3 = Slider(17, range=0..100)
number_slider_4 = Slider(18, range=0..100)

# ---- group: Random Parameters
number_slider_5 = Slider(100, range=0..100)
number_slider_6 = Slider(1, range=0..5)
number_slider_7 = Slider(2, range=0..90)

# ---- group: Block Size
number_slider_8 = Slider(8.56, range=0..10)
number_slider_9 = Slider(5.04, range=0..10)

# ---- group: Boundary Curve
crv = Curve(<curve referenced from the Rhino model>)

# ---- group: Bottom Surface
srf = Surface(<surface referenced from the Rhino model>)

# ---- group: Top Surface
srf_2 = Surface(<surface referenced from the Rhino model>)

# ----
c_script = CSharpScript(
    boundaryCurve=crv,
    topSurface=srf_2,
    bottomSurface=srf,
    distanceX=number_slider,
    distanceY=number_slider_2,
    countX=number_slider_3,
    countY=number_slider_4,
    blockW=number_slider_8,
    blockD=number_slider_9,
    randomSeed=number_slider_5,
    maxProbability=number_slider_6,
    maxTilt=number_slider_7)  # -> out, groundPoints, planes, blocks; inputs boundaryCurve: Curve, topSurface: Brep, bottomSurface: Brep, distanceX: Double, distanceY: Double, countX: Int32, countY: Int32, blockW: Double, blockD: Double, randomSeed: Int32, maxProbability: Double, maxTilt: Double
# ---------- c_script: C# usings ----------
using Rhino.Geometry.Intersect;
# ---------- c_script: C# ----------
    Print("Hello Berlin!");

    // Generate base points
    List<Point3d> basePoints = new List<Point3d>();
    for (int j = 0; j < countY; j++) {
      for (int i = 0; i < countX; i++) {
        double x = distanceX * i;
        double y = distanceY * j;
        Point3d p = new Point3d(x, y, 0);
        basePoints.Add(p);
      }
    }

    // Make sure curve is planar - lies in a single plane
    if (!boundaryCurve.IsPlanar()) {
      Component.AddRuntimeMessage(GH_RuntimeMessageLevel.Error, "NO! I need a planar curve!");
      return;
    }
    Plane curvePlane;
    boundaryCurve.TryGetPlane(out curvePlane);

    // Cull points outside curve
    List<Point3d> culledPts = new List<Point3d>();
    foreach (Point3d p in basePoints) {
      PointContainment pc = boundaryCurve.Contains(p, curvePlane, 0.0001);
      if (pc == PointContainment.Inside) {
        culledPts.Add(p);
      }
    }

    // Cull points very close to the curve
    Random rnd = new Random(randomSeed);
    List<Point3d> randomCulledPoints = new List<Point3d>();
    foreach(Point3d p in culledPts) {
      double t = 0;
      boundaryCurve.ClosestPoint(p, out t);
      Point3d ptc = boundaryCurve.PointAt(t);
      double dist = p.DistanceTo(ptc);
      double invD = 1.0 / dist;

      double r = maxProbability * rnd.NextDouble();

      if (invD < r) {
        randomCulledPoints.Add(p);
      }
    }

    // Project points to bottom surface
    Point3d[] ptsBottom = Rhino.Geometry.Intersect.Intersection.ProjectPointsToBreps(
      new List<Brep>() { bottomSurface },
      randomCulledPoints,
      -Vector3d.ZAxis,
      0.001);

    // Project points to top surface
    Point3d[] ptsTop = Rhino.Geometry.Intersect.Intersection.ProjectPointsToBreps(
      new List<Brep>() { topSurface },
      randomCulledPoints,
      Vector3d.ZAxis,
      0.001);

    // Planes on the bottom
    Plane[] basePlanes = new Plane[ptsBottom.Length];
    double TAU = 2 * Math.PI;
    double toDegrees = TAU / 360.0;
    for (int i = 0; i < basePlanes.Length; i++) {
      Plane pl = Plane.WorldXY;
      pl.Origin = ptsBottom[i];

      Vector3d vx = pl.XAxis;
      double randomAngle = TAU * rnd.NextDouble();
      vx.Rotate(randomAngle, Vector3d.ZAxis);

      double randomTiltAngle = maxTilt * toDegrees * rnd.NextDouble();
      pl.Rotate(randomTiltAngle, vx, pl.Origin);

      basePlanes[i] = pl;
    }

    // Create blocks
    Box[] boxes = new Box[basePlanes.Length];
    for (int i = 0; i < basePlanes.Length; i++) {
      double dist = ptsBottom[i].DistanceTo(ptsTop[i]);

      Box b = new Box(
        basePlanes[i],
        new Interval(-0.5 * blockW, 0.5 * blockW),
        new Interval(-0.5 * blockD, 0.5 * blockD),
        new Interval(0, dist));

      boxes[i] = b;
    }


    groundPoints = ptsBottom;
    planes = basePlanes;
    blocks = boxes;
# ---------- end c_script ----------
panel = Panel(c_script.out)

# ---- group: Generated Blocks
box = Box(c_script.blocks)

# ---- group: Preview base surface geometry
material = CreateMaterial(Diffuse="gray", Specular=RGB(255, 255, 255), Emission=RGB(0, 0, 0), Transparency=".5", Shine=0)
preview = CustomPreview(Geometry=srf, Material=material)

# ---- group: Preview blocks geometry
material_2 = CreateMaterial(Diffuse="gray", Specular=RGB(255, 255, 255), Emission=RGB(0, 0, 0), Transparency=0, Shine=0)
preview_2 = CustomPreview(Geometry=box, Material=material_2)
