# Grasshopper definition LUmbracle_p1_200521_WK.gh (Grasshopper 1.0.7)

# ---- group: Base point [0,0,0]
# ALGORITHMIC MODELLING SERIES
# L'Umbracle
# By Santiago Calatrava
# 01
# Part 1
# Jose Luis García del Castillo y López
# Cleaned by: Wojciech Karnowka
pt = ConstructPoint(XCoordinate=0, YCoordinate=0, ZCoordinate=0)

# ---- group: Base Point
pt_2 = Point(pt)

# ----
W = Slider(10, range=0..10)
H = Slider(6.16, range=0..10)
D = Slider(1.79, range=0..10)

h1 = Slider(1.87, range=0..10)
h2 = Slider(0.83, range=0..10)
offset = Slider(0.86, range=0..10)

n_ribs = Slider(60, range=0..100)
n_spans = Slider(10, range=0..100)

d1 = Slider(0.4, range=0..1)
d2 = Slider(0.15, range=0..1)
w = Slider(0.11, range=0..1)

md1 = Slider(0.25, range=0..1)
md2 = Slider(0.1, range=0..1)
mw = Slider(0.06, range=0..1)

pipe_radius = Slider(0.03, range=0..0.1)

# ---- group: Base arc generation / Base point
pt_3 = Point(pt_2)

# ---- group: Base arc generation
W_2 = Data(W)
H_2 = Data(W)

# ---- group: Base arc generation / Middle point
expression = Expression(x=W_2, Expression="0.5*x")
vec = VectorXYZ(XComponent=0, YComponent=expression, ZComponent=H_2)  # -> Vector, Length
move = Move(Geometry=pt_3, Motion=vec.Vector)  # -> Geometry, Transform
ptb = Point(move.Geometry)

# ---- group: Middle arc generation / Base point
pt_4 = Point(pt_2)

# ---- group: Middle arc generation
D_2 = Data(D)
W_3 = Data(W)
expression_2 = Expression(x=D_2, Expression="0.5*x")
expression_3 = Expression(x=D_2, Expression="0.5*x")
Y = UnitY(Factor=W_3)
vec_2 = VectorXYZ(XComponent=expression_2, YComponent=0, ZComponent=h2)  # -> Vector, Length
vec_3 = VectorXYZ(XComponent=expression_3, YComponent=0, ZComponent=h1)  # -> Vector, Length
move_2 = Move(Geometry=pt_4, Motion=vec_3.Vector)  # -> Geometry, Transform
move_3 = Move(Geometry=move_2.Geometry, Motion=Y)  # -> Geometry, Transform
move_4 = Move(Geometry=ptb, Motion=vec_2.Vector)  # -> Geometry, Transform
intcrv = Interpolate(Vertices=[move_2.Geometry, move_4.Geometry, move_3.Geometry], Degree=3, Periodic=False, KnotStyle=1)  # -> Curve, Length, Domain
crv = Curve(intcrv.Curve)

# ---- group: Base arc generation / End point
Y_2 = UnitY(Factor=W_2)
move_5 = Move(Geometry=pt_3, Motion=Y_2)  # -> Geometry, Transform
ptc = Point(move_5.Geometry)

# ---- group: Base arc generation / Start point
pta = Point(pt_3)

# ---- group: Base arc generation / Base arc
merge = Merge(Data1=pta, Data2=ptb, Data3=ptc)
intcrv_2 = Interpolate(Vertices=merge, Degree=3, Periodic=False, KnotStyle=1)  # -> Curve, Length, Domain
crv_2 = Curve(intcrv_2.Curve)

crv_3 = Curve(crv_2)

# ---- group: Find curve parameters at given height
xy = XYPlane(Origin=Point(0, 0, 0))
Z = UnitZ(Factor=offset)
move_6 = Move(Geometry=xy, Motion=Z)  # -> Geometry, Transform
pcx = CurvePlane(Curve=crv_3, Plane=move_6.Geometry)  # -> Points, ParamsC, ParamsP

# ---- group: Base arc offset generation
H_3 = Data(D)
X = UnitX(Factor=H_3)
move_7 = Move(Geometry=crv_3, Motion=X)  # -> Geometry, Transform

# ---- group: Base arc offset generation / Base arc offset
crv_4 = Curve(move_7.Geometry)

# ---- group: Shatter arc and select middle segment
shatter = Shatter(Curve=crv_3, Parameters=pcx.ParamsC)
item = ListItem(List=shatter, Index="1", Wrap=True)

shatter_2 = Shatter(Curve=crv_4, Parameters=pcx.ParamsC)
item_2 = ListItem(List=shatter_2, Index="1", Wrap=True)

# ---- group: Middle Sweep / Base point
pt_5 = Point(move_2.Geometry)

# ---- group: Middle Sweep / Middle point
pt_6 = Point(move_4.Geometry)

# ---- group: Base Sweep / Middle Point
ptb_2 = Point(move.Geometry)

# ---- group: Base Sweep / Base point
pt_7 = Point(pt_2)

# ---- group: Base Sweep
crv_5 = Curve(crv_3)
pframes = PerpFrames(Curve=crv_5, Count="30", Align=True)  # -> Frames, Parameters
pdecon = Deconstruct(Point=ptb_2)  # -> XComponent, YComponent, ZComponent
pdecon_2 = Deconstruct(Point=pt_7)  # -> XComponent, YComponent, ZComponent
deplane = DeconstructPlane(Plane=pframes.Frames)  # -> Origin, XAxis, YAxis, ZAxis
pdecon_3 = Deconstruct(Point=deplane.Origin)  # -> XComponent, YComponent, ZComponent
subtraction = Subtraction(A=pdecon_3.ZComponent, B=pdecon_2.ZComponent)
subtraction_2 = Subtraction(A=d1, B=d2)
w_2 = Data(w)
division = Division(A=subtraction, B=pdecon.ZComponent)
multiplication = Multiplication(A=division, B=subtraction_2)
subtraction_3 = Subtraction(A=d1, B=multiplication)
expression_4 = Expression(x=subtraction_3, Expression="-0.5*x")
expression_5 = Expression(x=subtraction_3, Expression="0.5*x")
expression_6 = Expression(x=w_2, Expression="-0.5*x")
expression_7 = Expression(x=w_2, Expression="0.5*x")
diff_section_depth = Panel(subtraction_2)
dom = ConstructDomain(DomainStart=expression_4, DomainEnd=expression_5)
dom_2 = ConstructDomain(DomainStart=expression_6, DomainEnd=expression_7)
rectangle = Rectangle(Plane=pframes.Frames, XSize=dom, YSize=dom_2, Radius=0)  # -> Rectangle, Length

# ----
w_3 = Data(mw)

# ---- group: Middle Sweep
crv_6 = Curve(crv)
pframes_2 = PerpFrames(Curve=crv_6, Count="30", Align=True)  # -> Frames, Parameters
pdecon_4 = Deconstruct(Point=pt_5)  # -> XComponent, YComponent, ZComponent
pdecon_5 = Deconstruct(Point=pt_6)  # -> XComponent, YComponent, ZComponent
deplane_2 = DeconstructPlane(Plane=pframes_2.Frames)  # -> Origin, XAxis, YAxis, ZAxis
pdecon_6 = Deconstruct(Point=deplane_2.Origin)  # -> XComponent, YComponent, ZComponent
subtraction_4 = Subtraction(A=pdecon_6.ZComponent, B=pdecon_4.ZComponent)
subtraction_5 = Subtraction(A=md1, B=md2)
division_2 = Division(A=subtraction_4, B=pdecon_5.ZComponent)
multiplication_2 = Multiplication(A=division_2, B=subtraction_5)
subtraction_6 = Subtraction(A=md1, B=multiplication_2)
diff_section_depth_2 = Panel(subtraction_5)
expression_8 = Expression(x=subtraction_6, Expression="-0.5*x")
expression_9 = Expression(x=subtraction_6, Expression="0.5*x")
expression_10 = Expression(x=w_3, Expression="-0.5*x")
expression_11 = Expression(x=w_3, Expression="0.5*x")
dom_3 = ConstructDomain(DomainStart=expression_8, DomainEnd=expression_9)
dom_4 = ConstructDomain(DomainStart=expression_10, DomainEnd=expression_11)
rectangle_2 = Rectangle(Plane=pframes_2.Frames, XSize=dom_3, YSize=dom_4, Radius=0)  # -> Rectangle, Length

# ---- group: Support connections
n_ribs_2 = Data(n_ribs)
pipe_radius_2 = Data(pipe_radius)

# ---- group: Support connections / Right support connections generation
divide = DivideCurve(Curve=item_2, Count=n_ribs_2, Kinks=False)  # -> Points, Tangents, Parameters
divide_2 = DivideCurve(Curve=crv, Count=n_ribs_2, Kinks=False)  # -> Points, Tangents, Parameters
ln = Line(StartPoint=divide.Points, EndPoint=divide_2.Points)
pipe = Pipe(Curve=ln, Radius=pipe_radius_2, Caps=0)

# ---- group: Support connections / Left support connections generation
divide_3 = DivideCurve(Curve=item, Count=n_ribs_2, Kinks=False)  # -> Points, Tangents, Parameters
divide_4 = DivideCurve(Curve=crv, Count=n_ribs_2, Kinks=False)  # -> Points, Tangents, Parameters
ln_2 = Line(StartPoint=divide_3.Points, EndPoint=divide_4.Points)
pipe_2 = Pipe(Curve=ln_2, Radius=pipe_radius_2, Caps=0)

# ---- group: Base Sweep / sweep brep
swp1 = Sweep1(Rail=crv_5, Sections=rectangle.Rectangle, Miter=1)
brep = Brep(swp1)

# ---- group: Middle Sweep / sweep brep
swp1_2 = Sweep1(Rail=crv_6, Sections=rectangle_2.Rectangle, Miter=1)
brep_2 = Brep(swp1_2)

# ---- group: Span array generation
n_spans_2 = Data(n_spans)
expression_12 = Expression(x=n_spans_2, Expression="x + 1")
series = Series(Start=0, Step=D, Count=n_spans_2)
series_2 = Series(Start=0, Step=D, Count=expression_12)
X_2 = UnitX(Factor=series_2)
X_3 = UnitX(Factor=series)
crv_7 = Curve(crv_3)
move_8 = Move(Geometry=crv_7, Motion=X_2)  # -> Geometry, Transform

# ---- group: Support connections array generation
brep_3 = Brep(graft(brep))
crv_8 = Curve(crv)
crv_9 = Curve([ln_2, ln])
brep_4 = Brep(graft([brep_2, pipe_2, pipe]))
graft = GraftTree(Tree=crv_9, IncludeEmptyLists=True, IncludeNullItems=True)
move_9 = Move(Geometry=crv_8, Motion=X_3)  # -> Geometry, Transform
move_10 = Move(Geometry=graft, Motion=X_3)  # -> Geometry, Transform
move_11 = Move(Geometry=brep_3, Motion=X_2)  # -> Geometry, Transform
move_12 = Move(Geometry=brep_4, Motion=X_3)  # -> Geometry, Transform

# ----
merge_2 = Merge(Data1=move_8.Geometry, Data2=move_9.Geometry, Data3=move_10.Geometry)
merge_3 = Merge(Data1=move_11.Geometry, Data2=move_12.Geometry)

# ---- group: Generated Curves Merged
crv_10 = Curve(merge_2)

# ---- group: Generated Breps Merged
brep_5 = Brep(merge_3)

# ---- group: Preview brep geometry
material = CreateMaterial(Diffuse="gray", Specular=RGB(255, 255, 255), Emission=RGB(0, 0, 0), Transparency=".5", Shine=0)
preview = CustomPreview(Geometry=brep_5, Material=material)

# ---- group: Preview curves geometry
material_2 = CreateMaterial(Diffuse="black", Specular=RGB(255, 255, 255), Emission=RGB(0, 0, 0), Transparency=0, Shine=0)
preview_2 = CustomPreview(Geometry=crv_10, Material=material_2)
