# Grasshopper definition LUmbracle_p2_200526_WK.gh (Grasshopper 1.0.7)

# ----
# ALGORITHMIC MODELLING SERIES
# L'Umbracle
# By Santiago Calatrava
# 02
# Part 2
# Jose Luis García del Castillo y López
# Cleaned by: Wojciech Karnowka
X = Slider(4.26, range=0..10)
Y = Slider(4.71, range=0..10)
Z = Slider(0, range=0..10)

# ---- group: Base point [0,0,0]
pt = ConstructPoint(XCoordinate=X, YCoordinate=Y, ZCoordinate=Z)

# ---- group: Base Point
pt_2 = Point(pt)

# ----
W = Slider(10, range=0..10)
H = Slider(6.5, range=0..10)
D = Slider(1.8, range=0..10)

n_ribs = Slider(50, range=0..100)
n_spans = Slider(10, range=0..100)

d1 = Slider(0.4, range=0..1)
d2 = Slider(0.15, range=0..1)
w = Slider(0.1, range=0..1)

md2 = Slider(0.1, range=0..1)
mw = Slider(0.06, range=0..1)
md1 = Slider(0.25, range=0..1)

pipe_radius = Slider(0.03, range=0..0.1)

h1 = Slider(1.8, range=0..10)
h2 = Slider(0.7, range=0..10)
offset = Slider(0.85, range=0..10)

c_script = CSharpScript(
    basePoint=pt_2,
    W=W,
    H=H,
    D=D,
    h1=h1,
    h2=h2,
    offset=offset,
    nRibs=n_ribs,
    nSpans=n_spans,
    d1=d1,
    d2=d2,
    w=w,
    md1=md1,
    md2=md2,
    mw=mw,
    pipeRadius=pipe_radius)  # -> out, baseArchCurves, baseArchBreps, middleArchCurves, middleArchBreps, ribLines, ribSurfaces, console; inputs basePoint: Point3d, W: Double, H: Double, D: Double, h1: Double, h2: Double, offset: Double, nRibs: Int32, nSpans: Int32, d1: Double, d2: Double, w: Double, md1: Double, md2: Double, mw: Double, pipeRadius: Double
# ---------- c_script: C# usings ----------
using Rhino.Geometry.Intersect;
# ---------- c_script: C# ----------
    // Create the base arch curve
    // Create list of points for the base arch
    List <Point3d> archPoints = new List<Point3d>();
    // Create curve points and add to the list
    archPoints.Add(basePoint);
    archPoints.Add(new Point3d(basePoint.X, basePoint.Y + 0.5 * W, basePoint.Z + H));
    archPoints.Add(new Point3d(basePoint.X, basePoint.Y + W, basePoint.Z));
    // Create base arch curve
    Curve archCurve = Curve.CreateInterpolatedCurve(archPoints, 3);

    // Create all base arches
    // Create base arch DataTree
    DataTree<Curve> arches = new DataTree<Curve>();
    // For each base arch (count = nSpans) duplicate curve and move by distance (D)
    for (int i = 0; i < nSpans + 1; i++) {
      Curve clone = archCurve.DuplicateCurve();
      double distance = i * D;
      clone.Translate(distance, 0, 0);
      // Add it to the tree in its own branch
      GH_Path path = new GH_Path(i);
      arches.Add(clone, path);
    }

    // Create middle arches
    // Create list of points for the middle arch
    List<Point3d> middleArchPoints = new List<Point3d>();
    // Create middle arch points and add to the list
    middleArchPoints.Add(new Point3d(basePoint.X + 0.5 * D, basePoint.Y, basePoint.Z + h1));
    middleArchPoints.Add(new Point3d(basePoint.X + 0.5 * D, basePoint.Y + 0.5 * W, basePoint.Z + H + h2));
    middleArchPoints.Add(new Point3d(basePoint.X + 0.5 * D, basePoint.Y + W, basePoint.Z + h1));
    // Create middle arch curve
    Curve archMiddleCurve = Curve.CreateInterpolatedCurve(middleArchPoints, 3);

    // Create all middle arches
    // Create middle arch DataTree
    DataTree<Curve> middleArches = new DataTree<Curve>();
    // For each middle arch (count = nSpans) duplicate curve and move by distance (D)
    for (int i = 0; i < nSpans; i++) {
      Curve clone = archMiddleCurve.DuplicateCurve();
      double distance = i * D;
      clone.Translate(distance, 0, 0);

      // Add it to the tree in its own branch
      GH_Path path = new GH_Path(i);
      middleArches.Add(clone, path);
    }

    // Compute the subcurve for base arch
    // Create plane at split locations
    Plane splittingPlane = new Plane(
      new Point3d(basePoint.X, basePoint.Y, basePoint.Z + offset),
      Vector3d.XAxis,
      Vector3d.YAxis
      );


    /* Verbose way
    List<double> splittingParameters = new List<double>();
    CurveIntersections curveInts =
      Intersection.CurvePlane(archCurve, splittingPlane, 0.0001);
    for (int i = 0; i < curveInts.Count; i++) {
      IntersectionEvent iEvent = curveInts[i];
      double t = iEvent.ParameterA;
      splittingParameters.Add(t);
      Print(t.ToString());
    }

    Curve[] splits = archCurve.Split(splittingParameters);
    Curve subMainArch = splits[1];
 */


    // Trim curve ends
    // Find intersections between plane and base arch
    CurveIntersections curveInts =
      Intersection.CurvePlane(archCurve, splittingPlane, 0.0001);
    // If curve was not split into three segments, raise message
    if (curveInts.Count != 2) {
      Component.AddRuntimeMessage(GH_RuntimeMessageLevel.Error, "Something went wrong with the intersection");
      return;
    }
    // Trim method
    Curve subMainArch = archCurve.Trim(
      curveInts[0].ParameterA,
      curveInts[1].ParameterA
      );

    // Create left ribs
    // Define array of points for left ribs
    Point3d[] archCurvePointsLeft, middleArchCurvePoints;
    // Divide sub base arch
    subMainArch.DivideByCount(nRibs, true, out archCurvePointsLeft);
    // Divide middle arch (count = nRibs)
    archMiddleCurve.DivideByCount(nRibs, true, out middleArchCurvePoints);
    // Create list of lines for left ribs
    List<Line> leftSpanRibs = new List<Line>();
    // Create list of surfaces for left ribs
    List<Surface> leftSpanSrfs = new List<Surface>();
    // For each point on base arch, create (left) line and surface, add to the list
    for (int i = 0; i < archCurvePointsLeft.Length; i++) {
      Line l = new Line(archCurvePointsLeft[i], middleArchCurvePoints[i]);
      leftSpanRibs.Add(l);
      Surface srf = PipeFromLine(l, pipeRadius);
      leftSpanSrfs.Add(srf);
    }
    
    // Create righ ribs
    // Create array of points for right ribs
    Point3d[] archCurvePointsRight = new Point3d[archCurvePointsLeft.Length];
    // For each point on left side, create equivalent for right side by adding (D) to X coordinate.
    for (int i = 0; i < archCurvePointsLeft.Length; i++) {
      Point3d p = new Point3d(
        archCurvePointsLeft[i].X + D,
        archCurvePointsLeft[i].Y,
        archCurvePointsLeft[i].Z
        );
      archCurvePointsRight[i] = p;
    }
    // Create list of lines for right ribs
    List<Line> rightSpanRibs = new List<Line>();
    // Create list of surfaces for right ribs
    List<Surface> rightSpanSrfs = new List<Surface>();
    // For each point on base arch, create (right) line and surface, add to the list
    for (int i = 0; i < archCurvePointsRight.Length; i++) {
      Line l = new Line(
        archCurvePointsRight[i],
        middleArchCurvePoints[i]
        );
      rightSpanRibs.Add(l);
      Surface srfRight = PipeFromLine(l, pipeRadius);
      rightSpanSrfs.Add(srfRight);
    }

    // Create DataTree
    DataTree<Line> ribAxes = new DataTree<Line>();
    // Create DataTree of surfaces
    DataTree<Surface> ribSrfs = new DataTree<Surface>();
    // For each span (count = nSpans) duplicate and move by vector (v)
    for (int i = 0; i < nSpans; i++) {
      Vector3d v = new Vector3d(i * D, 0, 0);
      //  Create list of left line clones
      List<Line> leftClones = new List<Line>();
      // Create list of left surface clones
      List<Surface> leftSurfClones = new List<Surface>();
      // For each line, translate Start, End point by vector (v)
      for (int j = 0; j < leftSpanRibs.Count; j++) {
        Line clone = leftSpanRibs[j];  // Lines are structs, this is a copy
        clone.From += v;
        clone.To += v;
        leftClones.Add(clone);

        Surface source = leftSpanSrfs[j];
        Surface cloneS = (Surface) source.Duplicate();
        cloneS.Translate(v);
        leftSurfClones.Add(cloneS);
      }
      // Define array of path indices
      int[] pathIndices = new int[2] {i, 0};
      // Create DataTree path
      GH_Path path = new GH_Path(pathIndices);
      // Add to DataTree
      ribAxes.AddRange(leftClones, path);
      ribSrfs.AddRange(leftSurfClones, path);

      // Create list of right line clones
      List<Line> rightClones = new List<Line>();
      // Create list of right surface clones
      List<Surface> rightSurfClones = new List<Surface>();
      // For each line, translate Start, End point by vector (v)
      for (int j = 0; j < rightSpanRibs.Count; j++) {
        Line clone = rightSpanRibs[j];  // Lines are structs, this is a copy
        clone.From += v;
        clone.To += v;
        rightClones.Add(clone);

        Surface source = rightSpanSrfs[j];
        Surface cloneS = (Surface) source.Duplicate();
        cloneS.Translate(v);
        rightSurfClones.Add(cloneS);
      }
      // Define array of path indices
      pathIndices = new int[2] {i, 1};
      // Create DataTree path
      path = new GH_Path(pathIndices);
      // Add to DataTree
      ribAxes.AddRange(rightClones, path);
      ribSrfs.AddRange(rightSurfClones, path);
    }

    // Create main arch sweep Brep
    // Create array of base arch sub parameters and divide base curve
    double[] mainArchSubParameters = archCurve.DivideByCount(30, true);
    // Create planes perpendicular to base curves at sub parameters
    Plane[] perpFrameMainArch = archCurve.GetPerpendicularFrames(mainArchSubParameters);
    // Create array of cross sections
    Curve[] sections = new Curve[perpFrameMainArch.Length];
    // Define section parameter
    double sectionDiff = d1 - d2;
    // For each plane create cross section rectangle
    for (int i = 0; i < sections.Length; i++) {
      Plane pl = perpFrameMainArch[i];
      double normHeight = (pl.OriginZ - basePoint.Z) / H;
      double newSectionHeight = d1 - sectionDiff * normHeight;
      Interval width = new Interval(-0.5 * newSectionHeight, 0.5 * newSectionHeight);
      Interval height = new Interval(-0.5 * w, 0.5 * w);
      Rectangle3d r = new Rectangle3d(pl, width, height);
      sections[i] = r.ToNurbsCurve();
    }
    // Create sweep
    SweepOneRail sweep = new SweepOneRail();
    // Sweep parameters
    sweep.AngleToleranceRadians = doc.ModelAngleToleranceRadians;
    sweep.ClosedSweep = false;
    sweep.SweepTolerance = doc.ModelAbsoluteTolerance;
    sweep.SetToRoadlikeTop();
    // Perform sweep
    Brep[] mainArchSurfaces = sweep.PerformSweep(archCurve, sections);
    Brep mainArchBrep = mainArchSurfaces[0];

    // Create DataTree of base arche breps
    DataTree<Brep> baseArchSurfaces = new DataTree<Brep>();
    // For each base arch brep move by distance (D), add to DataTree
    for (int i = 0; i < nSpans + 1; i++) {
      Brep brep = mainArchBrep.DuplicateBrep();
      brep.Translate(i * D, 0, 0);

      GH_Path path = new GH_Path(i);
      baseArchSurfaces.Add(brep, path);
    }

    // Create middle arch sweep Brep
    // Create array of middle arch sub parameters and divide middle curve
    double[] middleArchSubParameters = archMiddleCurve.DivideByCount(30, true);
    // Create planes perpendicular to middle curves at sub parameters
    Plane[] perpFrameMiddleArch = archMiddleCurve.GetPerpendicularFrames(middleArchSubParameters);
    // Create array of cross sections
    sections = new Curve[perpFrameMiddleArch.Length];
    // Define section parameters
    sectionDiff = md1 - md2;
    double archBase = basePoint.Z + h1;
    double archTop = basePoint.Z + H + h2;
    double archHeight = archTop - archBase;
    // For each plane create cross section rectangle
    for (int i = 0; i < sections.Length; i++) {
      Plane pl = perpFrameMiddleArch[i];
      double normHeight = (pl.OriginZ - archBase) / archHeight;
      double newSectionHeight = md1 - sectionDiff * normHeight;
      Interval width = new Interval(-0.5 * newSectionHeight, 0.5 * newSectionHeight);
      Interval height = new Interval(-0.5 * mw, 0.5 * mw);
      Rectangle3d r = new Rectangle3d(pl, width, height);
      sections[i] = r.ToNurbsCurve();
    }
    // Perform sweep
    Brep[] middleArchSrfs = sweep.PerformSweep(archMiddleCurve, sections);
    Brep middleArchBrep = middleArchSrfs[0];

    // Create DataTree of Brep middle arches
    DataTree<Brep> middleArchSurfaces = new DataTree<Brep>();
    // For each middle arch brep move by distance (D), add to DataTree
    for (int i = 0; i < nSpans; i++) {
      Brep brep = middleArchBrep.DuplicateBrep();
      brep.Translate(i * D, 0, 0);

      GH_Path path = new GH_Path(i);
      middleArchSurfaces.Add(brep, path);
    }

    // Outputs
    baseArchCurves = arches;
    baseArchBreps = baseArchSurfaces;
    middleArchCurves = middleArches;
    middleArchBreps = middleArchSurfaces;
    ribLines = ribAxes;
    ribSurfaces = ribSrfs;
# ---------- c_script: C# additional code ----------
  Surface PipeFromLine(Line line, double radius) {
    Vector3d dir = line.To - line.From;
    Plane pl = new Plane(line.From, dir);
    Circle c = new Circle(pl, radius);
    Curve crv = c.ToNurbsCurve();

    Surface srf = Surface.CreateExtrusion(crv, dir);

    return srf;
  }
# ---------- end c_script ----------
panel = Panel(c_script.out)

# ---- group: baseArchBreps
geo = Geometry(c_script.baseArchBreps)

geo_2 = Geometry(c_script.middleArchBreps)

# ---- group: ribSurfaces
geo_3 = Geometry(c_script.ribSurfaces)

# ----
merge = Merge(Data1=geo, Data2=geo_2, Data3=geo_3)

# ---- group: Preview brep geometry
material = CreateMaterial(Diffuse="gray", Specular=RGB(255, 255, 255), Emission=RGB(0, 0, 0), Transparency=".5", Shine=0)
preview = CustomPreview(Geometry=merge, Material=material)

# ---- group: Base arc generation
W_2 = Data(W)
H_2 = Data(W)

# ---- group: Base arc generation / Base point
pt_3 = Point(pt_2)

# ---- group: Base arc generation / Middle point
expression = Expression(x=W_2, Expression="0.5*x")
vec = VectorXYZ(XComponent=0, YComponent=expression, ZComponent=H_2)  # -> Vector, Length
move = Move(Geometry=pt_3, Motion=vec.Vector)  # -> Geometry, Transform
ptb = Point(move.Geometry)

# ---- group: Middle arc generation / Base point
pt_4 = Point(pt_2)

# ---- group: Base arc generation / End point
Y_2 = UnitY(Factor=W_2)
move_2 = Move(Geometry=pt_3, Motion=Y_2)  # -> Geometry, Transform
ptc = Point(move_2.Geometry)

# ---- group: Middle arc generation
D_2 = Data(D)
W_3 = Data(W)
expression_2 = Expression(x=D_2, Expression="0.5*x")
expression_3 = Expression(x=D_2, Expression="0.5*x")
Y_3 = UnitY(Factor=W_3)
vec_2 = VectorXYZ(XComponent=expression_2, YComponent=0, ZComponent=h2)  # -> Vector, Length
vec_3 = VectorXYZ(XComponent=expression_3, YComponent=0, ZComponent=h1)  # -> Vector, Length
move_3 = Move(Geometry=pt_4, Motion=vec_3.Vector)  # -> Geometry, Transform
move_4 = Move(Geometry=move_3.Geometry, Motion=Y_3)  # -> Geometry, Transform
move_5 = Move(Geometry=ptb, Motion=vec_2.Vector)  # -> Geometry, Transform
intcrv = Interpolate(Vertices=[move_3.Geometry, move_5.Geometry, move_4.Geometry], Degree=3, Periodic=False, KnotStyle=1)  # -> Curve, Length, Domain
crv = Curve(intcrv.Curve)

# ---- group: Base arc generation / Start point
pta = Point(pt_3)

# ---- group: Base arc generation / Base arc
merge_2 = Merge(Data1=pta, Data2=ptb, Data3=ptc)
intcrv_2 = Interpolate(Vertices=merge_2, Degree=3, Periodic=False, KnotStyle=1)  # -> Curve, Length, Domain
crv_2 = Curve(intcrv_2.Curve)

crv_3 = Curve(crv_2)

# ---- group: Find curve parameters at given height
xy = XYPlane(Origin=Point(0, 0, 0))
Z_2 = UnitZ(Factor=offset)
move_6 = Move(Geometry=xy, Motion=Z_2)  # -> Geometry, Transform
pcx = CurvePlane(Curve=crv_3, Plane=move_6.Geometry)  # -> Points, ParamsC, ParamsP

# ---- group: Base arc offset generation
H_3 = Data(D)
X_2 = UnitX(Factor=H_3)
move_7 = Move(Geometry=crv_3, Motion=X_2)  # -> Geometry, Transform

# ---- group: Base arc offset generation / Base arc offset
crv_4 = Curve(move_7.Geometry)

# ---- group: Shatter arc and select middle segment
shatter = Shatter(Curve=crv_3, Parameters=pcx.ParamsC)
item = ListItem(List=shatter, Index="1", Wrap=True)

shatter_2 = Shatter(Curve=crv_4, Parameters=pcx.ParamsC)
item_2 = ListItem(List=shatter_2, Index="1", Wrap=True)

# ---- group: Middle Sweep / Base point
pt_5 = Point(move_3.Geometry)

# ---- group: Middle Sweep / Middle point
pt_6 = Point(move_5.Geometry)

# ---- group: Base Sweep / Middle Point
ptb_2 = Point(move.Geometry)

# ---- group: Base Sweep / Base point
pt_7 = Point(pt_2)

# ---- group: Base Sweep
crv_5 = Curve(crv_3)
pframes = PerpFrames(Curve=crv_5, Count="30", Align=True)  # -> Frames, Parameters
pdecon = Deconstruct(Point=ptb_2)  # -> XComponent, YComponent, ZComponent
pdecon_2 = Deconstruct(Point=pt_7)  # -> XComponent, YComponent, ZComponent
deplane = DeconstructPlane(Plane=pframes.Frames)  # -> Origin, XAxis, YAxis, ZAxis
pdecon_3 = Deconstruct(Point=deplane.Origin)  # -> XComponent, YComponent, ZComponent
subtraction = Subtraction(A=pdecon_3.ZComponent, B=pdecon_2.ZComponent)
subtraction_2 = Subtraction(A=d1, B=d2)
division = Division(A=subtraction, B=pdecon.ZComponent)
w_2 = Data(w)
multiplication = Multiplication(A=division, B=subtraction_2)
subtraction_3 = Subtraction(A=d1, B=multiplication)
expression_4 = Expression(x=subtraction_3, Expression="-0.5*x")
expression_5 = Expression(x=subtraction_3, Expression="0.5*x")
expression_6 = Expression(x=w_2, Expression="-0.5*x")
expression_7 = Expression(x=w_2, Expression="0.5*x")
diff_section_depth = Panel(subtraction_2)
dom = ConstructDomain(DomainStart=expression_4, DomainEnd=expression_5)
dom_2 = ConstructDomain(DomainStart=expression_6, DomainEnd=expression_7)
rectangle = Rectangle(Plane=pframes.Frames, XSize=dom, YSize=dom_2, Radius=0)  # -> Rectangle, Length

# ----
w_3 = Data(mw)

# ---- group: Middle Sweep
crv_6 = Curve(crv)
pframes_2 = PerpFrames(Curve=crv_6, Count="30", Align=True)  # -> Frames, Parameters
pdecon_4 = Deconstruct(Point=pt_5)  # -> XComponent, YComponent, ZComponent
pdecon_5 = Deconstruct(Point=pt_6)  # -> XComponent, YComponent, ZComponent
deplane_2 = DeconstructPlane(Plane=pframes_2.Frames)  # -> Origin, XAxis, YAxis, ZAxis
pdecon_6 = Deconstruct(Point=deplane_2.Origin)  # -> XComponent, YComponent, ZComponent
subtraction_4 = Subtraction(A=pdecon_6.ZComponent, B=pdecon_4.ZComponent)
subtraction_5 = Subtraction(A=md1, B=md2)
division_2 = Division(A=subtraction_4, B=pdecon_5.ZComponent)
multiplication_2 = Multiplication(A=division_2, B=subtraction_5)
subtraction_6 = Subtraction(A=md1, B=multiplication_2)
diff_section_depth_2 = Panel(subtraction_5)
expression_8 = Expression(x=subtraction_6, Expression="-0.5*x")
expression_9 = Expression(x=subtraction_6, Expression="0.5*x")
expression_10 = Expression(x=w_3, Expression="-0.5*x")
expression_11 = Expression(x=w_3, Expression="0.5*x")
dom_3 = ConstructDomain(DomainStart=expression_8, DomainEnd=expression_9)
dom_4 = ConstructDomain(DomainStart=expression_10, DomainEnd=expression_11)
rectangle_2 = Rectangle(Plane=pframes_2.Frames, XSize=dom_3, YSize=dom_4, Radius=0)  # -> Rectangle, Length

# ---- group: Support connections
n_ribs_2 = Data(n_ribs)
pipe_radius_2 = Data(pipe_radius)

# ---- group: Support connections / Right support connections generation
divide = DivideCurve(Curve=item_2, Count=n_ribs_2, Kinks=False)  # -> Points, Tangents, Parameters
divide_2 = DivideCurve(Curve=crv, Count=n_ribs_2, Kinks=False)  # -> Points, Tangents, Parameters
ln = Line(StartPoint=divide.Points, EndPoint=divide_2.Points)
pipe = Pipe(Curve=ln, Radius=pipe_radius_2, Caps=0)

# ---- group: Support connections / Left support connections generation
divide_3 = DivideCurve(Curve=item, Count=n_ribs_2, Kinks=False)  # -> Points, Tangents, Parameters
divide_4 = DivideCurve(Curve=crv, Count=n_ribs_2, Kinks=False)  # -> Points, Tangents, Parameters
ln_2 = Line(StartPoint=divide_3.Points, EndPoint=divide_4.Points)
pipe_2 = Pipe(Curve=ln_2, Radius=pipe_radius_2, Caps=0)

# ---- group: Base Sweep / sweep brep
swp1 = Sweep1(Rail=crv_5, Sections=rectangle.Rectangle, Miter=1)
brep = Brep(swp1)

# ---- group: Middle Sweep / sweep brep
swp1_2 = Sweep1(Rail=crv_6, Sections=rectangle_2.Rectangle, Miter=1)
brep_2 = Brep(swp1_2)

# ---- group: Span array generation
n_spans_2 = Data(n_spans)
expression_12 = Expression(x=n_spans_2, Expression="x + 1")
series = Series(Start=0, Step=D, Count=n_spans_2)
series_2 = Series(Start=0, Step=D, Count=expression_12)
X_3 = UnitX(Factor=series_2)
X_4 = UnitX(Factor=series)
crv_7 = Curve(crv_3)
move_8 = Move(Geometry=crv_7, Motion=X_3)  # -> Geometry, Transform

# ---- group: Support connections array generation
brep_3 = Brep(graft(brep))
crv_8 = Curve(crv)
crv_9 = Curve([ln_2, ln])
brep_4 = Brep(graft([brep_2, pipe_2, pipe]))
graft = GraftTree(Tree=crv_9, IncludeEmptyLists=True, IncludeNullItems=True)
move_9 = Move(Geometry=crv_8, Motion=X_4)  # -> Geometry, Transform
move_10 = Move(Geometry=graft, Motion=X_4)  # -> Geometry, Transform
move_11 = Move(Geometry=brep_3, Motion=X_3)  # -> Geometry, Transform
move_12 = Move(Geometry=brep_4, Motion=X_4)  # -> Geometry, Transform

# ----
merge_3 = Merge(Data1=move_8.Geometry, Data2=move_9.Geometry, Data3=move_10.Geometry)
merge_4 = Merge(Data1=move_11.Geometry, Data2=move_12.Geometry)

# ---- group: Generated Curves Merged
crv_10 = Curve(merge_3)

# ---- group: Generated Breps Merged
brep_5 = Brep(merge_4)

# ---- group: Preview brep geometry
material_2 = CreateMaterial(Diffuse="gray", Specular=RGB(255, 255, 255), Emission=RGB(0, 0, 0), Transparency=".5", Shine=0)
preview_2 = CustomPreview(Geometry=brep_5, Material=material_2)  # disabled

# ---- group: Preview curves geometry
material_3 = CreateMaterial(Diffuse="black", Specular=RGB(255, 255, 255), Emission=RGB(0, 0, 0), Transparency=0, Shine=0)
preview_3 = CustomPreview(Geometry=crv_10, Material=material_3)  # disabled
