# Grasshopper definition Algorithmic Modeling #3.1 Pearl Necklace.gh (Grasshopper 1.0.7)

number_of_pearls = Slider(15, range=0..100)
# ALGORITHMIC MODELING SERIES
# 3
# Pearl Necklace
# Part 1/3
# By Jose Luis García del Castillo y López @ ParametricCamp
# https://youtu.be/HD1B1NHgHiM
crv = Curve(<curve referenced from the Rhino model>)

diameter = Slider(8, range=0..10)

# ---- group: GIVEN THE DIAMETER
divdist = DivideDistance(Curve=crv, Distance=diameter)  # -> Points, Tangents, Parameters
division = Division(A=diameter, B="2")
sph = Sphere(Base=divdist.Points, Radius=division)

# ---- group: GIVEN # OF PEARLS
subtraction = Subtraction(A=number_of_pearls, B="1")
divide = DivideCurve(Curve=crv, Count=subtraction, Kinks=False)  # -> Points, Tangents, Parameters

len = Length(Curve=crv)
division_2 = Division(A=len, B=subtraction)
division_3 = Division(A=division_2, B="2")

sph_2 = Sphere(Base=divide.Points, Radius=division_3)
