# Grasshopper definition Algorithmic Modeling #3.2 Pearl Necklace.gh (Grasshopper 1.0.7)

number_of_pearls = Slider(12, range=0..100)
# ALGORITHMIC MODELING SERIES
# 3
# Pearl Necklace
# Part 2/3
# By Jose Luis García del Castillo y López @ ParametricCamp
# https://youtu.be/JPLTuX2FeVc
crv = Curve(<curve referenced from the Rhino model>)

diameter = Slider(7.187, range=0..10)
c_script = CSharpScript(curve=crv, n=number_of_pearls)  # -> out, centers, spheres; inputs curve: Curve, n: Int32
# ---------- c_script: C# ----------
    // Find center points for spheres
    int segmentCount = n - 1;
    Point3d[] cents;
    curve.DivideByCount(segmentCount, true, out cents);

    // Compute the radius of the spheres
    double curveLength = curve.GetLength();
    double segmentLength = curveLength / segmentCount;
    double sphereRadius = 0.5 * segmentLength;

    // Create spheres on centers
    Sphere[] sph = new Sphere[cents.Length];
    for (int i = 0; i < cents.Length; i++) {
      Sphere s = new Sphere(cents[i], sphereRadius);
      sph[i] = s;
    }

    // Outputs
    centers = cents;
    spheres = sph;
# ---------- end c_script ----------
c_script_2 = CSharpScript(curve=crv, d=diameter)  # -> out, centers, spheres; inputs curve: Curve, d: Double
# ---------- c_script_2: C# ----------
    // Find center points for spheres
    double sphereRadius = 0.5 * d;
    Point3d[] cents = curve.DivideEquidistant(d);

    // Create spheres on centers
    Sphere[] sph = new Sphere[cents.Length];
    for (int i = 0; i < cents.Length; i++) {
      Sphere s = new Sphere(cents[i], sphereRadius);
      sph[i] = s;
    }

    // Outputs
    centers = cents;
    spheres = sph;
# ---------- end c_script_2 ----------
panel = Panel(c_script.out)
