# Grasshopper definition Algorithmic Modeling #3.3 Pearl Necklace.gh (Grasshopper 1.0.7)

galapagos = Galapagos(fitness=abs, gene=diameter)

number_of_spheres = Slider(15, range=0..100)
diameter = Slider(4.197, range=2..100)
# ALGORITHMIC MODELING SERIES
# 3
# Pearl Necklace
# Part 3/3
# By Jose Luis García del Castillo y López @ ParametricCamp
# https://youtu.be/AB6CQlkt4Yo
crv = Curve(<curve referenced from the Rhino model>)

# ---- group: GIVEN THE DIAMETER
divdist = DivideDistance(Curve=crv, Distance=diameter)  # -> Points, Tangents, Parameters
division = Division(A=diameter, B="2")
split = SplitList(List=divdist.Points, Index=number_of_spheres)  # -> ListA, ListB
sph = Sphere(Base=split.ListA, Radius=division)

# ---- group: COMPUTE VIRTIAL PARAMETER DISTANCE FROM LAST CENTER TO END OF CURVE
lng = ListLength(List=divdist.Points)
division_2 = Division(A=number_of_spheres, B=lng)
item = ListItem(List=split.ListA, Index="-1", Wrap=True)
crv_cp = CurveClosestPoint(Point=item, Curve=crv)  # -> Point, Parameter, Distance
dedomain = DeconstructDomain(Domain=crv)  # -> Start, End
multiplication = Multiplication(A=division_2, B=crv_cp.Parameter)
panel = Panel([dedomain.Start, dedomain.End])
subtraction = Subtraction(A=dedomain.End, B=multiplication)
abs = Absolute(Value=subtraction)

# ----
sphere_count = Panel(lng)
