# Grasshopper definition AM_004_VisualizingMotion.gh (Grasshopper 1.0.7)

# ----
# ALGORITHMIC MODELING SERIES
# 4
# Part 1/1
# By Jose Luis García del Castillo y López @ ParametricCamp
# https://youtu.be/6yT8-inuFWQ
panel = Panel("C:\Users\JLX\Desktop\csv\motion_01.csv")

# ----
# Visualizing Motion
c_script = CSharpScript(csvPath="C:\Users\JLX\Desktop\csv\motion_02.csv")  # -> out, Timestamps, T0Planes, T0TriggerPressed, T0TriggerClicked, T0TriggerValue, T0TouchpadPressed, T0TouchpadClicked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; inputs csvPath: String
# ---------- c_script: C# ----------
    // Read the contents of the CSV files as individual lines
    string[] csvLines = System.IO.File.ReadAllLines(csvPath);

    // List of timestamps
    var timestamps = new List<long>();

    // List of Controller 0 Data
    var controller0Planes = new List<Plane>();
    var controller0TriggerPressed = new List<bool>();
    var controller0TriggerClicked = new List<bool>();
    var controller0TriggerValue = new List<double>();
    var controller0TouchpadPressed = new List<bool>();
    var controller0TouchpadClicked = new List<bool>();
    var controller0TouchpadValues = new List<Vector3d>();

    // List of Controller 1 Data
    var controller1Planes = new List<Plane>();
    var controller1TriggerPressed = new List<bool>();
    var controller1TriggerClicked = new List<bool>();
    var controller1TriggerValue = new List<double>();
    var controller1TouchpadPressed = new List<bool>();
    var controller1TouchpadClicked = new List<bool>();
    var controller1TouchpadValues = new List<Vector3d>();

    // Parse all lines
    for (int i = 1; i < csvLines.Length; i++) {
      string[] rowData = csvLines[i].Split(',');

      // Tiemstamps
      timestamps.Add(Convert.ToInt64(rowData[0]));

      // CONTROLLER 0
      // ORIGIN
      double x = Convert.ToDouble(rowData[1]);
      double y = Convert.ToDouble(rowData[2]);
      double z = Convert.ToDouble(rowData[3]);
      Point3d origin0 = new Point3d(x, y, z);

      // X AXIS
      x = Convert.ToDouble(rowData[4]);
      y = Convert.ToDouble(rowData[5]);
      z = Convert.ToDouble(rowData[6]);
      Vector3d xAxis0 = new Vector3d(x, y, z);

      // Y AXIS
      x = Convert.ToDouble(rowData[7]);
      y = Convert.ToDouble(rowData[8]);
      z = Convert.ToDouble(rowData[9]);
      Vector3d yAxis0 = new Vector3d(x, y, z);

      // CONTROLLER 0 PLANE
      Plane pl0 = new Plane(origin0, xAxis0, yAxis0);
      controller0Planes.Add(pl0);

      // Triggers
      controller0TriggerPressed.Add(Convert.ToBoolean(rowData[10]));
      controller0TriggerClicked.Add(Convert.ToBoolean(rowData[11]));
      controller0TriggerValue.Add(Convert.ToDouble(rowData[12]));

      // Touchpad
      controller0TouchpadPressed.Add(Convert.ToBoolean(rowData[13]));
      controller0TouchpadClicked.Add(Convert.ToBoolean(rowData[14]));
      x = Convert.ToDouble(rowData[15]);
      y = Convert.ToDouble(rowData[16]);
      controller0TouchpadValues.Add(new Vector3d(x, y, 0));


      // CONTROLLER 1
      // ORIGIN
      x = Convert.ToDouble(rowData[17]);
      y = Convert.ToDouble(rowData[18]);
      z = Convert.ToDouble(rowData[19]);
      Point3d origin1 = new Point3d(x, y, z);

      // X AXIS
      x = Convert.ToDouble(rowData[20]);
      y = Convert.ToDouble(rowData[21]);
      z = Convert.ToDouble(rowData[22]);
      Vector3d xAxis1 = new Vector3d(x, y, z);

      // Y AXIS
      x = Convert.ToDouble(rowData[23]);
      y = Convert.ToDouble(rowData[24]);
      z = Convert.ToDouble(rowData[25]);
      Vector3d yAxis1 = new Vector3d(x, y, z);

      // CONTROLLER 0 PLANE
      Plane pl1 = new Plane(origin1, xAxis1, yAxis1);
      controller1Planes.Add(pl1);

      // Triggers
      controller1TriggerPressed.Add(Convert.ToBoolean(rowData[26]));
      controller1TriggerClicked.Add(Convert.ToBoolean(rowData[27]));
      controller1TriggerValue.Add(Convert.ToDouble(rowData[28]));

      // Touchpad
      controller1TouchpadPressed.Add(Convert.ToBoolean(rowData[29]));
      controller1TouchpadClicked.Add(Convert.ToBoolean(rowData[30]));
      x = Convert.ToDouble(rowData[31]);
      y = Convert.ToDouble(rowData[32]);
      controller1TouchpadValues.Add(new Vector3d(x, y, 0));

    }

    // Outputs
    Timestamps = timestamps;

    // Controller info
    T0Planes = controller0Planes;
    T0TriggerPressed = controller0TriggerPressed;
    T0TriggerClicked = controller0TriggerClicked;
    T0TriggerValue = controller0TriggerValue;
    T0TouchpadPressed = controller0TouchpadPressed;
    T0TouchpadClicked = controller0TouchpadClicked;
    T0TouchpadValues = controller0TouchpadValues;

    T1Planes = controller1Planes;
    T1TriggerPressed = controller1TriggerPressed;
    T1TriggerClicked = controller1TriggerClicked;
    T1TriggerValue = controller1TriggerValue;
    T1TouchpadPressed = controller1TouchpadPressed;
    T1TouchpadClicked = controller1TouchpadClicked;
    T1TouchpadValues = controller1TouchpadValues;
# ---------- end c_script ----------

pln = Plane(c_script.T1Planes)
bool = Boolean(c_script.T1TriggerPressed)
bool_2 = Boolean(c_script.T1TriggerClicked)
num = Number(c_script.T1TriggerValue)
bool_3 = Boolean(c_script.T1TouchpadPressed)
bool_4 = Boolean(c_script.T1TouchpadClicked)
vec = Vector(c_script.T1TouchpadValues)

num_2 = Number(c_script.T0TriggerValue)
vec_2 = Vector(c_script.T0TouchpadValues)
pln_2 = Plane(c_script.T0Planes)
bool_5 = Boolean(c_script.T0TriggerPressed)
bool_6 = Boolean(c_script.T0TriggerClicked)
bool_7 = Boolean(c_script.T0TouchpadPressed)
bool_8 = Boolean(c_script.T0TouchpadClicked)

num_3 = Number(c_script.Timestamps)

c_script_2 = CSharpScript(
    plane=pln_2,
    cleanGeometry=Toggle(False),
    generate=bool_7,
    radius=Slider(0.012, range=0..1),
    width1=Slider(0.01, range=0..1),
    width2=Slider(0.03, range=0..1),
    height=Slider(0.5, range=0..1))  # -> out, sphere, cone, box, line; inputs plane: Plane, cleanGeometry: Boolean, generate: Boolean, radius: Double, width1: Double, width2: Double, height: Double
# ---------- c_script_2: C# ----------
    if (cleanGeometry == true && generate == false) {
      return;
    }

    // Sphere generation
    Sphere s = new Sphere(plane, radius);

    // Cone generation
    Cone c = new Cone(plane, height, radius);

    // Box
    Interval ix = new Interval(-0.5 * width1, 0.5 * width1);
    Interval iy = new Interval(-0.5 * width2, 0.5 * width2);
    Interval iz = new Interval(0, height);
    Box b = new Box(plane, ix, iy, iz);

    // Line
    Vector3d translation = plane.ZAxis * height;
    Point3d endPoint = plane.Origin + translation;
    Line l = new Line(plane.Origin, endPoint);


    // Outputs
    sphere = s;
    cone = c;
    box = b;
    line = l;
# ---------- end c_script_2 ----------
geo = Geometry(c_script_2.sphere)
geo_2 = Geometry(c_script_2.cone)
geo_3 = Geometry(c_script_2.box)

c_script_3 = CSharpScript(planes=pln_2, maxHeight=Slider(10, range=0..10))  # -> out, polyline, curve, lines, graphPoly, loft; inputs planes: list of Plane, maxHeight: Double
# ---------- c_script_3: C# ----------
    // Take all origin points
    var origins = new List<Point3d>();
    for (int i = 0; i < planes.Count; i++) {
      origins.Add(planes[i].Origin);
    }

    // Create polyline
    Polyline poly = new Polyline(origins);

    // Create Curve
    Curve c = Curve.CreateInterpolatedCurve(origins, 3);

    // Lines
    var lin = new List<Line>();
    for (int i = 1; i < planes.Count; i++) {
      Plane p = planes[i];
      Plane prevP = planes[i - 1];

      // double factor = Math.Sin(2 * Math.PI * (i / (double) planes.Count));
      double dist = p.Origin.DistanceTo(prevP.Origin);
      double factor = dist;

      Line l = LinePerpendicularToPlane(p, factor * maxHeight);
      lin.Add(l);
    }

    // Polyline with speed of the motion
    var graphPoints = new List<Point3d>();
    foreach (Line line in lin) {
      graphPoints.Add(line.To);
    }
    Polyline graph = new Polyline(graphPoints);
    
    // Loft
    var curvedLines = new List<Curve>();
    foreach(Line l in lin) {
      curvedLines.Add(l.ToNurbsCurve());
    }
    Brep[] srf = Brep.CreateFromLoft(curvedLines, Point3d.Unset, Point3d.Unset, LoftType.Normal, false);

    polyline = poly;
    curve = c;
    lines = lin;
    graphPoly = graph;
    loft = srf;
# ---------- c_script_3: C# additional code ----------
  Line LinePerpendicularToPlane(Plane plane, double height) {
    // Line
    Vector3d translation = plane.ZAxis * height;
    Point3d endPoint = plane.Origin + translation;
    Line l = new Line(plane.Origin, endPoint);
    return l;
  }
# ---------- end c_script_3 ----------
geo_4 = Geometry(c_script_3.polyline)
geo_5 = Geometry(c_script_3.curve)
geo_6 = Geometry(c_script_3.lines)
geo_7 = Geometry(c_script_3.graphPoly)

geo_8 = Geometry(c_script_2.line)
geo_9 = Geometry(c_script_3.loft)
