# Grasshopper definition AM_005_KochSnowflake.gh (Grasshopper 1.0.7)

panel = Panel("-1")
Z = UnitZ(Factor="1")
# ALGORITHMIC MODELING SERIES
# 5
# Koch Snowflake
# Part 1/1
# By Jose Luis García del Castillo y López @ ParametricCamp
# https://youtu.be/RI_NnQ-kYZ4
crv = Curve(<curve referenced from the Rhino model>)
vec = Vector(Z)
vec_2 = Vector(Z)
vec_3 = Vector(Z)
vec_4 = Vector(Z)

explode = Explode(Curve=crv, Recursive=True)  # -> Segments, Vertices
eval = EvaluateCurve(Curve=reparameterize(explode.Segments), Parameter="0.5")  # -> Point, Tangent, Angle
len = Length(Curve=explode.Segments)
end = EndPoints(Curve=explode.Segments)  # -> Start, End
divide = DivideCurve(Curve=explode.Segments, Count="3", Kinks=False)  # -> Points, Tangents, Parameters
expression = Expression(x=len, Expression="(x / 3.0) * (Sqrt(3) / 2.0)")
vec2pt = Vector2Pt(PointA=end.Start, PointB=end.End, Unitize=False)  # -> Vector, Length
unit = UnitVector(Vector=vec2pt.Vector)
xprod = CrossProduct(VectorA=unit, VectorB=vec_4, Unitize=False)  # -> Vector, Length
multiplication = Multiplication(A=xprod.Vector, B=expression)
vdis = VectorDisplay(Anchor=eval.Point, Vector=multiplication)
move = Move(Geometry=eval.Point, Motion=multiplication)  # -> Geometry, Transform
graft = GraftTree(Tree=move.Geometry, IncludeEmptyLists=True, IncludeNullItems=True)
ins = InsertItems(List=divide.Points, Item=graft, Indices="2", Wrap=True)
flatten = FlattenTree(Tree=ins, Path="{0}")
pline = PolyLine(Vertices=flatten, Closed=False)
crv_2 = Curve(pline)

explode_2 = Explode(Curve=crv_2, Recursive=True)  # -> Segments, Vertices
eval_2 = EvaluateCurve(Curve=reparameterize(explode_2.Segments), Parameter="0.5")  # -> Point, Tangent, Angle
len_2 = Length(Curve=explode_2.Segments)
end_2 = EndPoints(Curve=explode_2.Segments)  # -> Start, End
divide_2 = DivideCurve(Curve=explode_2.Segments, Count="3", Kinks=False)  # -> Points, Tangents, Parameters
expression_2 = Expression(x=len_2, Expression="(x / 3.0) * (Sqrt(3) / 2.0)")
vec2pt_2 = Vector2Pt(PointA=end_2.Start, PointB=end_2.End, Unitize=False)  # -> Vector, Length
unit_2 = UnitVector(Vector=vec2pt_2.Vector)
xprod_2 = CrossProduct(VectorA=unit_2, VectorB=vec_3, Unitize=False)  # -> Vector, Length
multiplication_2 = Multiplication(A=xprod_2.Vector, B=expression_2)
vdis_2 = VectorDisplay(Anchor=eval_2.Point, Vector=multiplication_2)
move_2 = Move(Geometry=eval_2.Point, Motion=multiplication_2)  # -> Geometry, Transform
graft_2 = GraftTree(Tree=move_2.Geometry, IncludeEmptyLists=True, IncludeNullItems=True)
ins_2 = InsertItems(List=divide_2.Points, Item=graft_2, Indices="2", Wrap=True)
flatten_2 = FlattenTree(Tree=ins_2, Path="{0}")
pline_2 = PolyLine(Vertices=flatten_2, Closed=False)
crv_3 = Curve(pline_2)

explode_3 = Explode(Curve=crv_3, Recursive=True)  # -> Segments, Vertices
eval_3 = EvaluateCurve(Curve=reparameterize(explode_3.Segments), Parameter="0.5")  # -> Point, Tangent, Angle
len_3 = Length(Curve=explode_3.Segments)
end_3 = EndPoints(Curve=explode_3.Segments)  # -> Start, End
divide_3 = DivideCurve(Curve=explode_3.Segments, Count="3", Kinks=False)  # -> Points, Tangents, Parameters
expression_3 = Expression(x=len_3, Expression="(x / 3.0) * (Sqrt(3) / 2.0)")
vec2pt_3 = Vector2Pt(PointA=end_3.Start, PointB=end_3.End, Unitize=False)  # -> Vector, Length
unit_3 = UnitVector(Vector=vec2pt_3.Vector)
xprod_3 = CrossProduct(VectorA=unit_3, VectorB=vec_2, Unitize=False)  # -> Vector, Length
multiplication_3 = Multiplication(A=xprod_3.Vector, B=expression_3)
vdis_3 = VectorDisplay(Anchor=eval_3.Point, Vector=multiplication_3)
move_3 = Move(Geometry=eval_3.Point, Motion=multiplication_3)  # -> Geometry, Transform
graft_3 = GraftTree(Tree=move_3.Geometry, IncludeEmptyLists=True, IncludeNullItems=True)
ins_3 = InsertItems(List=divide_3.Points, Item=graft_3, Indices="2", Wrap=True)
flatten_3 = FlattenTree(Tree=ins_3, Path="{0}")
pline_3 = PolyLine(Vertices=flatten_3, Closed=False)
crv_4 = Curve(pline_3)

explode_4 = Explode(Curve=crv_4, Recursive=True)  # -> Segments, Vertices
eval_4 = EvaluateCurve(Curve=reparameterize(explode_4.Segments), Parameter="0.5")  # -> Point, Tangent, Angle
len_4 = Length(Curve=explode_4.Segments)
end_4 = EndPoints(Curve=explode_4.Segments)  # -> Start, End
divide_4 = DivideCurve(Curve=explode_4.Segments, Count="3", Kinks=False)  # -> Points, Tangents, Parameters
expression_4 = Expression(x=len_4, Expression="(x / 3.0) * (Sqrt(3) / 2.0)")
vec2pt_4 = Vector2Pt(PointA=end_4.Start, PointB=end_4.End, Unitize=False)  # -> Vector, Length
unit_4 = UnitVector(Vector=vec2pt_4.Vector)
xprod_4 = CrossProduct(VectorA=unit_4, VectorB=vec, Unitize=False)  # -> Vector, Length
multiplication_4 = Multiplication(A=xprod_4.Vector, B=expression_4)
vdis_4 = VectorDisplay(Anchor=eval_4.Point, Vector=multiplication_4)
move_4 = Move(Geometry=eval_4.Point, Motion=multiplication_4)  # -> Geometry, Transform
graft_4 = GraftTree(Tree=move_4.Geometry, IncludeEmptyLists=True, IncludeNullItems=True)
ins_4 = InsertItems(List=divide_4.Points, Item=graft_4, Indices="2", Wrap=True)
flatten_4 = FlattenTree(Tree=ins_4, Path="{0}")
pline_4 = PolyLine(Vertices=flatten_4, Closed=False)
crv_5 = Curve(pline_4)

boundary = BoundarySurfaces(Edges=crv_5)
Z_2 = UnitZ(Factor=1)
crv_6 = Curve(crv)
c_script = CSharpScript(poly=crv_6, levels=Slider(5, range=0..10), normal=Z_2)  # -> out, koch; inputs poly: Polyline, levels: Int32, normal: Vector3d
# ---------- c_script: C# ----------
    koch = KochStar(poly, levels, normal);
# ---------- c_script: C# additional code ----------
  
  // Create a Koch star by recursive subdivision of a polyline
  Polyline KochStar(Polyline pol, int levels, Vector3d normal)
  {
    Polyline star = pol;

    for (int i = 0; i < levels; i++)
    {
      star = KochSubdivision(star, normal);
    }

    return star;
  }

  // Create a polyline that has been performed
  // Koch subdivision.
  Polyline KochSubdivision(Polyline pol, Vector3d normal)
  {
    int pointCount = pol.Count;

    // Create new empty poly
    Polyline sub = new Polyline();
    sub.Add(pol.First);

    // Iterate over each segment of the poly
    for (int i = 1; i < pointCount; i++)
    {
      // Get end points of this segment
      Point3d start = pol[i - 1];
      Point3d end = pol[i];

      // Compute first third pt
      Point3d p13 = PointAlongLineRelative(start, end, 1 / 3.0);
      sub.Add(p13);

      // Compute pt at tip of sub
      Vector3d axis = end - start;
      axis.Unitize();
      Vector3d norm = normal;
      Vector3d perp = Vector3d.CrossProduct(axis, norm);
      double a = Distance(start, end);
      double a3 = a / 3.0;
      double h = a3 * Math.Sqrt(3) / 2.0;
      perp = h * perp;
      Point3d mid = PointAlongLineRelative(start, end, 0.5);
      mid += perp;
      sub.Add(mid);

      // Compute second third pt
      Point3d p23 = PointAlongLineRelative(start, end, 2 / 3.0);
      sub.Add(p23);

      // Add the end point!
      sub.Add(end);
    }

    return sub;
  }


  // Point Along Line (Geometry Gem #7)
  Point3d PointAlongLineRelative(Point3d a, Point3d b, double t) {
    // Doing it the 'vector algebra' way ;)
    Vector3d AB = b - a;
    Vector3d AC = t * AB;
    Point3d c = a + AC;

    return c;
  }

  // Distance between 2 points (Geometry Gem #4)
  double Distance(Point3d a, Point3d b) {
    // Calculate sides of the triangle
    double dx = b.X - a.X;
    double dy = b.Y - a.Y;
    double dz = b.Z - a.Z;

    // Calculate length of the larger side of the triangle
    double d = Math.Sqrt(dx * dx + dy * dy + dz * dz);

    return d;
  }
# ---------- end c_script ----------
panel_3 = Panel(c_script.out)
geo = Geometry(c_script.koch)
panel_4 = Panel(geo)
