# Grasshopper definition AM_006_SierpinskiTriangle.gh (Grasshopper 1.0.7)

# ALGORITHMIC MODELING SERIES
# 6
# Sierpinski Triangle
# Part 1/1
# By Jose Luis García del Castillo y López @ ParametricCamp
# https://youtu.be/VteOx72f9FU
crv = Curve(<curve referenced from the Rhino model>)

explode = Explode(Curve=crv, Recursive=True)  # -> Segments, Vertices
end = EndPoints(Curve=explode.Segments)  # -> Start, End
eval = EvaluateCurve(Curve=reparameterize(explode.Segments), Parameter="0.5")  # -> Point, Tangent, Angle
shift = ShiftList(List=eval.Point, Shift="-1", Wrap=True)
graft = GraftTree(Tree=shift, IncludeEmptyLists=True, IncludeNullItems=True)  # -> simplify(Tree)
graft_2 = GraftTree(Tree=end.Start, IncludeEmptyLists=True, IncludeNullItems=True)  # -> simplify(Tree)
graft_3 = GraftTree(Tree=eval.Point, IncludeEmptyLists=True, IncludeNullItems=True)  # -> simplify(Tree)
merge = Merge(Data1=graft_2, Data2=graft_3, Data3=graft, Data4=graft_2)
pline = PolyLine(Vertices=merge, Closed=False)
crv_2 = Curve(pline)

explode_2 = Explode(Curve=crv_2, Recursive=True)  # -> Segments, Vertices
end_2 = EndPoints(Curve=explode_2.Segments)  # -> Start, End
eval_2 = EvaluateCurve(Curve=reparameterize(explode_2.Segments), Parameter="0.5")  # -> Point, Tangent, Angle
shift_2 = ShiftList(List=eval_2.Point, Shift="-1", Wrap=True)
graft_4 = GraftTree(Tree=shift_2, IncludeEmptyLists=True, IncludeNullItems=True)  # -> simplify(Tree)
graft_5 = GraftTree(Tree=end_2.Start, IncludeEmptyLists=True, IncludeNullItems=True)  # -> simplify(Tree)
graft_6 = GraftTree(Tree=eval_2.Point, IncludeEmptyLists=True, IncludeNullItems=True)  # -> simplify(Tree)
merge_2 = Merge(Data1=graft_5, Data2=graft_6, Data3=graft_4, Data4=graft_5)
pline_2 = PolyLine(Vertices=merge_2, Closed=False)
crv_3 = Curve(pline_2)

explode_3 = Explode(Curve=crv_3, Recursive=True)  # -> Segments, Vertices
end_3 = EndPoints(Curve=explode_3.Segments)  # -> Start, End
eval_3 = EvaluateCurve(Curve=reparameterize(explode_3.Segments), Parameter="0.5")  # -> Point, Tangent, Angle
shift_3 = ShiftList(List=eval_3.Point, Shift="-1", Wrap=True)
graft_7 = GraftTree(Tree=shift_3, IncludeEmptyLists=True, IncludeNullItems=True)  # -> simplify(Tree)
graft_8 = GraftTree(Tree=end_3.Start, IncludeEmptyLists=True, IncludeNullItems=True)  # -> simplify(Tree)
graft_9 = GraftTree(Tree=eval_3.Point, IncludeEmptyLists=True, IncludeNullItems=True)  # -> simplify(Tree)
merge_3 = Merge(Data1=graft_8, Data2=graft_9, Data3=graft_7, Data4=graft_8)
pline_3 = PolyLine(Vertices=merge_3, Closed=False)
crv_4 = Curve(pline_3)

explode_4 = Explode(Curve=crv_4, Recursive=True)  # -> Segments, Vertices
end_4 = EndPoints(Curve=explode_4.Segments)  # -> Start, End
eval_4 = EvaluateCurve(Curve=reparameterize(explode_4.Segments), Parameter="0.5")  # -> Point, Tangent, Angle
shift_4 = ShiftList(List=eval_4.Point, Shift="-1", Wrap=True)
graft_10 = GraftTree(Tree=shift_4, IncludeEmptyLists=True, IncludeNullItems=True)  # -> simplify(Tree)
graft_11 = GraftTree(Tree=end_4.Start, IncludeEmptyLists=True, IncludeNullItems=True)  # -> simplify(Tree)
graft_12 = GraftTree(Tree=eval_4.Point, IncludeEmptyLists=True, IncludeNullItems=True)  # -> simplify(Tree)
merge_4 = Merge(Data1=graft_11, Data2=graft_12, Data3=graft_10, Data4=graft_11)
pline_4 = PolyLine(Vertices=merge_4, Closed=False)
crv_5 = Curve(pline_4)

panel = Panel(crv)
boundary = BoundarySurfaces(Edges=crv_5)
crv_6 = Curve(crv)
c_script = CSharpScript(poly=crv_6, levels=Slider(6, range=0..10))  # -> out, sierpinski; inputs poly: Polyline, levels: Int32
# ---------- c_script: C# ----------
    sierpinski = SierpinskiStar(poly, levels);
# ---------- c_script: C# additional code ----------
  List<Polyline> SierpinskiStar(Polyline pol, int levels)
  {
    // Start an empy list of polys
    List<Polyline> triangles = new List<Polyline>();

    // kickstart it with the original polyline
    triangles.Add(pol);

    for (int i = 0; i < levels; i++)
    {
      List<Polyline> subdivisions = new List<Polyline>();

      foreach (Polyline p in triangles)
      {
        List<Polyline> subs = SierpinskiSubdivision(p);
        subdivisions.AddRange(subs);
      }

      triangles = subdivisions;
    }

    return triangles;
  }


  // Perform Sierpinski subdivision to a polyline
  List<Polyline> SierpinskiSubdivision(Polyline pol)
  {
    List < Polyline > subdivisions = new List<Polyline>();

    for (int i = 0; i < pol.Count - 1; i++)
    {
      // Create an empty polyline
      Polyline pl = new Polyline();

      // Retrieve meaningful points for this triangle
      Point3d current = pol[i];
      Point3d next = pol[i + 1];
      Point3d prev;
      if (i != 0)
      {
        prev = pol[i - 1];
      }
      else
      {
        prev = pol[pol.Count - 2];
      }

      // Add the current vertex
      pl.Add(current);

      // Add middle points
      Point3d midNext = PointAlongLineRelative(current, next, 0.5);
      pl.Add(midNext);
      Point3d midPrev = PointAlongLineRelative(current, prev, 0.5);
      pl.Add(midPrev);

      // Close the polyline by adding the same point again
      pl.Add(current);

      subdivisions.Add(pl);
    }

    return subdivisions;
  }

  // Point Along Line (Geometry Gem #7)
  Point3d PointAlongLineRelative(Point3d a, Point3d b, double t) {
    // Doing it the 'vector algebra' way ;)
    Vector3d AB = b - a;
    Vector3d AC = t * AB;
    Point3d c = a + AC;

    return c;
  }
# ---------- end c_script ----------
geo = Geometry(c_script.sierpinski)
panel_2 = Panel(c_script.out)
boundary_2 = BoundarySurfaces(Edges=geo)
panel_3 = Panel(geo)
