# Grasshopper definition ComputationalDesingLiveStream38_Hoopsnake.gh (Grasshopper 1.0.7)
# plug-ins: HoopSnake

# Salvador Calgua
# https://github.com/chino89/ComputationalDesign_C--_To_Python
# https://www.instagram.com/secg_iokan/
number_slider = Slider(1, range=0..10)
# Plug Curve into
# S Hoopsnake
crv = Curve(<curve referenced from the Rhino model>)
crv_2 = Curve(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)
panel = Panel(crv)
panel_2 = Panel(crv_2)

# ---- group: OutputCurves
crv_3 = Curve(Tree({0;0;0;0;0}: [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], {0;0;0;0;1}: [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], {0;0;0;0;2}: [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], {0;0;0;1;0}: [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], {0;0;0;1;1}: [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], {0;0;0;1;2}: [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]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))

# ---- group: OutputCurve
crv_4 = Curve(Tree({0;0;0;0;0}: [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], {0;0;0;0;1}: [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], {0;0;0;0;2}: [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], {0;0;0;1;0}: [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], {0;0;0;1;1}: [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], {0;0;0;1;2}: [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]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))

# ----
hs = HoopSnake(
    StartingData=crv,
    Data=graft(crv_5),
    TerminationCondition=Slider(1, range=0..10),
    Hoopsnake_Data_autoUpdate=False,
    Hoopsnake_Data_dataLimit=2147483647,
    Hoopsnake_Data_delay=0,
    Hoopsnake_Data_resetCounter=True,
    Hoopsnake_Data_updateView=True)  # -> Feedback, CumulativeFeedback, LoopsCounter, IterationsCounter
explode = Explode(Curve=hs.Feedback, Recursive=True)  # -> Segments, Vertices
domain = Domain(explode.Segments)
panel_3 = Panel(domain)
eval = EvaluateCurve(Curve=reparameterize(explode.Segments), Parameter=Slider(0.5, range=0..1))  # -> Point, Tangent, Angle
panel_4 = Panel(eval.Point)
end = EndPoints(Curve=explode.Segments)  # -> Start, End
shift = ShiftList(List=eval.Point, Shift="-1", Wrap=True)
graft = GraftTree(Tree=end.Start, IncludeEmptyLists=True, IncludeNullItems=True)  # -> simplify(Tree)
graft_2 = GraftTree(Tree=eval.Point, IncludeEmptyLists=True, IncludeNullItems=True)  # -> simplify(Tree)
graft_3 = GraftTree(Tree=shift, IncludeEmptyLists=True, IncludeNullItems=True)  # -> simplify(Tree)
panel_5 = Panel(graft)
panel_6 = Panel(shift)
merge = Merge(Data1=graft, Data2=graft_2, Data3=graft_3, Data4=graft)
panel_7 = Panel(graft_2)
panel_8 = Panel(merge)
pline = PolyLine(Vertices=merge, Closed=False)
panel_9 = Panel(graft_3)
# Plug curve into
# D (Grafted) Hoopsnake
crv_5 = Curve(pline)
boundary = BoundarySurfaces(Edges=crv_5)  # disabled
explode_2 = Explode(Curve=hs_2.Feedback, Recursive=True)  # -> Segments, Vertices
domain_2 = Domain(explode_2.Segments)
panel_10 = Panel(domain_2)
eval_2 = EvaluateCurve(Curve=reparameterize(explode_2.Segments), Parameter=Slider(0.5, range=0..1))  # -> Point, Tangent, Angle
panel_11 = Panel(eval_2.Point)
end_2 = EndPoints(Curve=explode_2.Segments)  # -> Start, End
shift_2 = ShiftList(List=eval_2.Point, Shift="-1", Wrap=True)
graft_4 = GraftTree(Tree=end_2.Start, IncludeEmptyLists=True, IncludeNullItems=True)  # -> simplify(Tree)
graft_5 = GraftTree(Tree=eval_2.Point, IncludeEmptyLists=True, IncludeNullItems=True)  # -> simplify(Tree)
graft_6 = GraftTree(Tree=shift_2, IncludeEmptyLists=True, IncludeNullItems=True)  # -> simplify(Tree)
panel_12 = Panel(graft_4)
panel_13 = Panel(shift_2)
merge_2 = Merge(Data1=graft_4, Data2=graft_5, Data3=graft_6, Data4=graft_4)
panel_14 = Panel(graft_5)
panel_15 = Panel(merge_2)
pline_2 = PolyLine(Vertices=merge_2, Closed=False)
panel_16 = Panel(graft_6)
crv_6 = Curve(pline_2)
hs_2 = HoopSnake(
    StartingData=crv_2,
    Data=graft(crv_6),
    TerminationCondition=number_slider,
    Hoopsnake_Data_autoUpdate=False,
    Hoopsnake_Data_dataLimit=2147483647,
    Hoopsnake_Data_delay=0,
    Hoopsnake_Data_resetCounter=True,
    Hoopsnake_Data_updateView=True)  # -> Feedback, CumulativeFeedback, LoopsCounter, IterationsCounter
boundary_2 = BoundarySurfaces(Edges=crv_6)  # disabled
