# Grasshopper definition voxel-world.ghx (Grasshopper 1.0.7)
# plug-ins: VoxelTools

number_slider = Slider(64, range=0..256)
number_slider_2 = Slider(32, range=0..256)
number_slider_3 = Slider(64, range=0..256)
voxelterrain = CSharpScript(vx=number_slider_3, vy=number_slider, vz=number_slider_2, seed=Slider(4, range=0..1000))  # -> out, voxelCorners, voxelValues; inputs vx: Int32, vy: Int32, vz: Int32, seed: Int32
# ---------- voxelterrain: C# ----------
    Random rnd = new Random(seed);

    int[,,] blockTypes = new int[vx, vy, vz];

    // Block types:
    // 0 --> air
    // 1 --> dirt
    // 2 --> water
    // 3 --> coal
    // 4 --> grass
    // 5 --> sand
    // 6 --> stone
    // 7 --> diamonds

    double randXAmp = 28 + 8 * rnd.NextDouble();
    double randYAmp = 14 + 4 * rnd.NextDouble();
    double randXOff = 1000 * rnd.NextDouble();
    double randYOff = 1000 * rnd.NextDouble();

    for (int x = 0; x < vx; x++)
    {
      for (int y = 0; y < vy; y++)
      {
        for (int z = 0; z < vz; z++)
        {
          // Initialize to air
          int t = 0;

          // Should be dirt?
          double sineH = vz / 2 +
            2 * Math.Sin(x / randXAmp + randXOff) +
            3 * Math.Cos(y / randYAmp + randYOff);

          //          double sineH = vz / 2 +
          //            Math.Sin(5 * Math.Cos(2 * Math.Sin(x / 32.0) / 14)) +
          //            Math.Cos(4 * Math.Sin(3 * Math.Cos(y / 16.0) / 25));


          if (z <= sineH) t = 1;

          // Fill in with water
          if (z < vz / 2 && t == 0) t = 2;

          // Should this block be grass?
          int surfDepth = (int) Math.Ceiling(sineH - z);
          if (surfDepth == 1 && z + 1 >= vz / 2) t = 4;

          // Should this block be sand?
          if (surfDepth == 1 && z + 1 < vz / 2) t = 5;

          // Should this block be stone?
          double sineHStone = vz / 3.5 +
            2.1 * Math.Sin(x / 29.0) +
            2.9 * Math.Cos(y / 20.0);
          if (z < sineHStone) t = 6;


          // Should populate with minerals?
          if (t == 1 || t == 6)
          {
            // coal
            double r = rnd.NextDouble();
            if (r < (0.01 - (0.01 * z) / vz)) t = 3;

            // diamond
            r = rnd.NextDouble();
            if (r < (0.001 - (0.001 * z) / vz)) t = 7;
          }

          blockTypes[x, y, z] = t;
        }
      }
    }


    // Carve out some cavities
    int holeCount = rnd.Next(4);
    Print("Generating " + holeCount + " holes");

    for (int h = 0; h < holeCount; h++)
    {
      int hx = rnd.Next(0, vx);
      int hy = rnd.Next(0, vy);
      int hz = rnd.Next(0, vz / 2);
      double hr = vz / 2.0 * rnd.NextDouble();
      double hr2 = hr * hr;

      Print(hx + " " + hy + " " + hz + " " + hr);

      for (int x = 0; x < vx; x++)
      {
        double dx = x - hx;
        for (int y = 0; y < vy; y++)
        {
          double dy = y - hy;
          for (int z = 0; z < vz; z++)
          {
            double dz = z - hz;

            double d2 = dx * dx + dy * dy + dz * dz;
            if (d2 < hr2) blockTypes[x, y, z] = 0;
          }
        }
      }
    }

    // Propagate some waterfalls
    for (int x = 0; x < vx; x++)
    {
      for (int y = 0; y < vy; y++)
      {
        int surfZ = vz;
        int surfType = 0;

        // Find the first non-aair voxel
        while(surfType == 0 && surfZ > 0)
        {
          surfZ--;
          surfType = blockTypes[x, y, surfZ];
        }

        //        Print(x + " " + y + " " + surfZ + " type: " + surfType);

        // If found water, find the next non-water voxel
        if (surfType == 2)
        {
          while(surfType == 2 && surfZ > 0)
          {
            surfZ--;
            surfType = blockTypes[x, y, surfZ];
          }

          //          Print(x + " " + y + " " + surfZ + " type: " + surfType);

          // If we found air, change air to water until
          // we find non-air
          if (surfType == 0)
          {
            while(surfType == 0 && surfZ >= 0)
            {
              blockTypes[x, y, surfZ] = 2;
              surfZ--;
              if (surfZ < 0) break;
              surfType = blockTypes[x, y, surfZ];
            }
          }
        }


      }
    }



    // Flatten the integer list
    GH_Integer[] types = new GH_Integer[blockTypes.Length];
    int it = 0;
    for (int x = 0; x < vx; x++)
    {
      for (int y = 0; y < vy; y++)
      {
        for (int z = 0; z < vz; z++)
        {
          types[it++] = new GH_Integer(blockTypes[x, y, z]);
        }
      }
    }

    voxelValues = types;
# ---------- end voxelterrain ----------

box = DomainBox(Base=PlaneXY(0, 0, 0), X=number_slider_3, Y=number_slider, Z=number_slider_2)
voxcreate = CreateVoxelGrid(BoundingBox=box, SizeX="1", SizeY="1", SizeZ="1")

pt = Point(voxelterrain.voxelCorners)
panel = Panel(voxelterrain.out)

# ---- group: DIRT
equals = CSharpScript(A=voxelterrain.voxelValues, B="3")  # -> out, eq; inputs A: list, B: Int32
# ---------- equals: C# ----------
    var EQ = new GH_Boolean[A.Count];

    int it = 0;
    foreach (var a in A)
    {
      EQ[it++] = new GH_Boolean(((int)a) == B);
    }

    eq = EQ;
# ---------- end equals ----------
vglist = VoxelGridFromList(Grid=voxcreate, Bool=equals.eq)
material = CreateMaterial(Diffuse="black", Specular=RGB(255, 255, 255), Emission=RGB(0, 0, 0), Transparency=0, Shine=0)
preview = CustomPreview(Geometry=vglist, Material=material)

equals_2 = CSharpScript(A=voxelterrain.voxelValues, B="4")  # -> out, eq; inputs A: list, B: Int32; same code as equals
vglist_2 = VoxelGridFromList(Grid=voxcreate, Bool=equals_2.eq)
material_2 = CreateMaterial(Diffuse="green", Specular=RGB(255, 255, 255), Emission=RGB(0, 0, 0), Transparency=0, Shine=0)
preview_2 = CustomPreview(Geometry=vglist_2, Material=material_2)

equals_3 = CSharpScript(A=voxelterrain.voxelValues, B="1")  # -> out, eq; inputs A: list, B: Int32; same code as equals
vglist_3 = VoxelGridFromList(Grid=voxcreate, Bool=equals_3.eq)
material_3 = CreateMaterial(Diffuse="brown", Specular=RGB(255, 255, 255), Emission=RGB(0, 0, 0), Transparency=0, Shine=0)
preview_3 = CustomPreview(Geometry=vglist_3, Material=material_3)

equals_4 = CSharpScript(A=voxelterrain.voxelValues, B="5")  # -> out, eq; inputs A: list, B: Int32; same code as equals
vglist_4 = VoxelGridFromList(Grid=voxcreate, Bool=equals_4.eq)
material_4 = CreateMaterial(Diffuse="lemonchiffon", Specular=RGB(255, 255, 255), Emission=RGB(0, 0, 0), Transparency=0, Shine=0)
preview_4 = CustomPreview(Geometry=vglist_4, Material=material_4)

equals_5 = CSharpScript(A=voxelterrain.voxelValues, B="2")  # -> out, eq; inputs A: list, B: Int32; same code as equals
vglist_5 = VoxelGridFromList(Grid=voxcreate, Bool=equals_5.eq)
material_5 = CreateMaterial(Diffuse="blue", Specular=RGB(255, 255, 255), Emission=RGB(0, 0, 0), Transparency=Slider(0.25, range=0..1), Shine=0)
preview_5 = CustomPreview(Geometry=vglist_5, Material=material_5)

panel_2 = Panel("7")
material_6 = CreateMaterial(Diffuse="lightcyan", Specular=RGB(255, 255, 255), Emission=RGB(0, 0, 0), Transparency=0, Shine=0)

# ----
equals_6 = CSharpScript(A=voxelterrain.voxelValues, B=panel_2)  # -> out, eq; inputs A: list, B: Int32
# ---------- equals_6: C# ----------
    var EQ = new GH_Boolean[A.Count];

    int it = 0;
    foreach (var a in A)
    {
      EQ[it++] = new GH_Boolean(((int) a) == B);
    }

    eq = EQ;
# ---------- end equals_6 ----------

# ---- group: DIRT (continued)
vglist_6 = VoxelGridFromList(Grid=voxcreate, Bool=equals_6.eq)
preview_6 = CustomPreview(Geometry=vglist_6, Material=material_6)

panel_3 = Panel("6")
material_7 = CreateMaterial(Diffuse="gray", Specular=RGB(255, 255, 255), Emission=RGB(0, 0, 0), Transparency=0, Shine=0)

# ----
equals_7 = CSharpScript(A=voxelterrain.voxelValues, B=panel_3)  # -> out, eq; inputs A: list, B: Int32; same code as equals

# ---- group: DIRT (continued)
vglist_7 = VoxelGridFromList(Grid=voxcreate, Bool=equals_7.eq)
preview_7 = CustomPreview(Geometry=vglist_7, Material=material_7)
