# Grasshopper definition dalle-api.ghx (Grasshopper 1.0.7)
# plug-ins: jSwan, Firefly.X

# ----
# Dall-E-3 UPDATE!
panel = Panel("https://api.openai.com/v1/images/generations")
list = ValueList({"dall-e-2", "dall-e-3"}, selected="dall-e-3")
list_2 = ValueList({"256x256", "512x512", "1024x1024", "1792x1024", "1024x1792"}, selected="1792x1024")
list_3 = ValueList({"standard", "hd"}, selected="hd")
list_4 = ValueList({"natural", "vivid"}, selected="vivid")
panel_2 = Panel("an isometric view of a miniature city, tilt shift, bokeh, voxel, vray render, high detail")
int = Integer(Slider(1, range=0..10))
txt = Text(list_4)
txt_2 = Text(list)
txt_3 = Text(list_2)
txt_4 = Text(list_3)

# ----
# This example is part of the `Fun with Dall-E` video tutorial series at ParametricCamp:
# https://www.youtube.com/playlist?list=PLx3k0RGeXZ_zs3az0Z2BnpTIPH2lxQfFX
panel_3 = Panel("https://api.openai.com/v1/images/generations")
panel_4 = Panel("an isometric view of a miniature city, tilt shift, bokeh, voxel, vray render, high detail")
list_5 = ValueList({"256", "512", "1024"}, selected="256")
expression = Expression(x=list_5, Expression="Format(\"{0}x{0}\", x)")
int_2 = Integer(Slider(1, range=0..10))

list_6 = ValueList({"256", "512", "1024"}, selected="256")
panel_5 = Panel("an isometric view of a miniature city, tilt shift, bokeh, voxel, vray render, high detail")
expression_2 = Expression(x=list_6, Expression="Format(\"{0}x{0}\", x)")
int_3 = Integer(Slider(1, range=0..10))

openai_api_key = CSharpScript()  # -> out, key
# ---------- openai_api_key: C# ----------
    key = Environment.GetEnvironmentVariable("OPENAI_API_KEY");
# ---------- end openai_api_key ----------
openai_api_key_2 = CSharpScript()  # -> out, key; same code as openai_api_key
openai_api_key_3 = CSharpScript()  # -> out, key; same code as openai_api_key
rejson = SerializeJson(
    Prompt=panel_2,
    Model=txt_2,
    N=int,
    Size=txt_3,
    Quality=txt_4,
    Data6=txt,
    Response_format="b64_json",
    IncludeNullAndEmptyProperties=False)
panel_6 = Panel([panel_4, int_2, expression, "url"])
panel_7 = Panel([panel_5, int_3, expression_2, "b64_json"])
panel_8 = Panel(rejson)
rejson_2 = SerializeJson(Prompt=panel_4, N=int_2, Size=expression, Response_format="url", IncludeNullAndEmptyProperties=False)
rejson_3 = SerializeJson(Prompt=panel_5, N=int_3, Size=expression_2, Response_format="b64_json", IncludeNullAndEmptyProperties=False)
dalle_req = CSharpScript(url=panel, bearerToken=openai_api_key.key, body=rejson)  # -> out, response; inputs url: String, bearerToken: String, body: String; disabled
# ---------- dalle_req: C# usings ----------
using System.Net;   // for requests
using System.Text;  // for class Encoding
using System.IO;    // for StreamReader
# ---------- dalle_req: C# ----------
    if (url == null) return;

    var data = Encoding.ASCII.GetBytes(body);

    var request = (HttpWebRequest) WebRequest.Create(url);
    request.Method = "POST";
    request.ContentType = "application/json";
    request.ContentLength = body.Length;

    // If required by the server, set the credentials.
    if (bearerToken.Length > 0)
    {
      System.Net.ServicePointManager.Expect100Continue = true;
      System.Net.ServicePointManager.SecurityProtocol = System.Net.SecurityProtocolType.Tls12; //the auth type

      request.PreAuthenticate = true;
      request.Headers.Add("Authorization", "Bearer " + bearerToken);
    }
    else
    {
      request.Credentials = System.Net.CredentialCache.DefaultCredentials;
    }

    using (var stream = request.GetRequestStream())
    {
      stream.Write(data, 0, data.Length);
    }

    var res = (HttpWebResponse) request.GetResponse();

    var responseString = new StreamReader(res.GetResponseStream()).ReadToEnd();

    response = responseString;
# ---------- end dalle_req ----------
dalle_req_2 = CSharpScript(url=panel_3, bearerToken=openai_api_key_2.key, body=rejson_2)  # -> out, response; inputs url: String, bearerToken: String, body: String; disabled; same code as dalle_req
dalle_req_3 = CSharpScript(url="https://api.openai.com/v1/images/generations", bearerToken=openai_api_key_3.key, body=rejson_3)  # -> out, response; inputs url: String, bearerToken: String, body: String; disabled; same code as dalle_req
panel_9 = Panel(rejson_2)
panel_10 = Panel(rejson_3)
dejson = DeserializeJson(JSON=dalle_req.response, OutputsLocked=False)  # -> Created, Data
dejson_2 = DeserializeJson(JSON=dalle_req_2.response, OutputsLocked=False)  # -> Created, Data
dejson_3 = DeserializeJson(JSON=dalle_req_3.response, OutputsLocked=False)  # -> Created, Data
dejson_4 = DeserializeJson(JSON=dejson.Data, OutputsLocked=False)  # -> B64_json, Revised_prompt
dejson_5 = DeserializeJson(JSON=dejson_2.Data, OutputsLocked=False)
panel_11 = Panel(dejson_5)
ghfilepath = CSharpScript()  # -> out, doc_folder, doc_name, doc_ext
# ---------- ghfilepath: C# usings ----------
using System.IO;
# ---------- ghfilepath: C# ----------
    string targetFolder = "";
    string targetFileName = "";
    string targetFileExt = "";

    GH_Document gh_d = owner.OnPingDocument();
    if (gh_d.IsFilePathDefined)
    {
      string ghFilePath = gh_d.FilePath;
      targetFolder = Path.GetDirectoryName(ghFilePath);
      targetFileName = Path.GetFileNameWithoutExtension(ghFilePath);
      targetFileExt = Path.GetExtension(ghFilePath);
      Print(ghFilePath);
    }
    else
    {
      Print("No local folder found, please save your file first.");
    }

    doc_folder = targetFolder;
    doc_name = targetFileName;
    doc_ext = targetFileExt;
# ---------- end ghfilepath ----------
dejson_6 = DeserializeJson(JSON=dejson_3.Data, OutputsLocked=False)
decode = DecodeBase64ToFireflyBitmap(Base64=dejson_4.B64_json)
decode_2 = DecodeBase64ToFireflyBitmap(Base64=dejson_6)
painter = BitmapPainter(BitmapToPaint=decode)
save_bitmap = SaveBitmap(FireflyBitmap=decode, FileDirectory=ghfilepath.doc_folder, FileName="dalle-image.png")
painter_2 = BitmapPainter(BitmapToPaint=decode_2)
