# Grasshopper definition ollama-api.ghx (Grasshopper 1.0.8)
# plug-ins: jSwan, RhinoCodePluginGH

panel = Panel("Can you explain to me what the cross product of two vectors is?")
panel_2 = Panel("deepseek-r1:8b")

rejson = SerializeJson(Model="llama3.2:latest", Prompt=panel, Data3=Toggle(False), IncludeNullAndEmptyProperties=False)
panel_3 = Panel(rejson)
http_post = CSharpScript(url="http://localhost:11434/api/generate")  # -> out, response; inputs url: String, body: String
# ---------- http_post: C# ----------
// Grasshopper Script Instance
#region Usings
using System;
using System.Linq;
using System.Collections;
using System.Collections.Generic;
using System.Drawing;

using System.Net;   // for requests
using System.Text;  // for class Encoding
using System.IO;    // for StreamReader

using Rhino;
using Rhino.Geometry;

using Grasshopper;
using Grasshopper.Kernel;
using Grasshopper.Kernel.Data;
using Grasshopper.Kernel.Types;
#endregion

public class Script_Instance : GH_ScriptInstance
{
    #region Notes
    /* 
      Members:
        RhinoDoc RhinoDocument
        GH_Document GrasshopperDocument
        IGH_Component Component
        int Iteration

      Methods (Virtual & overridable):
        Print(string text)
        Print(string format, params object[] args)
        Reflect(object obj)
        Reflect(object obj, string method_name)
    */
    #endregion

    private void RunScript(string url, string body, ref object response)
    {
        if (url == null) return;

        var data = Encoding.ASCII.GetBytes(body);

        var request = (HttpWebRequest) WebRequest.Create(url);
        request.Method = "POST";
        request.ContentType = "application/json";
        request.ContentLength = body.Length;
        request.Credentials = System.Net.CredentialCache.DefaultCredentials;


        using (var stream = request.GetRequestStream())
        {
            stream.Write(data, 0, data.Length);
        }

        var res = (HttpWebResponse) request.GetResponse();

        var responseString = new StreamReader(res.GetResponseStream()).ReadToEnd();

        response = responseString;
    }
}
# ---------- end http_post ----------
dejson = DeserializeJson(JSON=http_post.response, OutputsLocked=False)  # -> Model, Created_at, Response, Done, Done_reason, Context, Total_duration, Load_duration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
panel_4 = Panel(http_post.response)
panel_5 = Panel(dejson.Response)
