# Grasshopper definition GameOfLife_p1_200419_WK.gh (Grasshopper 1.0.7)

# ---- group: Grid Parameters
# GEOMETRY GEMS
# Game of Life
# By John Horton Conway
# 01
# Part 1
# Jose Luis García del Castillo y López
# Cleaned by: Wojciech Karnowka
number_slider = Slider(50, range=0..100)
number_slider_2 = Slider(40, range=0..100)

# ---- group: Simulation parameters
birthrule = Panel("3")
survivalrule = Panel("""2
3""")

# ---- group: Activation
run = BooleanToggle(True)
reset = Button()

# ---- group: Boundary Curve
crv = Curve(<curve referenced from the Rhino model>)

# ---- group: Points Grid
sqgrid = Square(Plane=PlaneXY(0, 0, 0), Size=1, ExtentX=number_slider, ExtentY=number_slider_2)  # -> Cells, Points

# ---- group: Cells
rec = Rectangle(sqgrid.Cells)

# ---- group: Points
pt = Point(sqgrid.Points)

# ---- group: Curve inclusion test
area = Area(Geometry=rec)  # -> Area, Centroid
point_containment = Panel("2")
incurve = PointInCurve(Point=area.Centroid, Curve=crv)  # -> Relationship, Point
equals = Equality(FirstNumber=incurve.Relationship, SecondNumber=point_containment)  # -> Equality, Inequality
flatten = FlattenTree(Tree=equals.Equality, Path="{0}")

# ---- group: Simulation
c_script = CSharpScript(
    cells=flatten,
    rows=number_slider_2,
    columns=number_slider,
    birthRule=birthrule,
    survivalRule=survivalrule,
    run=run,
    reset=reset)  # -> out, previous, newIteration, A, B; inputs cells: list of Boolean, rows: Int32, columns: Int32, birthRule: list of Int32, survivalRule: list of Int32, run: Boolean, reset: Boolean
# ---------- c_script: C# ----------
    // Sanity
    if (run == false) {
      return;
    }

    if (cells.Count != rows * columns) {
      Component.AddRuntimeMessage(GH_RuntimeMessageLevel.Error, "Something weird with dimensions of the grid");
      return;
    }

    // Initialize calculations
    if (reset == true) {
      // Turn the list into a 2D array
      prevCells = new bool[columns, rows];
      int it = 0;
      for (int j = 0; j < columns; j++) {
        for (int i = 0; i < rows; i++) {
          prevCells[j, i] = cells[it];
          it++;
        }
      }
    }

    // New array of alive/dead cells for next iteration
    int[,] nCount = new int[columns, rows];

    // Switch previous cells with new ones
    bool[,] newCells = new bool[columns, rows];

    for (int j = 0; j < columns; j++) {
      for (int i = 0; i < rows; i++) {

        // Compute alive neighbors
        int aliveNeighbors = 0;
        int ni, nj;

        // Topleft
        ni = i + 1;
        nj = j - 1;
        if (ni > rows - 1) ni = 0;
        else if (ni < 0) ni = rows - 1;
        if (nj > columns - 1) nj = 0;
        else if (nj < 0 ) nj = columns - 1;
        if (prevCells[nj, ni] == true) aliveNeighbors++;

        // Top
        ni = i + 1;
        nj = j;
        if (ni > rows - 1) ni = 0;
        else if (ni < 0) ni = rows - 1;
        if (nj > columns - 1) nj = 0;
        else if (nj < 0 ) nj = columns - 1;
        if (prevCells[nj, ni] == true) aliveNeighbors++;

        // TopRight
        ni = i + 1;
        nj = j + 1;
        if (ni > rows - 1) ni = 0;
        else if (ni < 0) ni = rows - 1;
        if (nj > columns - 1) nj = 0;
        else if (nj < 0 ) nj = columns - 1;
        if (prevCells[nj, ni] == true) aliveNeighbors++;

        // Left
        ni = i;
        nj = j - 1;
        if (ni > rows - 1) ni = 0;
        else if (ni < 0) ni = rows - 1;
        if (nj > columns - 1) nj = 0;
        else if (nj < 0 ) nj = columns - 1;
        if (prevCells[nj, ni] == true) aliveNeighbors++;

        // Right
        ni = i;
        nj = j + 1;
        if (ni > rows - 1) ni = 0;
        else if (ni < 0) ni = rows - 1;
        if (nj > columns - 1) nj = 0;
        else if (nj < 0 ) nj = columns - 1;
        if (prevCells[nj, ni] == true) aliveNeighbors++;

        // Bottomleft
        ni = i - 1;
        nj = j - 1;
        if (ni > rows - 1) ni = 0;
        else if (ni < 0) ni = rows - 1;
        if (nj > columns - 1) nj = 0;
        else if (nj < 0 ) nj = columns - 1;
        if (prevCells[nj, ni] == true) aliveNeighbors++;

        // Bottom
        ni = i - 1;
        nj = j;
        if (ni > rows - 1) ni = 0;
        else if (ni < 0) ni = rows - 1;
        if (nj > columns - 1) nj = 0;
        else if (nj < 0 ) nj = columns - 1;
        if (prevCells[nj, ni] == true) aliveNeighbors++;

        // Bottomright
        ni = i - 1;
        nj = j + 1;
        if (ni > rows - 1) ni = 0;
        else if (ni < 0) ni = rows - 1;
        if (nj > columns - 1) nj = 0;
        else if (nj < 0 ) nj = columns - 1;
        if (prevCells[nj, ni] == true) aliveNeighbors++;

        nCount[j, i] = aliveNeighbors;

        //Print("Alive neighbours: " + aliveNeighbors);

        // Compute new state
        bool prevState = prevCells[j, i];
        bool newState = false;

        // If cell was dead
        if (prevState == false) {
          foreach (int b in birthRule) {
            if (b == aliveNeighbors) {
              newState = true;
              break;
            }
          }
        }
          // If cell was alive
        else {
          foreach (int s in survivalRule) {
            if (s == aliveNeighbors) {
              newState = true;
              break;
            }
          }
        }

        // Store new state in new array
        newCells[j, i] = newState;

      }
    }

    // Output
    previous = prevCells;
    newIteration = newCells;
    A = nCount;

    // Store newCells for next iteration
    prevCells = newCells;
# ---------- c_script: C# additional code ----------
  // Create persistent variables
  bool[,] prevCells;
# ---------- end c_script ----------

# ---- group: Active cells / Cells
rec_2 = Rectangle(rec)

# ---- group: Active cells
flatten_2 = FlattenTree(Tree=rec_2, Path="{0}")
cull = CullPattern(List=flatten_2, CullPattern=c_script.newIteration)
boundary = BoundarySurfaces(Edges=cull)

# ---- group: Generated Surfaces
srf = Surface(boundary)

# ---- group: Preview geometry
material = CreateMaterial(Diffuse="gray", Specular=RGB(255, 255, 255), Emission=RGB(0, 0, 0), Transparency=0, Shine=0)
preview = CustomPreview(Geometry=srf, Material=material)
