# Grasshopper definition GameOfLife_p3_200419_WK.gh (Grasshopper 1.0.7)

# ---- group: Simulation parameters
birthrule = Panel("3")
survivalrule = Panel("""2
3""")

# ---- group: Activation
run = BooleanToggle(True)
reset = Button()
timer = Timer(TimerInterval=20, Target=c_script)

# ---- group: Domain Division Parameters
# GEOMETRY GEMS
# Game of Life
# By John Horton Conway
# 01
# Part 3
# Jose Luis García del Castillo y López
# Cleaned by: Wojciech Karnowka
number_slider = Slider(50, range=0..100)
number_slider_2 = Slider(50, range=0..100)

# ---- group: Boundary Sphere
brep = Brep(<brep referenced from the Rhino model>)

# ---- group: Base surface
srf = Surface(<surface referenced from the Rhino model>)

# ---- group: Domain division
divide = DivideDomain²(Domain=srf, UCount=number_slider, VCount=number_slider_2)

# ---- group: Cell domains
domain² = Domain²(divide)

# ---- group: Divide surface
partition = PartitionList(List=domain², Size=number_slider)
subsrf = Isotrim(Surface=srf, Domain=partition)

# ---- group: Cells
srf_2 = Surface(subsrf)

# ---- group: Curve inclusion test
area = Area(Geometry=srf_2)  # -> Area, Centroid
brepinc = PointInBrep(Brep=brep, Point=area.Centroid, Strict=False)

# ---- group: Simulation
c_script = CSharpScript(cells=brepinc, birthRule=birthrule, survivalRule=survivalrule, run=run, reset=reset)  # -> out, newIteration; inputs cells: tree of Boolean, birthRule: list of Int32, survivalRule: list of Int32, run: Boolean, reset: Boolean
# ---------- c_script: C# ----------
    // Sanity
    if (run == false) {
      return;
    }

    // Compute number of rows and columns
    int rows = 0;
    int columns = cells.BranchCount;
    rows = cells.Branches[0].Count;  // num of elements in first branch
    foreach (var branch in cells.Branches) {
      if (branch.Count != rows) {
        Component.AddRuntimeMessage(GH_RuntimeMessageLevel.Error, "Not a square grid");
        return;
      }
    }
    Print("Columns: " + columns + ", rows: " + rows);

    // Is it necessary to perform calculation
    bool performIteration = true;
    if (reset) {
      performIteration = false;
      didJustReset = true;
    }
    else if (didJustReset) {
      didJustReset = false;
      performIteration = false;
    }

    // If no calculation, then output input data
    if (!performIteration) {
      // Store data for next iteration
      prevCells = new bool[columns, rows];
      for (int j = 0; j < cells.BranchCount; j++) {
        var branch = cells.Branches[j];
        for (int i = 0; i < branch.Count; i++) {
          bool val = branch[i];
          prevCells[j, i] = val;
        }
      }

      // Output input data with no changes
      newIteration = cells;

      return;
    }


    // Convert DataTree to 2D Array
    bool[,] inputCells = new bool[columns, rows];
    for (int j = 0; j < cells.BranchCount; j++) {
      var branch = cells.Branches[j];
      for (int i = 0; i < branch.Count; i++) {
        bool val = branch[i];
        inputCells[j, i] = val;
      }
    }

    // New array of alive/dead cells for next iteration
    int[,] nCount = new int[columns, rows];

    // Switch previous cells with new ones
    bool[,] newCells = new bool[columns, rows];

    for (int j = 0; j < columns; j++) {
      for (int i = 0; i < rows; i++) {

        // Compute alive neighbors
        int aliveNeighbors = 0;
        int ni, nj;

        // Topleft
        ni = i + 1;
        nj = j - 1;
        if (ni > rows - 1) ni = 0;
        else if (ni < 0) ni = rows - 1;
        if (nj > columns - 1) nj = 0;
        else if (nj < 0 ) nj = columns - 1;
        if (prevCells[nj, ni] == true) aliveNeighbors++;

        // Top
        ni = i + 1;
        nj = j;
        if (ni > rows - 1) ni = 0;
        else if (ni < 0) ni = rows - 1;
        if (nj > columns - 1) nj = 0;
        else if (nj < 0 ) nj = columns - 1;
        if (prevCells[nj, ni] == true) aliveNeighbors++;

        // TopRight
        ni = i + 1;
        nj = j + 1;
        if (ni > rows - 1) ni = 0;
        else if (ni < 0) ni = rows - 1;
        if (nj > columns - 1) nj = 0;
        else if (nj < 0 ) nj = columns - 1;
        if (prevCells[nj, ni] == true) aliveNeighbors++;

        // Left
        ni = i;
        nj = j - 1;
        if (ni > rows - 1) ni = 0;
        else if (ni < 0) ni = rows - 1;
        if (nj > columns - 1) nj = 0;
        else if (nj < 0 ) nj = columns - 1;
        if (prevCells[nj, ni] == true) aliveNeighbors++;

        // Right
        ni = i;
        nj = j + 1;
        if (ni > rows - 1) ni = 0;
        else if (ni < 0) ni = rows - 1;
        if (nj > columns - 1) nj = 0;
        else if (nj < 0 ) nj = columns - 1;
        if (prevCells[nj, ni] == true) aliveNeighbors++;

        // Bottomleft
        ni = i - 1;
        nj = j - 1;
        if (ni > rows - 1) ni = 0;
        else if (ni < 0) ni = rows - 1;
        if (nj > columns - 1) nj = 0;
        else if (nj < 0 ) nj = columns - 1;
        if (prevCells[nj, ni] == true) aliveNeighbors++;

        // Bottom
        ni = i - 1;
        nj = j;
        if (ni > rows - 1) ni = 0;
        else if (ni < 0) ni = rows - 1;
        if (nj > columns - 1) nj = 0;
        else if (nj < 0 ) nj = columns - 1;
        if (prevCells[nj, ni] == true) aliveNeighbors++;

        // Bottomright
        ni = i - 1;
        nj = j + 1;
        if (ni > rows - 1) ni = 0;
        else if (ni < 0) ni = rows - 1;
        if (nj > columns - 1) nj = 0;
        else if (nj < 0 ) nj = columns - 1;
        if (prevCells[nj, ni] == true) aliveNeighbors++;

        nCount[j, i] = aliveNeighbors;

        //Print("Alive neighbours: " + aliveNeighbors);

        // Compute new state
        bool prevState = prevCells[j, i];
        bool newState = false;

        // If cell was dead
        if (prevState == false) {
          foreach (int b in birthRule) {
            if (b == aliveNeighbors) {
              newState = true;
              break;
            }
          }
        }
          // If cell was alive
        else {
          foreach (int s in survivalRule) {
            if (s == aliveNeighbors) {
              newState = true;
              break;
            }
          }
        }

        // Store new state in new array
        newCells[j, i] = newState;

      }
    }

    // Switch back from 2D array to Datatree
    DataTree<bool> newCellsTree = new DataTree<bool>();
    for (int j = 0; j < columns; j++) {
      GH_Path path = cells.Paths[j];

      for (int i = 0; i < rows; i++) {
        bool val = newCells[j, i];
        newCellsTree.Add(val, path);
      }
    }

    // Output
    newIteration = newCellsTree;


    // Save newCells for next iteration
    prevCells = newCells;
# ---------- c_script: C# additional code ----------
  // Create persistent variables
  bool[,] prevCells;

  bool didJustReset = false;
# ---------- end c_script ----------

# ---- group: Active cells / Cells
srf_3 = Surface(subsrf)

# ---- group: Active cells
cull = CullPattern(List=srf_3, CullPattern=c_script.newIteration)

# ---- group: Active Cells
srf_4 = Surface(cull)

# ---- group: Base surface - Preview geometry
Z = UnitZ(Factor="-.1")
material = CreateMaterial(Diffuse="gray", Specular=RGB(255, 255, 255), Emission=RGB(0, 0, 0), Transparency=".5", Shine=0)
move = Move(Geometry=srf, Motion=Z)  # -> Geometry, Transform
preview = CustomPreview(Geometry=move.Geometry, Material=material)

# ---- group: Active Cells - Preview geometry
material_2 = CreateMaterial(Diffuse="gray", Specular=RGB(255, 255, 255), Emission=RGB(0, 0, 0), Transparency=0, Shine=0)
preview_2 = CustomPreview(Geometry=srf_4, Material=material_2)
