# Grasshopper definition GameOFLife3D.gh (Grasshopper 1.0.7)

# ---- group: Sphere parameters
# Geometry Gems
# Game of Life 3D
# By John Conway
# 01
# Extended
# Jose Luis García del Castillo y López
# Extended By Hariprasath Loganathan
sphere_radius = Slider(20, range=0..100)
panel = Panel("10")
panel_2 = Panel("20")

# ----
grid_spacing = Slider(100, range=0..200)
boundary_soild = Brep(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)

# ---- group: Grid Parameters
number_of_cells = Slider(15, range=0..20)

# ---- group: Born & Survive Rule
born_if_given_number_of_neibhours_are_tr = Panel("4")  # "Born if given number of neibhours are true"
survive_if_given_number_of_neibhours_are = Panel("""4
15
26""")  # "Survive if given number of neibhours are true"

# ---- group: Activate
run = BooleanToggle(True)
reset = BooleanToggle(True)
timer = Timer(TimerInterval=20, Target=c_script)  # disabled

# ---- group: Box spacing
rectangle = Rectangle(Plane=PlaneXY(0, 0, 0), XSize=grid_spacing, YSize=grid_spacing, Radius=0)  # -> Rectangle, Length
box_rectangle = BoxRectangle(Rectangle=rectangle.Rectangle, Height=grid_spacing)

# ---- group: Base shape
# Mesh Sphere will improve computational speed
mesh_sphere = MeshSphere(Base=PlaneXY(0, 0, 0), Radius=sphere_radius, UCount=panel, VCount=panel_2)

# ---- group: Grid of spheres
box_array = BoxArray(Geometry=mesh_sphere, Cell=box_rectangle, XCount=number_of_cells, YCount=number_of_cells, ZCount=number_of_cells)  # -> Geometry, Transform

# ---- group: Test whether sphere centroid is inside Boundary solid
volume = Volume(Geometry=box_array.Geometry)  # -> Volume, Centroid
brepinc = PointInBrep(Brep=boundary_soild, Point=volume.Centroid, Strict=False)

# ---- group: X, Y & Z Count
number = Number(number_of_cells)
number_2 = Number(number_of_cells)
number_3 = Number(number_of_cells)

# ----
list_of_booleans = Boolean(brepinc)
c_script = CSharpScript(
    cells=list_of_booleans,
    xDir=number_2,
    yDir=number,
    zDir=number_3,
    birthRule=born_if_given_number_of_neibhours_are_tr,
    survivalRule=survive_if_given_number_of_neibhours_are,
    run=run,
    reset=reset)  # -> out, previous, newIteration, A; inputs cells: list of Boolean, xDir: Int32, yDir: Int32, zDir: Int32, birthRule: list of Int32, survivalRule: list of Int32, run: Boolean, reset: Boolean
# ---------- c_script: C# ----------
    // Sanity check
    if (run == false) {
      return;
    }

    // Check if number of Boxes are equal to cells count
    if (cells.Count != xDir * yDir * zDir) {
      Component.AddRuntimeMessage(GH_RuntimeMessageLevel.Error, "Something weird with dimensions of the grid");
      return;
    }
    // Figure out if I need to perform calculations or not
    bool performIteration = true;
    if (reset) {
      performIteration = false;
      didJustReset = true;
    }
    else if (didJustReset) {
      didJustReset = false;
      performIteration = false;
    }

    // If no calculation, then exit with input data
    if (!performIteration) {
      // Turn the list into a 3D array
      prevCells = new bool[zDir, yDir, xDir];
      int it = 0;
      for(int k = 0;k < zDir;k++){
        for (int j = 0; j < yDir; j++) {
          for (int i = 0; i < xDir; i++) {
            prevCells[k, j, i] = cells[it];
            it++;
          }
        }
      }
      // Output input data with no changes
      newIteration = cells;

      return;
    }
    // Initialize calculations
    if (reset) {
      // Turn the list into a 3D array
      prevCells = new bool[zDir, yDir, xDir];
      int it = 0;
      for(int k = 0;k < zDir;k++){
        for (int j = 0; j < yDir; j++) {
          for (int i = 0; i < xDir; i++) {
            prevCells[k, j, i] = cells[it];
            it++;
          }
        }
      }
    }
    // Initialize nCount to store number of neighbour boxes alive
    int[,,] nCount = new int[zDir, yDir, xDir];

    // Switch previous cells with new ones
    bool[,,] newCells = new bool[zDir, yDir, xDir];
    for (int k = 0; k < zDir; k++) {
      for (int j = 0; j < yDir; j++) {
        for (int i = 0; i < xDir; i++) {
          // Initialize alive neighbours to store number
          // of neighbour boxes alive for each iteration
          int aliveNeighbors = 0;
          // Initialize ni, nj & nk to get neighbour boxes' index in the 3D array
          int ni, nj,nk;
          // Loop thru all the neighbour boxes and increment alive Neighbours
          // if the neighbour box is alive
          for (int l = -1; l < 2; l++) {
            for(int m = -1; m < 2; m++) {
              for(int n = -1;n < 2;n++) {
                // Skip the iteration if ni, nj & nk represents its very own box
                if(l == 0 && m == 0 & n == 0) continue;
                ni = i + n;
                nj = j + m;
                nk = k + l;
                // Check if index is out of range
                CheckBoundary(ref ni, xDir);
                CheckBoundary(ref nj, yDir);
                CheckBoundary(ref nk, zDir);
                if (prevCells[nk, nj, ni] == true) aliveNeighbors++;
              }
            }
          }
          nCount[k, j, i] = aliveNeighbors;
          // Compute new state
          bool prevState = prevCells[k, j, i];
          bool newState = false;

          // If cell was dead
          if (prevState == false) {
            foreach (int b in birthRule) {
              if (b == aliveNeighbors) {
                newState = true;
                break;
              }
            }
          }
            // If cell was alive
          else {
            foreach (int s in survivalRule) {
              if (s == aliveNeighbors) {
                newState = true;
                break;
              }
            }
          }
          // Store new state in new array
          newCells[k, j, i] = newState;
        }
      }
    }

    // Output
    previous = prevCells;
    newIteration = newCells;
    A = nCount;
    // Store newCells for next iteration
    prevCells = newCells;
# ---------- c_script: C# additional code ----------
  //Function to check if index is out of range
  private void CheckBoundary(ref int index, int limit)
  {
    if (index > limit - 1) index = 0;
    else if (index < 0) index = limit - 1;
  }

  // Create persistent variables
  bool[,,] prevCells;
  bool didJustReset = false;
# ---------- end c_script ----------
list_of_spheres = Geometry(box_array.Geometry)

# ---- group: Cull spheres from new list of booleans
cull = CullPattern(List=list_of_spheres, CullPattern=c_script.newIteration)

# ---- group: Calculate distance from brep to each sphere and convert to colour gradient
volume_2 = Volume(Geometry=boundary_soild)  # -> Volume, Centroid
volume_3 = Volume(Geometry=cull)  # -> Volume, Centroid
distance = Distance(PointA=volume_2.Centroid, PointB=volume_3.Centroid)
bounds = Bounds(Numbers=distance)
deconstruct_domain = DeconstructDomain(Domain=bounds)  # -> Start, End
gradient = Gradient(
    LowerLimit=deconstruct_domain.Start,
    UpperLimit=deconstruct_domain.End,
    Parameter=distance,
    stops=[0: RGB(243, 57, 0), 0.1: RGB(236, 27, 60), 0.2: RGB(210, 0, 118), 0.3: RGB(103, 0, 120), 0.4: RGB(39, 72, 161), 0.5: RGB(1, 192, 229), 0.6: RGB(18, 178, 90), 0.7: RGB(79, 186, 8), 0.8: RGB(220, 237, 32), 0.9: RGB(247, 159, 20), 1: RGB(243, 57, 0)])

# ---- group: Preview geometry
custom_preview = CustomPreview(Geometry=cull, Material=gradient)
