# Grasshopper definition Geometry Gems #2 Point to Line Distance.gh (Grasshopper 1.0.7)

pt = Point(<point referenced from the Rhino model>)
# GEOMETRY GEMS SERIES
# 02
# Point to Line Distance
# Part 1/1
# By Jose Luis García del Castillo y López @ ParametricCamp
# Video: https://youtu.be/tAWdhUdU8r4
pt_2 = Point(<point referenced from the Rhino model>)
pt_3 = Point(<point referenced from the Rhino model>)

ln = Line(StartPoint=pt, EndPoint=pt_3)
crv_cp = CurveClosestPoint(Point=pt_2, Curve=ln)  # -> Point, Parameter, Distance
panel = Panel(crv_cp.Distance)

c_script = CSharpScript(P=pt_2, A=pt, B=pt_3)  # -> out, DDot, DCross; inputs P: Point3d, A: Point3d, B: Point3d
# ---------- c_script: C# ----------
    DDot = distToLineDotProduct(P, A, B);

    DCross = distToLineCrossProduct(P, A, B);
# ---------- c_script: C# additional code ----------
  double distToLineDotProduct(Point3d P, Point3d A, Point3d B) {
    Vector3d AB = B - A;
    AB.Unitize();
    Vector3d AP = P - A;

    double dot = dotProduct(AP, AB);  // length fo the projection of AP over AB
    double lengthAP = AP.Length;

    double h = Math.Sqrt(lengthAP * lengthAP - (dot * dot));

    return h;
  }

  double distToLineCrossProduct(Point3d P, Point3d A, Point3d B) {
    Vector3d AB = B - A;
    Vector3d AP = P - A;

    Vector3d cross = crossProduct(AB, AP);
    double lengthCross = cross.Length;
    double lengthAB = AB.Length;

    double h = lengthCross / lengthAB;

    return h;
  }

  double dotProduct(Vector3d u, Vector3d v) {
    return u.X * v.X + u.Y * v.Y + u.Z * v.Z;
  }

  Vector3d crossProduct(Vector3d u, Vector3d v) {
    double x = u.Y * v.Z - u.Z * v.Y;
    double y = u.Z * v.X - u.X * v.Z;
    double z = u.X * v.Y - u.Y * v.X;

    return new Vector3d(x, y, z);
  }
# ---------- end c_script ----------
panel_2 = Panel([c_script.DDot, c_script.DCross])
