# Grasshopper definition 02_Ramer-Douglas-Peucker_p1_200508_HP.gh (Grasshopper 1.0.7)

# ----
# Geometry Gems
# 03
# Ramer–Douglas–Peucker algorithm
# Part 1
# By Jose Luis García del Castillo y López
# Cleaned by: Hariprasath Loganathan
# Drawn by: VictorLin
pt = Point(Point(31.14576203, 30.01014633, 10.96795342))
pt_2 = Point(Point(38.01091009, 35.25994631, 9.730265833))
pt_3 = Point(Point(25.79752538, 20.58105022, 0))

ln = Line(StartPoint=pt_2, EndPoint=pt_3)

c_script = CSharpScript(P=pt, A=pt_2, B=pt_3)  # -> out, DDot, DCross; inputs P: Point3d, A: Point3d, B: Point3d
# ---------- c_script: C# ----------
    // Method I
    // Call distToLineDotProduct function and assign the result to output
    DDot = distToLineDotProduct(P, A, B);
    // Method II
    // Call distToLineCrossProduct function and assign the result to output
    DCross = distToLineCrossProduct(P, A, B);
# ---------- c_script: C# additional code ----------
  double distToLineDotProduct(Point3d P, Point3d A, Point3d B) {
    // Create a vector from two points A & B and assign it to AB vector
    Vector3d AB = B - A;
    // Unitize AB vector
    AB.Unitize();
    // Create a vector from two points A & P and assign it to AP vector
    Vector3d AP = P - A;
    // Refer method I diagrams in GH for formulation
    // Calculate dot product by calling dotProduct function and assign it to dot
    double dot = dotProduct(AP, AB);
    // Get the length of AP vector from vector property and assign it to lengthAP
    double lengthAP = AP.Length;
    // Use the formula derived in method I to get the distance to line
    // h= sqrt( |AP|² - (AP * AB)² )
    double h = Math.Sqrt(lengthAP * lengthAP - (dot * dot));
    // return the value of h
    return h;
  }

  double distToLineCrossProduct(Point3d P, Point3d A, Point3d B) {
    // Create a vector from two points A & B and assign it to AB vector
    Vector3d AB = B - A;
    // Create a vector from two points A & P and assign it to AP vector
    Vector3d AP = P - A;
    // Refer method II diagrams in GH for formulation
    // Calculate cross product by calling crossProduct function and assign it to cross
    Vector3d cross = crossProduct(AB, AP);
    // Get the length of cross vector from vector property and assign it to lengthCross
    double lengthCross = cross.Length;
    // Get the length of AB vector from vector property and assign it to lengthAB
    double lengthAB = AB.Length;
    // Use the formula derived in method II to get the distance to line
    // h = | AB * AP | / |AB|
    double h = lengthCross / lengthAB;
    // return the value of h
    return h;
  }

  double dotProduct(Vector3d u, Vector3d v) {
    // Calculate the dot product of two vectors and return it
    return u.X * v.X + u.Y * v.Y + u.Z * v.Z;
  }

  Vector3d crossProduct(Vector3d u, Vector3d v) {
    // Calculate the cross product of two vectors and assign each components to x, y & z respectively
    double x = u.Y * v.Z - u.Z * v.Y;
    double y = u.Z * v.X - u.X * v.Z;
    double z = u.X * v.Y - u.Y * v.X;
    // Create a new vector with x, y & z components and return it
    return new Vector3d(x, y, z);
  }
# ---------- end c_script ----------
crv_cp = CurveClosestPoint(Point=pt, Curve=ln)  # -> Point, Parameter, Distance
# Method 1
# Dot product
# L = AP * AB
# h= sqrt( |AP|² - L²) = sqrt( |AP|² - (AP * AB)² )
# |AP| * cosθ * |AB|
# L
# cosθ =
# --> L = cosθ * |AP| =
# |AP|
# |AB|
# Property of vector dot product
# u * v = |u| * |v| * cosθ
# Legend:
# |##| = Length of Vector
#  →  = Vector
#   ^   = Unitized Vector
# AP*AB
# = AP * AB = L
# |AB|
# L = AP * AB
# |AP|² = h² + L²
# h= sqrt( |AP|² - L²) = sqrt( |AP|² - (AP * AB)² )
panel = Panel(crv_cp.Distance)
# Method 2
# Cross product
# Cross Product Vector
# Perpendicular
# Right hand rule
# Area = b * h
# Area
# h =
# b
# | AB * AP |
# h =
# |AB|
# Cross Product Vector
# Perpendicular
# Right hand rule
# Vector Length = Area of parallelogram
panel_2 = Panel([c_script.DDot, c_script.DCross])
