# Grasshopper definition Geometry Gems #5 Clean Duplicate Points.gh (Grasshopper 1.0.7)

number_slider = Slider(10000, range=0..1000000)
box = CenterBox(Base=PlaneXY(0, 0, 0), X=1, Y=1, Z=1)

# ----
# GEOMETRY GEMS SERIES
# 05
# Clean Duplicate Points
# Part 1/1
# By Jose Luis García del Castillo y López @ ParametricCamp
# Video: https://youtu.be/AJhICixtsAg
number_slider_2 = Slider(5, range=0..100)
pop3d = Populate3D(Region=box, Count=Slider(1000, range=0..1000), Seed=Slider(1000, range=0..1000))
pt = Point(flatten(pop3d))

expression = Expression(x=number_slider_2, Expression="Format(\"0 To {0}\", x - 1)")
expression_2 = Expression(x=Slider(10, range=0..100), Expression="Format(\"0 To {0}\", x - 1)")

subset = SubList(List=pop3d, Domain=expression_2, Wrap=True)  # -> List, Index
subset_2 = SubList(List=pop3d, Domain=expression, Wrap=True)  # -> List, Index
pt_2 = Point(flatten(subset_2.List))
pt_3 = Point(flatten(subset.List))
merge = Merge(Data1=pt_2, Data2=pt_3, Data3=pt)  # -> flatten(Result)
jitter = Jitter(List=merge, Jitter=1, Seed=Slider(100, range=0..100))  # -> Values, Indices
pt_4 = Point(jitter.Values)

number_slider_3 = Slider(0.018427, range=0..1)
cleanduplicatepoints = CSharpScript(points=pt_4, tolerance=number_slider_3)  # -> out, cleanPoints; inputs points: list of Point3d, tolerance: Double
# ---------- cleanduplicatepoints: C# ----------
    // Go over each point on the list
    for (int i = 0; i < points.Count; i++) {
      // Compare with the rest of the points
      // Loop backwards to make sure we don't skip any item
      for (int j = points.Count - 1; j > i; j--) {
        double d = Distance(points[i], points[j]);
        if (d < tolerance) {
          //Print(i + " is duplicate of " + j);
          points.RemoveAt(j);
        }
      }
    }

    cleanPoints = points;
# ---------- cleanduplicatepoints: C# additional code ----------
  // Functions from Geometry Gem #4: Distance between Points

  double Distance(Point3d a, Point3d b) {
    // Calculate sides of the triangle
    double dx = b.X - a.X;
    double dy = b.Y - a.Y;
    double dz = b.Z - a.Z;

    // Calculate length of the larger side of the triangle
    double d = Math.Sqrt(dx * dx + dy * dy + dz * dz);

    return d;
  }

  double DistanceSquared(Point3d a, Point3d b) {
    // Calculate sides of the triangle
    double dx = b.X - a.X;
    double dy = b.Y - a.Y;
    double dz = b.Z - a.Z;

    // Calculate squared length of the larger side of the triangle
    double d2 = dx * dx + dy * dy + dz * dz;

    return d2;
  }
# ---------- end cleanduplicatepoints ----------
cleanduplicatepoints_faster = CSharpScript(points=pt_4, tolerance=number_slider_3)  # -> out, cleanPoints; inputs points: list of Point3d, tolerance: Double
# ---------- cleanduplicatepoints_faster: C# ----------
    // Compare against the square of the tolerance
    double t2 = tolerance * tolerance;

    // Go over each point on the list
    for (int i = 0; i < points.Count; i++) {
      // Compare with the rest of the points
      // Loop backwards to make sure we don't skip any item
      for (int j = points.Count - 1; j > i; j--) {
        // Use the squared distance to compare points faster
        double d2 = DistanceSquared(points[i], points[j]);
        if (d2 < t2) {
          //Print(i + " is duplicate of " + j);
          points.RemoveAt(j);
        }
      }
    }

    cleanPoints = points;
# ---------- cleanduplicatepoints_faster: C# additional code ----------
  // Functions from Geometry Gem #4: Distance between Points

  double Distance(Point3d a, Point3d b) {
    // Calculate sides of the triangle
    double dx = b.X - a.X;
    double dy = b.Y - a.Y;
    double dz = b.Z - a.Z;

    // Calculate length of the larger side of the triangle
    double d = Math.Sqrt(dx * dx + dy * dy + dz * dz);

    return d;
  }

  double DistanceSquared(Point3d a, Point3d b) {
    // Calculate sides of the triangle
    double dx = b.X - a.X;
    double dy = b.Y - a.Y;
    double dz = b.Z - a.Z;

    // Calculate squared length of the larger side of the triangle
    double d2 = dx * dx + dy * dy + dz * dz;

    return d2;
  }
# ---------- end cleanduplicatepoints_faster ----------
