# Grasshopper definition Geometry Gems #6 Point Sorting.gh (Grasshopper 1.0.7)

box = CenterBox(Base=PlaneXY(0, 0, 0), X=1, Y=1, Z=1)

mesh = Mesh(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)
demesh = DeconstructMesh(Mesh=mesh)  # -> Vertices, Faces, Colours, Normals
pt = Point(demesh.Vertices)

sortpointsbycoordinate = CSharpScript(points=pt, coordinate="z")  # -> out, sortedPoints; inputs points: list of Point3d, coordinate: String
# ---------- sortpointsbycoordinate: C# ----------
    // Check the input coordinate
    int coordInt = -1;
    if (coordinate.ToLower() == "x") {
      coordInt = 0;
    } else if (coordinate.ToLower() == "y") {
      coordInt = 1;
    } else if (coordinate.ToLower() == "z") {
      coordInt = 2;
    }

    // Sanity
    if (coordInt == -1) {
      Component.AddRuntimeMessage(GH_RuntimeMessageLevel.Error, "Wrong coordinate input type");
    }


    // Create an empty list to store sorted pioints:
    List<Point3d> sorted = new List<Point3d>();

    // As long as we have points, keep checking
    while (points.Count > 0) {
      double currentMin = Double.MaxValue;
      int currentIndex = -1;

      // Iterate over all remaining points and find the one
      // with the smallest X coord
      for (int i = 0; i < points.Count; i++) {
        if (points[i][coordInt] < currentMin) {
          currentMin = points[i][coordInt];
          currentIndex = i;
        }
      }

      // Move that point to sorted list, and remove it from
      // original list
      sorted.Add(points[currentIndex]);
      points.RemoveAt(currentIndex);
    }

    // Output
    sortedPoints = sorted;
# ---------- end sortpointsbycoordinate ----------
sortpointsbydistance = CSharpScript(points=pt, byMin=Toggle(True))  # -> out, sortedPoints; inputs points: list of Point3d, byMin: Boolean
# ---------- sortpointsbydistance: C# ----------
    // Create an empty list to store sorted pioints:
    List<Point3d> sorted = new List<Point3d>();

    // Keep track of the last smallest distance
    double currentDistance = byMin ? Double.MaxValue : Double.MinValue;
    int currentIndex = -1;

    // Pick first point and move it to sorted
    Point3d lastPoint = points[0];
    sorted.Add(points[0]);
    points.RemoveAt(0);

    // While there are still points in the list,
    // keep iterating
    while (points.Count > 0) {
      // Check all points
      for (int i = 0; i < points.Count; i++) {
        // Use squared distance to compare (cheaper operation)
        double d2 = DistanceSquared(lastPoint, points[i]);

        // Check against last best value
        if (
          (byMin == true && d2 < currentDistance)
          || (byMin == false && d2 > currentDistance)
        ) {
          currentDistance = d2;
          currentIndex = i;
        }
      }

      // Once checked, remove point from source list
      // and move to sorted list
      Point3d choseOne = points[currentIndex];
      sorted.Add(choseOne);
      points.RemoveAt(currentIndex);
      lastPoint = choseOne;

      // Prepare for next iteration
      currentDistance = byMin ? Double.MaxValue : Double.MinValue;
      currentIndex = -1;
    }

    // Output
    sortedPoints = sorted;
# ---------- sortpointsbydistance: C# additional code ----------
  // From Geometry Gem #4: Distance between points
  double Distance(Point3d a, Point3d b) {
    // Calculate sides of the triangle
    double dx = b.X - a.X;
    double dy = b.Y - a.Y;
    double dz = b.Z - a.Z;

    // Calculate length of the larger side of the triangle
    double d = Math.Sqrt(dx * dx + dy * dy + dz * dz);

    return d;
  }

  double DistanceSquared(Point3d a, Point3d b) {
    // Calculate sides of the triangle
    double dx = b.X - a.X;
    double dy = b.Y - a.Y;
    double dz = b.Z - a.Z;

    // Calculate squared length of the larger side of the triangle
    double d2 = dx * dx + dy * dy + dz * dz;

    return d2;
  }
# ---------- end sortpointsbydistance ----------
panel = Panel(sortpointsbycoordinate.out)
panel_2 = Panel(sortpointsbydistance.out)
pline = PolyLine(Vertices=sortpointsbydistance.sortedPoints, Closed=False)
pline_2 = PolyLine(Vertices=sortpointsbycoordinate.sortedPoints, Closed=False)

# ----
# GEOMETRY GEMS SERIES
# 06
# Point Sorting
# Part 1/1
# By Jose Luis García del Castillo y López @ ParametricCamp
# Video: https://youtu.be/w7qRnPTuyUA
number_slider = Slider(5, range=0..100)
number_slider_2 = Slider(1000, range=0..1000)
pop3d = Populate3D(Region=box, Count=number_slider_2, Seed=Slider(1000, range=0..1000))
pt_2 = Point(flatten(pop3d))

expression = Expression(x=number_slider, Expression="Format(\"0 To {0}\", x - 1)")
expression_2 = Expression(x=Slider(10, range=0..100), Expression="Format(\"0 To {0}\", x - 1)")

subset = SubList(List=pop3d, Domain=expression_2, Wrap=True)  # -> List, Index
subset_2 = SubList(List=pop3d, Domain=expression, Wrap=True)  # -> List, Index
pt_3 = Point(flatten(subset_2.List))
pt_4 = Point(flatten(subset.List))
merge = Merge(Data1=pt_3, Data2=pt_4, Data3=pt_2)  # -> flatten(Result)
jitter = Jitter(List=merge, Jitter=1, Seed=Slider(100, range=0..100))  # -> Values, Indices
pt_5 = Point(jitter.Values)

cyl = Cylinder(Base=PlaneXY(0, 0, 0), Radius=0.5, Length=1)
popgeo = PopulateGeometry(Geometry=cyl, Count=number_slider_2, Seed=1)

srf = Surface(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)
popgeo_2 = PopulateGeometry(Geometry=srf, Count=number_slider_2, Seed=1)

pline_3 = PolyLine(Vertices=pt_5, Closed=False)
