# Grasshopper definition Geometry Gems #7 Point Along Line.gh (Grasshopper 1.0.7)

# ----
# GEOMETRY GEMS SERIES
# 07
# Point Along Line
# Part 1/1
# By Jose Luis García del Castillo y López @ ParametricCamp
# Video: https://youtu.be/t13LOCz7Cd4
pt = Point(Point(4.981559504, 3.928868893, 0))
pt_2 = Point(Point(13.54013144, 7.72743369, 10.195181))
n = Slider(0.518, range=0..1)
d = Slider(5.437, range=0..10)

c_script = CSharpScript(A=pt, B=pt_2, n=n)  # -> out, C; inputs A: Point3d, B: Point3d, n: Double
# ---------- c_script: C# ----------
    // Output
    C = PointAlongLine(A, B, n);
# ---------- c_script: C# additional code ----------
  
  // This function returns a point at a relative distance t
  // between points a and b.
  Point3d PointAlongLine(Point3d a, Point3d b, double t) {
    // Find relative distances between points
    double dx = b.X - a.X;
    double dy = b.Y - a.Y;
    double dz = b.Z - a.Z;
  
    // Compute relative distances for c
    double nx = t * dx;
    double ny = t * dy;
    double nz = t * dz;
  
    // Compute world coordinates for c
    double cx = a.X + nx;
    double cy = a.Y + ny;
    double cz = a.Z + nz;

    // Compute c point
    Point3d c = new Point3d(cx, cy, cz);

    // // Doing it the 'vector algebra' way ;)
    //    Vector3d AB = b - a;
    //    Vector3d AC = t * AB;
    //    Point3d c = a + AC;

    return c;
  }
# ---------- end c_script ----------
c_script_2 = CSharpScript(A=pt, B=pt_2, d=d)  # -> out, C; inputs A: Point3d, B: Point3d, d: Double
# ---------- c_script_2: C# ----------
    // Output
    C = PointAlongLineAbsolute(A, B, d);
# ---------- c_script_2: C# additional code ----------
  // This function returns a point at an absolute Euclidean distance d
  // between points a and b.
  Point3d PointAlongLineAbsolute(Point3d a, Point3d b, double d) {
    double D = Distance(a, b);
    double n = d / D;
    
    Point3d p = PointAlongLineRelative(a, b, n);
    
    return p;
  }

  // This function returns a point at a relative distance t
  // between points a and b.
  Point3d PointAlongLineRelative(Point3d a, Point3d b, double t) {
    // Find relative distances between points
    double dx = b.X - a.X;
    double dy = b.Y - a.Y;
    double dz = b.Z - a.Z;

    // Compute relative distances for c
    double nx = t * dx;
    double ny = t * dy;
    double nz = t * dz;

    // Compute world coordinates for c
    double cx = a.X + nx;
    double cy = a.Y + ny;
    double cz = a.Z + nz;

    // Compute c point
    Point3d c = new Point3d(cx, cy, cz);

    // // Doing it the 'vector algebra' way ;)
    //    Vector3d AB = b - a;
    //    Vector3d AC = t * AB;
    //    Point3d c = a + AC;

    return c;
  }
  
  // Distance between 2 points (Geometry Gem #4)
  double Distance(Point3d a, Point3d b) {
    // Calculate sides of the triangle
    double dx = b.X - a.X;
    double dy = b.Y - a.Y;
    double dz = b.Z - a.Z;

    // Calculate length of the larger side of the triangle
    double d = Math.Sqrt(dx * dx + dy * dy + dz * dz);

    return d;
  }
# ---------- end c_script_2 ----------

ln = Line(StartPoint=pt, EndPoint=pt_2)
