# Grasshopper definition Geometry Gems #8 Chaikins Algorithm.gh (Grasshopper 1.0.7)

# ----
# GEOMETRY GEMS SERIES
# 08
# Chaikin's Algorithm for Polyline Smoothing
# Part 1/1
# By Jose Luis García del Castillo y López @ ParametricCamp
# Video: https://youtu.be/SzRsPqG_94w
pt = Point([<point referenced from the Rhino model> x6])

chaikin_s_algorithm = CSharpScript(pts=pt, iterations=Slider(6, range=0..10), prop=Slider(0.25, range=0..1), periodic=Toggle(True))  # -> out, ptsOut; inputs pts: list of Point3d, iterations: Int32, prop: Double, periodic: Boolean
# ---------- chaikin_s_algorithm: C# ----------
    // Create our working list of points (clone)
    List<Point3d> ctrlPts = new List<Point3d>(pts);

    // Duplicate points for a peridic curve
    if (periodic) {
      ctrlPts.Add(ctrlPts[0]);
      ctrlPts.Add(ctrlPts[1]);
    }

    // Iterations of smoothing
    for (int i = 0; i < iterations; i++) {
      ctrlPts = SmoothPolyline(ctrlPts, prop);
    }

    // Remove the last duplicate point 
    if (periodic) {
      ctrlPts.RemoveAt(ctrlPts.Count - 1);
    }

    // Output
    ptsOut = ctrlPts;
# ---------- chaikin_s_algorithm: C# additional code ----------
  // Returns a list of smoothed ctrl points for the polyline
  List<Point3d> SmoothPolyline(List<Point3d> pts, double t) {
    // Empty list to populate with new pts
    List<Point3d> newPts = new List<Point3d>();

    // Compute the relative parameters of the points
    double t0 = t;
    double t1 = 1 - t;
    
    // Find the two control points for each line segment
    for (int i = 1; i < pts.Count; i++) {
      Point3d A = pts[i - 1];
      Point3d B = pts[i];

      Point3d p0 = PointAlongLine(A, B, t0);
      Point3d p1 = PointAlongLine(A, B, t1);

      newPts.Add(p0);
      newPts.Add(p1);
    }

    return newPts;
  }


  // FROM GEOMETRY GEM #6
  // This function returns a point at a relative distance t
  // between points a and b.
  Point3d PointAlongLine(Point3d a, Point3d b, double t) {
    // Find relative distances between points
    double dx = b.X - a.X;
    double dy = b.Y - a.Y;
    double dz = b.Z - a.Z;

    // Compute relative distances for c
    double nx = t * dx;
    double ny = t * dy;
    double nz = t * dz;

    // Compute world coordinates for c
    double cx = a.X + nx;
    double cy = a.Y + ny;
    double cz = a.Z + nz;

    // Compute c point
    Point3d c = new Point3d(cx, cy, cz);

    return c;
  }
# ---------- end chaikin_s_algorithm ----------
pline = PolyLine(Vertices=pt, Closed=False)

pt_2 = Point(chaikin_s_algorithm.ptsOut)
pline_2 = PolyLine(Vertices=pt_2, Closed=False)
