# Grasshopper definition Geometry Gems #9 Chaikins Algorithm From Interpolation Points.gh (Grasshopper 1.0.7)

# ----
# GEOMETRY GEMS SERIES
# 09
# Chaikin's Algorithm from Interpolation Points
# Part 1/1
# By Jose Luis García del Castillo y López @ ParametricCamp
# Video: https://youtu.be/0DQVETCl6qI
pt = Point([<point referenced from the Rhino model> x6])
number_slider = Slider(-7.068, range=-100..100)

number_slider_2 = Slider(-24.076, range=-100..100)
number_slider_3 = Slider(-10.13, range=-100..100)
vec = VectorXYZ(XComponent=number_slider, YComponent=number_slider_2, ZComponent=number_slider_3)  # -> Vector, Length

item = ListItem(List=pt, Index=0, Wrap=True)
vdisex = VectorDisplayEx(Point=item, Vector=vec.Vector, Colour=RGB(0, 0, 0), Width=2)

chaikin_s_algorithm_from_interpolated_pt = CSharpScript(pts=pt, tangent=vec.Vector, iterations=Slider(6, range=0..10), prop=Slider(0.25, range=0..1), periodic=Toggle(False))  # -> out, polyline, ctrlPolyline; "Chaikin's Algorithm from Interpolated Pts"; inputs pts: list of Point3d, tangent: Vector3d, iterations: Int32, prop: Double, periodic: Boolean
# ---------- chaikin_s_algorithm_from_interpolated_pt: C# ----------
    // Create empty list for control points
    List<Point3d> ctrPts;

    // Output
    polyline =
      ChaikinPolylineSmoothingFromInterpolationPoints(pts, tangent, iterations, prop, periodic, out ctrPts);

    ctrlPolyline = ctrPts;
# ---------- chaikin_s_algorithm_from_interpolated_pt: C# additional code ----------
  // Given a list of interpolation points and the tangnet at the starting point,
  // returns the corresponding control polygon as s list of points.
  List<Point3d> ControlPolygonFromInterpolationPoints(List<Point3d> pts, Vector3d tangent){
    // Start an empty list
    List<Point3d> controlPts = new List<Point3d>();

    // Compute the first point
    Point3d start = pts[0];
    start.X += tangent.X;
    start.Y += tangent.Y;
    start.Z += tangent.Z;
    controlPts.Add(start);

    // Compute the rest of control pts
    for (int i = 0; i < pts.Count; i++) {
      Point3d prev = controlPts[i];
      Point3d inter = pts[i];
      Point3d newPt = PointAlongLine(prev, inter, 2);
      controlPts.Add(newPt);
    }

    return controlPts;
  }

  // Smooth a Polyline with Chaikin's Algorithm,
  // using INTERPOLATION POINTS and TANGENT VECTOR as inputs.
  List<Point3d> ChaikinPolylineSmoothingFromInterpolationPoints(List<Point3d> pts, Vector3d tangent,
  int iterations, double prop, bool periodic, out List<Point3d> controlPts) {

    // Compute the control polygon
    List<Point3d> controlPoints =
      ControlPolygonFromInterpolationPoints(pts, tangent);

    controlPts = controlPoints;

    // Smooth Polygon with Chaikin's algorithm
    List<Point3d> smoothPoly =
      ChaikinPolylineSmoothingFromControlPoints(controlPoints, iterations, prop, periodic);

    // Replace starting point
    smoothPoly.RemoveAt(0);
    smoothPoly.Insert(0, pts[0]);

    // Replace end point
    smoothPoly.RemoveAt(smoothPoly.Count - 1);
    smoothPoly.Add(pts[pts.Count - 1]);

    return smoothPoly;
  }


  // Smooth a Polyline with Chaikin's Algorithm
  // http://www.cs.unc.edu/~dm/UNC/COMP258/LECTURES/Chaikins-Algorithm.pdf
  List<Point3d> ChaikinPolylineSmoothingFromControlPoints(List<Point3d> pts, int iterations,
  double prop, bool periodic) {
    // Create our working list of points (clone)
    List<Point3d> ctrlPts = new List<Point3d>(pts);

    // Duplicate points for a peridic curve
    if (periodic) {
      ctrlPts.Add(ctrlPts[0]);
      ctrlPts.Add(ctrlPts[1]);
    }

    // Iterations of smoothing
    for (int i = 0; i < iterations; i++) {
      ctrlPts = SmoothPolyline(ctrlPts, prop);
    }

    // Remove the last duplicate point
    if (periodic) {
      ctrlPts.RemoveAt(ctrlPts.Count - 1);
    }

    return ctrlPts;
  }

  // Returns a list of smoothed ctrl points for the polyline
  List<Point3d> SmoothPolyline(List<Point3d> pts, double t) {
    // Empty list to populate with new pts
    List<Point3d> newPts = new List<Point3d>();

    // Compute the relative parameters of the points
    double t0 = t;
    double t1 = 1 - t;

    // Find the two control points for each line segment
    for (int i = 1; i < pts.Count; i++) {
      Point3d A = pts[i - 1];
      Point3d B = pts[i];

      Point3d p0 = PointAlongLine(A, B, t0);
      Point3d p1 = PointAlongLine(A, B, t1);

      newPts.Add(p0);
      newPts.Add(p1);
    }

    return newPts;
  }


  // FROM GEOMETRY GEM #7
  // This function returns a point at a relative distance t
  // between points a and b.
  Point3d PointAlongLine(Point3d a, Point3d b, double t) {
    // Find relative distances between points
    double dx = b.X - a.X;
    double dy = b.Y - a.Y;
    double dz = b.Z - a.Z;

    // Compute relative distances for c
    double nx = t * dx;
    double ny = t * dy;
    double nz = t * dz;

    // Compute world coordinates for c
    double cx = a.X + nx;
    double cy = a.Y + ny;
    double cz = a.Z + nz;

    // Compute c point
    Point3d c = new Point3d(cx, cy, cz);

    return c;
  }
# ---------- end chaikin_s_algorithm_from_interpolated_pt ----------

pt_2 = Point(chaikin_s_algorithm_from_interpolated_pt.polyline)
pt_3 = Point(chaikin_s_algorithm_from_interpolated_pt.ctrlPolyline)
pline = PolyLine(Vertices=pt_3, Closed=False)
pline_2 = PolyLine(Vertices=pt_2, Closed=False)

galapagos = Galapagos(fitness=len, gene=[number_slider_2, number_slider, number_slider_3])
len = Length(Curve=pline)
