# Grasshopper definition Geometry Gems #11 Point in Local Coordinates.gh (Grasshopper 1.0.7)

# ----
# GEOMETRY GEM SERIES
# 11
# Point in Local Coordinates
# Part 1/1
# By Jose Luis García del Castillo y López @ ParametricCamp
# https://youtu.be/Brf4huewj-A
pt = Point(<point referenced from the Rhino model>)
pt_2 = Point(<point referenced from the Rhino model>)
pt_3 = Point(<point referenced from the Rhino model>)
pt_4 = Point(<point referenced from the Rhino model>)
pdecon = Deconstruct(Point=pt)  # -> XComponent, YComponent, ZComponent
pl_3pt = Plane3Pt(PointA=pt_2, PointB=pt_3, PointC=pt_4)
panel = Panel(pl_3pt)
panel_2 = Panel([pdecon.XComponent, pdecon.YComponent, pdecon.ZComponent])
c_script = CSharpScript(point=pt, plane=pl_3pt)  # -> out, x, y, z; inputs point: Point3d, plane: Plane
# ---------- c_script: C# ----------
    Point3d p = LocalCoordinates(point, plane);

    x = p.X;
    y = p.Y;
    z = p.Z;
# ---------- c_script: C# additional code ----------
  // Returns the point pt in local coordinates of the CS parameter
  Point3d LocalCoordinates(Point3d pt, Plane cs) {
    Vector3d posVec = pt - cs.Origin;

    double projX = DotProduct(posVec, cs.XAxis);
    double projY = DotProduct(posVec, cs.YAxis);
    double projZ = DotProduct(posVec, cs.ZAxis);
    
    return new Point3d(projX, projY, projZ);
  }
   
  // From Geometry Gem #2
  double DotProduct(Vector3d u, Vector3d v) {
    return u.X * v.X + u.Y * v.Y + u.Z * v.Z;
  }
# ---------- end c_script ----------
panel_3 = Panel([c_script.x, c_script.y, c_script.z])
