# Grasshopper definition Geometry Gems #12 Change of Basis.gh (Grasshopper 1.0.7)

# ----
# GEOMETRY GEM SERIES
# 12
# Change of Basis
# Part 1/1
# By Jose Luis García del Castillo y López @ ParametricCamp
# https://youtu.be/xJley97zI9w
pt = Point(<point referenced from the Rhino model>)
pt_2 = Point(<point referenced from the Rhino model>)
pt_3 = Point(<point referenced from the Rhino model>)
pt_4 = Point(<point referenced from the Rhino model>)
pt_5 = Point(<point referenced from the Rhino model>)
pt_6 = Point(<point referenced from the Rhino model>)
pt_7 = Point(<point referenced from the Rhino model>)
mesh = Mesh(<mesh referenced from the Rhino model>)
srf = Surface(<surface referenced from the Rhino model>)
sframes = SurfaceFrames(Surface=srf, UCount=10, VCount=10)  # -> Frames, Parameters
pdecon = Deconstruct(Point=pt)  # -> XComponent, YComponent, ZComponent
pl_3pt = Plane3Pt(PointA=pt_2, PointB=pt_3, PointC=pt_4)
pl_3pt_2 = Plane3Pt(PointA=pt_5, PointB=pt_6, PointC=pt_7)
demesh = DeconstructMesh(Mesh=mesh)  # -> Vertices, Faces, Colours, Normals
panel = Panel([pdecon.XComponent, pdecon.YComponent, pdecon.ZComponent])
c_script = CSharpScript(point=demesh.Vertices, sourceCS=pl_3pt, targetCS=pl_3pt_2)  # -> out, reorientedPoint; inputs point: Point3d, sourceCS: Plane, targetCS: Plane
# ---------- c_script: C# ----------
    Point3d p = LocalCoordinates(point, sourceCS);
    Point3d newP = LocalPointOnPlane(targetCS, p.X, p.Y, p.Z);

    reorientedPoint = newP;
# ---------- c_script: C# additional code ----------
 
  Point3d LocalPointOnPlane(Plane cs, double x, double y, double z) {
    Vector3d pos = x * cs.XAxis + y * cs.YAxis + z * cs.ZAxis;
    Point3d p = cs.Origin + pos;  // Rhinocommon operators
    // Point3d p = new Point3d(cs.Origin.X + pos.X, cs.Origin.Y + pos.Y, cs.Origin.Z + pos.Z);  // manually
    
    return p;
  }
  
  // From previous Geometry Gem!
  // Returns the point pt in local coordinates of the CS parameter
  Point3d LocalCoordinates(Point3d pt, Plane cs) {
    Vector3d posVec = pt - cs.Origin;

    double projX = DotProduct(posVec, cs.XAxis);
    double projY = DotProduct(posVec, cs.YAxis);
    double projZ = DotProduct(posVec, cs.ZAxis);

    return new Point3d(projX, projY, projZ);
  }

  // From Geometry Gem #2
  double DotProduct(Vector3d u, Vector3d v) {
    return u.X * v.X + u.Y * v.Y + u.Z * v.Z;
  }
# ---------- end c_script ----------
conmesh = ConstructMesh(Vertices=c_script.reorientedPoint, Faces=demesh.Faces)
geo = Geometry(c_script.reorientedPoint)
