# Grasshopper definition Geometry Gems #13 Vector Length.gh (Grasshopper 1.0.7)

vec = VectorXYZ(XComponent=Slider(5.58, range=0..10), YComponent=Slider(4.62, range=0..10), ZComponent=Slider(2.61, range=0..10))  # -> Vector, Length
c_script = CSharpScript(V=vec.Vector)  # -> out, L; inputs V: Vector3d
# ---------- c_script: C# ----------
    // Manual way
    L = VectorLength(V);
    
//    // Rhinocommon's way
//    L = V.Length;
# ---------- c_script: C# additional code ----------
  double VectorLength(Vector3d v) {
    return Math.Sqrt(v.X * v.X + v.Y * v.Y + v.Z * v.Z);
  }
# ---------- end c_script ----------
panel = Panel(c_script.L)
panel_2 = Panel(vec.Vector)
panel_3 = Panel(vec.Length)
vdis = VectorDisplay(Anchor="{0,0,0}", Vector=vec.Vector)
