# Grasshopper definition Geometry Gems #14 Unitize Vector.gh (Grasshopper 1.0.7)

vec = VectorXYZ(XComponent=Slider(4.34, range=0..10), YComponent=Slider(4.08, range=0..10), ZComponent=Slider(3.06, range=0..10))  # -> Vector, Length
vdis = VectorDisplay(Anchor="{0,0,0}", Vector=vec.Vector)
panel = Panel(vec.Vector)
panel_2 = Panel(vec.Length)
c_script = CSharpScript(V=vec.Vector)  # -> out, Vunit; inputs V: Vector3d
# ---------- c_script: C# ----------
    // Manual way
    Vunit = UnitVector(V);

    //    // Rhinocommon way
    //    bool success = V.Unitize();
    //    if (success == false)
    //    {
    //      this.Component.AddRuntimeMessage(GH_RuntimeMessageLevel.Error, "CANNOT UNITIZE VECTOR");
    //    }
    //
    //    Vunit = V;
# ---------- c_script: C# additional code ----------
  Vector3d UnitVector(Vector3d v)
  {
    // Compute the length of the original vector
    double length = VectorLength(v);

    // Compute unit vector coordinates
    double vx = v.X / length;
    double vy = v.Y / length;
    double vz = v.Z / length;

    // Create a vector object
    Vector3d unitVector = new Vector3d(vx, vy, vz);

    return unitVector;
  }

  // From Geometry Gem #13
  double VectorLength(Vector3d v) {
    return Math.Sqrt(v.X * v.X + v.Y * v.Y + v.Z * v.Z);
  }
# ---------- end c_script ----------
unit = UnitVector(Vector=vec.Vector)
vdis_2 = VectorDisplay(Anchor="{0,0,0}", Vector=unit)
c_script_2 = CSharpScript(V=c_script.Vunit)  # -> out, L; inputs V: Vector3d
# ---------- c_script_2: C# ----------
    // Manual way
    L = VectorLength(V);
    
//    // Rhinocommon's way
//    L = V.Length;
# ---------- c_script_2: C# additional code ----------
  double VectorLength(Vector3d v) {
    return Math.Sqrt(v.X * v.X + v.Y * v.Y + v.Z * v.Z);
  }
# ---------- end c_script_2 ----------
panel_3 = Panel(unit)
panel_4 = Panel(c_script.Vunit)
panel_5 = Panel(c_script_2.L)
