# Grasshopper definition 2.3 What is Parametric Modeling - Introduction to Parametric Modeling.gh (Grasshopper 1.0.7)

pt = ConstructPoint(XCoordinate=Slider(1, range=-10..10), YCoordinate=Slider(2.498, range=-10..10), ZCoordinate=Slider(3.38, range=-10..10))
panel = Panel(pt)
cyl = Cylinder(Base=pt, Radius=Slider(0.503, range=-10..10), Length=Slider(3.274, range=-10..10))
panel_2 = Panel(cyl)
