# Grasshopper definition 3.1 Structure of Components - Introduction to Parametric Modeling.gh (Grasshopper 1.0.7)
# plug-ins: Bifocals

pt = ConstructPoint(XCoordinate=Slider(0.025, range=0..1), YCoordinate=Slider(0.77, range=0..1), ZCoordinate=Slider(0, range=0..1))
pt_2 = ConstructPoint(XCoordinate=Slider(0.238, range=0..1), YCoordinate=Slider(0.22, range=0..1), ZCoordinate=Slider(0.602, range=0..1))
pt_3 = ConstructPoint(XCoordinate=Slider(0.552, range=0..1), YCoordinate=Slider(0.419, range=0..1), ZCoordinate=Slider(0.535, range=0..1))
pt_4 = ConstructPoint(XCoordinate=Slider(0.368, range=0..1), YCoordinate=Slider(0.431, range=0..1), ZCoordinate=Slider(0.408, range=0..1))
panel = Panel(pt_4)
sph4pt = Sphere4Pt(Point1=pt_4, Point2=pt_2, Point3=pt, Point4=pt_3)  # -> Center, Radius, Sphere
circle = Circle3Pt(PointA=pt_4, PointB=pt_2, PointC=pt)  # -> Circle, Plane, Radius
panel_2 = Panel(circle.Circle)
panel_3 = Panel(circle.Plane)
panel_4 = Panel(circle.Radius)
