# Grasshopper definition 3.3 Basic Arithmetic - Introduction to Parametric Modeling.gh (Grasshopper 1.0.7)
# plug-ins: Bifocals

radius = Slider(1.689, range=0..5)
value_a = Slider(7.17, range=-10..10)
value_b = Slider(2, range=-10..10)
pi = Pi(Factor="2")
sqr = Square(Value=radius)
pi_2 = Pi(Factor=1)
addition = Addition(A=value_a, B=value_b)
subtraction = Subtraction(A=value_a, B=value_b)
multiplication = Multiplication(A=value_a, B=value_b)
division = Division(A=value_a, B=value_b)
pow = Power(A=value_a, B=value_b)
multiplication_2 = Multiplication(A=radius, B=pi)
multiplication_3 = Multiplication(A=sqr, B=pi_2)
panel = Panel(addition)
panel_2 = Panel(subtraction)
panel_3 = Panel(multiplication)
panel_4 = Panel(multiplication_3)
panel_5 = Panel(division)
panel_6 = Panel(pow)
panel_7 = Panel(multiplication_2)
