# Grasshopper definition 3.4 Keeping your Definitions Tidy and Clean! - Introduction to Parametric Modeling.gh (Grasshopper 1.0.7)

# ---- group: INPUT PARAMETERS
radius = Slider(1.689, range=0..5)

value_a = Slider(7.17, range=-10..10)
value_b = Slider(2, range=-10..10)

# ---- group: CIRCLE LENGTH
pi = Pi(Factor="2")
multiplication = Multiplication(A=radius, B=pi)
panel = Panel(multiplication)

# ---- group: CIRCLE AREA
sqr = Square(Value=radius)
pi_2 = Pi(Factor=1)
multiplication_2 = Multiplication(A=sqr, B=pi_2)
panel_2 = Panel(multiplication_2)

# ---- group: MAIN OPERATIONS
addition = Addition(A=value_a, B=value_b)
subtraction = Subtraction(A=value_a, B=value_b)
multiplication_3 = Multiplication(A=value_a, B=value_b)
division = Division(A=value_a, B=value_b)
pow = Power(A=value_a, B=value_b)

# ---- group: RESULTS
addition_2 = Panel(addition)
subtracttion = Panel(subtraction)
multiplication_4 = Panel(multiplication_3)
division_2 = Panel(division)
power = Panel(pow)
