# Grasshopper definition 3.5 Advanced Arithmetic.gh (Grasshopper 1.0.7)

# ---- group: INPUT PARAMETERS
radius = Slider(1.689, range=0..5)

# ---- group: INPUTS
a = Slider(2, range=-100..100)
b = Slider(4, range=-100..100)
c = Slider(-10, range=-100..100)

# ---- group: CIRCLE LENGTH
expression = Expression(radius=radius, Expression="2 * π * radius")
panel = Panel(expression)

# ---- group: CIRCLE AREA
expression_2 = Expression(radius=radius, Expression="π * radius²")
panel_2 = Panel(expression_2)

# ---- group: SPHERE AREA
expression_3 = Expression(radius=radius, Expression="4 * π * radius²")
panel_3 = Panel(expression_3)

# ---- group: VOLUME AREA
expression_4 = Expression(radius=radius, Expression="4 / 3 * π * Pow(radius, 3)")
panel_4 = Panel(expression_4)

# ---- group: CIRCLE LENGTH
pi = Pi(Factor="2")
multiplication = Multiplication(A=radius, B=pi)
panel_5 = Panel(multiplication)

# ---- group: QUADRATIC FORMULA
expression_5 = Expression(a=a, b=b, c=c, Expression="(-b - Sqrt(b² - 4 * a * c)) / 2 * a")
expression_6 = Expression(a=a, b=b, c=c, Expression="(-b + Sqrt(b² - 4 * a * c)) / 2 * a")
panel_6 = Panel(expression_6)
panel_7 = Panel(expression_5)

# ---- group: CIRCLE AREA
sqr = Square(Value=radius)
pi_2 = Pi(Factor=1)
multiplication_2 = Multiplication(A=sqr, B=pi_2)
panel_8 = Panel(multiplication_2)
