# Grasshopper definition 3.7 Relation between Rhino and GH.gh (Grasshopper 1.0.7)
# plug-ins: Bifocals

# ---- group: INPUT PARAMETERS OF A POINT
X = Slider(-4.369, range=-10..10)
Y = Slider(8.938, range=-10..10)
Z = Slider(2.346, range=-10..10)
radius = Slider(0.96, range=0..10)

X_2 = Slider(-3.538, range=-10..10)
Y_2 = Slider(1.86, range=-10..10)
Z_2 = Slider(1.077, range=-10..10)
radius_2 = Slider(1.01, range=0..10)
length = Slider(3.87, range=0..10)

X_3 = Slider(1.595, range=-10..10)
Y_3 = Slider(-3.715, range=-10..10)
Z_3 = Slider(-0.958, range=-10..10)
radius_3 = Slider(0.59, range=0..10)
length_2 = Slider(1.91, range=0..10)

# ----
pt = ConstructPoint(XCoordinate=X, YCoordinate=Y, ZCoordinate=Z)
sph = Sphere(Base=pt, Radius=radius)
panel = Panel(pt)
panel_2 = Panel(sph)

pt_2 = ConstructPoint(XCoordinate=X_3, YCoordinate=Y_3, ZCoordinate=Z_3)
cyl = Cylinder(Base=pt_2, Radius=radius_3, Length=length_2)
panel_3 = Panel(cyl)

pt_3 = ConstructPoint(XCoordinate=X_2, YCoordinate=Y_2, ZCoordinate=Z_2)
cone = Cone(Base=pt_3, Radius=radius_2, Length=length)  # -> Cone, Tip
panel_4 = Panel(cone.Cone)
