# Grasshopper definition 4.3 Lines, Polylines & Splines.gh (Grasshopper 1.0.7)

# ---- group: INPUT PARAMETERS
Y = Slider(5.736, range=-10..10)
Z = Slider(3.911, range=-10..10)
X = Slider(1.553, range=-10..10)
Y_2 = Slider(-0.689, range=-10..10)
Z_2 = Slider(1.729, range=-10..10)
Y_3 = Slider(10, range=-10..10)
Z_3 = Slider(1.956, range=-10..10)
X_2 = Slider(5.468, range=-10..10)
X_3 = Slider(5.6, range=-10..10)
Y_4 = Slider(3.142, range=-10..10)
Z_4 = Slider(0.186, range=-10..10)
X_4 = Slider(8.715, range=-10..10)
closed = BooleanToggle(False)
pt = ConstructPoint(XCoordinate=X, YCoordinate=Y, ZCoordinate=Z)
pt_2 = ConstructPoint(XCoordinate=X_2, YCoordinate=Y_2, ZCoordinate=Z_2)
pt_3 = ConstructPoint(XCoordinate=X_3, YCoordinate=Y_3, ZCoordinate=Z_3)
pt_4 = ConstructPoint(XCoordinate=X_4, YCoordinate=Y_4, ZCoordinate=Z_4)

# ----
number_slider = Slider(3, range=1..3)

pline = PolyLine(Vertices=[pt_2, pt, pt_3, pt_4], Closed=closed)
panel = Panel(pline)

ln = Line(StartPoint=pt_2, EndPoint=pt)
ln_2 = Line(StartPoint=pt, EndPoint=pt_3)
ln_3 = Line(StartPoint=pt_3, EndPoint=pt_4)

nurbs = NurbsCurve(Vertices=[pt_2, pt, pt_3, pt_4], Degree=number_slider, Periodic=closed)  # -> Curve, Length, Domain
panel_2 = Panel(nurbs.Curve)
panel_3 = Panel(nurbs.Length)
panel_4 = Panel(nurbs.Domain)

intcrv = Interpolate(Vertices=[pt_2, pt, pt_3, pt_4], Degree=number_slider, Periodic=closed, KnotStyle=1)  # -> Curve, Length, Domain
panel_5 = Panel(intcrv.Curve)
panel_6 = Panel(intcrv.Length)
panel_7 = Panel(intcrv.Domain)
