# Grasshopper definition 4.4 Importing Rhino Geometry.gh (Grasshopper 1.0.7)

number_slider = Slider(3, range=1..3)
crv = Curve(<curve referenced from the Rhino model>)
crv_2 = Curve(<curve referenced from the Rhino model>)
pt = Point([<point referenced from the Rhino model> x16])

# ---- group: INPUT PARAMETERS
closed = BooleanToggle(False)

# ----
panel = Panel(crv)
loft = Loft(Curves=[crv, crv_2], Options={Adjust=False, Closed=False, LoftEnds=0, LoftSimp=0, LoftType=0, Rebuild=10, Refit=0.01})
panel_2 = Panel(pt)
pt_2 = Point([<point referenced from the Rhino model> x4])
panel_3 = Panel(pt_2)
pline = PolyLine(Vertices=pt, Closed=False)
nurbs = NurbsCurve(Vertices=pt, Degree=3, Periodic=False)  # -> Curve, Length, Domain
intcrv = Interpolate(Vertices=pt, Degree=3, Periodic=False, KnotStyle=1)  # -> Curve, Length, Domain
sph = Sphere(Base=pt, Radius=1)

pline_2 = PolyLine(Vertices=pt_2, Closed=closed)
panel_4 = Panel(pline_2)

nurbs_2 = NurbsCurve(Vertices=pt_2, Degree=number_slider, Periodic=closed)  # -> Curve, Length, Domain
panel_5 = Panel(nurbs_2.Curve)
panel_6 = Panel(nurbs_2.Length)
panel_7 = Panel(nurbs_2.Domain)

intcrv_2 = Interpolate(Vertices=pt_2, Degree=number_slider, Periodic=closed, KnotStyle=1)  # -> Curve, Length, Domain
panel_8 = Panel(intcrv_2.Curve)
panel_9 = Panel(intcrv_2.Length)
panel_10 = Panel(intcrv_2.Domain)
