# Grasshopper definition 4.5 NURBS Surfaces.gh (Grasshopper 1.0.7)

# ---- group: FOUR POINT SURFACE
pt = Point(<point referenced from the Rhino model>)
pt_2 = Point(<point referenced from the Rhino model>)
pt_3 = Point(<point referenced from the Rhino model>)
pt_4 = Point(<point referenced from the Rhino model>)
srf4pt = _4PointSurface(CornerA=pt, CornerB=pt_2, CornerC=pt_3, CornerD=pt_4)

# ---- group: EDGES + PIPE SURFACE
crv = Curve(<curve referenced from the Rhino model>)
crv_2 = Curve(<curve referenced from the Rhino model>)
crv_3 = Curve(<curve referenced from the Rhino model>)
crv_4 = Curve(<curve referenced from the Rhino model>)
edgesrf = EdgeSurface(CurveA=crv, CurveB=crv_2, CurveC=crv_3, CurveD=crv_4)
pipe = Pipe(Curve=[crv, crv_2, crv_3, crv_4], Radius=Slider(0.3, range=0..10), Caps=0)

# ---- group: RULED SURFACE
crv_5 = Curve(<curve referenced from the Rhino model>)
crv_6 = Curve(<curve referenced from the Rhino model>)
rulesrf = RuledSurface(CurveA=crv_5, CurveB=crv_6)

# ---- group: LOFT
crv_7 = Curve(<curve referenced from the Rhino model>)
crv_8 = Curve(<curve referenced from the Rhino model>)
crv_9 = Curve(<curve referenced from the Rhino model>)
loft = Loft(
    Curves=[crv_7, crv_8, crv_9],
    Options={Adjust=False, Closed=False, LoftEnds=0, LoftSimp=0, LoftType=0, Rebuild=10, Refit=0.01})

# ---- group: SWEEP
crv_10 = Curve(<curve referenced from the Rhino model>)
crv_11 = Curve(<curve referenced from the Rhino model>)
swp1 = Sweep1(Rail=crv_10, Sections=crv_11, Miter=1)
