# Grasshopper definition 5.1 Introduction to Data.gh (Grasshopper 1.0.7)

crv = Curve(<curve referenced from the Rhino model>)
crv_2 = Curve(<curve referenced from the Rhino model>)
number_slider = Slider(15, range=0..100)

divide = DivideCurve(Curve=crv, Count=number_slider, Kinks=False)  # -> Points, Tangents, Parameters
divide_2 = DivideCurve(Curve=crv_2, Count=number_slider, Kinks=False)  # -> Points, Tangents, Parameters
ln = Line(StartPoint=divide.Points, EndPoint=divide_2.Points)
eval = EvaluateCurve(Curve=ln, Parameter=Slider(0.488, range=0..1))  # -> Point, Tangent, Angle
pdecon = Deconstruct(Point=eval.Point)  # -> XComponent, YComponent, ZComponent
addition = Addition(A=pdecon.ZComponent, B=Slider(7.646, range=0..10))
pt = ConstructPoint(XCoordinate=pdecon.XComponent, YCoordinate=pdecon.YComponent, ZCoordinate=addition)
pt_2 = Point(divide.Points)
pt_3 = Point(pt)
pt_4 = Point(divide_2.Points)
intcrv = Interpolate(Vertices=[pt_2, pt_3, pt_4], Degree=3, Periodic=False, KnotStyle=1)  # -> Curve, Length, Domain
panel = Panel(intcrv.Curve)
