# Grasshopper definition 5.2 Data Structures in Grasshopper.gh (Grasshopper 1.0.7)
# plug-ins: Bifocals

srf = Surface(<surface referenced from the Rhino model>)
sdivide = DivideSurface(Surface=srf, UCount=Slider(2, range=0..10), VCount=Slider(4, range=0..10))  # -> Points, Normals, Parameters
panel = Panel(sdivide.Points)
