# Grasshopper definition 5.3 Data Tree Operations in Grasshopper.gh (Grasshopper 1.0.7)
# plug-ins: Bifocals

srf = Surface(<surface referenced from the Rhino model>)
sdivide = DivideSurface(Surface=srf, UCount=Slider(2, range=0..10), VCount=Slider(4, range=0..10))  # -> Points, Normals, Parameters
panel = Panel(sdivide.Points)
graft = GraftTree(Tree=sdivide.Points, IncludeEmptyLists=True, IncludeNullItems=True)
panel_2 = Panel(graft)
points = PointList(Points=graft, Size=Slider(6.923, range=0..10))
flatten = FlattenTree(Tree=sdivide.Points, Path="{0}")
panel_3 = Panel(flatten)
