# Grasshopper definition 5.4 List-Level Behavior in Grasshopper.gh (Grasshopper 1.0.7)

srf = Surface(<surface referenced from the Rhino model>)
sdivide = DivideSurface(Surface=srf, UCount=Slider(2, range=0..10), VCount=Slider(4, range=0..10))  # -> Points, Normals, Parameters
flatten = FlattenTree(Tree=sdivide.Points, Path="{0}")
graft = GraftTree(Tree=sdivide.Points, IncludeEmptyLists=True, IncludeNullItems=True)
intcrv = Interpolate(Vertices=sdivide.Points, Degree=3, Periodic=False, KnotStyle=1)  # -> Curve, Length, Domain
points = PointList(Points=sdivide.Points, Size=Slider(6.923, range=0..10))
panel = Panel(intcrv.Curve)
panel_2 = Panel(graft)
panel_3 = Panel(sdivide.Points)
panel_4 = Panel(flatten)
