# Grasshopper definition 6.1 Vectors.gh (Grasshopper 1.0.7)

sqgrid = Square(Plane=PlaneXY(0, 0, 0), Size=1, ExtentX=5, ExtentY=5)  # -> Cells, Points
pt = Point(<point referenced from the Rhino model>)
pt_2 = Point(<point referenced from the Rhino model>)
crv = Curve(<curve referenced from the Rhino model>)
srf = Surface(<surface referenced from the Rhino model>)
pt_3 = Point(<point referenced from the Rhino model>)
pt_4 = Point(<point referenced from the Rhino model>)
X = UnitX(Factor=1)
Y = UnitY(Factor=1)
Z = UnitZ(Factor=1)
pt_5 = Point(<point referenced from the Rhino model>)
pt_6 = Point(sqgrid.Points)
divide = DivideCurve(Curve=crv, Count=Slider(20, range=0..100), Kinks=False)  # -> Points, Tangents, Parameters
sdivide = DivideSurface(Surface=srf, UCount=Slider(15, range=0..100), VCount=Slider(15, range=0..100))  # -> Points, Normals, Parameters
vec2pt = Vector2Pt(PointA=pt_2, PointB=pt, Unitize=False)  # -> Vector, Length
panel = Panel(X)
panel_2 = Panel(Y)
panel_3 = Panel(Z)
vec = VectorXYZ(XComponent=Slider(2.2, range=0..10), YComponent=Slider(2.89, range=0..10), ZComponent=Slider(3.97, range=0..10))  # -> Vector, Length
vec2pt_2 = Vector2Pt(PointA=pt_2, PointB=pt_6, Unitize=False)  # -> Vector, Length
vec2pt_3 = Vector2Pt(PointA=pt_4, PointB=pt_3, Unitize=False)  # -> Vector, Length
vec_2 = VectorXYZ(XComponent=Slider(2.2, range=0..10), YComponent=Slider(2.89, range=0..10), ZComponent=Slider(3.97, range=0..10))  # -> Vector, Length
amp = Amplitude(Vector=sdivide.Normals, Amplitude=Slider(-7.12, range=-10..10))
vlen = VectorLength(Vector=divide.Tangents)
amp_2 = Amplitude(Vector=divide.Tangents, Amplitude=Slider(8.649, range=0..10))
vdis = VectorDisplay(Anchor=sdivide.Points, Vector=amp)
vec_3 = VectorXYZ(XComponent=Slider(1.95, range=0..10), YComponent=Slider(2.89, range=0..10), ZComponent=Slider(3.97, range=0..10))  # -> Vector, Length
vdis_2 = VectorDisplay(Anchor=divide.Points, Vector=amp_2)
vdis_3 = VectorDisplay(Anchor=pt_3, Vector=vec_2.Vector)
vdis_4 = VectorDisplay(Anchor=pt_4, Vector=vec2pt_3.Vector)
panel_4 = Panel(amp_2)
vdis_5 = VectorDisplay(Anchor=pt_5, Vector=vec_3.Vector)
addition = Addition(A=pt_5, B=vec_3.Vector)
panel_5 = Panel([vec.Vector, vec2pt.Vector])
addition_2 = Addition(A=vec2pt_3.Vector, B=vec_2.Vector)
panel_6 = Panel([pt_5, vec_3.Vector, addition])
panel_7 = Panel([vec2pt_3.Vector, vec_2.Vector, addition_2])
vdis_6 = VectorDisplay(Anchor=pt_4, Vector=addition_2)
