# Grasshopper definition 6.2 Planes.gh (Grasshopper 1.0.7)

srf = Surface(<surface referenced from the Rhino model>)
crv = Curve(<curve referenced from the Rhino model>)
X = Slider(10, range=0..10)
Y = Slider(6.11, range=0..10)
Z = Slider(3.92, range=0..10)
pt = Point(<point referenced from the Rhino model>)
pt_2 = Point(<point referenced from the Rhino model>)
pt_3 = Point(<point referenced from the Rhino model>)
number_slider = Slider(0.799, range=0..1)
sframes = SurfaceFrames(Surface=srf, UCount=Slider(20, range=0..100), VCount=Slider(20, range=0..100))  # -> Frames, Parameters
pframes = PerpFrames(Curve=crv, Count=Slider(20, range=0..100), Align=True)  # -> Frames, Parameters
vec2pt = Vector2Pt(PointA=pt, PointB=pt_3, Unitize=False)  # -> Vector, Length
vec2pt_2 = Vector2Pt(PointA=pt, PointB=pt_2, Unitize=False)  # -> Vector, Length
pl_3pt = Plane3Pt(PointA=pt, PointB=pt_3, PointC=pt_2)
pl = ConstructPlane(Origin=pt, XAxis=vec2pt.Vector, YAxis=vec2pt_2.Vector)
vdis = VectorDisplay(Anchor=pt, Vector=vec2pt_2.Vector)
vdis_2 = VectorDisplay(Anchor=pt, Vector=vec2pt.Vector)
ellipse = Ellipse(Plane=pframes.Frames, Radius1=Slider(1.8045, range=0..10), Radius2=Slider(0.6561, range=0..10))  # -> Ellipse, Focus1, Focus2
xy = XYPlane(Origin=Point(0, 0, 0))
xz = XZPlane(Origin=Point(0, 0, 0))
yz = YZPlane(Origin=Point(0, 0, 0))
box = CenterBox(Base=sframes.Frames, X=number_slider, Y=number_slider, Z=Slider(4.575, range=0..10))
panel = Panel(pl)
loft = Loft(Curves=ellipse.Ellipse, Options={Adjust=False, Closed=False, LoftEnds=0, LoftSimp=0, LoftType=0, Rebuild=10, Refit=0.01})
ellipse_2 = Ellipse(Plane=xy, Radius1=X, Radius2=Y)  # -> Ellipse, Focus1, Focus2
ellipse_3 = Ellipse(Plane=yz, Radius1=Y, Radius2=Z)  # -> Ellipse, Focus1, Focus2
ellipse_4 = Ellipse(Plane=xz, Radius1=X, Radius2=Z)  # -> Ellipse, Focus1, Focus2
