# Grasshopper definition 6.3 Domains, Series & Ranges.gh (Grasshopper 1.0.7)
# plug-ins: Bifocals

start = Slider(0, range=-10..10)
end = Slider(720, range=-10..720)
number_slider = Slider(2.156, range=-10..10)
start_2 = Slider(0, range=-10..10)
count = Slider(100, range=0..100)
step = Slider(0.213, range=-10..10)
subtraction = Subtraction(A=count, B="1")
dom = ConstructDomain(DomainStart=start, DomainEnd=end)
series = Series(Start=start_2, Step=step, Count=count)
range = Range(Domain=dom, Steps=subtraction)
panel = Panel(series)
rad = Radians(Degrees=range)
sin = Sine(Value=rad)
pt = ConstructPoint(XCoordinate=series, YCoordinate=Slider(7.544, range=-10..10), ZCoordinate=sin)
panel_2 = Panel(sin)
intcrv = Interpolate(Vertices=pt, Degree=3, Periodic=False, KnotStyle=1)  # -> Curve, Length, Domain

start_3 = Slider(0, range=-10..10)
end_2 = Slider(10, range=-10..10)
count_2 = Slider(10, range=0..100)
start_4 = Slider(0, range=-10..10)
step_2 = Slider(1, range=-10..10)
step_3 = Slider(10, range=0..100)
dom_2 = ConstructDomain(DomainStart=start_3, DomainEnd=end_2)
series_2 = Series(Start=start_4, Step=step_2, Count=count_2)
panel_3 = Panel(series_2)
panel_4 = Panel(dom_2)
range_2 = Range(Domain=dom_2, Steps=step_3)
panel_5 = Panel(range_2)

start_5 = Slider(0, range=-10..10)
step_4 = Slider(0.2, range=-10..10)
start_6 = Slider(0, range=-10..10)
end_3 = Slider(720, range=-10..720)
number_slider_2 = Slider(48, range=0..100)
start_7 = Slider(0, range=-10..10)
step_5 = Slider(0.465, range=-10..10)
dom_3 = ConstructDomain(DomainStart=start_6, DomainEnd=end_3)
addition = Addition(A=number_slider_2, B="1")
addition_2 = Addition(A=number_slider_2, B="1")
range_3 = Range(Domain=dom_3, Steps=number_slider_2)
series_3 = Series(Start=start_5, Step=step_4, Count=addition)
series_4 = Series(Start=start_7, Step=step_5, Count=addition_2)
rad_2 = Radians(Degrees=range_3)
expression = Expression(angle=rad_2, radius=series_3, Expression="radius * Cos(angle)")
panel_6 = Panel(series_4)
expression_2 = Expression(angle=rad_2, radius=series_3, Expression="radius * Sin(angle)")
pt_2 = ConstructPoint(XCoordinate=expression, YCoordinate=expression_2, ZCoordinate=series_4)
intcrv_2 = Interpolate(Vertices=pt_2, Degree=3, Periodic=False, KnotStyle=1)  # -> Curve, Length, Domain
pframes = PerpFrames(Curve=intcrv_2.Curve, Count=10, Align=True)  # -> Frames, Parameters
ellipse = Ellipse(Plane=pframes.Frames, Radius1=1, Radius2=1)  # -> Ellipse, Focus1, Focus2
swp1 = Sweep1(Rail=intcrv_2.Curve, Sections=ellipse.Ellipse, Miter=1)

start_8 = Slider(0, range=-10..10)
step_6 = Slider(1, range=-10..10)
count_3 = Slider(10, range=0..100)
start_9 = Slider(0, range=-10..10)
step_7 = Slider(1.5, range=-10..10)
count_4 = Slider(5, range=0..100)
pt_3 = Point(<point referenced from the Rhino model>)
pdecon = Deconstruct(Point=pt_3)  # -> XComponent, YComponent, ZComponent
series_5 = Series(Start=pdecon.XComponent, Step=step_6, Count=count_3)
series_6 = Series(Start=pdecon.YComponent, Step=step_7, Count=count_4)
panel_7 = Panel(series_5)
graft = GraftTree(Tree=series_6, IncludeEmptyLists=True, IncludeNullItems=True)
panel_8 = Panel(series_6)
pt_4 = ConstructPoint(XCoordinate=series_5, YCoordinate=graft, ZCoordinate=0)
panel_9 = Panel(graft)
