# Grasshopper definition 6.4 Transformations.gh (Grasshopper 1.0.7)

vec = VectorXYZ(XComponent=Slider(1.431, range=0..10), YComponent=Slider(0, range=0..10), ZComponent=Slider(0, range=0..10))  # -> Vector, Length

start = Slider(0, range=0..10)
step = Slider(0.951, range=0..10)
count = Slider(7, range=0..10)
brep = Brep(<brep referenced from the Rhino model>)
pt = Point(<point referenced from the Rhino model>)
pt_2 = Point(<point referenced from the Rhino model>)
pt_3 = Point(<point referenced from the Rhino model>)
pt_4 = Point(<point referenced from the Rhino model>)
srf = Surface(<surface referenced from the Rhino model>)
xy = XYPlane(Origin=pt)
brep_2 = Brep(brep)
xy_2 = XYPlane(Origin=pt)
series = Series(Start=start, Step=step, Count=count)
panel = Panel(series)
rad = Radians(Degrees=Slider(42.01, range=0..360))
xy_3 = XYPlane(Origin=pt)
pl_3pt = Plane3Pt(PointA=pt_3, PointB=pt_4, PointC=pt_2)
brep_3 = Brep(<brep referenced from the Rhino model>)
volume = Volume(Geometry=brep)  # -> Volume, Centroid
sframes = SurfaceFrames(Surface=srf, UCount=Slider(10, range=0..100), VCount=Slider(10, range=0..100))  # -> Frames, Parameters
panel_2 = Panel(brep)
vec_2 = VectorXYZ(XComponent=series, YComponent=0, ZComponent=0)  # -> Vector, Length
panel_3 = Panel(vec_2.Vector)
move = Move(Geometry=brep, Motion=vec.Vector)  # -> Geometry, Transform
scale_nu = ScaleNU(
    Geometry=brep,
    Plane=xy,
    ScaleX=Slider(0.535, range=0..10),
    ScaleY=Slider(9.927, range=0..10),
    ScaleZ=Slider(1.113, range=0..10))  # -> Geometry, Transform
rotate = Rotate(Geometry=brep, Angle=rad, Plane=xy_2)  # -> Geometry, Transform
scale = Scale(Geometry=brep, Center=pt, Factor=Slider(1.692, range=0..10))  # -> Geometry, Transform
orient = Orient(Geometry=brep, Source=xy_3, Target=pl_3pt)  # -> Geometry, Transform
orient_2 = Orient(Geometry=brep, Source=xy_3, Target=sframes.Frames)  # -> Geometry, Transform
move_2 = Move(Geometry=brep_2, Motion=vec_2.Vector)  # -> Geometry, Transform
transform = Transform(Geometry=brep_3, Transform=move_2.Transform)
panel_4 = Panel(move_2.Geometry)
