# Grasshopper definition 7.1 Data Lists.gh (Grasshopper 1.0.7)

srf = Surface(<surface referenced from the Rhino model>)
U = Slider(2, range=1..10)
V = Slider(3, range=1..10)
text_size = Slider(3, range=1..10)
sdivide = DivideSurface(Surface=srf, UCount=U, VCount=V)  # -> Points, Normals, Parameters
panel = Panel(sdivide.Points)
graft = GraftTree(Tree=sdivide.Points, IncludeEmptyLists=True, IncludeNullItems=True)
flatten = FlattenTree(Tree=sdivide.Points, Path="{0}")
dom = ConstructDomain(DomainStart=Slider(1, range=0..10), DomainEnd=Slider(2, range=0..10))
split = SplitList(List=sdivide.Points, Index=Slider(2, range=0..10))  # -> ListA, ListB
shift = ShiftList(List=sdivide.Points, Shift=Slider(1, range=-10..10), Wrap=Toggle(False))
item = ListItem(List=sdivide.Points, Index=Slider(3, range=0..10), Wrap=Toggle(False))
lng = ListLength(List=sdivide.Points)
subset = SubList(List=sdivide.Points, Domain=dom, Wrap=True)  # -> List, Index
points = PointList(Points=subset.List, Size=Slider(4.88, range=0..10))
rev = ReverseList(List=sdivide.Points)
panel_2 = Panel(split.ListA)
panel_3 = Panel(shift)
panel_4 = Panel(lng)
panel_5 = Panel(rev)
panel_6 = Panel(split.ListB)
panel_7 = Panel(item)
panel_8 = Panel(subset.List)
