# Grasshopper definition 7.2 Advanced Data Tree Manipulation.gh (Grasshopper 1.0.7)

srf = Surface(<surface referenced from the Rhino model>)
sdivide = DivideSurface(Surface=srf, UCount=Slider(2, range=0..10), VCount=Slider(3, range=0..10))  # -> Points, Normals, Parameters

panel = Panel(sdivide.Points)
path_mapper = PathMapper(sdivide.Points, source="{a; b; c}(i)", target="{a; b; i}")
panel_2 = Panel(path_mapper)
intcrv = Interpolate(Vertices=path_mapper, Degree=3, Periodic=False, KnotStyle=1)  # -> Curve, Length, Domain
points = PointList(Points=sdivide.Points, Size=Slider(4.4475, range=0..10))

path_mapper_2 = PathMapper(sdivide.Points, source="{a; b; c}", target="{0}")
panel_4 = Panel(path_mapper_2)

path_mapper_3 = PathMapper(sdivide.Points, source="{a; b; c}(i)", target="{a; b; c; i}")
panel_6 = Panel(path_mapper_3)

path_mapper_4 = PathMapper(sdivide.Points, source="{a; b; c}", target="{a; b; pow(c, 3)}")
panel_8 = Panel(path_mapper_4)
path_mapper_5 = PathMapper(sdivide.Points, source="{a; b; c}", target="{a; b; if(c = 0, -1, c)}")
panel_10 = Panel(path_mapper_5)

path_mapper_6 = PathMapper(sdivide.Points, source="{a; b; c}", target="{c}")
panel_12 = Panel(path_mapper_6)

path_mapper_7 = PathMapper(sdivide.Points, source="{a; b; c}", target="{a; b; 2 * c}")
panel_14 = Panel(path_mapper_7)
path_mapper_8 = PathMapper(sdivide.Points, source="{a; b; c}", target="{a; b; 1 + 2 * c}")
panel_15 = Panel(path_mapper_8)
panel_16 = Panel([path_mapper_7, path_mapper_8])

points_2 = PointList(Points=sdivide.Points, Size=Slider(4.4475, range=0..10))

path_mapper_9 = PathMapper(sdivide.Points, source="{a; b; c}", target="{a; b; c + 1}")
panel_18 = Panel(path_mapper_9)
