# Grasshopper definition 8.1 Intersections.gh (Grasshopper 1.0.7)

crv = Curve(<curve referenced from the Rhino model>)
crv_2 = Curve(<curve referenced from the Rhino model>)

cylinder = Brep(<brep referenced from the Rhino model>)
box = Brep(<brep referenced from the Rhino model>)
sphere = Brep(<brep referenced from the Rhino model>)

pt = Point(<point referenced from the Rhino model>)
pt_2 = Point(<point referenced from the Rhino model>)
pt_3 = Point(<point referenced from the Rhino model>)

pl_3pt = Plane3Pt(PointA=pt, PointB=pt_2, PointC=pt_3)
pcx = CurvePlane(Curve=crv_2, Plane=pl_3pt)  # -> Points, ParamsC, ParamsP
bbx = BrepBrep(BrepA=cylinder, BrepB=sphere)  # -> Curves, Points
sdiff = SolidDifference(BrepsA=cylinder, BrepsB=sphere)
runion = RegionUnion(Curves=[crv_2, crv])
rdiff = RegionDifference(CurvesA=crv_2, CurvesB=crv)
sec = BrepPlane(Brep=sphere, Plane=pl_3pt)  # -> Curves, Points
sunion = SolidUnion(Breps=[cylinder, sphere, box])
boundary = BoundarySurfaces(Edges=rdiff)
