# Grasshopper definition 8.1 Randomness.gh (Grasshopper 1.0.7)
# plug-ins: Bifocals

dom = ConstructDomain(DomainStart=Slider(0, range=0..100), DomainEnd=Slider(10, range=0..100))

dom_2 = ConstructDomain(DomainStart=Slider(0, range=0..100), DomainEnd=Slider(10, range=0..100))

dom_3 = ConstructDomain(DomainStart=Slider(0, range=0..100), DomainEnd=Slider(10, range=0..100))

number_slider = Slider(10, range=0..100)
dom_4 = ConstructDomain(DomainStart=Slider(0, range=0..100), DomainEnd=Slider(10, range=0..100))

series = Series(Start=0, Step=1, Count=Slider(11, range=0..100))
random = Random(Range=dom, Number=Slider(1000000, range=0..1000000), Seed=Slider(0, range=0..100000))
random_2 = Random(Range=dom_2, Number=number_slider, Seed=Slider(7427, range=0..100000))
random_3 = Random(Range=dom_3, Number=number_slider, Seed=Slider(1650, range=0..100000))
random_4 = Random(Range=dom_4, Number=number_slider, Seed=Slider(0, range=0..100000))
int = Integer(series)
pt = ConstructPoint(XCoordinate=random_4, YCoordinate=random_3, ZCoordinate=random_2)
round = Round(Number=random)  # -> Nearest, Floor, Ceiling
box = DomainBox(Base=PlaneXY(0, 0, 0), X=dom_4, Y=dom_3, Z=dom_2)
mindex = MemberIndex(Set=round.Floor, Member=int)  # -> Index, Count
panel = Panel(random_4)
panel_2 = Panel(random_3)
panel_3 = Panel(round.Nearest)
panel_4 = Panel(series)
panel_5 = Panel(mindex.Count)
