# Grasshopper definition 8.3 Meshes.gh (Grasshopper 1.0.7)

number_slider = Slider(10, range=0..10)
srf = Surface(<surface referenced from the Rhino model>)
msphere = MeshSphere(Base=PlaneXY(0, 0, 0), Radius=Slider(4.9, range=0..10), UCount=Slider(10, range=0..100), VCount=Slider(10, range=0..100))
mesh = Mesh(<mesh referenced from the Rhino model>)
mesh_uv = MeshSurface(Surface=srf, UCount=number_slider, VCount=number_slider, Overhang=True, Equalize=False)
demesh = DeconstructMesh(Mesh=msphere)  # -> Vertices, Faces, Colours, Normals
facen = FaceNormals(Mesh=msphere)  # -> Centers, Normals
demesh_2 = DeconstructMesh(Mesh=mesh_uv)  # -> Vertices, Faces, Colours, Normals
facen_2 = FaceNormals(Mesh=mesh_uv)  # -> Centers, Normals
points = PointList(Points=demesh.Vertices, Size=Slider(0.561, range=0..10))
points_2 = PointList(Points=demesh_2.Vertices, Size=Slider(0.561, range=0..10))
vdis = VectorDisplay(Anchor=facen.Centers, Vector=facen.Normals)
vdis_2 = VectorDisplay(Anchor=demesh.Vertices, Vector=demesh.Normals)
vdis_3 = VectorDisplay(Anchor=facen_2.Centers, Vector=facen_2.Normals)
vdis_4 = VectorDisplay(Anchor=demesh_2.Vertices, Vector=demesh_2.Normals)
panel = Panel(demesh.Normals)
