# Grasshopper definition 8.4 Color & Images.gh (Grasshopper 1.0.7)

number_slider = Slider(10, range=0..10)
number_slider_2 = Slider(0.05, range=0..1)
colour = ColourPicker(PickedColour=RGB(255, 0, 0))
sqgrid = Square(Plane=PlaneXY(0, 0, 0), Size=Slider(0.1, range=0..0.1), ExtentX=number_slider, ExtentY=number_slider)  # -> Cells, Points
image = ImageSampler(
    sqgrid.Points,
    FilePath="C:\Users\jlx\Desktop\heightfield_terragen.png",
    Filter="Value",
    Interpolate=False,
    Umax=1,
    Umin=0,
    Vmax=1,
    Vmin=0,
    Wrap=1)
image_2 = ImageSampler(
    sqgrid.Points,
    FilePath="C:\Users\jlx\Desktop\joseluis.jpg",
    Filter="Colour",
    Interpolate=False,
    Umax=1,
    Umin=0,
    Vmax=1,
    Vmin=0,
    Wrap=1)
sph = Sphere(Base=sqgrid.Points, Radius=number_slider_2)
panel = Panel(colour)
cyl = Cylinder(Base=sqgrid.Points, Radius=number_slider_2, Length=image)
preview = CustomPreview(Geometry=sph, Material=image_2)
panel_2 = Panel(image)
