# Grasshopper definition E.1 - Pearl Necklace.gh (Grasshopper 1.0.7)

# ---- group: INPUTS
crv = Curve(<curve referenced from the Rhino model>)
number_of_pearls = Slider(53, range=2..100)

# ----
len = Length(Curve=crv)
panel = Panel(len)
expression = Expression(L=len, N=number_of_pearls, Expression="0.5 * L / N")
expression_2 = Expression(x=number_of_pearls, Expression="X - 1")
panel_2 = Panel(expression)
divide = DivideCurve(Curve=crv, Count=expression_2, Kinks=False)  # -> Points, Tangents, Parameters
panel_3 = Panel(divide.Points)
sph = Sphere(Base=divide.Points, Radius=expression)
