# Grasshopper definition E.12 Solar Panels.gh (Grasshopper 1.0.7)

nx = Slider(6, range=0..10)
ny = Slider(6, range=0..10)
srf = Surface(<surface referenced from the Rhino model>)
pt = Point(<point referenced from the Rhino model>)

sframes = SurfaceFrames(Surface=srf, UCount=nx, VCount=ny)  # -> Frames, Parameters
deplane = DeconstructPlane(Plane=sframes.Frames)  # -> Origin, XAxis, YAxis, ZAxis
Z = UnitZ(Factor=Slider(3.71, range=0..10))
move = Move(Geometry=deplane.Origin, Motion=Z)  # -> Geometry, Transform
ln = Line(StartPoint=deplane.Origin, EndPoint=move.Geometry)

vec2pt = Vector2Pt(PointA=pt, PointB=move.Geometry, Unitize=False)  # -> Vector, Length
rev = Reverse(Vector=vec2pt.Vector)
vdis = VectorDisplay(Anchor=move.Geometry, Vector=rev)

Z_2 = UnitZ(Factor=1)
pl = ConstructPlane(Origin=move.Geometry, XAxis=Z_2, YAxis=vec2pt.Vector)
deplane_2 = DeconstructPlane(Plane=pl)  # -> Origin, XAxis, YAxis, ZAxis
vdis_2 = VectorDisplay(Anchor=deplane_2.Origin, Vector=deplane_2.ZAxis)

pl_2 = ConstructPlane(Origin=move.Geometry, XAxis=deplane_2.ZAxis, YAxis=rev)
deplane_3 = DeconstructPlane(Plane=pl_2)  # -> Origin, XAxis, YAxis, ZAxis
vdis_3 = VectorDisplay(Anchor=deplane_3.Origin, Vector=deplane_3.ZAxis)

number_slider = Slider(4.17, range=0..10)
number_slider_2 = Slider(7.06, range=0..10)
expression = Expression(d=number_slider, Expression="-0.5 * d")
expression_2 = Expression(d=number_slider_2, Expression="-0.5 * d")
expression_3 = Expression(d=number_slider, Expression="0.5 * d")
expression_4 = Expression(d=number_slider_2, Expression="0.5 * d")
dom = ConstructDomain(DomainStart=expression, DomainEnd=expression_3)
dom_2 = ConstructDomain(DomainStart=expression_2, DomainEnd=expression_4)

pl_3 = PlaneNormal(Origin=move.Geometry, ZAxis=rev)
rectangle = Rectangle(Plane=pl_3, XSize=dom_2, YSize=dom, Radius=0)  # -> Rectangle, Length
boundary = BoundarySurfaces(Edges=rectangle.Rectangle)

pl_4 = ConstructPlane(Origin=move.Geometry, XAxis=deplane_2.ZAxis, YAxis=deplane_3.ZAxis)
rectangle_2 = Rectangle(Plane=pl_4, XSize=dom_2, YSize=dom, Radius=0)  # -> Rectangle, Length
boundary_2 = BoundarySurfaces(Edges=rectangle_2.Rectangle)
