# Grasshopper definition E.17 Warren Spatial Truss.gh (Grasshopper 1.0.7)

number_slider = Slider(20, range=0..100)
crv = Curve(<curve referenced from the Rhino model>)
crv_2 = Curve(<curve referenced from the Rhino model>)
divide = DivideCurve(Curve=crv, Count=number_slider, Kinks=False)  # -> graft(Points), Tangents, Parameters
divide_2 = DivideCurve(Curve=crv_2, Count=number_slider, Kinks=False)  # -> graft(Points), Tangents, Parameters

end_support = Point(<point referenced from the Rhino model>)
truss_height_l = Slider(3.19, range=0..30)
truss_width_l = Slider(17.05, range=0..30)
start_support = Point(<point referenced from the Rhino model>)
truss_depth_l = Slider(10.41, range=0..30)
spans = Slider(20, range=0..50)
void_spans = Slider(4, range=0..10)

dist = Distance(PointA=start_support, PointB=end_support)
division = Division(A=dist, B=truss_height_l)
division_2 = Division(A=dist, B=truss_depth_l)
division_3 = Division(A=dist, B=truss_width_l)
depth = Number(division_2)
height = Number(division)
width = Number(division_3)

ln = Line(StartPoint=start_support, EndPoint=end_support)
Z = UnitZ(Factor=height)
eval = EvaluateCurve(Curve=ln, Parameter="0.5")  # -> Point, Tangent, Angle
move = Move(Geometry=eval.Point, Motion=Z)  # -> Geometry, Transform
intcrv = Interpolate(Vertices=[start_support, move.Geometry, end_support], Degree=3, Periodic=False, KnotStyle=1)  # -> Curve, Length, Domain

Z_2 = UnitZ(Factor=depth)

pl_3pt = Plane3Pt(PointA=start_support, PointB=end_support, PointC=move.Geometry)
expression = Expression(W=width, Expression="-w / 2")
expression_2 = Expression(W=width, Expression="w / 2")
deplane = DeconstructPlane(Plane=pl_3pt)  # -> Origin, XAxis, YAxis, ZAxis
multiplication = Multiplication(A=deplane.ZAxis, B=expression_2)
multiplication_2 = Multiplication(A=deplane.ZAxis, B=expression)
addition = Addition(A=Z_2, B=multiplication)
addition_2 = Addition(A=Z_2, B=multiplication_2)
vdis = VectorDisplay(Anchor=move.Geometry, Vector=[addition, addition_2])

move_2 = Move(Geometry=move.Geometry, Motion=addition_2)  # -> Geometry, Transform
move_3 = Move(Geometry=move.Geometry, Motion=addition)  # -> Geometry, Transform
intcrv_2 = Interpolate(Vertices=[start_support, move_3.Geometry, end_support], Degree=3, Periodic=False, KnotStyle=1)  # -> Curve, Length, Domain
intcrv_3 = Interpolate(Vertices=[start_support, move_2.Geometry, end_support], Degree=3, Periodic=False, KnotStyle=1)  # -> Curve, Length, Domain

top_left_arch = Curve(intcrv_2.Curve)
top_right_arch = Curve(intcrv_3.Curve)
base_arch = Curve(intcrv.Curve)

divide_3 = DivideCurve(Curve=base_arch, Count=spans, Kinks=False)  # -> Points, Tangents, Parameters
divide_4 = DivideCurve(Curve=top_left_arch, Count=spans, Kinks=False)  # -> Points, Tangents, Parameters
divide_5 = DivideCurve(Curve=top_right_arch, Count=spans, Kinks=False)  # -> Points, Tangents, Parameters
subtraction = Subtraction(A=spans, B=void_spans)
dom = ConstructDomain(DomainStart=void_spans, DomainEnd=subtraction)
subset = SubList(List=divide_3.Points, Domain=dom, Wrap=True)  # -> List, Index
subset_2 = SubList(List=divide_4.Points, Domain=dom, Wrap=True)  # -> List, Index
subset_3 = SubList(List=divide_5.Points, Domain=dom, Wrap=True)  # -> List, Index
panel = Panel("""False
True""")
panel_2 = Panel("""True
False""")
panel_3 = Panel("""True
False""")
cull = CullPattern(List=subset.List, CullPattern=panel)
cull_2 = CullPattern(List=subset_2.List, CullPattern=panel_2)
cull_3 = CullPattern(List=subset_3.List, CullPattern=panel_3)
panel_4 = Panel("""1
0""")
panel_5 = Panel("""1
0""")
weave = Weave(Pattern=panel_4, Stream0=cull, Stream1=cull_2, NullGaps=False)
weave_2 = Weave(Pattern=panel_5, Stream0=cull, Stream1=cull_3, NullGaps=False)
pline = PolyLine(Vertices=weave_2, Closed=False)
pline_2 = PolyLine(Vertices=weave, Closed=False)
ln_2 = Line(StartPoint=cull_2, EndPoint=cull_3)

explode = Explode(Curve=pline_2, Recursive=True)  # -> Segments, Vertices
explode_2 = Explode(Curve=pline, Recursive=True)  # -> Segments, Vertices

flatten = FlattenTree(Tree=intcrv.Curve, Path="{0}")
loft = Loft(Curves=flatten, Options={Adjust=False, Closed=False, LoftEnds=0, LoftSimp=0, LoftType=0, Rebuild=10, Refit=0.01})
pipe = Pipe(Curve=[ln_2, explode.Segments, explode_2.Segments], Radius=Slider(0.026, range=0..0.1), Caps=0)
pipe_2 = Pipe(Curve=[base_arch, top_left_arch, top_right_arch], Radius=Slider(0.05, range=0..1), Caps=0)
