# Grasshopper definition E.18 Triangulated Facade.gh (Grasshopper 1.0.7)

crv = Curve(<curve referenced from the Rhino model>)
crv_2 = Curve(<curve referenced from the Rhino model>)
spans = Slider(9, range=0..50)
panel_separation = Slider(10, range=0..10)

divide = DivideCurve(Curve=crv, Count=spans, Kinks=False)  # -> Points, Tangents, Parameters
loft = Loft(Curves=[crv, crv_2], Options={Adjust=False, Closed=False, LoftEnds=0, LoftSimp=0, LoftType=0, Rebuild=10, Refit=0.01})
divide_2 = DivideCurve(Curve=crv_2, Count=spans, Kinks=False)  # -> Points, Tangents, Parameters

bottom_nodes = Point(divide.Points)
top_nodes = Point(divide_2.Points)

shift = ShiftList(List=top_nodes, Shift="-1", Wrap="False")
shift_2 = ShiftList(List=bottom_nodes, Shift="-1", Wrap="False")
shift_3 = ShiftList(List=top_nodes, Shift="1", Wrap="False")
shift_4 = ShiftList(List=bottom_nodes, Shift="1", Wrap="False")
bottom_nodes_minus_last = Point(shift_2)
bottom_nodes_minus_first = Point(shift_4)
top_nodes_minus_last = Point(shift)
top_nodes_minus_first = Point(shift_3)

series = Series(Start=0, Step=panel_separation, Count=spans)
expression = Expression(x=panel_separation, Expression="X / 2")
xy = XYPlane(Origin=Point(0, 0, 0))
X = UnitX(Factor=series)
X_2 = UnitX(Factor=expression)
move = Move(Geometry=xy, Motion=X)  # -> Geometry, Transform
move_2 = Move(Geometry=xy, Motion=X_2)  # -> Geometry, Transform
move_3 = Move(Geometry=move_2.Geometry, Motion=X)  # -> Geometry, Transform

points = PointList(Points=top_nodes_minus_last, Size=Slider(1, range=0..1))

srf4pt = _4PointSurface(CornerA=bottom_nodes_minus_last, CornerB=bottom_nodes_minus_first, CornerC=top_nodes_minus_last)
srf4pt_2 = _4PointSurface(CornerA=bottom_nodes_minus_first, CornerB=top_nodes_minus_first, CornerC=top_nodes_minus_last)

pl_3pt = Plane3Pt(PointA=bottom_nodes_minus_last, PointB=bottom_nodes_minus_first, PointC=top_nodes_minus_last)
pl_3pt_2 = Plane3Pt(PointA=top_nodes_minus_first, PointB=top_nodes_minus_last, PointC=bottom_nodes_minus_first)
orient = Orient(Geometry=srf4pt, Source=pl_3pt, Target=move.Geometry)  # -> Geometry, Transform
orient_2 = Orient(Geometry=srf4pt_2, Source=pl_3pt_2, Target=move_3.Geometry)  # -> Geometry, Transform

series_2 = Series(Start=0, Step=1, Count=spans)
concat = Concatenate(FragmentA="T-", FragmentB=series_2)
number_slider = Slider(0.8136, range=0..1)
concat_2 = Concatenate(FragmentA="B-", FragmentB=series_2)
tag = TextTag3D(Location=move_3.Geometry, Text=concat, Size=number_slider, Justification=7)
tag_2 = TextTag3D(Location=move.Geometry, Text=concat_2, Size=number_slider, Justification=7)

panel = Panel(concat_2)
