# Grasshopper definition E.19 Triangulated Surface.gh (Grasshopper 1.0.7)

srf = Surface(<surface referenced from the Rhino model>)
number_slider = Slider(5, range=0..10)
number_slider_2 = Slider(7, range=0..10)
pt = Point(<point referenced from the Rhino model>)
pt_2 = Point(<point referenced from the Rhino model>)
dx = Slider(12.181, range=0..100)
dy = Slider(13.272, range=0..100)

sdivide = DivideSurface(Surface=srf, UCount=number_slider, VCount=number_slider_2)  # -> Points, Normals, Parameters
tstat = TreeStatistics(Tree=sdivide.Points)  # -> Paths, Length, Count

panel = Panel(sdivide.Points)

shift = ShiftList(List=tstat.Paths, Shift="1", Wrap="False")
branch = TreeBranch(Tree=sdivide.Points, Path=shift, MaintainPaths=True)
shift_2 = ShiftList(List=branch, Shift="1", Wrap="False")

shift_3 = ShiftList(List=tstat.Paths, Shift="-1", Wrap="False")
branch_2 = TreeBranch(Tree=sdivide.Points, Path=shift_3, MaintainPaths=True)
shift_4 = ShiftList(List=branch_2, Shift="1", Wrap="False")

shift_5 = ShiftList(List=tstat.Paths, Shift="1", Wrap="False")
branch_3 = TreeBranch(Tree=sdivide.Points, Path=shift_5, MaintainPaths=True)
shift_6 = ShiftList(List=branch_3, Shift="-1", Wrap="False")

shift_7 = ShiftList(List=tstat.Paths, Shift="-1", Wrap="False")
branch_4 = TreeBranch(Tree=sdivide.Points, Path=shift_7, MaintainPaths=True)
shift_8 = ShiftList(List=branch_4, Shift="-1", Wrap="False")

points = PointList(Points=shift_2, Size=Slider(4.514, range=0..10))

bottom_right_points = Point(shift_4)
bottom_left_points = Point(shift_8)
top_right_points = Point(shift_2)
top_left_points = Point(shift_6)

srf4pt = _4PointSurface(CornerA=bottom_left_points, CornerB=bottom_right_points, CornerC=top_left_points)
srf4pt_2 = _4PointSurface(CornerA=bottom_right_points, CornerB=top_right_points, CornerC=top_left_points)

pl_3pt = Plane3Pt(PointA=bottom_left_points, PointB=bottom_right_points, PointC=top_left_points)
pl_3pt_2 = Plane3Pt(PointA=top_right_points, PointB=top_left_points, PointC=bottom_right_points)

xy = XYPlane(Origin=pt)
series = Series(Start=0, Step=dy, Count=number_slider)
series_2 = Series(Start=0, Step=dx, Count=number_slider_2)
Y = UnitY(Factor=series)
X = UnitX(Factor=series_2)
move = Move(Geometry=xy, Motion=X)  # -> graft(Geometry), Transform
move_2 = Move(Geometry=move.Geometry, Motion=Y)  # -> Geometry, Transform
flip = FlipMatrix(Data=move_2.Geometry)
orient = Orient(Geometry=srf4pt, Source=pl_3pt, Target=flip)  # -> Geometry, Transform

xy_2 = XYPlane(Origin=pt_2)
series_3 = Series(Start=0, Step=dy, Count=number_slider)
series_4 = Series(Start=0, Step=dx, Count=number_slider_2)
Y_2 = UnitY(Factor=series_3)
X_2 = UnitX(Factor=series_4)
move_3 = Move(Geometry=xy_2, Motion=X_2)  # -> graft(Geometry), Transform
move_4 = Move(Geometry=move_3.Geometry, Motion=Y_2)  # -> Geometry, Transform
flip_2 = FlipMatrix(Data=move_4.Geometry)
orient_2 = Orient(Geometry=srf4pt_2, Source=pl_3pt_2, Target=flip_2)  # -> Geometry, Transform

srf_2 = Surface(orient.Geometry)
srf_3 = Surface(orient_2.Geometry)
