# Grasshopper definition E.2 - Drinking Glass.gh (Grasshopper 1.0.7)

# ---- group: INPUTS
h = Slider(6.171, range=0..10)
pt = Point(<point referenced from the Rhino model>)
R = Slider(2.277, range=0..10)
b = Slider(0.736, range=-5..5)

# ---- group: REVOLUTION AXIS
pdecon = Deconstruct(Point=pt)  # -> XComponent, YComponent, ZComponent
addition = Addition(A=pdecon.ZComponent, B="1")
pt_2 = ConstructPoint(XCoordinate=pdecon.XComponent, YCoordinate=pdecon.YComponent, ZCoordinate=addition)
ln = Line(StartPoint=pt, EndPoint=pt_2)

# ---- group: POINT 1
pdecon_2 = Deconstruct(Point=pt)  # -> XComponent, YComponent, ZComponent
addition_2 = Addition(A=pdecon_2.XComponent, B=R)
pt_3 = ConstructPoint(XCoordinate=addition_2, YCoordinate=pdecon_2.YComponent, ZCoordinate=pdecon_2.ZComponent)

# ---- group: POINT 2
pdecon_3 = Deconstruct(Point=pt_3)  # -> XComponent, YComponent, ZComponent
addition_3 = Addition(A=b, B=pdecon_3.XComponent)
addition_4 = Addition(A=pdecon_3.ZComponent, B=h)
pt_4 = ConstructPoint(XCoordinate=addition_3, YCoordinate=pdecon_3.YComponent, ZCoordinate=addition_4)

# ---- group: SURFACE
pline = PolyLine(Vertices=[pt, pt_3, pt_4], Closed=False)
revsrf = Revolution(Curve=pline, Axis=ln, Domain=Domain(0, 6.283185307))
