# Grasshopper definition E.20 Sections.gh (Grasshopper 1.0.7)

brep = Brep(<brep referenced from the Rhino model>)
crv = Curve(<curve referenced from the Rhino model>)
sections = Slider(20, range=0..100)
distance_between_drawings = Slider(5.978, range=0..10)
section_margin = Slider(0.779, range=0..1)
pt = Point(<point referenced from the Rhino model>)

bbox = BoundingBox(Content=brep, Plane=PlaneXY(0, 0, 0))  # -> Box, Box_2
box_corners = BoxCorners(Box=bbox.Box)  # -> CornerA, CornerB, CornerC, CornerD, CornerE, CornerF, CornerG, CornerH
wires = BrepWireframe(Brep=bbox.Box, Density=-1)
ln = Line(StartPoint=box_corners.CornerA, EndPoint=box_corners.CornerD)
item = ListItem(List=wires, Index="3", Wrap=True)

expression = Expression(x=sections, Expression="x - 1")
divide = DivideCurve(Curve=ln, Count=expression, Kinks=False)  # -> Points, Tangents, Parameters
xz = XZPlane(Origin=divide.Points)
graft = GraftTree(Tree=xz, IncludeEmptyLists=True, IncludeNullItems=True)
sec = BrepPlane(Brep=brep, Plane=xz)  # -> Curves, Points

xy = XYPlane(Origin=pt)
series = Series(Start=0, Step=distance_between_drawings, Count=sections)
Y = UnitY(Factor=series)
move = Move(Geometry=xy, Motion=Y)  # -> Geometry, Transform
graft_2 = GraftTree(Tree=move.Geometry, IncludeEmptyLists=True, IncludeNullItems=True)

panel = Panel(series)
panel_2 = Panel(sec.Curves)

bbox_2 = BoundingBox(Content=sec.Curves, Plane=PlaneXY(0, 0, 0), UnionBox=True)  # -> Box, Box_2
debox = DeconstructBox(Box=bbox_2.Box_2)  # -> Plane, X, Y, Z
nullrep = ReplaceNulls(Items=debox.Z, Replacements="0")  # -> Items, Count
dedomain = DeconstructDomain(Domain=nullrep.Items)  # -> Start, End
subtraction = Subtraction(A=dedomain.End, B=dedomain.Start)

section_heights = Number(subtraction)

flatten = FlattenTree(Tree=section_heights, Path="{0}")
addition = Addition(A=section_margin, B=flatten)
merge = Merge(Data1="0", Data2=addition)
ma = MassAddition(Input=merge)  # -> Result, PartialResults

panel_3 = Panel(ma.PartialResults)

xy_2 = XYPlane(Origin=pt)
Y_2 = UnitY(Factor=ma.PartialResults)
move_2 = Move(Geometry=xy_2, Motion=Y_2)  # -> Geometry, Transform
graft_3 = GraftTree(Tree=move_2.Geometry, IncludeEmptyLists=True, IncludeNullItems=True)
orient = Orient(Geometry=sec.Curves, Source=graft, Target=graft_3)  # -> Geometry, Transform
orient_2 = Orient(Geometry=bbox_2.Box_2, Source=graft, Target=graft_3)  # -> Geometry, Transform

# ---- group: OUTPUTS
sections_2 = Curve(sec.Curves)
sections_bb = Geometry(orient_2.Geometry)
sections_xy = Curve(orient.Geometry)
