# Grasshopper definition E.21 Landscape with Random Vegetation.gh (Grasshopper 1.0.7)

landscape = Surface(<surface referenced from the Rhino model>)
crv = Curve([<curve referenced from the Rhino model> x13])
pt = Point(<point referenced from the Rhino model>)
count = Slider(222, range=0..1000)
seed = Slider(1000, range=0..1000)
min_scale = Slider(1, range=0..10)
max_scale = Slider(5.4338, range=0..10)

addition = Addition(A=seed, B="1")
random = Random(Range=Domain(0, 1), Number=count, Seed=seed)
random_2 = Random(Range=Domain(0, 1), Number=count, Seed=addition)
pt_2 = ConstructPoint(XCoordinate=random, YCoordinate=random_2, ZCoordinate=0)
evalsrf = EvaluateSurface(Surface=reparameterize(landscape), Point=pt_2)  # -> Point, Normal, UDirection, VDirection, Frame

dom = ConstructDomain(DomainStart="0", DomainEnd="2 * Pi")
random_3 = Random(Range=dom, Number=count, Seed=2)

dom_2 = ConstructDomain(DomainStart=min_scale, DomainEnd=max_scale)
random_4 = Random(Range=dom_2, Number=count, Seed=2)
graft = GraftTree(Tree=random_4, IncludeEmptyLists=True, IncludeNullItems=True)

panel = Panel(random_4)

xy = XYPlane(Origin=evalsrf.Point)
xy_2 = XYPlane(Origin=pt)

rotate = Rotate(Geometry=xy, Angle=random_3, Plane=xy)  # -> Geometry, Transform

graft_2 = GraftTree(Tree=rotate.Geometry, IncludeEmptyLists=True, IncludeNullItems=True)
orient = Orient(Geometry=crv, Source=xy_2, Target=graft_2)  # -> Geometry, Transform

scale = Scale(Geometry=orient.Geometry, Center=graft_2, Factor=graft)  # -> Geometry, Transform
