# Grasshopper definition E.22 Wind-swept Grass.gh (Grasshopper 1.0.7)
# plug-ins: Bifocals

srf = Surface(<surface referenced from the Rhino model>)
count = Slider(1000, range=0..1000)
root_tangency = Slider(4.579, range=0..10)
grass_base_height = Slider(10, range=0..10)
grass_random_variation = Slider(2.858, range=0..10)
time = Slider(30, range=0..30)
random_seed = Slider(1000, range=0..1000)
pt = Point(<point referenced from the Rhino model>)

addition = Addition(A=random_seed, B="1")
random = Random(Range=Domain(0, 1), Number=count, Seed=random_seed)
random_2 = Random(Range=Domain(0, 1), Number=count, Seed=addition)
pt_2 = ConstructPoint(XCoordinate=random, YCoordinate=random_2, ZCoordinate=0)
evalsrf = EvaluateSurface(Surface=reparameterize(srf), Point=pt_2)  # -> Point, Normal, UDirection, VDirection, Frame
deplane = DeconstructPlane(Plane=evalsrf.Frame)  # -> Origin, XAxis, YAxis, ZAxis

neg = Negative(Value=grass_random_variation)
dom = ConstructDomain(DomainStart=neg, DomainEnd=grass_random_variation)
subtraction = Subtraction(A=grass_base_height, B=root_tangency)
random_3 = Random(Range=dom, Number=count, Seed=2)
addition_2 = Addition(A=subtraction, B=random_3)
Z = UnitZ(Factor=addition_2)

multiplication = Multiplication(A=deplane.ZAxis, B=root_tangency)
vdis = VectorDisplay(Anchor=deplane.Origin, Vector=multiplication)
move = Move(Geometry=deplane.Origin, Motion=multiplication)  # -> Geometry, Transform
move_2 = Move(Geometry=move.Geometry, Motion=Z)  # -> Geometry, Transform

vec2pt = Vector2Pt(PointA=pt, PointB=move_2.Geometry, Unitize=False)  # -> Vector, Length
addition_3 = Addition(A=vec2pt.Length, B=time)
sin = Sine(Value=addition_3)
vdis_2 = VectorDisplay(Anchor=pt, Vector=vec2pt.Vector)
amp = Amplitude(Vector=vec2pt.Vector, Amplitude=sin)
move_3 = Move(Geometry=move_2.Geometry, Motion=amp)  # -> Geometry, Transform

graft = GraftTree(Tree=deplane.Origin, IncludeEmptyLists=True, IncludeNullItems=True)
graft_2 = GraftTree(Tree=move.Geometry, IncludeEmptyLists=True, IncludeNullItems=True)
graft_3 = GraftTree(Tree=move_3.Geometry, IncludeEmptyLists=True, IncludeNullItems=True)

panel = Panel(addition_2)
nurbs = NurbsCurve(Vertices=[graft, graft_2, graft_3], Degree=3, Periodic=False)  # -> Curve, Length, Domain

pt_3 = Point(graft_3)
crv = Curve(nurbs.Curve)

panel_2 = Panel([graft, graft_2, graft_3])
