# Grasshopper definition E.23 Random Panel Facade.gh (Grasshopper 1.0.7)

# ---- group: INPUTS
height = Slider(32.45, range=0..100)
width = Slider(40.39, range=0..100)
nh = Slider(5, range=0..100)
nw = Slider(14, range=0..100)
seed = Slider(933, range=0..1000)

# ---- group: VERTICAL VARIATION
number_slider = Slider(1.27, range=0..10)
number_slider_2 = Slider(2.13, range=0..10)

# ---- group: HORIZONTAL VARIATION
number_slider_3 = Slider(1.28, range=0..10)
number_slider_4 = Slider(2.94, range=0..10)

# ----
xy = XYPlane(Origin=Point(0, 0, 0))
rectangle = Rectangle(Plane=xy, XSize=width, YSize=height, Radius=0)  # -> Rectangle, Length

boundary = BoundarySurfaces(Edges=rectangle.Rectangle)

addition = Addition(A=seed, B="1")
dom = ConstructDomain(DomainStart=number_slider_3, DomainEnd=number_slider_4)
series = Series(Start=addition, Step=1, Count=nh)
random = Random(Range=dom, Number=nw, Seed=series)
ma = MassAddition(Input=random)  # -> Result, PartialResults
division = Division(A=width, B=ma.Result)
multiplication = Multiplication(A=random, B=division)
ma_2 = MassAddition(Input=multiplication)  # -> Result, PartialResults
X = UnitX(Factor=ma_2.PartialResults)

panel = Panel(random)
panel_2 = Panel(multiplication)

dom_2 = ConstructDomain(DomainStart=number_slider, DomainEnd=number_slider_2)
random_2 = Random(Range=dom_2, Number=nh, Seed=seed)
ma_3 = MassAddition(Input=random_2)  # -> Result, PartialResults
division_2 = Division(A=height, B=ma_3.Result)
multiplication_2 = Multiplication(A=division_2, B=random_2)
ma_4 = MassAddition(Input=multiplication_2)  # -> Result, PartialResults
Y = UnitY(Factor=ma_4.PartialResults)
move = Move(Geometry=xy, Motion=Y)  # -> Geometry, Transform

panel_3 = Panel(multiplication_2)
panel_4 = Panel(ma_3.PartialResults)
flatten = FlattenTree(Tree=move.Geometry, Path="{0}")

merge = Merge(Data1=xy, Data2=flatten)
shift = ShiftList(List=merge, Shift=-1, Wrap=False)
rectangle_2 = Rectangle(Plane=shift, XSize=width, YSize=multiplication_2, Radius=0)  # -> Rectangle, Length

graft = GraftTree(Tree=shift, IncludeEmptyLists=True, IncludeNullItems=True)

move_2 = Move(Geometry=graft, Motion=X)  # -> Geometry, Transform
merge_2 = Merge(Data1=graft, Data2=move_2.Geometry)
shift_2 = ShiftList(List=merge_2, Shift=-1, Wrap=False)
graft_2 = GraftTree(Tree=multiplication_2, IncludeEmptyLists=True, IncludeNullItems=True)
rectangle_3 = Rectangle(Plane=shift_2, XSize=multiplication, YSize=graft_2, Radius=0)  # -> Rectangle, Length

rec = Rectangle(rectangle_3.Rectangle)
boundary_2 = BoundarySurfaces(Edges=rec)

panel_5 = Panel(rectangle_3.Rectangle)

panel_6 = Panel(graft)
