# Grasshopper definition E.24 Exploding Brick Wall.gh (Grasshopper 1.0.7)

time = Slider(0, range=0..25)

pt = Point(<point referenced from the Rhino model>)
nh = Slider(11, range=0..25)
nv = Slider(18, range=0..25)
w = Slider(0.8, range=0..1)
h = Slider(0.2, range=0..1)
d = Slider(0.4, range=0..1)
mortar_thickness = Slider(0.02, range=0..0.2)

pt_2 = Point(<point referenced from the Rhino model>)
xy = XYPlane(Origin=pt)

expression = Expression(w=w, nh=nh, Expression="w * (nh - 0.5)")
expression_2 = Expression(x=nv, Expression="Floor(0.5 * x)")
expression_3 = Expression(x=w, Expression="-0.25 * x")
expression_4 = Expression(x=h, Expression="2 * x")
series = Series(Start=0, Step=expression, Count="2")
vec = VectorXYZ(XComponent=expression_3, YComponent=0, ZComponent=h)  # -> Vector, Length
series_2 = Series(Start=0, Step=expression_4, Count=expression_2)
move = Move(Geometry=xy, Motion=vec.Vector)  # -> Geometry, Transform
Z = UnitZ(Factor=series_2)
X = UnitX(Factor=series)
graft = GraftTree(Tree=Z, IncludeEmptyLists=True, IncludeNullItems=True)
move_2 = Move(Geometry=move.Geometry, Motion=X)  # -> Geometry, Transform
move_3 = Move(Geometry=move_2.Geometry, Motion=graft)  # -> Geometry, Transform

expression_5 = Expression(x=nv, Expression="Floor(0.5 * x)")
expression_6 = Expression(x=w, Expression="0.5 * x")
expression_7 = Expression(x=nh, Expression="X - 1")
expression_8 = Expression(x=h, Expression="2 * x")
vec_2 = VectorXYZ(XComponent=expression_6, YComponent=0, ZComponent=h)  # -> Vector, Length
series_3 = Series(Start=0, Step=w, Count=expression_7)
series_4 = Series(Start=0, Step=expression_8, Count=expression_5)
move_4 = Move(Geometry=xy, Motion=vec_2.Vector)  # -> Geometry, Transform
Z_2 = UnitZ(Factor=series_4)
X_2 = UnitX(Factor=series_3)
move_5 = Move(Geometry=move_4.Geometry, Motion=X_2)  # -> Geometry, Transform
graft_2 = GraftTree(Tree=Z_2, IncludeEmptyLists=True, IncludeNullItems=True)
move_6 = Move(Geometry=move_5.Geometry, Motion=graft_2)  # -> Geometry, Transform

expression_9 = Expression(x=nv, Expression="0.5 * x")
expression_10 = Expression(x=h, Expression="2 * x")
series_5 = Series(Start=0, Step=expression_10, Count=expression_9)
series_6 = Series(Start=0, Step=w, Count=nh)
Z_3 = UnitZ(Factor=series_5)
X_3 = UnitX(Factor=series_6)
graft_3 = GraftTree(Tree=Z_3, IncludeEmptyLists=True, IncludeNullItems=True)
move_7 = Move(Geometry=xy, Motion=X_3)  # -> Geometry, Transform
move_8 = Move(Geometry=move_7.Geometry, Motion=graft_3)  # -> Geometry, Transform

panel = Panel(move_8.Geometry)
base_brick_planes = Plane(move_8.Geometry)
central_brick_planes = Plane(move_6.Geometry)
edge_brick_planes = Plane(move_3.Geometry)

pln = Plane(flatten([base_brick_planes, central_brick_planes]))
pln_2 = Plane(flatten(edge_brick_planes))
vec2pt = Vector2Pt(PointA=pt_2, PointB=pln, Unitize=False)  # -> Vector, Length
vec2pt_2 = Vector2Pt(PointA=pt_2, PointB=pln_2, Unitize=False)  # -> Vector, Length
expression_11 = Expression(x=vec2pt.Length, Expression="1 / x")
expression_12 = Expression(x=vec2pt_2.Length, Expression="1 / x")
multiplication = Multiplication(A=time, B=expression_11)
multiplication_2 = Multiplication(A=time, B=expression_12)
amp = Amplitude(Vector=vec2pt.Vector, Amplitude=multiplication)
amp_2 = Amplitude(Vector=vec2pt_2.Vector, Amplitude=multiplication_2)
move_9 = Move(Geometry=pln, Motion=amp)  # -> Geometry, Transform
move_10 = Move(Geometry=pln_2, Motion=amp_2)  # -> Geometry, Transform

number_slider = Slider(286, range=0..1000)
expression_13 = Expression(x=number_slider, Expression="x + 1")
expression_14 = Expression(x=number_slider, Expression="x + 2")
lng = ListLength(List=move_10.Geometry)
random = Random(Range="-1 To 1", Number=lng, Seed=number_slider)
random_2 = Random(Range="-1 To 1", Number=lng, Seed=expression_13)
random_3 = Random(Range="-1 To 1", Number=lng, Seed=expression_14)
vec_3 = VectorXYZ(XComponent=random, YComponent=random_2, ZComponent=random_3)  # -> Vector, Length
deplane = DeconstructPlane(Plane=move_10.Geometry)  # -> Origin, XAxis, YAxis, ZAxis
rot3d = Rotate3D(Geometry=move_10.Geometry, Angle=multiplication_2, Center=deplane.Origin, Axis=vec_3.Vector)  # -> Geometry, Transform

number_slider_2 = Slider(286, range=0..1000)
expression_15 = Expression(x=number_slider_2, Expression="x + 1")
expression_16 = Expression(x=number_slider_2, Expression="x + 2")
lng_2 = ListLength(List=move_9.Geometry)
random_4 = Random(Range="-1 To 1", Number=lng_2, Seed=number_slider_2)
random_5 = Random(Range="-1 To 1", Number=lng_2, Seed=expression_15)
random_6 = Random(Range="-1 To 1", Number=lng_2, Seed=expression_16)
vec_4 = VectorXYZ(XComponent=random_4, YComponent=random_5, ZComponent=random_6)  # -> Vector, Length
deplane_2 = DeconstructPlane(Plane=move_9.Geometry)  # -> Origin, XAxis, YAxis, ZAxis
rot3d_2 = Rotate3D(Geometry=move_9.Geometry, Angle=multiplication, Center=deplane_2.Origin, Axis=vec_4.Vector)  # -> Geometry, Transform

expression_17 = Expression(x=d, y=mortar_thickness, Expression="(x - y) / 2")
expression_18 = Expression(x=h, y=mortar_thickness, Expression="(x - y) / 2")
expression_19 = Expression(x=w, y=mortar_thickness, Expression="(x - y) / 2")
box = CenterBox(Base=rot3d_2.Geometry, X=expression_19, Y=expression_17, Z=expression_18)

expression_20 = Expression(x=w, y=mortar_thickness, Expression="(x - 2 * y) / 4")
expression_21 = Expression(x=d, y=mortar_thickness, Expression="(x - y) / 2")
expression_22 = Expression(x=h, y=mortar_thickness, Expression="(x - y) / 2")
box_2 = CenterBox(Base=rot3d.Geometry, X=expression_20, Y=expression_21, Z=expression_22)
