# Grasshopper definition E.25 Mesh Manipulation.gh (Grasshopper 1.0.7)

mesh = Mesh(<mesh referenced from the Rhino model>)
pt = Point(<point referenced from the Rhino model>)

demesh = DeconstructMesh(Mesh=mesh)  # -> Vertices, Faces, Colours, Normals
dist = Distance(PointA=demesh.Vertices, PointB=pt)
vdis = VectorDisplay(Anchor=demesh.Vertices, Vector=demesh.Normals)
expression = Expression(x=dist, y=Slider(0.565, range=0..10), Expression="y / x")
amp = Amplitude(Vector=demesh.Normals, Amplitude=expression)
move = Move(Geometry=demesh.Vertices, Motion=amp)  # -> Geometry, Transform
ln = Line(StartPoint=demesh.Vertices, EndPoint=move.Geometry)
conmesh = ConstructMesh(Vertices=move.Geometry, Faces=demesh.Faces)

mesh_2 = Mesh(conmesh)

bbox = BoundingBox(Content=mesh, Plane=PlaneXY(0, 0, 0))  # -> Box, Box_2
box_corners = BoxCorners(Box=bbox.Box)  # -> CornerA, CornerB, CornerC, CornerD, CornerE, CornerF, CornerG, CornerH
ln_2 = Line(StartPoint=box_corners.CornerA, EndPoint=box_corners.CornerE)
eval = EvaluateCurve(Curve=ln_2, Parameter=Slider(0.5, range=0..1))  # -> Point, Tangent, Angle
pdecon = Deconstruct(Point=demesh.Vertices)  # -> XComponent, YComponent, ZComponent
pdecon_2 = Deconstruct(Point=eval.Point)  # -> XComponent, YComponent, ZComponent
expression_2 = Expression(zV=pdecon.ZComponent, zA=pdecon_2.ZComponent, factor=Slider(0.328, range=0..1), Expression="factor * abs(zA - zV)")
amp_2 = Amplitude(Vector=demesh.Normals, Amplitude=expression_2)
move_2 = Move(Geometry=demesh.Vertices, Motion=amp_2)  # -> Geometry, Transform
ln_3 = Line(StartPoint=demesh.Vertices, EndPoint=move_2.Geometry)
conmesh_2 = ConstructMesh(Vertices=move_2.Geometry, Faces=demesh.Faces)

points = PointList(Points=demesh.Vertices, Size=Slider(0.106, range=0..10))
panel = Panel(expression_2)
