# Grasshopper definition E.26 Mesh Solar Analysis.gh (Grasshopper 1.0.7)

srf = Surface(<surface referenced from the Rhino model>)
crv = Curve(<curve referenced from the Rhino model>)
U = Slider(8, range=0..100)
V = Slider(27, range=0..100)
pt = Point(<point referenced from the Rhino model>)

eval = EvaluateCurve(Curve=reparameterize(crv), Parameter=Slider(1, range=0..1))  # -> Point, Tangent, Angle

mesh_uv = MeshSurface(Surface=srf, UCount=U, VCount=V, Overhang=True, Equalize=False)
demesh = DeconstructMesh(Mesh=mesh_uv)  # -> Vertices, Faces, Colours, Normals
vdis = VectorDisplay(Anchor=demesh.Vertices, Vector=demesh.Normals)

vec2pt = Vector2Pt(PointA=eval.Point, PointB=demesh.Vertices, Unitize=False)  # -> Vector, Length
vdis_2 = VectorDisplay(Anchor=eval.Point, Vector=vec2pt.Vector)
angle = Angle(VectorA=vec2pt.Vector, VectorB=demesh.Normals)  # -> Angle, Reflex
remap = RemapNumbers(Value=angle.Angle, Source="0 To Pi", Target="0 To 1")  # -> Mapped, Clipped

gradient = Gradient(
    LowerLimit=0,
    UpperLimit=1,
    Parameter=remap.Mapped,
    stops=[0.452: RGB(75, 107, 169), 0.589: RGB(173, 203, 249), 0.732: RGB(254, 244, 84), 0.856: RGB(234, 126, 0), 1: RGB(234, 38, 0)])
conmesh = ConstructMesh(Vertices=demesh.Vertices, Faces=demesh.Faces, Colours=gradient)

mesh = Mesh(conmesh)

panel = Panel(angle.Angle)
panel_2 = Panel(remap.Mapped)
panel_3 = Panel(gradient)
