# Grasshopper definition E.27 Slicer.gh (Grasshopper 1.0.7)

mesh = Mesh(<mesh referenced from the Rhino model>)
layer_height = Slider(0.038, range=0..1)

layer_height_2 = Slider(0.2, range=0..10)
layer_height_3 = Slider(0.2, range=0..10)
layer_height_4 = Slider(0.2, range=0..10)

bbox = BoundingBox(Content=mesh, Plane=PlaneXY(0, 0, 0))  # -> Box, Box_2
box_corners = BoxCorners(Box=bbox.Box)  # -> CornerA, CornerB, CornerC, CornerD, CornerE, CornerF, CornerG, CornerH
ln = Line(StartPoint=box_corners.CornerA, EndPoint=box_corners.CornerE)
divlength = DivideLength(Curve=ln, Length=layer_height)  # -> Points, Tangents, Parameters
xy = XYPlane(Origin=divlength.Points)
sec = MeshPlane(Mesh=mesh, Plane=xy)

clean = CleanTree(RemoveNulls=True, RemoveInvalid=True, RemoveEmpty=True, Tree=sec)
explode = Explode(Curve=clean, Recursive=True)  # -> Segments, Vertices
pdecon = Deconstruct(Point=explode.Vertices)  # -> XComponent, YComponent, ZComponent
viewer = ParamViewer(explode.Vertices)
concat = Concatenate(
    FragmentA="G1 X",
    FragmentB=pdecon.XComponent,
    FragmentC=" Y",
    FragmentD=pdecon.YComponent,
    FragmentE=" Z",
    FragmentF=pdecon.ZComponent)
flatten = FlattenTree(Tree=concat, Path="{0}")

panel = Panel(flatten)
panel_2 = Panel(clean)
