# Grasshopper definition E.28 Image-based Pattern.gh (Grasshopper 1.0.7)

brightness_threshold = Slider(0.6712, range=0..1)
number_of_cells = Slider(65, range=0..100)
grid_size = Slider(10, range=0..10)

division = Division(A=grid_size, B=number_of_cells)
sqgrid = Square(Plane=PlaneXY(0, 0, 0), Size=division, ExtentX=number_of_cells, ExtentY=number_of_cells)  # -> Cells, Points

image = ImageSampler(
    sqgrid.Points,
    FilePath="C:\Users\jlx\Desktop\joseluis.jpg",
    Filter="Value",
    Interpolate=False,
    Umax=10,
    Umin=0,
    Vmax=10,
    Vmin=0,
    Wrap=1)

panel = Panel(image)
smaller = SmallerThan(FirstNumber=image, SecondNumber=brightness_threshold)  # -> SmallerThan, OrEqualTo
cull = CullPattern(List=image, CullPattern=smaller.SmallerThan)
panel_2 = Panel(cull)
expression = Expression(cellSize=division, brightness=cull, Expression="0.5 * cellSize * (1 - brightness)")

cull_2 = CullPattern(List=sqgrid.Points, CullPattern=smaller.SmallerThan)
cir = Circle(Plane=cull_2, Radius=expression)
boundary = BoundarySurfaces(Edges=cir)
