# Grasshopper definition E.29 Terrain from Heighfield Image.gh (Grasshopper 1.0.7)

grid_size = Slider(10, range=0..10)
max_height = Slider(2.61, range=0..10)
definition_uv = Slider(50, range=0..50)
isocurve_height = Slider(0.05, range=0..1)
of_isocurves = Slider(41, range=0..100)

rectangle = Rectangle(Plane=PlaneXY(0, 0, 0), XSize=grid_size, YSize=grid_size, Radius=0)  # -> Rectangle, Length
mplane = MeshPlane(Boundary=rectangle.Rectangle, WidthCount=definition_uv, HeightCount=definition_uv)  # -> Mesh, Area
demesh = DeconstructMesh(Mesh=mplane.Mesh)  # -> Vertices, Faces, Colours, Normals

image = ImageSampler(
    demesh.Vertices,
    FilePath="C:\Users\jlx\Desktop\heightfield_terragen.png",
    Filter="Value",
    Interpolate=False,
    Umax=10,
    Umin=0,
    Vmax=10,
    Vmin=0,
    Wrap=1)
panel = Panel(image)
multiplication = Multiplication(A=max_height, B=image)
Z = UnitZ(Factor=multiplication)
move = Move(Geometry=demesh.Vertices, Motion=Z)  # -> Geometry, Transform

image_2 = ImageSampler(
    demesh.Vertices,
    FilePath="C:\Users\jlx\Desktop\heightfield_terragen.png",
    Filter="Colour",
    Interpolate=False,
    Umax=10,
    Umin=0,
    Vmax=10,
    Vmin=0,
    Wrap=1)
panel_2 = Panel(image_2)
conmesh = ConstructMesh(Vertices=move.Geometry, Faces=demesh.Faces, Colours=image_2)

addition = Addition(A=definition_uv, B="1")
srfgrid = SurfaceFromPoints(Points=move.Geometry, UCount=addition, Interpolate=False)

xy = XYPlane(Origin=Point(0, 0, 0))
series = Series(Start=0, Step=isocurve_height, Count=of_isocurves)
Z_2 = UnitZ(Factor=series)
panel_3 = Panel(Z_2)
move_2 = Move(Geometry=xy, Motion=Z_2)  # -> Geometry, Transform

xy_2 = XYPlane(Origin=Point(0, 0, 0))

sec = MeshPlane(Mesh=conmesh, Plane=move_2.Geometry)
project = Project(Geometry=sec, Plane=xy_2)  # -> Geometry, Transform

sec_2 = BrepPlane(Brep=srfgrid, Plane=move_2.Geometry)  # -> Curves, Points
project_2 = Project(Geometry=sec_2.Curves, Plane=xy_2)  # -> Geometry, Transform

explode = Explode(Curve=project.Geometry, Recursive=True)  # -> Segments, Vertices
intcrv = Interpolate(Vertices=explode.Vertices, Degree=3, Periodic=False, KnotStyle=1)  # -> Curve, Length, Domain
