# Grasshopper definition E.5.1 Attraction-Repulsion.gh (Grasshopper 1.0.7)

# ---- group: MAIN POINTS
pt = Point([<point referenced from the Rhino model> x11])

# ---- group: ATTRACTOR
pt_2 = Point(<point referenced from the Rhino model>)

# ----
ln = Line(StartPoint=pt_2, EndPoint=pt)
dist = Distance(PointA=pt_2, PointB=pt)
division = Division(A=Slider(100, range=0..100), B=dist)
len = Length(Curve=ln)
panel = Panel(dist)
cyl = Cylinder(Base=pt, Radius=Slider(1, range=0..1), Length=division)
multiplication = Multiplication(A=dist, B=Slider(0.205, range=0..1))
panel_2 = Panel(division)
cir = Circle(Plane=pt, Radius=multiplication)
panel_3 = Panel(multiplication)
