# Grasshopper definition E.6 Hanging Cloth.gh (Grasshopper 1.0.7)

crv = Curve(<curve referenced from the Rhino model>)
crv_2 = Curve(<curve referenced from the Rhino model>)
number_slider = Slider(20, range=0..100)
flip = FlipCurve(Curve=crv_2)  # -> Curve, Flag

divide = DivideCurve(Curve=crv, Count=number_slider, Kinks=False)  # -> Points, Tangents, Parameters
vec = VectorXYZ(XComponent=0, YComponent=0, ZComponent=Slider(1, range=-1..1))  # -> Vector, Length
divide_2 = DivideCurve(Curve=flip.Curve, Count=number_slider, Kinks=False)  # -> Points, Tangents, Parameters
cat = Catenary(PointA=divide.Points, PointB=divide_2.Points, Length=Slider(20.95, range=0..100), Gravity=vec.Vector)
loft = Loft(Curves=cat, Options={Adjust=False, Closed=False, LoftEnds=0, LoftSimp=0, LoftType=0, Rebuild=10, Refit=0.01})
