# Grasshopper definition E.9 3D Grids.gh (Grasshopper 1.0.7)

# ---- group: INPUTS
brep = Brep(<brep referenced from the Rhino model>)
dx = Slider(0.86, range=0..10)
dy = Slider(1.38, range=0..10)
nz = Slider(4, range=0..10)
nx = Slider(10, range=0..10)
ny = Slider(5, range=0..10)
dz = Slider(2.5, range=0..10)

# ----
pt = Point(<point referenced from the Rhino model>)

# ---- group: INPUTS
brep_2 = Brep(<brep referenced from the Rhino model>)
dx_2 = Slider(0.95, range=0..10)
nx_2 = Slider(10, range=0..10)
dy_2 = Slider(1.38, range=0..10)
ny_2 = Slider(5, range=0..10)
dz_2 = Slider(2.5, range=0..10)
nz_2 = Slider(4, range=0..10)

# ----
xy = XYPlane(Origin=pt)

# ---- group: ARRAY IN X
series = Series(Start=0, Step=dx, Count=nx)
vec = VectorXYZ(XComponent=series, YComponent=0, ZComponent=0)  # -> Vector, Length
move = Move(Geometry=brep, Motion=vec.Vector)  # -> Geometry, Transform

series_2 = Series(Start=0, Step=dx_2, Count=nx_2)
vec_2 = VectorXYZ(XComponent=series_2, YComponent=0, ZComponent=0)  # -> Vector, Length
move_2 = Move(Geometry=xy, Motion=vec_2.Vector)  # -> Geometry, Transform

# ----
graft = GraftTree(Tree=move.Geometry, IncludeEmptyLists=True, IncludeNullItems=True)

# ---- group: ARRAY IN Y
series_3 = Series(Start=0, Step=dy, Count=ny)
vec_3 = VectorXYZ(XComponent=0, YComponent=series_3, ZComponent=0)  # -> Vector, Length
move_3 = Move(Geometry=graft, Motion=vec_3.Vector)  # -> Geometry, Transform

# ----
graft_2 = GraftTree(Tree=move_2.Geometry, IncludeEmptyLists=True, IncludeNullItems=True)

# ---- group: ARRAY IN Y
series_4 = Series(Start=0, Step=dy_2, Count=ny_2)
vec_4 = VectorXYZ(XComponent=0, YComponent=series_4, ZComponent=0)  # -> Vector, Length
move_4 = Move(Geometry=graft_2, Motion=vec_4.Vector)  # -> Geometry, Transform

# ----
graft_3 = GraftTree(Tree=move_3.Geometry, IncludeEmptyLists=True, IncludeNullItems=True)

# ---- group: ARRAY IN Z
series_5 = Series(Start=0, Step=dz, Count=nz)
vec_5 = VectorXYZ(XComponent=0, YComponent=0, ZComponent=series_5)  # -> Vector, Length
move_5 = Move(Geometry=graft_3, Motion=vec_5.Vector)  # -> Geometry, Transform

# ----
graft_4 = GraftTree(Tree=move_4.Geometry, IncludeEmptyLists=True, IncludeNullItems=True)

# ---- group: ARRAY IN Z
series_6 = Series(Start=0, Step=dz_2, Count=nz_2)
vec_6 = VectorXYZ(XComponent=0, YComponent=0, ZComponent=series_6)  # -> Vector, Length
move_6 = Move(Geometry=graft_4, Motion=vec_6.Vector)  # -> Geometry, Transform

# ----
orient = Orient(Geometry=brep_2, Source=xy, Target=move_6.Geometry)  # -> Geometry, Transform
