# Grasshopper definition E10 Park Benches.gh (Grasshopper 1.0.7)

# ---- group: INPUTS
nx = Slider(25, range=0..50)
dx = Slider(4.93, range=0..10)
start_angle = Slider(0, range=0..720)
end_angle = Slider(471.12, range=0..720)
pt = Point(<point referenced from the Rhino model>)
X = Slider(1.06, range=0..10)
Y = Slider(6, range=0..10)
Z = Slider(0.6, range=0..10)

# ----
nx_2 = Slider(10, range=0..50)
dx_2 = Slider(6.11, range=0..10)
ny = Slider(12, range=0..50)
dy = Slider(5.49, range=0..10)
start_angle_2 = Slider(0, range=0..720)
end_angle_2 = Slider(1702.61, range=0..10000)

pt_2 = Point(<point referenced from the Rhino model>)
X_2 = Slider(3.76, range=0..10)
Y_2 = Slider(0.8, range=0..10)
Z_2 = Slider(0.6, range=0..10)
expression = Expression(nx=nx_2, ny=ny, Expression="nx * ny - 1")

series = Series(Start=0, Step=dx, Count=nx)
xy = XYPlane(Origin=pt)
X_3 = UnitX(Factor=series)
move = Move(Geometry=xy, Motion=X_3)  # -> Geometry, Transform

subtraction = Subtraction(A=nx, B="1")
dom = ConstructDomain(DomainStart=start_angle, DomainEnd=end_angle)
range = Range(Domain=dom, Steps=subtraction)
rad = Radians(Degrees=range)
rotate = Rotate(Geometry=move.Geometry, Angle=rad, Plane=move.Geometry)  # -> Geometry, Transform

series_2 = Series(Start=0, Step=dx_2, Count=nx_2)
xy_2 = XYPlane(Origin=pt_2)
X_4 = UnitX(Factor=series_2)
move_2 = Move(Geometry=xy_2, Motion=X_4)  # -> Geometry, Transform

series_3 = Series(Start=0, Step=dy, Count=ny)
dom_2 = ConstructDomain(DomainStart=start_angle_2, DomainEnd=end_angle_2)
Y_3 = UnitY(Factor=series_3)
range_2 = Range(Domain=dom_2, Steps=expression)

expression_2 = Expression(d=X, Expression="- 0.5 * d")
expression_3 = Expression(d=Y, Expression="- 0.5 * d")
expression_4 = Expression(d=X, Expression="0.5 * d")
expression_5 = Expression(d=Y, Expression="0.5 * d")
dom_3 = ConstructDomain(DomainStart=expression_2, DomainEnd=expression_4)
dom_4 = ConstructDomain(DomainStart=expression_3, DomainEnd=expression_5)
box = DomainBox(Base=rotate.Geometry, X=dom_3, Y=dom_4, Z=Z)

rad_2 = Radians(Degrees=range_2)
graft = GraftTree(Tree=move_2.Geometry, IncludeEmptyLists=True, IncludeNullItems=True)
move_3 = Move(Geometry=graft, Motion=Y_3)  # -> Geometry, Transform
flatten = FlattenTree(Tree=move_3.Geometry, Path="{0}")
rotate_2 = Rotate(Geometry=flatten, Angle=rad_2, Plane=flatten)  # -> Geometry, Transform

expression_6 = Expression(d=X_2, Expression="- 0.5 * d")
expression_7 = Expression(d=Y_2, Expression="- 0.5 * d")
expression_8 = Expression(d=X_2, Expression="0.5 * d")
expression_9 = Expression(d=Y_2, Expression="0.5 * d")
dom_5 = ConstructDomain(DomainStart=expression_6, DomainEnd=expression_8)
dom_6 = ConstructDomain(DomainStart=expression_7, DomainEnd=expression_9)
box_2 = DomainBox(Base=rotate_2.Geometry, X=dom_5, Y=dom_6, Z=Z_2)
