# Grasshopper definition E11 Solar facade.gh (Grasshopper 1.0.7)

srf = Surface(<surface referenced from the Rhino model>)
pt = Point(<point referenced from the Rhino model>)

panel = Panel(srf)

sframes = SurfaceFrames(Surface=srf, UCount=Slider(10, range=0..100), VCount=Slider(35, range=0..100))  # -> Frames, Parameters
deplane = DeconstructPlane(Plane=sframes.Frames)  # -> Origin, XAxis, YAxis, ZAxis
amp = Amplitude(Vector=deplane.ZAxis, Amplitude=Slider(4.31, range=0..10))
vdis = VectorDisplay(Anchor=deplane.Origin, Vector=amp)

vec2pt = Vector2Pt(PointA=pt, PointB=deplane.Origin, Unitize=False)  # -> Vector, Length
vdis_2 = VectorDisplay(Anchor=pt, Vector=vec2pt.Vector)
angle = Angle(VectorA=vec2pt.Vector, VectorB=deplane.ZAxis)  # -> Angle, Reflex

pi = Pi(Factor=1)
dom = ConstructDomain(DomainStart="1", DomainEnd="0")
dom_2 = ConstructDomain(DomainStart="0", DomainEnd=pi)
remap = RemapNumbers(Value=angle.Angle, Source=dom_2, Target=dom)  # -> Mapped, Clipped
multiplication = Multiplication(A=Slider(1, range=0..10), B=remap.Mapped)

panel_2 = Panel(angle.Angle)
panel_3 = Panel(remap.Mapped)

cir = Circle(Plane=sframes.Frames, Radius=multiplication)
cir_2 = Circle(Plane=sframes.Frames, Radius=Slider(0.41, range=0..1))
boundary = BoundarySurfaces(Edges=cir_2)
boundary_2 = BoundarySurfaces(Edges=cir)
