# Grasshopper definition E13 Oculus Roof.gh (Grasshopper 1.0.7)
# plug-ins: Bifocals

number_slider = Slider(3.07, range=0..10)
number_slider_2 = Slider(3.41, range=0..10)
srf = Surface(<surface referenced from the Rhino model>)

srf_2 = Surface(<surface referenced from the Rhino model>)

domain² = Domain²(srf_2)
divide = DivideDomain²(Domain=domain², UCount=Slider(10, range=0..10), VCount=Slider(10, range=0..10))

sframes = SurfaceFrames(Surface=srf, UCount=Slider(6, range=0..10), VCount=Slider(6, range=0..10))  # -> Frames, Parameters

expression = Expression(d=number_slider, Expression="-0.5 * d")
expression_2 = Expression(d=number_slider_2, Expression="-0.5 * d")
expression_3 = Expression(d=number_slider, Expression="0.5 * d")
expression_4 = Expression(d=number_slider_2, Expression="0.5 * d")
dom = ConstructDomain(DomainStart=expression_2, DomainEnd=expression_4)
dom_2 = ConstructDomain(DomainStart=expression, DomainEnd=expression_3)
rectangle = Rectangle(Plane=sframes.Frames, XSize=dom_2, YSize=dom, Radius=0)  # -> Rectangle, Length
graft = GraftTree(Tree=rectangle.Rectangle, IncludeEmptyLists=True, IncludeNullItems=True)

panel = Panel(divide)
subsrf = Isotrim(Surface=srf_2, Domain=divide)

deplane = DeconstructPlane(Plane=sframes.Frames)  # -> Origin, XAxis, YAxis, ZAxis
multiplication = Multiplication(A=deplane.ZAxis, B=Slider(3.99, range=0..10))
move = Move(Geometry=sframes.Frames, Motion=multiplication)  # -> Geometry, Transform
cir = Circle(Plane=move.Geometry, Radius=Slider(0.85, range=0..10))
graft_2 = GraftTree(Tree=cir, IncludeEmptyLists=True, IncludeNullItems=True)

pt = ConstructPoint(XCoordinate="0.5", YCoordinate="0.5", ZCoordinate=0)
panel_2 = Panel(pt)
evalsrf = EvaluateSurface(Surface=reparameterize(subsrf), Point=pt)  # -> Point, Normal, UDirection, VDirection, Frame

deplane_2 = DeconstructPlane(Plane=evalsrf.Frame)  # -> Origin, XAxis, YAxis, ZAxis
multiplication_2 = Multiplication(A=deplane_2.ZAxis, B=Slider(-4.78, range=-10..10))
move_2 = Move(Geometry=evalsrf.Frame, Motion=multiplication_2)  # -> Geometry, Transform
cir_2 = Circle(Plane=move_2.Geometry, Radius=Slider(0.63, range=0..10))
graft_3 = GraftTree(Tree=cir_2, IncludeEmptyLists=True, IncludeNullItems=True)  # -> simplify(Tree)

debrep = DeconstructBrep(Brep=subsrf)  # -> Faces, Edges, Vertices
join = JoinCurves(Curves=debrep.Edges, Preserve=False)  # -> simplify(Curves)

panel_3 = Panel(debrep.Edges)

loft_opt = LoftOptions(Closed=False, Adjust=Toggle(True), Rebuild=0, Refit=0, Type=0)
loft = Loft(Curves=[graft, graft_2], Options=loft_opt)

panel_4 = Panel([graft, graft_2])

loft_opt_2 = LoftOptions(Closed=False, Adjust=Toggle(True), Rebuild=0, Refit=0, Type=0)
loft_2 = Loft(Curves=[graft_3, join], Options=loft_opt_2)
