# Grasshopper definition E15 Vierendeel Truss.gh (Grasshopper 1.0.7)

# ---- group: INPUTS
start_support = Point(<point referenced from the Rhino model>)
end_support = Point(<point referenced from the Rhino model>)
spans = Slider(8, range=0..25)
depth_factor = Slider(8.58, range=0..20)

# ---- group: TOP NODES
ln = Line(StartPoint=start_support, EndPoint=end_support)
divide = DivideCurve(Curve=ln, Count=spans, Kinks=False)  # -> Points, Tangents, Parameters

# ---- group: BOTTOM NODES
len = Length(Curve=ln)
expression = Expression(len=len, factor=depth_factor, Expression="- len / factor ")
Z = UnitZ(Factor=expression)
move = Move(Geometry=divide.Points, Motion=Z)  # -> Geometry, Transform

# ----
bottom_nodes = Point(move.Geometry)
top_nodes = Point(divide.Points)

# ---- group: TOP CHORDS
split = SplitList(List=top_nodes, Index="1")  # -> ListA, ListB
split_2 = SplitList(List=top_nodes, Index=spans)  # -> ListA, ListB
ln_2 = Line(StartPoint=split_2.ListA, EndPoint=split.ListB)

# ---- group: BOTTOM CHORDS
split_3 = SplitList(List=bottom_nodes, Index="1")  # -> ListA, ListB
split_4 = SplitList(List=bottom_nodes, Index=spans)  # -> ListA, ListB
ln_3 = Line(StartPoint=split_4.ListA, EndPoint=split_3.ListB)

# ---- group: vertical bars
ln_4 = Line(StartPoint=top_nodes, EndPoint=bottom_nodes)

# ----
line = Line([ln_4, ln_2, ln_3])
pipe = Pipe(Curve=[ln_4, ln_2, ln_3], Radius=Slider(0.107, range=0..1), Caps=Slider(2, range=0..10))
