# Grasshopper definition E16 Pratt Truss.gh (Grasshopper 1.0.7)

# ---- group: OPTIONAL CURVE INPUTS
number_slider = Slider(17, range=0..100)
crv = Curve(<curve referenced from the Rhino model>)
crv_2 = Curve(<curve referenced from the Rhino model>)
divide = DivideCurve(Curve=crv_2, Count=number_slider, Kinks=False)  # -> graft(Points), Tangents, Parameters
divide_2 = DivideCurve(Curve=crv, Count=number_slider, Kinks=False)  # -> graft(Points), Tangents, Parameters

# ---- group: INPUTS
start_support = Point(<point referenced from the Rhino model>)
end_support = Point(<point referenced from the Rhino model>)
depth_factor = Slider(7.11, range=0..20)
spans = Slider(8, range=0..24)

# ---- group: TOP NODES
ln = Line(StartPoint=start_support, EndPoint=end_support)
divide_3 = DivideCurve(Curve=ln, Count=spans, Kinks=False)  # -> Points, Tangents, Parameters

# ----
len = Length(Curve=ln)
expression = Expression(len=len, factor=depth_factor, Expression="- len / factor ")
panel = Panel(expression)
expression_2 = Expression(x=spans, Expression="x - 1")
dom = ConstructDomain(DomainStart="1", DomainEnd=expression_2)
subset = SubList(List=divide_3.Points, Domain=dom, Wrap=True)  # -> List, Index
Z = UnitZ(Factor=expression)
move = Move(Geometry=subset.List, Motion=Z)  # -> Geometry, Transform

# ---- group: SOURCE NODES
top_nodes_all = Point(divide_3.Points)
top_nodes_minus_first_last = Point(subset.List)
bottom_nodes_all = Point(move.Geometry)

# ---- group: DIAGONALS LEFT
expression_3 = Expression(N=spans, Expression="(N / 2) - 1")
dom_2 = ConstructDomain(DomainStart="0", DomainEnd=expression_3)
subset_2 = SubList(List=top_nodes_all, Domain=dom_2, Wrap=True)  # -> List, Index
subset_3 = SubList(List=bottom_nodes_all, Domain=dom_2, Wrap=True)  # -> List, Index
ln_2 = Line(StartPoint=subset_2.List, EndPoint=subset_3.List)
left_diagonals = Line(ln_2)

# ---- group: DIAGONALS RIGHRT
expression_4 = Expression(N=spans, Expression="(N / 2) + 1")
expression_5 = Expression(N=spans, Expression="(N - 2) / 2")
expression_6 = Expression(N=spans, Expression="N - 2")
dom_3 = ConstructDomain(DomainStart=expression_4, DomainEnd=spans)
dom_4 = ConstructDomain(DomainStart=expression_5, DomainEnd=expression_6)
subset_4 = SubList(List=bottom_nodes_all, Domain=dom_4, Wrap=True)  # -> List, Index
subset_5 = SubList(List=top_nodes_all, Domain=dom_3, Wrap=True)  # -> List, Index
ln_3 = Line(StartPoint=subset_5.List, EndPoint=subset_4.List)
diagonals_right = Line(ln_3)

# ---- group: TOP CHORDS
shift = ShiftList(List=top_nodes_all, Shift="1", Wrap="False")
shift_2 = ShiftList(List=top_nodes_all, Shift="-1", Wrap="False")
ln_4 = Line(StartPoint=shift_2, EndPoint=shift)
top_chords = Line(ln_4)

# ---- group: BOTTOM CHORDS
shift_3 = ShiftList(List=bottom_nodes_all, Shift="1", Wrap="False")
shift_4 = ShiftList(List=bottom_nodes_all, Shift="-1", Wrap="False")
ln_5 = Line(StartPoint=shift_4, EndPoint=shift_3)
bottom_chords = Line(ln_5)

# ---- group: VERTICAL BARS
ln_6 = Line(StartPoint=top_nodes_minus_first_last, EndPoint=bottom_nodes_all)
vertical_bars = Line(ln_6)

# ---- group: PRATT TRUSS
line = Line([vertical_bars, top_chords, bottom_chords, left_diagonals, diagonals_right])

# ----
panel_2 = Panel(bottom_chords)
