# Grasshopper definition E3 - Flower Vase.gh (Grasshopper 1.0.7)
# plug-ins: Bifocals

# ---- group: INPUTS
pt = Point(<point referenced from the Rhino model>)
R = Slider(2.959, range=0..10)
b1 = Slider(-0.896, range=-3..3)
h1 = Slider(3.104, range=0..10)
b2 = Slider(-0.972, range=-3..3)
h2 = Slider(0, range=0..10)
b3 = Slider(0.881, range=-3..3)
h3 = Slider(5.108, range=0..10)

# ---- group: AXIS REVOLUTIO
pdecon = Deconstruct(Point=pt)  # -> XComponent, YComponent, ZComponent
addition = Addition(A=pdecon.ZComponent, B="1")
pt_2 = ConstructPoint(XCoordinate=pdecon.XComponent, YCoordinate=pdecon.YComponent, ZCoordinate=addition)
ln = Line(StartPoint=pt, EndPoint=pt_2)

# ---- group: POINT 1
pdecon_2 = Deconstruct(Point=pt)  # -> XComponent, YComponent, ZComponent
addition_2 = Addition(A=R, B=pdecon_2.XComponent)
pt_3 = ConstructPoint(XCoordinate=addition_2, YCoordinate=pdecon_2.YComponent, ZCoordinate=pdecon_2.ZComponent)

# ---- group: POINT 2
pdecon_3 = Deconstruct(Point=pt_3)  # -> XComponent, YComponent, ZComponent
addition_3 = Addition(A=b1, B=pdecon_3.XComponent)
addition_4 = Addition(A=pdecon_3.ZComponent, B=h1)
pt_4 = ConstructPoint(XCoordinate=addition_3, YCoordinate=pdecon_3.YComponent, ZCoordinate=addition_4)

# ---- group: POINT 3
pdecon_4 = Deconstruct(Point=pt_4)  # -> XComponent, YComponent, ZComponent
addition_5 = Addition(A=b2, B=pdecon_4.XComponent)
addition_6 = Addition(A=pdecon_4.ZComponent, B=h2)
pt_5 = ConstructPoint(XCoordinate=addition_5, YCoordinate=pdecon_4.YComponent, ZCoordinate=addition_6)

# ---- group: POINT 4'
pdecon_5 = Deconstruct(Point=pt_5)  # -> XComponent, YComponent, ZComponent
addition_7 = Addition(A=b3, B=pdecon_5.XComponent)
addition_8 = Addition(A=pdecon_5.ZComponent, B=h3)
pt_6 = ConstructPoint(XCoordinate=addition_7, YCoordinate=pdecon_5.YComponent, ZCoordinate=addition_8)

# ---- group: surface
ln_2 = Line(StartPoint=pt, EndPoint=pt_3)
intcrv = Interpolate(Vertices=[pt_3, pt_4, pt_5, pt_6], Degree=3, Periodic=False, KnotStyle=1)  # -> Curve, Length, Domain
join = JoinCurves(Curves=[ln_2, intcrv.Curve], Preserve=False)
revsrf = Revolution(Curve=join, Axis=ln, Domain=Domain(0, 6.283185307))
