# Grasshopper definition E4 Chess Board.gh (Grasshopper 1.0.7)

# ---- group: INPUTS
pt = Point(<point referenced from the Rhino model>)
cell_size = Slider(1, range=0..10)
cells_in_x_direction = Slider(8, range=0..20)
cells_in_y_direction = Slider(8, range=0..20)
rows_of_tiles = Slider(2, range=2..10)
tile_height = Slider(1.684, range=0..10)
tile_radius = Slider(0.4, range=0..10)

# ---- group: FIRST SET OF PAWNS
pdecon = Deconstruct(Point=pt)  # -> XComponent, YComponent, ZComponent
expression = Expression(coordinate=pdecon.XComponent, cellSize=cell_size, Expression="coordinate + 0.5 * cellSize")
expression_2 = Expression(coordinate=pdecon.YComponent, cellSize=cell_size, Expression="coordinate + 0.5 * cellSize")
pt_2 = ConstructPoint(XCoordinate=expression, YCoordinate=expression_2, ZCoordinate=pdecon.ZComponent)
expression_3 = Expression(x=cells_in_x_direction, Expression="x - 1")
expression_4 = Expression(x=rows_of_tiles, Expression="x - 1")
sqgrid = Square(Plane=pt_2, Size=cell_size, ExtentX=expression_3, ExtentY=expression_4)  # -> Cells, Points
cone = Cone(Base=sqgrid.Points, Radius=tile_radius, Length=tile_height)  # -> Cone, Tip

# ---- group: SECOND SET OF PAWNS
pdecon_2 = Deconstruct(Point=pt_2)  # -> XComponent, YComponent, ZComponent
cellsy = Expression(
    y=pdecon_2.YComponent,
    cellsY=cells_in_y_direction,
    cellSize=cell_size,
    tilesRows=rows_of_tiles,
    Expression="y + cellSize * (cellsY - tilesRows)")
pt_3 = ConstructPoint(XCoordinate=pdecon_2.XComponent, YCoordinate=cellsy, ZCoordinate=pdecon_2.ZComponent)
expression_5 = Expression(x=cells_in_x_direction, Expression="x - 1")
expression_6 = Expression(x=rows_of_tiles, Expression="x - 1")
sqgrid_2 = Square(Plane=pt_3, Size=cell_size, ExtentX=expression_5, ExtentY=expression_6)  # -> Cells, Points
cone_2 = Cone(Base=sqgrid_2.Points, Radius=tile_radius, Length=tile_height)  # -> Cone, Tip

# ---- group: SECOND SET OF CELLS
pdecon_3 = Deconstruct(Point=pt)  # -> XComponent, YComponent, ZComponent
addition = Addition(A=cell_size, B=pdecon_3.XComponent)
addition_2 = Addition(A=cell_size, B=pdecon_3.YComponent)
pt_4 = ConstructPoint(XCoordinate=addition, YCoordinate=addition_2, ZCoordinate=pdecon_3.ZComponent)
expression_7 = Expression(x=cells_in_x_direction, Expression="floor((X - 2) / 2)")
expression_8 = Expression(x=cells_in_y_direction, Expression="floor((x - 2) / 2)")
expression_9 = Expression(x=cell_size, Expression="2 * X")
sqgrid_3 = Square(Plane=pt_4, Size=expression_9, ExtentX=expression_7, ExtentY=expression_8)  # -> Cells, Points
planesrf = PlaneSurface(Plane=sqgrid_3.Points, XSize=cell_size, YSize=cell_size)

# ---- group: FIRST SET OF CELLS
expression_10 = Expression(x=cells_in_x_direction, Expression="floor((X - 1) / 2)")
expression_11 = Expression(x=cells_in_y_direction, Expression="floor((x - 1) / 2)")
expression_12 = Expression(x=cell_size, Expression="2 * X")
sqgrid_4 = Square(Plane=pt, Size=expression_12, ExtentX=expression_10, ExtentY=expression_11)  # -> Cells, Points
planesrf_2 = PlaneSurface(Plane=sqgrid_4.Points, XSize=cell_size, YSize=cell_size)

# ---- group: GRID
sqgrid_5 = Square(Plane=pt, Size=cell_size, ExtentX=cells_in_x_direction, ExtentY=cells_in_y_direction)  # -> Cells, Points

# ----
panel = Panel(sqgrid_5.Points)
