# Grasshopper definition E5.2 Attraction-Repulsion.gh (Grasshopper 1.0.7)

pt = Point(<point referenced from the Rhino model>)

pt_2 = Point(<point referenced from the Rhino model>)

sqgrid = Square(Plane=pt_2, Size=Slider(10, range=0..10), ExtentX=Slider(10, range=0..100), ExtentY=Slider(10, range=0..100))  # -> Cells, Points

dist = Distance(PointA=sqgrid.Points, PointB=pt)
multiplication = Multiplication(A=dist, B=Slider(0.034, range=0..1))

pt_3 = Point(<point referenced from the Rhino model>)
dist_2 = Distance(PointA=sqgrid.Points, PointB=pt_3)
multiplication_2 = Multiplication(A=dist_2, B=Slider(0.025, range=0..1))

pt_4 = Point(<point referenced from the Rhino model>)
dist_3 = Distance(PointA=sqgrid.Points, PointB=pt_4)
multiplication_3 = Multiplication(A=dist_3, B=Slider(0.05, range=0..1))

box = CenterBox(Base=sqgrid.Points, X=multiplication, Y=multiplication_2, Z=multiplication_3)
