# Grasshopper definition E7 Berlin Holocaust Memorial.gh (Grasshopper 1.0.7)

srf = Surface(<surface referenced from the Rhino model>)
number_slider = Slider(1.132, range=0..10)
number_slider_2 = Slider(2.532, range=0..10)

sdivide = DivideSurface(Surface=srf, UCount=Slider(10, range=0..10), VCount=Slider(10, range=0..10))  # -> Points, Normals, Parameters
expression = Expression(x=number_slider, Expression="-x / 2")
expression_2 = Expression(x=number_slider_2, Expression="-x / 2")
expression_3 = Expression(x=number_slider, Expression="x / 2")
expression_4 = Expression(x=number_slider_2, Expression="x / 2")
dom = ConstructDomain(DomainStart=expression, DomainEnd=expression_3)
dom_2 = ConstructDomain(DomainStart=expression_2, DomainEnd=expression_4)
pdecon = Deconstruct(Point=sdivide.Points)  # -> XComponent, YComponent, ZComponent
pt = ConstructPoint(XCoordinate=pdecon.XComponent, YCoordinate=pdecon.YComponent, ZCoordinate=0)
rectangle = Rectangle(Plane=pt, XSize=dom, YSize=dom_2, Radius=0)  # -> Rectangle, Length
boxrec = BoxRectangle(Rectangle=rectangle.Rectangle, Height=pdecon.ZComponent)
