# Grasshopper definition E8 Freeform Pavillion.gh (Grasshopper 1.0.7)

crv = Curve(<curve referenced from the Rhino model>)
crv_2 = Curve(<curve referenced from the Rhino model>)
number_slider = Slider(10, range=0..100)

divide = DivideCurve(Curve=crv, Count=number_slider, Kinks=False)  # -> Points, Tangents, Parameters
divide_2 = DivideCurve(Curve=crv_2, Count=number_slider, Kinks=False)  # -> Points, Tangents, Parameters
ln = Line(StartPoint=divide.Points, EndPoint=divide_2.Points)
eval = EvaluateCurve(Curve=ln, Parameter=Slider(0.469, range=0..1))  # -> Point, Tangent, Angle
pdecon = Deconstruct(Point=eval.Point)  # -> XComponent, YComponent, ZComponent
addition = Addition(A=pdecon.ZComponent, B=Slider(6.123, range=0..10))
pt = ConstructPoint(XCoordinate=pdecon.XComponent, YCoordinate=pdecon.YComponent, ZCoordinate=addition)
pt_2 = Point(divide.Points)
pt_3 = Point(pt)
pt_4 = Point(divide_2.Points)
graft = GraftTree(Tree=pt_2, IncludeEmptyLists=True, IncludeNullItems=True)
panel = Panel(graft)
graft_2 = GraftTree(Tree=pt_3, IncludeEmptyLists=True, IncludeNullItems=True)
graft_3 = GraftTree(Tree=pt_4, IncludeEmptyLists=True, IncludeNullItems=True)
panel_2 = Panel(graft_2)
panel_3 = Panel([graft, graft_2, graft_3])
panel_4 = Panel(graft_3)
intcrv = Interpolate(Vertices=[graft, graft_2, graft_3], Degree=3, Periodic=False, KnotStyle=1)  # -> Curve, Length, Domain
panel_5 = Panel(intcrv.Curve)
flatten = FlattenTree(Tree=intcrv.Curve, Path="{0}")
panel_6 = Panel(flatten)
loft = Loft(Curves=flatten, Options={Adjust=False, Closed=False, LoftEnds=0, LoftSimp=0, LoftType=0, Rebuild=10, Refit=0.01})
panel_7 = Panel(loft)
