# Grasshopper definition dalle-api.gh (Grasshopper 1.0.7)
# plug-ins: jSwan, Firefly.X

# ----
# This example is part of the `Fun with Dall-E` video tutorial series at ParametricCamp:
# https://www.youtube.com/playlist?list=PLx3k0RGeXZ_zs3az0Z2BnpTIPH2lxQfFX
panel = Panel("https://api.openai.com/v1/images/generations")
panel_2 = Panel("an isometric view of a miniature city, tilt shift, bokeh, voxel, vray render, high detail")
list = ValueList({"256", "512", "1024"}, selected="256")
expression = Expression(x=list, Expression="Format(\"{0}x{0}\", x)")
int = Integer(Slider(1, range=0..10))

list_2 = ValueList({"256", "512", "1024"}, selected="256")
panel_3 = Panel("an isometric view of a miniature city, tilt shift, bokeh, voxel, vray render, high detail")
expression_2 = Expression(x=list_2, Expression="Format(\"{0}x{0}\", x)")
int_2 = Integer(Slider(1, range=0..10))

openai_api_key = CSharpScript()  # -> out, key
# ---------- openai_api_key: C# ----------
    key = Environment.GetEnvironmentVariable("OPENAI_API_KEY");
# ---------- end openai_api_key ----------
openai_api_key_2 = CSharpScript()  # -> out, key; same code as openai_api_key
panel_4 = Panel([panel_2, int, expression, "url"])
panel_5 = Panel([panel_3, int_2, expression_2, "b64_json"])
rejson = SerializeJson(Prompt=panel_2, N=int, Size=expression, Response_format="url", IncludeNullAndEmptyProperties=False)
rejson_2 = SerializeJson(Prompt=panel_3, N=int_2, Size=expression_2, Response_format="b64_json", IncludeNullAndEmptyProperties=False)
dalle_req = CSharpScript(url=panel, bearerToken=openai_api_key.key, body=rejson)  # -> out, response; inputs url: String, bearerToken: String, body: String; disabled
# ---------- dalle_req: C# usings ----------
using System.Net;   // for requests
using System.Text;  // for class Encoding
using System.IO;    // for StreamReader
# ---------- dalle_req: C# ----------
    if (url == null) return;

    var data = Encoding.ASCII.GetBytes(body);

    var request = (HttpWebRequest) WebRequest.Create(url);
    request.Method = "POST";
    request.ContentType = "application/json";
    request.ContentLength = body.Length;

    // If required by the server, set the credentials.
    if (bearerToken.Length > 0)
    {
      System.Net.ServicePointManager.Expect100Continue = true;
      System.Net.ServicePointManager.SecurityProtocol = System.Net.SecurityProtocolType.Tls12; //the auth type

      request.PreAuthenticate = true;
      request.Headers.Add("Authorization", "Bearer " + bearerToken);
    }
    else
    {
      request.Credentials = System.Net.CredentialCache.DefaultCredentials;
    }

    using (var stream = request.GetRequestStream())
    {
      stream.Write(data, 0, data.Length);
    }

    var res = (HttpWebResponse) request.GetResponse();

    var responseString = new StreamReader(res.GetResponseStream()).ReadToEnd();

    response = responseString;
# ---------- end dalle_req ----------
dalle_req_2 = CSharpScript(url="https://api.openai.com/v1/images/generations", bearerToken=openai_api_key_2.key, body=rejson_2)  # -> out, response; inputs url: String, bearerToken: String, body: String; disabled; same code as dalle_req
panel_6 = Panel(rejson)
panel_7 = Panel(rejson_2)
dejson = DeserializeJson(JSON=dalle_req.response, OutputsLocked=False)  # -> Created, Data
dejson_2 = DeserializeJson(JSON=dalle_req_2.response, OutputsLocked=False)  # -> Created, Data
dejson_3 = DeserializeJson(JSON=dejson.Data, OutputsLocked=False)
panel_8 = Panel(dejson_3)
dejson_4 = DeserializeJson(JSON=dejson_2.Data, OutputsLocked=False)
decode = DecodeBase64ToFireflyBitmap(Base64=dejson_4)
painter = BitmapPainter(BitmapToPaint=decode)
