# Grasshopper definition GH#_001_Basics.gh (Grasshopper 1.0.7)
# plug-ins: Bifocals

# ----
# GH# SERIES
# 01
# By Jose Luis García del Castillo y López
# Part 1
# Cleaned by: Hariprasath Loganathan
number_slider = Slider(5.79, range=0..10)
number_slider_2 = Slider(3.97, range=0..10)

# ----
# Retrive an element from a List
panel = Panel("""0
10
20
30
40""")
number_slider_3 = Slider(3, range=0..10)
wrap = BooleanToggle(False)

number_slider_4 = Slider(4.51, range=0..10)
number_slider_5 = Slider(0.224, range=-10..10)
number_slider_6 = Slider(5, range=0..10)

# ----
# Generate a range of numbers
number_slider_7 = Slider(7.15, range=0..10)
number_slider_8 = Slider(5, range=0..10)

number_slider_9 = Slider(4.93, range=0..10)
number_slider_10 = Slider(4.07, range=0..10)
number_slider_11 = Slider(3.52, range=0..10)

point = Point(Point(4.93, 4.07, 3.52))

toggle = BooleanToggle(False)

toggle_2 = BooleanToggle(False)

c_script = CSharpScript(L=panel, i=number_slider_3, W=wrap)  # -> out, iOut; inputs L: list, i: Int32, W: Boolean
# ---------- c_script: C# ----------
    // Assign vslue of i to pos
    int pos = i;
    // Check if pos is greater than or equal to list 'L' count
    if (pos >= L.Count) {
      // If TRUE then check if wrap is true
      if (W) {
        // If TRUE then assign the reminder of i divided by L count to pos.
        // pos denotes how many values need to be wraped from end of list to start of list
        pos = i % L.Count;
      }
        // If FALSE notify user with error message
      else {
        Component.AddRuntimeMessage(GH_RuntimeMessageLevel.Warning, "Supply index is too high");
        return;
      }
    }

    // Retrive the item at pos from the list L
    object datum = L[pos];

    // Output
    iOut = datum;
# ---------- end c_script ----------
item = ListItem(List=panel, Index=number_slider_3, Wrap=wrap)
panel_2 = Panel(c_script.iOut)
panel_3 = Panel(item)

c_script_2 = CSharpScript(S=number_slider_4, N=number_slider_5, C=number_slider_6)  # -> out, SOut; inputs S: Double, N: Double, C: Int32
# ---------- c_script_2: C# ----------
    // OPTION - I
    // Doing it with a list
    /*
    // Initialize a new list - nums
    List<double> nums = new List<double>();
    // Loop until value of i is less than Count
    for (int i = 0; i < C; i++) {
    // Mutiply i with steps and add the result with start value
    // Assign the result to val
    double val = S + N * i;
    // Add val to nums
    nums.Add(val);
    }*/

    // OPTION - II
    // Doing it with a array
    // Initialize a new array - nums
    double[] nums = new double[C];
    // Loop until value of i is less than Count
    for (int i = 0; i < C; i++) {
      // Mutiply i with steps and add the result with start value
      // Assign the result to val
      double val = S + N * i;
      // Assign val to index i in nums array
      nums[i] = val;
    }
    // Output
    SOut = nums;
# ---------- end c_script_2 ----------
# Generate a series of numbers
series = Series(Start=number_slider_4, Step=number_slider_5, Count=number_slider_6)
panel_4 = Panel(series)
panel_5 = Panel(c_script_2.SOut)

c_script_3 = CSharpScript(A=number_slider, B=number_slider_2)  # -> out, R; inputs A: Double, B: Double
# ---------- c_script_3: C# ----------
    // Add A & B and assign the result to sum
    double sum = A + B;

    // Output
    R = sum;
# ---------- end c_script_3 ----------
# Addition of Two Numbers
addition = Addition(A=number_slider, B=number_slider_2)
panel_6 = Panel(addition)
# 1.Cull original cells list by boolean values returned by simulation
# 1.Cull original cells list by boolean values returned by simulation
# 1.Cull original cells list by boolean values returned by simulation
panel_7 = Panel(c_script_3.R)

c_script_4 = CSharpScript(X=number_slider_9, Y=number_slider_10, Z=number_slider_11)  # -> out, Pt; inputs X: Double, Y: Double, Z: Double
# ---------- c_script_4: C# ----------
    // Initialize a new point p with given x, y & z values
    Point3d p = new Point3d(X, Y, Z);
    // Output
    Pt = p;
# ---------- end c_script_4 ----------
# Construct a Point
pt = ConstructPoint(XCoordinate=number_slider_9, YCoordinate=number_slider_10, ZCoordinate=number_slider_11)
panel_8 = Panel(pt)
panel_9 = Panel(c_script_4.Pt)

c_script_5 = CSharpScript(P=point)  # -> out, X, Y, Z; inputs P: Point3d
# ---------- c_script_5: C# ----------
    // Assign the coordinates of the point to respective items
    X = P.X;
    Y = P.Y;
    Z = P.Z;
# ---------- end c_script_5 ----------
# Deconstruct a Point
pdecon = Deconstruct(Point=point)  # -> XComponent, YComponent, ZComponent
panel_10 = Panel(pdecon.XComponent)
panel_11 = Panel(pdecon.YComponent)
panel_12 = Panel(pdecon.ZComponent)
panel_13 = Panel(c_script_5.X)
panel_14 = Panel(c_script_5.Y)
panel_15 = Panel(c_script_5.Z)

# ----
# Create a line between two points
pt_2 = ConstructPoint(XCoordinate=Slider(2.81, range=0..10), YCoordinate=Slider(5.2, range=0..10), ZCoordinate=Slider(2.28, range=0..10))
pt_3 = ConstructPoint(XCoordinate=Slider(2.77, range=0..10), YCoordinate=Slider(3.98, range=0..10), ZCoordinate=Slider(6.47, range=0..10))

# ----
# Calculate length of a vector
vec = VectorXYZ(XComponent=Slider(4.93, range=0..10), YComponent=Slider(3.48, range=0..10), ZComponent=Slider(3.52, range=0..10))  # -> Vector, Length

# ----
# Calculate dot product of two vectors
vec_2 = VectorXYZ(XComponent=Slider(4.93, range=0..10), YComponent=Slider(3.84, range=0..10), ZComponent=Slider(3.52, range=0..10))  # -> Vector, Length
vec_3 = VectorXYZ(XComponent=Slider(2.83, range=0..10), YComponent=Slider(5.94, range=0..10), ZComponent=Slider(6.85, range=0..10))  # -> Vector, Length

# ----
# Calculate cross product of two vectors
vector_a = VectorXYZ(XComponent=Slider(4.93, range=0..10), YComponent=Slider(3.84, range=0..10), ZComponent=Slider(3.52, range=0..10))  # -> Vector, Length
vector_b = VectorXYZ(XComponent=Slider(2.83, range=0..10), YComponent=Slider(5.94, range=0..10), ZComponent=Slider(6.85, range=0..10))  # -> Vector, Length

dom = ConstructDomain(DomainStart=number_slider_7, DomainEnd=Slider(3, range=0..10))

c_script_6 = CSharpScript(D=dom, N=number_slider_8)  # -> out, R; inputs N: Int32
# ---------- c_script_6: C# ----------
    // Get steps by dividing domain length with count
    double step = D.Length / N;
    Print("step size " + step);
    // Initialize a new list of double - nums
    List<double> nums = new List<double>();
    // Loop until i is lesser than or equal to count
    for (int i = 0; i <= N; i++) {
      // Multiply i with steps and add theresult with domain min value
      // Assign the value to val
      double val = D.T0 + step * i;
      // Add val to nums
      nums.Add(val);
    }
    // Output
    R = nums;
# ---------- end c_script_6 ----------
range = Range(Domain=dom, Steps=number_slider_8)
panel_16 = Panel(range)
panel_17 = Panel(c_script_6.R)

c_script_7 = CSharpScript(V=vec.Vector)  # -> out, L; inputs V: Vector3d
# ---------- c_script_7: C# ----------
    // OPTION - I
    // Calculate vector length manually
    //double len = Math.Sqrt(V.X * V.X + V.Y * V.Y + V.Z * V.Z);

    // OPTION - II
    // Get length from vector property
    double len = V.Length;
    // Output
    L = len;
# ---------- end c_script_7 ----------
vlen = VectorLength(Vector=vec.Vector)
panel_18 = Panel(vlen)
panel_19 = Panel(c_script_7.L)

c_script_8 = CSharpScript(A=vec_2.Vector, B=vec_3.Vector, U=toggle)  # -> out, D; inputs A: Vector3d, B: Vector3d, U: Boolean
# ---------- c_script_8: C# ----------
    // Unitize is TRUE then unitize(convert to unit vectors)
    if (U) {
      A.Unitize();
      B.Unitize();
    }

    // OPTION - I
    // Calculate dot product manually
    // double dot = A.X * B.X + A.Y * B.Y + A.Z * B.Z;

    // OPTION - II
    // Calculate dot product by operator overloading
    // double dot = A * B;

    // OPTION - III
    // Calculate dot product by calling vector function
    double dot = Vector3d.Multiply(A, B);

    // Output
    D = dot;
# ---------- end c_script_8 ----------
dprod = DotProduct(VectorA=vec_2.Vector, VectorB=vec_3.Vector, Unitize=toggle)
panel_20 = Panel(dprod)
panel_21 = Panel(c_script_8.D)

c_script_9 = CSharpScript(A=vector_a.Vector, B=vector_b.Vector, U=toggle_2)  # -> out, V, L; inputs A: Vector3d, B: Vector3d, U: Boolean
# ---------- c_script_9: C# ----------
    // Unitize is TRUE then unitize(convert to unit vectors)
    if (U) {
      A.Unitize();
      B.Unitize();
    }
    // Calculate cross product by calling vector function
    Vector3d cross = Vector3d.CrossProduct(A, B);

    // Outputs
    V = cross;
    L = cross.Length;
# ---------- end c_script_9 ----------
xprod = CrossProduct(VectorA=vector_a.Vector, VectorB=vector_b.Vector, Unitize=toggle_2)  # -> Vector, Length
panel_22 = Panel([xprod.Vector, xprod.Length])
panel_23 = Panel([c_script_9.V, c_script_9.L])

c_script_10 = CSharpScript(A=pt_2, B=pt_3)  # -> out, L; inputs A: Point3d, B: Point3d
# ---------- c_script_10: C# ----------
    // Initialize a new line with point A & point B
    Line line = new Line(A, B);

    // Output
    L = line;
# ---------- end c_script_10 ----------
ln = Line(StartPoint=pt_2, EndPoint=pt_3)

panel_24 = Panel(ln)
panel_25 = Panel(c_script_10.L)
