# Grasshopper definition GH#_002_Geometry.gh (Grasshopper 1.0.7)
# plug-ins: Bifocals

# ----
# GH# SERIES
# 01
# By Jose Luis García del Castillo y López
# Part 1 & 2
# Cleaned by: Hariprasath Loganathan
number_slider = Slider(5.79, range=0..10)
number_slider_2 = Slider(3.97, range=0..10)

# ----
# Retrive an element from a List
panel = Panel("""0
10
20
30
40""")
number_slider_3 = Slider(3, range=0..10)
wrap = BooleanToggle(False)

number_slider_4 = Slider(4.51, range=0..10)
number_slider_5 = Slider(0.224, range=-10..10)
number_slider_6 = Slider(5, range=0..10)

# ----
# Generate a range of numbers
number_slider_7 = Slider(7.15, range=0..10)
number_slider_8 = Slider(5, range=0..10)

number_slider_9 = Slider(4.93, range=0..10)
number_slider_10 = Slider(4.07, range=0..10)
number_slider_11 = Slider(3.52, range=0..10)

point = Point(Point(4.93, 4.07, 3.52))

toggle = BooleanToggle(False)

toggle_2 = BooleanToggle(False)

c_script = CSharpScript(L=panel, i=number_slider_3, W=wrap)  # -> out, iOut; inputs L: list, i: Int32, W: Boolean
# ---------- c_script: C# ----------
    // Assign vslue of i to pos
    int pos = i;
    // Check if pos is greater than or equal to list 'L' count
    if (pos >= L.Count) {
      // If TRUE then check if wrap is true
      if (W) {
        // If TRUE then assign the reminder of i divided by L count to pos.
        // pos denotes how many values need to be wraped from end of list to start of list
        pos = i % L.Count;
      }
        // If FALSE notify user with error message
      else {
        Component.AddRuntimeMessage(GH_RuntimeMessageLevel.Warning, "Supply index is too high");
        return;
      }
    }

    // Retrive the item at pos from the list L
    object datum = L[pos];

    // Output
    iOut = datum;
# ---------- end c_script ----------
item = ListItem(List=panel, Index=number_slider_3, Wrap=wrap)
panel_2 = Panel(c_script.iOut)
panel_3 = Panel(item)

c_script_2 = CSharpScript(S=number_slider_4, N=number_slider_5, C=number_slider_6)  # -> out, SOut; inputs S: Double, N: Double, C: Int32
# ---------- c_script_2: C# ----------
    // OPTION - I
    // Doing it with a list
    /*
    // Initialize a new list - nums
    List<double> nums = new List<double>();
    // Loop until value of i is less than Count
    for (int i = 0; i < C; i++) {
    // Mutiply i with steps and add the result with start value
    // Assign the result to val
    double val = S + N * i;
    // Add val to nums
    nums.Add(val);
    }*/

    // OPTION - II
    // Doing it with a array
    // Initialize a new array - nums
    double[] nums = new double[C];
    // Loop until value of i is less than Count
    for (int i = 0; i < C; i++) {
      // Mutiply i with steps and add the result with start value
      // Assign the result to val
      double val = S + N * i;
      // Assign val to index i in nums array
      nums[i] = val;
    }
    // Output
    SOut = nums;
# ---------- end c_script_2 ----------
# Generate a series of numbers
series = Series(Start=number_slider_4, Step=number_slider_5, Count=number_slider_6)
panel_4 = Panel(series)
panel_5 = Panel(c_script_2.SOut)

c_script_3 = CSharpScript(A=number_slider, B=number_slider_2)  # -> out, R; inputs A: Double, B: Double
# ---------- c_script_3: C# ----------
    // Add A & B and assign the result to sum
    double sum = A + B;

    // Output
    R = sum;
# ---------- end c_script_3 ----------
# Addition of Two Numbers
addition = Addition(A=number_slider, B=number_slider_2)
panel_6 = Panel(addition)
panel_7 = Panel(c_script_3.R)

c_script_4 = CSharpScript(X=number_slider_9, Y=number_slider_10, Z=number_slider_11)  # -> out, Pt; inputs X: Double, Y: Double, Z: Double
# ---------- c_script_4: C# ----------
    // Initialize a new point p with given x, y & z values
    Point3d p = new Point3d(X, Y, Z);
    // Output
    Pt = p;
# ---------- end c_script_4 ----------
# Construct a Point
pt = ConstructPoint(XCoordinate=number_slider_9, YCoordinate=number_slider_10, ZCoordinate=number_slider_11)
panel_8 = Panel(pt)
panel_9 = Panel(c_script_4.Pt)

c_script_5 = CSharpScript(P=point)  # -> out, X, Y, Z; inputs P: Point3d
# ---------- c_script_5: C# ----------
    // Assign the coordinates of the point to respective items
    X = P.X;
    Y = P.Y;
    Z = P.Z;
# ---------- end c_script_5 ----------
# Deconstruct a Point
pdecon = Deconstruct(Point=point)  # -> XComponent, YComponent, ZComponent
panel_10 = Panel(pdecon.XComponent)
panel_11 = Panel(pdecon.YComponent)
panel_12 = Panel(pdecon.ZComponent)
panel_13 = Panel(c_script_5.X)
panel_14 = Panel(c_script_5.Y)
panel_15 = Panel(c_script_5.Z)

# ----
# Calculate cross product of two vectors
vector_a = VectorXYZ(XComponent=Slider(4.93, range=0..10), YComponent=Slider(3.84, range=0..10), ZComponent=Slider(3.52, range=0..10))  # -> Vector, Length
vector_b = VectorXYZ(XComponent=Slider(2.83, range=0..10), YComponent=Slider(5.94, range=0..10), ZComponent=Slider(6.85, range=0..10))  # -> Vector, Length

# ----
# Create a line between two points
pt_2 = ConstructPoint(XCoordinate=Slider(2.81, range=0..10), YCoordinate=Slider(5.2, range=0..10), ZCoordinate=Slider(2.28, range=0..10))
pt_3 = ConstructPoint(XCoordinate=Slider(2.77, range=0..10), YCoordinate=Slider(3.98, range=0..10), ZCoordinate=Slider(6.47, range=0..10))

# ----
# Calculate length of a vector
vec = VectorXYZ(XComponent=Slider(4.93, range=0..10), YComponent=Slider(3.48, range=0..10), ZComponent=Slider(3.52, range=0..10))  # -> Vector, Length

# ----
# Calculate dot product of two vectors
vec_2 = VectorXYZ(XComponent=Slider(4.93, range=0..10), YComponent=Slider(3.84, range=0..10), ZComponent=Slider(3.52, range=0..10))  # -> Vector, Length
vec_3 = VectorXYZ(XComponent=Slider(2.83, range=0..10), YComponent=Slider(5.94, range=0..10), ZComponent=Slider(6.85, range=0..10))  # -> Vector, Length

dom = ConstructDomain(DomainStart=number_slider_7, DomainEnd=Slider(3, range=0..10))

c_script_6 = CSharpScript(D=dom, N=number_slider_8)  # -> out, R; inputs N: Int32
# ---------- c_script_6: C# ----------
    // Get steps by dividing domain length with count
    double step = D.Length / N;
    Print("step size " + step);
    // Initialize a new list of double - nums
    List<double> nums = new List<double>();
    // Loop until i is lesser than or equal to count
    for (int i = 0; i <= N; i++) {
      // Multiply i with steps and add theresult with domain min value
      // Assign the value to val
      double val = D.T0 + step * i;
      // Add val to nums
      nums.Add(val);
    }
    // Output
    R = nums;
# ---------- end c_script_6 ----------
range = Range(Domain=dom, Steps=number_slider_8)
panel_16 = Panel(range)
panel_17 = Panel(c_script_6.R)

c_script_7 = CSharpScript(V=vec.Vector)  # -> out, L; inputs V: Vector3d
# ---------- c_script_7: C# ----------
    // OPTION - I
    // Calculate vector length manually
    //double len = Math.Sqrt(V.X * V.X + V.Y * V.Y + V.Z * V.Z);

    // OPTION - II
    // Get length from vector property
    double len = V.Length;
    // Output
    L = len;
# ---------- end c_script_7 ----------
vlen = VectorLength(Vector=vec.Vector)
panel_18 = Panel(vlen)
panel_19 = Panel(c_script_7.L)

c_script_8 = CSharpScript(A=vec_2.Vector, B=vec_3.Vector, U=toggle)  # -> out, D; inputs A: Vector3d, B: Vector3d, U: Boolean
# ---------- c_script_8: C# ----------
    // If unitize is TRUE then unitize(convert to unit vectors)
    if (U) {
      A.Unitize();
      B.Unitize();
    }

    // OPTION - I
    // Calculate dot product manually
    // double dot = A.X * B.X + A.Y * B.Y + A.Z * B.Z;

    // OPTION - II
    // Calculate dot product by operator overloading
    // double dot = A * B;

    // OPTION - III
    // Calculate dot product by calling vector function
    double dot = Vector3d.Multiply(A, B);

    // Output
    D = dot;
# ---------- end c_script_8 ----------
dprod = DotProduct(VectorA=vec_2.Vector, VectorB=vec_3.Vector, Unitize=toggle)
panel_20 = Panel(dprod)
panel_21 = Panel(c_script_8.D)

c_script_9 = CSharpScript(A=vector_a.Vector, B=vector_b.Vector, U=toggle_2)  # -> out, V, L; inputs A: Vector3d, B: Vector3d, U: Boolean
# ---------- c_script_9: C# ----------
    // If unitize is TRUE then unitize(convert to unit vectors)
    if (U) {
      A.Unitize();
      B.Unitize();
    }
    // Calculate cross product by calling vector function
    Vector3d cross = Vector3d.CrossProduct(A, B);

    // Outputs
    V = cross;
    L = cross.Length;
# ---------- end c_script_9 ----------
xprod = CrossProduct(VectorA=vector_a.Vector, VectorB=vector_b.Vector, Unitize=toggle_2)  # -> Vector, Length
panel_22 = Panel([xprod.Vector, xprod.Length])
panel_23 = Panel([c_script_9.V, c_script_9.L])

c_script_10 = CSharpScript(A=pt_2, B=pt_3)  # -> out, L; inputs A: Point3d, B: Point3d
# ---------- c_script_10: C# ----------
    // Initialize a new line with point A & point B
    Line line = new Line(A, B);

    // Output
    L = line;
# ---------- end c_script_10 ----------
ln = Line(StartPoint=pt_2, EndPoint=pt_3)

panel_24 = Panel(ln)
panel_25 = Panel(c_script_10.L)

toggle_3 = BooleanToggle(True)
curve = Curve(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)
number_slider_12 = Slider(10, range=0..10)

surface = Surface(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)

toggle_4 = BooleanToggle(True)
# Create an interpolated curve through a set of points
pt_4 = Point([Point(9.620893106, 5.495001411, 0), Point(4.385911107, 14.61537951, 0), Point(12.00846963, 19.65060272, 0), Point(16.54618486, 6.712428418, 0), Point(25.06970642, 7.962811459, 0)])
number_slider_13 = Slider(3, range=0..10)
number_slider_14 = Slider(0, range=0..10)

curve_2 = Curve(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)
number_slider_15 = Slider(7.694, range=0..100)

# ----
# Create a lofted surface through set of section curves
crv = Curve([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])

pt_5 = Point(Point(15.06665572, 11.19524034, 0))
surface_2 = Surface(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)

toggle_5 = BooleanToggle(False)
curve_3 = Curve(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)
number_slider_16 = Slider(10, range=0..10)

# ----
# Get the closest point on the surface
srf_cp = SurfaceClosestPoint(Point=pt_5, Surface=surface_2)  # -> Point, UVPoint, Distance
c_script_11 = CSharpScript(P=pt_5, S=surface_2)  # -> out, POut, uvP, D; inputs P: Point3d, S: Surface
# ---------- c_script_11: C# ----------
    // Initialize a double - u,v
    // This will be used as argument passed by reference
    double u, v;
    // Call surface function
    // Assign the result to boolean - success
    // u,v coordinate at the point will be stored in u,v
    bool success = S.ClosestPoint(P, out u, out v);
    // Initialize a Point3d - point
    // Initialize a array of Vector3d - derivatives
    // This will be used as argument passed by reference
    Point3d point;
    Vector3d[] derivatives;
    // Call surface function
    // point at u,v coordinate will be stored in point
    // Tangent vectors at u,v coordinates will be stored in derivatives
    S.Evaluate(u, v, 1, out point, out derivatives);
    // Get distance between p and point by calling point function
    double d = point.DistanceTo(P);

    // Outputs
    POut = point;
    uvP = new Point3d(u, v, 0);
    D = d;
# ---------- end c_script_11 ----------
panel_26 = Panel([srf_cp.Point, srf_cp.UVPoint, srf_cp.Distance])
panel_27 = Panel([c_script_11.POut, c_script_11.uvP, c_script_11.D])

c_script_12 = CSharpScript(V=pt_4, D=number_slider_13, P=toggle_4, K=number_slider_14)  # -> out, C, L, DOut; inputs V: list of Point3d, D: Int32, P: Boolean, K: Int32
# ---------- c_script_12: C# ----------
    // Initialize knotStyle and assign the value of K
    int knotStyle = K;

    // Make sure values are within range
    if (knotStyle < 0 || knotStyle > 2) {
      Component.AddRuntimeMessage(GH_RuntimeMessageLevel.Warning, "Valid knot spacing values are 0, 1 and 2");

      // Set a safe default to work with
      knotStyle = 2;
    }

    // If Periodic is TRUE then increment the value by 3 and duplicate the last point
    if (P) {
      knotStyle += 3;
      if (V[0].DistanceTo(V[V.Count - 1]) > 0.00001) {
        V.Add(V[0]);
      }
    }


    // Cast knotStyle from int to CurveKnotStyle enum and assign it to style
    CurveKnotStyle style = (CurveKnotStyle) knotStyle;

    // Create curve by calling static curve function
    Curve c = Curve.CreateInterpolatedCurve(V, D, style);
    // Get curve length from curve function
    double curveLength = c.GetLength();
    // Get curve domain from curve property
    Interval dom = c.Domain;

    // Outputs
    C = c;
    L = curveLength;
    DOut = dom;
# ---------- end c_script_12 ----------
intcrv = Interpolate(Vertices=pt_4, Degree=number_slider_13, Periodic=toggle_4, KnotStyle=number_slider_14)  # -> Curve, Length, Domain
panel_28 = Panel([c_script_12.C, c_script_12.L, c_script_12.DOut])
panel_29 = Panel([intcrv.Curve, intcrv.Length, intcrv.Domain])

# ----
# Divide a curve into equal length segments
c_script_13 = CSharpScript(C=curve_2, t=number_slider_15)  # -> out, P, T, A; inputs C: Curve, t: Double
# ---------- c_script_13: C# ----------
    // Get curve domain by calling curve function and assign it to dom
    Interval dom = C.Domain;
    // Check if 't' value is within the domain and assign it to isInsideDomain
    bool isInsideDomain = dom.IncludesParameter(t);
    // If 't' is outside the curve domain notify user with error message
    if (!isInsideDomain) {
      Component.AddRuntimeMessage(GH_RuntimeMessageLevel.Warning, "Outside domain!!!");
    }
    // Get point at 't' parameter of a curve by calling curve function
    Point3d p = C.PointAt(t);
    // Get tangent vector at 't' parameter of a curve by calling curve function
    Vector3d tangent = C.TangentAt(t);

    // Outputs
    P = p;
    T = tangent;
# ---------- end c_script_13 ----------
# Evaluate a curve at 't' parameter
eval = EvaluateCurve(Curve=curve_2, Parameter=number_slider_15)  # -> Point, Tangent, Angle
panel_30 = Panel([eval.Point, eval.Tangent, eval.Angle])
panel_31 = Panel([c_script_13.P, c_script_13.T, c_script_13.A])

c_script_14 = CSharpScript(C=curve_3, N=number_slider_16, K=toggle_5)  # -> out, P, T, t; inputs C: Curve, N: Int32, K: Boolean
# ---------- c_script_14: C# ----------
    // Initialize a array of Point3d - pts, this will be used as argument passed by reference
    Point3d[] pts;
    // Call curve function
    // Assign array of 't' parameters to tValues
    // points at tValues will be stored in pts
    double[] tValues = C.DivideByCount(N, true, out pts);
    // Initialize a new list of vectors - tangents
    List<Vector3d> tangents = new List<Vector3d>();
    // Loop thru all the tValues
    for (int i = 0; i < tValues.Length; i++) {
      // Assign the 't' parameter at index i to param
      double param = tValues[i];
      // Get tangent vector at 't' parameter of a curve by calling curve function
      // Assign tangent vector tan
      Vector3d tan = C.TangentAt(param);
      // Add tan to tangents
      tangents.Add(tan);
    }

    // Outputs
    P = pts;
    T = tangents;
    t = tValues;
# ---------- end c_script_14 ----------
divide = DivideCurve(Curve=curve_3, Count=number_slider_16, Kinks=toggle_5)  # -> Points, Tangents, Parameters
panel_32 = Panel(divide.Points)
panel_33 = Panel(c_script_14.P)
panel_34 = Panel(divide.Tangents)
panel_35 = Panel(c_script_14.T)
panel_36 = Panel(divide.Parameters)
panel_37 = Panel(c_script_14.t)

c_script_15 = CSharpScript(C=crv, Cls=Toggle(False), T=Slider(0, range=0..6))  # -> out, L; inputs C: list of Curve, Cls: Boolean, T: Int32
# ---------- c_script_15: C# ----------
    // Cast T value from int to LoftType
    LoftType ltype = (LoftType) T;
    // Create a loft surface by calling static Brep function
    Brep[] surf = Brep.CreateFromLoft(C, Point3d.Unset, Point3d.Unset, ltype, Cls);

    // Output
    L = surf;
# ---------- end c_script_15 ----------
loft = Loft(Curves=crv, Options={Adjust=False, Closed=False, LoftEnds=0, LoftSimp=0, LoftType=0, Rebuild=10, Refit=0.01})
panel_38 = Panel(loft)
panel_39 = Panel(c_script_15.L)

c_script_16 = CSharpScript(C=curve, N=number_slider_12, A=toggle_3)  # -> out, F, t; inputs C: Curve, N: Int32, A: Boolean
# ---------- c_script_16: C# ----------
    // Initialize array of double & Plane - tValues & planes
    double[] tValues;
    Plane[] planes;
    // If Align is TRUE then perpendicular frames should be aligned
    if (A) {
      // Get the array of 't' parameters by calling curve function
      // Assign it to tValues
      tValues = C.DivideByCount(N, true);
      // Get the array of perpendicular frames by calling curve function
      // Assign it to planes
      planes = C.GetPerpendicularFrames(tValues);
    }
    else {
      // Initialize a array of Point3d - pts, this will be used as argument passed by reference
      Point3d[] pts;
      // Call curve function
      // Assign array of 't' parameters to tValues
      // points at tValues will be stored in pts
      tValues = C.DivideByCount(N, true, out pts);
      // Change the length of planes array
      planes = new Plane[tValues.Length];
      // Loop thru all the tValues
      for (int i = 0; i < tValues.Length; i++) {
        // Get tangent vector at 't' parameter at index i of a curve by calling curve function
        // Assign tangent vector tan
        Vector3d tan = C.TangentAt(tValues[i]);
        // Create a new plane with origin and normal
        // Assign it to pl
        Plane pl = new Plane(pts[i], tan);
        // Assign pl to planes at index i
        planes[i] = pl;
      }
    }

    // Outputs
    F = planes;
    t = tValues;
# ---------- end c_script_16 ----------
# Divide a curve into equal length segments
pframes = PerpFrames(Curve=curve, Count=number_slider_12, Align=toggle_3)  # -> Frames, Parameters
panel_40 = Panel(c_script_16.F)
panel_41 = Panel(pframes.Frames)
panel_42 = Panel(pframes.Parameters)
panel_43 = Panel(c_script_16.t)

# ----
# Evaluate a surface at 'u,v' coordinate
pt_6 = ConstructPoint(XCoordinate=Slider(10, range=0..10), YCoordinate=Slider(10, range=0..10), ZCoordinate=0)
panel_44 = Panel(c_script_12.out)

evalsrf = EvaluateSurface(Surface=surface, Point=pt_6)  # -> Point, Normal, UDirection, VDirection, Frame
c_script_17 = CSharpScript(S=surface, uv=pt_6)  # -> out, P, N, U, V, F; inputs S: Surface, uv: Point3d
# ---------- c_script_17: C# ----------
    // Initialize a Point3d - point
    // Initialize a array of Vector3d - derivatives
    // This will be used as argument passed by reference
    Point3d point;
    Vector3d[] derivatives;
    // Call surface function
    // Assign the result to boolean - evalSuccess
    // point at u,v coordinate will be stored in point
    // Tangent vectors at u,v coordinates will be stored in derivatives
    bool evalSuccess = S.Evaluate(uv.X, uv.Y, 1, out point, out derivatives);
    // Get the normal vector at u,v coordinate by calling surface function
    // Assign it to normal
    Vector3d normal = S.NormalAt(uv.X, uv.Y);
    // Initialize a Plane - frame
    // This will be used as argument passed by reference
    Plane frame;
    // Call surface function
    // Assign the result to boolean - frameSuccessful
    // plane at u,v coordinate will be stored in frame
    bool frameSuccessful = S.FrameAt(uv.X, uv.Y, out frame);

    // Output
    P = point;
    N = normal;
    U = derivatives[0];
    V = derivatives[1];
    F = frame;
# ---------- end c_script_17 ----------
panel_45 = Panel([c_script_17.P, c_script_17.N, c_script_17.U, c_script_17.V, c_script_17.F])
panel_46 = Panel([evalsrf.Point, evalsrf.Normal, evalsrf.UDirection, evalsrf.VDirection, evalsrf.Frame])
