# Grasshopper definition grasshopper-websocket-client-circle.gh (Grasshopper 1.0.7)
# plug-ins: Bifocals, jSwan

websocket_client_start = WebsocketClientStart(Address="ws://simple-websocket-server-echo.glitch.me/", Reset=Toggle(True))
websocket_client_receiver = WebsocketClientReceiver(WebsocketObjects=websocket_client_start, AutoUpdate=True)  # -> Message, Status
websocket_client_sender = WebsocketClientSender(WebsocketObjects=websocket_client_start, Message=Slider(6, range=0..10))
panel = Panel(websocket_client_receiver.Message)
dejsonkv = DeserializeKeysAndValues(JSON=websocket_client_receiver.Message, Keys="x")  # -> Key, Value
dejsonkv_2 = DeserializeKeysAndValues(JSON=websocket_client_receiver.Message, Keys="y")  # -> Key, Value
num = Number(dejsonkv_2.Value)
expression = Expression(y=num, Expression="1 - y")
pt = ConstructPoint(XCoordinate=dejsonkv.Value, YCoordinate=expression, ZCoordinate=0)
trigger = Trigger(Interval=20, TimerInterval=20, Target=c_script)
c_script = CSharpScript(dataPoint=pt, easing=Slider(0.05, range=0..0.1), radius=Slider(0.068, range=0..1))  # -> out, circle; inputs dataPoint: Point3d, easing: Double, radius: Double
# ---------- c_script: C# ----------
    
    target = dataPoint;
    
    // Smooth the position towards the target
    pos.X += easing * (target.X - pos.X);
    pos.Y += easing * (target.Y - pos.Y);
    
    Circle c = new Circle(pos, radius);
    
    circle = c;
# ---------- c_script: C# additional code ----------
  
  // This data is going to be persistent
  Point3d pos;
  Point3d target;
# ---------- end c_script ----------
