# Grasshopper definition grasshopper-websocket-client-sphere-nurbs-telegrambot.gh (Grasshopper 1.0.7)
# plug-ins: Bifocals, jSwan

# ws://simple-websocket-server-echo.glitch.me/
panel = Panel("ws://pcamp-telegram-bot.glitch.me/")
websocket_client_start = WebsocketClientStart(Address=panel, Reset=Toggle(False))
websocket_client_receiver = WebsocketClientReceiver(WebsocketObjects=websocket_client_start, AutoUpdate=True)  # -> Message, Status
websocket_client_sender = WebsocketClientSender(WebsocketObjects=websocket_client_start, Message=Slider(6, range=0..10))
panel_2 = Panel(websocket_client_receiver.Message)
dejsonkv = DeserializeKeysAndValues(JSON=websocket_client_receiver.Message, Keys="x")  # -> Key, Value
dejsonkv_2 = DeserializeKeysAndValues(JSON=websocket_client_receiver.Message, Keys="y")  # -> Key, Value
num = Number(dejsonkv_2.Value)
expression = Expression(y=num, Expression="1 - y")
pt = ConstructPoint(XCoordinate=dejsonkv.Value, YCoordinate=expression, ZCoordinate=0)
srf = Surface(<surface referenced from the Rhino model>)
trigger = Trigger(Interval=20, TimerInterval=20, Target=c_script)
dedom2num = DeconstructDomain²(Domain=srf)  # -> UMin, UMax, VMin, VMax
c_script = CSharpScript(surface=srf, dataPoint=pt, easing=Slider(0.05, range=0..0.1), radius=Slider(1, range=0..1))  # -> out, sphere; inputs surface: Surface, dataPoint: Point3d, easing: Double, radius: Double
# ---------- c_script: C# ----------
    target = dataPoint;

    // Smooth the position towards the target
    pos.X += easing * (target.X - pos.X);
    pos.Y += easing * (target.Y - pos.Y);

    // "Reparameterize"
    surface.SetDomain(0, new Interval(0, 1));
    surface.SetDomain(1, new Interval(0, 1));
    
    // Find Cartesian point for UV coordinates
    Point3d sphereCenter = surface.PointAt(pos.X, pos.Y);

    Sphere s = new Sphere(sphereCenter, radius);

    // Output
    sphere = s;
# ---------- c_script: C# additional code ----------
  // This data is going to be persistent
  Point3d pos;
  Point3d target;
# ---------- end c_script ----------
panel_3 = Panel([dedom2num.UMin, dedom2num.UMax, dedom2num.VMin, dedom2num.VMax])
geo = Geometry(c_script.sphere)
